# Grasshopper definition Collection cluster.gh (Grasshopper 1.0.7)

panel = Panel("""DL,SDL,WIND,SNOW
1,0,0,0
0,1,0,0
1,1,0,0
0,0,1,0
0,0,0,1
0,0,0,1
0,0,0,1
0,0,0,0
1,1,0,1
1,1,1,0
1.35,1.35,0,0
1.35,1.35,1.5,0.75
1.35,1.35,0.75,1.5""")
cull_i = CullIndex(List=panel, Indices=0, Wrap=True)
lng = ListLength(List=cull_i)
series = Series(Start=0, Step=1, Count=lng)
split = TextSplit(Text=cull_i, Separators=",")  # -> simplify(Result)
int = Integer(graft(series))
int_2 = Integer(flatten(int))
lc = Panel(int_2)
ins = InsertItems(List=split, Item=int, Indices=0, Wrap=True)
flip = FlipMatrix(Data=ins)  # -> simplify(Data)
bang = ExplodeTree(Data=flip)  # -> simplify(graft(Branch0)), simplify(graft(Branch1)), simplify(graft(Branch2)), simplify(graft(Branch3)), simplify(graft(Branch4)), simplify(graft(Branch5)), simplify(graft(Branch6))
