# Grasshopper definition MultiSupportedBeam.gh (Grasshopper 1.0.7)
# plug-ins: karambaGH

# ----
# Geometry
beam_length = Slider(24, range=0..100)
genes = GenePool(Decimals=2, Maximum=1, Minimum=0, Value=[0, 0.33, 0.67, 1])
# Ingegneria Parametrica
# Multi Supported Beam
# Author: Marco Pellegrino
# Contact: ingegneria.parametrica.ltd@gmail.com
pt = ConstructPoint(XCoordinate=0, YCoordinate=0, ZCoordinate=0)
X = UnitX(Factor=beam_length)
move = Move(Geometry=pt, Motion=X)  # -> Geometry, Transform
ln = Line(StartPoint=pt, EndPoint=move.Geometry)
shatter = Shatter(Curve=reparameterize(ln), Parameters=genes)

# ----
# Line to Beam
number_slider = Slider(20, range=0..100)
crosecrselect = CrossSectionRangeSelectorKaramba3D(MaximumHeight_cm=-1, MaximumWidth_cm=-1, menu=[dropdown(1), dropdown(0), dropdown(3)])
crosecselect = CrossSectionSelectorKaramba3D(CrossSections=crosecrselect, NameOrListIndexOfCrossSection=number_slider)  # -> CrossSection, Info
linetobeam = LineToBeamKaramba3D(Line=shatter, Identifier="Beam", CrossSection=crosecselect.CrossSection, New=True, Remove=True, LimitDistance_m=0.005)  # -> Element, Points, Info

# ----
# Support
join = JoinCurves(Curves=shatter, Preserve=False)
explode = Explode(Curve=join, Recursive=True)  # -> Segments, Vertices
pt_2 = Point(explode.Vertices)
supp = SupportKaramba(PosInd=pt_2, menu=[buttons(on, on, on, on, off, on)])

# ----
# Load
panel = Panel("-200")
Z = UnitZ(Factor=panel)
loads = LoadsKaramba3D(Vector=Z, LCase=0, mode="Uniform Line", menu=[buttons(off, on, off)])
loads_2 = LoadsKaramba3D(Vector=Vector(0, 0, -1), LCase=0, mode="Gravity")
load = LoadKaramba3D([loads_2, loads])

# ----
# Assemble
assemble = AssembleModelKaramba(Elem=linetobeam.Element, Support=supp, Load=load, LimitDistance_m=0.005)  # -> Model, Info, Mass_kg, CenterOfGravity
panel_2 = Panel(assemble.Mass_kg)

# ----
# Analyses
analyze = AnalyzeKaramba3D(Model=assemble.Model)  # -> CalculatedModel, MaximumDisplacement_cm, ResultingForceOfGravity_kN, ElasticEnergy_kNm
panel_3 = Panel(analyze.MaximumDisplacement_cm)

# ----
# Model View
modelview = ModelViewKaramba3D(
    Model=analyze.CalculatedModel,
    ResultFactors=1,
    ResultCase=-1,
    Colors=[RGB(204, 0, 71), RGB(255, 182, 71), RGB(206, 255, 115), RGB(26, 180, 214), RGB(0, 0, 207)])  # -> Model, DeformedMesh, DeformedAxes, DeformedModel
beamview = BeamViewKaramba(Model=modelview.Model)  # -> Model, MeshesOfRenderedBeams, DeformedBeamAxes, LegendColors, LegendTags
