# Grasshopper definition uovo di pasqua.gh (Grasshopper 0.9.76)
# plug-ins: Karamba, Kangaroo Components, Weaverbird, Kangaroo2 Components, plankton

crv = Curve(<curve referenced from the Rhino model>)
crv_2 = Curve(<curve referenced from the Rhino model>)
number_slider = Slider(0.1, range=0..1)
revsrf = Revolution(Curve=crv, Axis=crv_2, Domain=Domain(0, 6.283185307))
mesh_breps = MeshBreps(
    Brep=revsrf,
    MeshResolution=number_slider,
    EdgeRefinementFactor=0.67,
    PointReduction=False,
    SmoothingStepSize=0,
    SmoothingIterations=5)  # -> Mesh, Info
demesh = DeconstructMesh(Mesh=mesh_breps.Mesh)  # -> Vertices, Faces, Colours, Normals
Z = UnitZ(Factor=Slider(-0.65, range=-1..0))
xy = XYPlane(Origin=Z)
pull = PullPoint(Point=demesh.Vertices, Geometry=xy, ClosestOnly=True)  # -> ClosestPoint, Distance
smaller = SmallerThan(FirstNumber=pull.Distance, SecondNumber=0.01)  # -> SmallerThan, OrEqualTo
debrep = DeconstructBrep(Brep=revsrf)  # -> Faces, Edges, Vertices
dispatch = Dispatch(List=demesh.Vertices, DispatchPattern=smaller.SmallerThan)  # -> ListA, ListB
pt = Point(dispatch.ListA)
meshmachine = MeshMachine(
    Geometry=mesh_breps.Mesh,
    Length=number_slider,
    FixCurves=flatten(debrep.Edges),
    FixVertices=flatten([pt, debrep.Vertices]),
    Flip=1,
    PullStrength=0.8,
    CurvatureAdaptivity=0,
    BoundaryScale=1,
    BoundaryDistance=5,
    Exponent=2,
    Background=0.5,
    Iterations=Slider(50, range=0..100),
    Reset=Button())
pmesh = PlanktonMesh(meshmachine)
Z_2 = UnitZ(Factor=expr("-x", Slider(0.28, range=0.01..0.5)))
item = ListItem(List=debrep.Vertices, Index=0, Wrap=True)  # -> Item, Item1
mesh = Mesh(pmesh)
move = Move(Geometry=item.Item1, Motion=expr("-x", Z_2))  # -> Geometry, Transform
clean = CombineClean(Meshes=mesh_breps.Mesh)
vec = VectorXYZ(XComponent=0, YComponent=Slider(0.79, range=0..1), ZComponent=expr("-x", Slider(0.43, range=0..1)))  # -> Vector, Length
Z_3 = UnitZ(Factor=expr("-x", Slider(100, range=1..100)))
duppt = RemoveDuplicatePts(Points=pt, Tolerance=0.01)
vdisex = VectorDisplayEx(Point=move.Geometry, Vector=Z_2, Colour=ColourSwatch(SwatchColor=RGB(255, 0, 0)), Width=Slider(5, range=0..10))
normshade = NormalShader(
    mesh=clean,
    direction=vec.Vector,
    color=ColourSwatch(SwatchColor=RGB(0, 0, 0)),
    intensity=Slider(0.28, range=0..1),
    Reference="C:\USERS\MARCO\DESKTOP\old personal google drive\AA_Aarhus_Workshop_Folder\Grasshopper Resources\Libraries\SpatialSlur.dll")  # -> out, result; inputs mesh: Mesh, direction: Vector3d, color: Color, intensity: Double
# ---------- normshade: C# ----------
    if(mesh.Normals.Count != mesh.Vertices.Count)
      mesh.Normals.ComputeNormals();

    if(mesh.VertexColors.Count != mesh.Vertices.Count)
      mesh.VertexColors.CreateMonotoneMesh(Color.White);

    NormalShader(mesh, direction, color, intensity);
    result = mesh;
# ---------- normshade: C# additional code ----------
  //
  void NormalShader(Mesh mesh, Vector3d direction, Color color, double intensity)
  {
    if(!direction.Unitize())
      throw new System.ArgumentException("the direction vector cannot be zero length");

    Color[] vc = mesh.VertexColors.ToArray();

    var chunks = System.Collections.Concurrent.Partitioner.Create(0, mesh.Vertices.Count);
    System.Threading.Tasks.Parallel.ForEach(chunks, range =>
      {
      for (int i = range.Item1; i < range.Item2; i++)
      {
        double t = direction * mesh.Normals[i] * 0.5 + 0.5;
        vc[i] = vc[i].LerpTo(color, t * intensity);
      }
      });

    mesh.VertexColors.SetColors(vc);
  }
# ---------- end normshade ----------
supp = SupportKaramba(PosInd=duppt, menu=[buttons(on, on, on, off, off, off)])
meshtoshell = MeshToShellKaramba(Mesh=clean, LimitDistance_m=0.005)  # -> Element, Points, Info
loads = LoadsKaramba(ForceVector=Z_3, Local=False, PosInd=item.Item1, LCase=0, mode="Point")
loads_2 = LoadsKaramba(Vector=Vector(0, 0, -1), LCase=0, mode="Gravity")
assemble = AssembleModelKaramba(Elem=meshtoshell.Element, Support=supp, Load=loads_2, LimitDistance_m=0.005)  # -> Model, Info, Mass_kg, CenterOfGravity
number_slider_2 = Slider(9, range=0..100)

timer = Timer(TimerInterval=1, Target=counter)  # disabled
range = Range(Domain="0.01 to 0.90", Steps=number_slider_2)
counter = Counter(Reset=Toggle(True))
range_2 = Range(Domain="-1 to -0.1", Steps=number_slider_2)
range_3 = Range(Domain="1 to -0.9", Steps=Slider(19, range=0..100))
data = Data([range, range_3, range_2])
item_2 = ListItem(List=data, Index=counter, Wrap=True)

analyzethii = AnalyzeThIIKaramba(Model=assemble.Model, LoadCase=-1, RTolerance=1e-07, MaxIterations=50, NoTensionalNII=False)  # -> CalculatedModel, MaximumDisplacement_m, ResultingForceOfGravity_kN, ElasticEnergy_kNm
number_slider_3 = Slider(1, range=0..1)
bmodes = BucklingModesKaramba(
    Model=analyzethii.CalculatedModel,
    FromIndex=1,
    NumberOfModes=Slider(10, range=0..10),
    MaximumNumberOfIterations=300,
    Epsilon=1e-07)  # -> ModelWithBucklingModesAsLoadCaseResults, BucklingLoadFactors
colours = LegendColour()
modelview = ModelViewKaramba(
    Model=bmodes.ModelWithBucklingModesAsLoadCaseResults,
    LoadCaseFactorsForLinearSuperposition=item_2,
    IndexOfVisibleLoadcase=-1,
    ListOfColorsForColoringPlots=colours)  # -> Model, DeformedMesh, DeformedAxes, DeformedModel
area = Area(Geometry=revsrf)  # -> Area, Centroid
pt_2 = Point(area.Centroid)
Z_4 = UnitZ(Factor=1)
move_2 = Move(Geometry=pt_2, Motion=Z_4)  # -> Geometry, Transform
shellview = ShellViewKaramba(Model=modelview.Model, IndexOfLayer=0)  # -> Model, MeshesOfRenderedShells, LegendColors, LegendTags
cir = Circle(Plane=move_2.Geometry, Radius=Slider(7, range=0..10))
crv_3 = Curve(cir)
divide = DivideCurve(Curve=crv_3, Count=Slider(200, range=0..1000), Kinks=False)  # -> Points, Tangents, Parameters
item_3 = ListItem(List=divide.Points, Index=counter, Wrap=True)
wbloop = WeaverbirdsLoopSubdivision(MeshCurves=shellview.MeshesOfRenderedShells, Level=1, SmoothNakedEdges=2)
panel = Panel(item_3)
c_script = CSharpScript(points=pt_2, newLocation=item_3)  # -> out, A, cameraPosition; inputs points: list of Point3d, index: Int32, newLocation: Point3d
# ---------- c_script: C# ----------
    int myIndex = index > (points.Count - 1) ? points.Count - 1 : index;
    Point3d camPos = new Point3d();
    Point3d myPoint = points[myIndex];



    camPos = Rhino.RhinoDoc.ActiveDoc.Views.ActiveView.ActiveViewport.CameraLocation;
    Rhino.RhinoDoc.ActiveDoc.Views.ActiveView.ActiveViewport.SetCameraTarget(myPoint, true);
    Rhino.RhinoDoc.ActiveDoc.Views.ActiveView.ActiveViewport.SetCameraLocations(myPoint, newLocation);


    A = myPoint;

    cameraPosition = camPos;
# ---------- end c_script ----------
panel_2 = Panel(c_script.cameraPosition)
panel_3 = Panel(c_script.A)

# ==== cluster LegendColour: Legend colour for Karamba
merge = Merge(
    Data1=ColourSwatch(SwatchColor=RGB(255, 0, 0)),
    Data2=ColourSwatch(SwatchColor=RGB(255, 179, 0)),
    Data3=ColourSwatch(SwatchColor=RGB(255, 255, 0)),
    Data4=ColourSwatch(SwatchColor=RGB(0, 255, 0)),
    Data5=ColourSwatch(SwatchColor=RGB(0, 255, 255)),
    Data6=ColourSwatch(SwatchColor=RGB(4, 177, 255)),
    Data7=ColourSwatch(SwatchColor=RGB(0, 0, 255)),
    Data8=ColourSwatch(SwatchColor=RGB(129, 0, 190)),
    Data9=ColourSwatch(SwatchColor=RGB(75, 0, 130)))  # -> reverse(Result)
legend = ClusterOutput(merge)  # List of colours to plug on Karamba Legend
