# Grasshopper definition connessione splice.gh (Grasshopper 1.0.7)
# plug-ins: treesloth01, Pufferfish, TT Toolbox

connection_location = Point(<point referenced from the Rhino model>)
crv = Curve(reparameterize(<curve referenced from the Rhino model>))
dots = DotDisplay(Point=connection_location, Colour=ColourSwatch(SwatchColor=RGB(255, 0, 0)), Size=Slider(0.01, range=0..0.01))

diameter = Slider(194, range=120..400)
thickness = Slider(16, range=8..16)
thickness_long_steel_plate = Slider(0.02, range=0.01..0.05)
length_of_welded_connection = Slider(0.14, range=0.1..0.45)
length_of_bolts_connection = Slider(0.39, range=0.3..0.6)
n_bolts = Slider(2, range=2..8)
stiffner_thickness = Slider(0.018, range=0.01..0.03)
distance_from_the_edge = Slider(0.038, range=0.02..0.07)
diameter_tube = Text(flatten(diameter))
thickness_2 = Text(flatten(thickness))
crv_cp = CurveClosestPoint(Point=graft(connection_location), Curve=crv)  # -> Point, Parameter, Distance
sort = SortList(
    Keys=crv_cp.Distance,
    ValuesE=crv,
    ValuesD=crv_cp.Point,
    ValuesC=crv_cp.Parameter,
    ValuesA=diameter_tube,
    ValuesB=thickness_2)  # -> Keys, ValuesE, ValuesD, ValuesC, ValuesA, ValuesB
item = ListItem(List=sort.Keys, Index=0, Wrap=True)
item_2 = ListItem(List=sort.ValuesE, Index=0, Wrap=True)
item_3 = ListItem(List=sort.ValuesD, Index=0, Wrap=True)
item_4 = ListItem(List=sort.ValuesC, Index=0, Wrap=True)
item_5 = ListItem(List=sort.ValuesA, Index=0, Wrap=True)
item_6 = ListItem(List=sort.ValuesB, Index=0, Wrap=True)
t_parameter_for_curve = Data(simplify(item_4))
diameter_2 = Data(simplify(item_5))
thickness_3 = Data(simplify(item_6))
data = Data(simplify(item))
crv_2 = Data(simplify(item_2))
point = Data(simplify(item_3))
eval = EvaluateCurve(Curve=reparameterize(flatten(crv_2)), Parameter=flatten(t_parameter_for_curve))  # -> simplify(graft(Point)), simplify(graft(Tangent)), Angle
xz = XZPlane(Origin=eval.Point)
pl = PlaneNormal(Origin=xz, ZAxis=eval.Tangent)
thickness_tube = Number(expr("x/1000", thickness_3))
diameter_3 = Number(expr("x/1000", diameter_2))
cir = Circle(Plane=pl, Radius=expr("x/2", diameter_3))
offset = OffsetCurve(Curve=cir, Distance=expr("-x", thickness_tube), Plane=pl, Corners=1)
match = MatchTree(Tree=offset, Guide=cir)
merge = Merge(Data1=simplify(cir), Data2=simplify(match))
darc = DeconstructArc(Arc=cir)  # -> BasePlane, Radius, Angle
loft = Loft(Curves=merge, Options={Adjust=False, Closed=False, LoftEnds=0, LoftSimp=0, LoftType=0, Rebuild=10, Refit=0.01})
num = Number(expr("x/2", thickness_tube))
subtraction = Subtraction(A=darc.Radius, B=num)
panel = Panel(loft)
num_2 = Number(expr("x/2", thickness_long_steel_plate))
neg = Negative(Value=num_2)
neg_2 = Negative(Value=subtraction)
dom = ConstructDomain(DomainStart=neg_2, DomainEnd=subtraction)
dom_2 = ConstructDomain(DomainStart=neg, DomainEnd=num_2)
rectangle = Rectangle(Plane=darc.BasePlane, XSize=dom, YSize=dom_2, Radius=0)  # -> Rectangle, Length
rectangle_2 = Rectangle(Plane=darc.BasePlane, XSize=dom_2, YSize=dom, Radius=0)  # -> Rectangle, Length
runion = RegionUnion(Curves=[rectangle.Rectangle, rectangle_2.Rectangle])
rint = RegionIntersection(CurvesA=runion, CurvesB=offset)
explode = Explode(Curve=rint, Recursive=True)  # -> Segments, Vertices
end = EndPoints(Curve=explode.Segments)  # -> Start, End
ln = Line(StartPoint=end.Start, EndPoint=end.End)
boundary = BoundarySurfaces(Edges=ln)
srf = Surface(loft)
amp = Amplitude(Vector=eval.Tangent, Amplitude=length_of_bolts_connection)
amp_2 = Amplitude(Vector=eval.Tangent, Amplitude=length_of_welded_connection)
extr = Extrude(Base=srf, Direction=expr("x*1.5", amp))
extr_2 = Extrude(Base=boundary, Direction=expr("-x", amp_2))
extr_3 = Extrude(Base=srf, Direction=expr("-x*1.5", amp_2))
extr_4 = Extrude(Base=boundary, Direction=amp)
debrep = DeconstructBrep(Brep=extr_4)  # -> Faces, Edges, Vertices
edges = BrepEdges(Brep=debrep.Faces)  # -> simplify(Naked), Interior, NonManifold
lng = ListLength(List=edges.Naked)
equals = Equality(FirstNumber=lng, SecondNumber="4")  # -> Equality, Inequality
shift = ShiftPaths(Data=equals.Equality, Offset=-1)
cull = CullPattern(List=debrep.Faces, CullPattern=shift)
area = Area(Geometry=cull)  # -> Area, Centroid
sort_2 = SortList(Keys=area.Area, ValuesA=cull)  # -> Keys, ValuesA
series = Series(Start=0, Step=1, Count=4)
item_7 = ListItem(List=sort_2.ValuesA, Index=series, Wrap=True)
iso = IsoCurve(Surface=reparameterize(item_7), UVPoint="{0.5,0.5,0}")  # -> UIsocurve, VIsocurve
merge_2 = Merge(Data1=iso.UIsocurve, Data2=iso.VIsocurve)
sort_3 = SortList(Keys=merge_2, ValuesA=merge_2)  # -> Keys, reverse(ValuesA)
item_8 = ListItem(List=sort_3.ValuesA, Index=0, Wrap=True)
num_3 = Number(length_of_bolts_connection)

subtraction_2 = Subtraction(A=num_3, B=distance_from_the_edge)
merge_3 = Merge(Data1="0", Data2=distance_from_the_edge, Data4=subtraction_2, Data5=num_3)
division = Division(A=merge_3, B=num_3)

shatter = Shatter(Curve=item_8, Parameters=division)
item_9 = ListItem(List=shatter, Index="1", Wrap=True)
divide = DivideCurve(Curve=simplify(item_9), Count=expr("x-1", Slider(4, range=0..8)), Kinks=False)  # -> Points, Tangents, Parameters
srf_cp = SurfaceClosestPoint(Point=divide.Points, Surface=graft(item_7))  # -> Point, UVPoint, Distance
evalsrf = EvaluateSurface(Surface=graft(item_7), Point=srf_cp.UVPoint)  # -> simplify(Point), Normal, UDirection, VDirection, Frame
line = LineSDL(Start=evalsrf.Point, Direction=evalsrf.Normal, Length=0.4)  # -> simplify(Line)
shift_2 = ShiftPaths(Data=simplify(line), Offset=-1)
bcx = BrepCurve(Brep=extr, Curve=simplify(shift_2))  # -> Curves, Points
item_10 = ListItem(List=reverse(bcx.Points), Index=0, Wrap=True)
shift_3 = ShiftPaths(Data=simplify(item_10), Offset=-1)
match_2 = MatchTreeStructure(DataList=flatten(shift_3), TreeMask=evalsrf.Point)
pl_origin = PlaneOrigin(Base=evalsrf.Frame, Origin=match_2)
pl_2 = PlaneNormal(Origin=pl_origin, ZAxis=evalsrf.Normal)
flip_last = FlipLast(Data=evalsrf.Point)
brep = Brep(extr_4)
plfit = PlaneFit(Points=flip_last)  # -> Plane, Deviation
shift_4 = ShiftPaths(Data=plfit.Plane, Offset=-1)
sec = BrepPlane(Brep=simplify(brep), Plane=shift_4)  # -> Curves, Points
explode_2 = Explode(Curve=sec.Curves, Recursive=True)  # -> Segments, Vertices
len = Length(Curve=explode_2.Segments)
smaller = SmallerThan(FirstNumber=len, SecondNumber=expr("x*1.1", thickness_long_steel_plate))  # -> SmallerThan, OrEqualTo
cull_2 = CullPattern(List=explode_2.Segments, CullPattern=invert(smaller.SmallerThan))
join = JoinCurves(Curves=cull_2, Preserve=False)  # -> simplify(Curves)
flip_last_2 = FlipLast(Data=join)
item_11 = ListItem(List=flip_last_2, Index=0, Wrap=True)
flip = FlipCurve(Curve=flip_last_2, Guide=item_11)  # -> simplify(graft(Curve)), Flag

# ---- group: other way to do filler
offset_2 = OffsetCurve(Curve=flip.Curve, Distance=expr("-x", "0.005"), Plane=flip.Curve, Corners=1)
merge_4 = Merge(Data1=simplify(graft(flip.Curve)), Data2=simplify(offset_2))
loft_2 = Loft(Curves=merge_4, Options={Adjust=False, Closed=False, LoftEnds=0, LoftSimp=0, LoftType=0, Rebuild=10, Refit=0.01})

# ----
preview = CustomPreview(Geometry=flip.Curve, Material=ColourSwatch(SwatchColor=RGB(255, 0, 0)))
preview_2 = CustomPreview(Geometry=offset_2, Material=ColourSwatch(SwatchColor=RGB(42, 0, 255)))

item_12 = ListItem(List=flatten(offset_2), Index=0, Wrap=True)
item_13 = ListItem(List=flatten(flip.Curve), Index=0, Wrap=True)
flip_2 = FlipCurve(Curve=offset_2, Guide=item_12)  # -> graft(Curve), Flag
flip_3 = FlipCurve(Curve=flip.Curve, Guide=item_13)  # -> graft(Curve), Flag
end_2 = EndPoints(Curve=flip_2.Curve)  # -> Start, End
end_3 = EndPoints(Curve=flip_3.Curve)  # -> Start, End
ln_2 = Line(StartPoint=end_2.End, EndPoint=end_2.Start)
ln_3 = Line(StartPoint=end_3.End, EndPoint=end_3.Start)
merge_5 = Merge(Data1=simplify(ln_2), Data2=simplify(flip_2.Curve))  # -> simplify(Result)
merge_6 = Merge(Data1=simplify(ln_3), Data2=simplify(flip_3.Curve))  # -> simplify(Result)
boundary_2 = BoundarySurfaces(Edges=merge_5)
boundary_3 = BoundarySurfaces(Edges=merge_6)

list = ValueList({"Chamfer Plate": 0, "No Chamfer Plate": 1}, selected="No Chamfer Plate")
merge_7 = Merge(Data1=loft_2, Data2=boundary_2)
filter = StreamFilter(Gate=list, Stream0=merge_7, Stream1=boundary_3)
plate_thickness = Panel("0.015")

_16x2_std_mm_allen_wrench_no_thread = Brep(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)
_16x2_std_mm_allen_wrench = Brep(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)

offsrf = OffsetSurface(Surface=filter, Distance=expr("x/2", stiffner_thickness), BothSides=invert(False), CreateSolid=True)
join_2 = BrepJoin(Breps=offsrf)  # -> Breps, Closed
brep_2 = Brep(extr)
shift_5 = ShiftPaths(Data=join_2.Breps, Offset="3")

orient = Orient(Geometry=_16x2_std_mm_allen_wrench_no_thread, Source=PlaneXY(0, 0, 0), Target=pl_2)  # -> simplify(Geometry), Transform
brep_3 = Brep(simplify(extr_2))
brep_4 = Brep(extr_3)
brep_5 = Brep(orient.Geometry)
preview_3 = CustomPreview(Geometry=brep_4, Material=ColourSwatch(SwatchColor=RGBA(191, 191, 191, 100)))
preview_4 = CustomPreview(Geometry=brep_5, Material=ColourSwatch(SwatchColor=RGB(89, 89, 89)))
preview_5 = CustomPreview(Geometry=brep_3, Material=ColourSwatch(SwatchColor=RGB(0, 93, 255)))

shift_6 = ShiftPaths(Data=orient.Geometry, Offset=-1)

sdiff = SolidDifference(BrepsA=simplify(brep), BrepsB=shift_6)
sdiff_2 = SolidDifference(BrepsA=brep_2, BrepsB=shift_6)
volume = Volume(Geometry=sdiff_2)  # -> Volume, Centroid
brep_6 = Brep(sdiff)
sort_4 = SortList(Keys=volume.Volume, ValuesA=sdiff_2)  # -> reverse(Keys), reverse(ValuesA)
split = SplitList(List=sort_4.ValuesA, Index="1")  # -> ListA, ListB
brep_7 = Brep(split.ListA)
wires = BrepWireframe(Brep=[join_2.Breps, sdiff, orient.Geometry, brep_3], Density=-1)
preview_6 = CustomPreview(Geometry=brep_7, Material=ColourSwatch(SwatchColor=RGBA(255, 173, 51, 100)))

merge_8 = Merge(Data1=flatten(brep_6), Data3=flatten(shift_5))
sunion = SolidUnion(Breps=merge_8)

preview_7 = CustomPreview(Geometry=sunion, Material=ColourSwatch(SwatchColor=RGB(0, 204, 255)))
