# Grasshopper definition Edifici torsionali.gh (Grasshopper 1.0.7)
# plug-ins: Karamba, Kangaroo Components, Weaverbird, TT Toolbox

crv = Curve(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)
number_slider = Slider(1, range=1..4)
cir = Circle(Plane=PlaneXY(0, 0, 0), Radius="12")
neg = Negative(Value=number_slider)
offset = OffsetCurve(Curve=crv, Distance=[neg, number_slider], Plane=PlaneXY(0, 0, 0), Corners=1)  # -> flatten(Curve)
sort = SortList(Keys=offset, ValuesA=offset)  # -> Keys, ValuesA
item = ListItem(List=sort.ValuesA, Index=0, Wrap=True)
number_slider_2 = Slider(16, range=10..30)
divide = DivideCurve(Curve=item, Count=number_slider_2, Kinks=False)  # -> Points, Tangents, Parameters
n_floor = Slider(10, range=0..10)
series = Series(Start="3.5", Step="3.50", Count="10")
merge = Merge(Data1="0", Data2=series)  # -> flatten(Result)

divide_2 = DivideCurve(Curve=item, Count=number_slider_2, Kinks=False)  # -> Points, Tangents, Parameters
panel = Panel("20")
series_2 = Series(Start="3.5", Step="3.50", Count=Slider(23, range=1..30))
merge_2 = Merge(Data1="0", Data2=series_2)  # -> flatten(Result)
Z = UnitZ(Factor=merge_2)
move = Move(Geometry=graft(crv), Motion=Z)  # -> simplify(Geometry), Transform
move_2 = Move(Geometry=graft(divide_2.Points), Motion=Z)  # -> simplify(Geometry), Transform
cull_i = CullIndex(List=move.Geometry, Indices="0", Wrap=True)
pline = PolyLine(Vertices=move_2.Geometry, Closed=False)
displaycrv = DisplayCurve(curve=pline, color=ColourSwatch(SwatchColor=RGB(255, 255, 255)), weight=Slider(2.93, range=0.1..5))  # -> out; inputs curve: Curve, color: Color, weight: Int32
# ---------- displaycrv: C# ----------
    // silently skip null curves
    if(curve == null) return;

    // add to display cache
    _curves.Add(curve);
    _colors.Add(color);
    _weights.Add(weight);
    _clippingBox.Union(curve.GetBoundingBox(false));
# ---------- displaycrv: C# additional code ----------
  List<Curve> _curves;
  List<Color> _colors;
  List<int> _weights;
  BoundingBox _clippingBox;


  /// <summary>
  /// This method will be called once every solution, before any calls to RunScript.
  /// </summary>
  public override void BeforeRunScript()
  {
    _curves = new List<Curve>();
    _colors = new List<Color>();
    _weights = new List<int>();
    _clippingBox = new BoundingBox();
  }


  //
  public override BoundingBox ClippingBox
  {
    get{return _clippingBox;}
  }


  //
  public override void DrawViewportWires(IGH_PreviewArgs args)
  {
    base.DrawViewportWires(args);

    for(int i = 0; i < _curves.Count; i++)
      args.Display.DrawCurve(_curves[i], _colors[i], _weights[i]);
  }
# ---------- end displaycrv ----------
displaycrv_2 = DisplayCurve(curve=cull_i, color=ColourSwatch(SwatchColor=RGB(255, 0, 0)), weight=Slider(3.87, range=0.1..5))  # -> out; inputs curve: Curve, color: Color, weight: Int32; same code as displaycrv

Z_2 = UnitZ(Factor=merge)
move_3 = Move(Geometry=graft(crv), Motion=Z_2)  # -> simplify(Geometry), Transform
move_4 = Move(Geometry=graft(divide.Points), Motion=Z_2)  # -> simplify(Geometry), Transform
flip = FlipMatrix(Data=move_4.Geometry)
divide_3 = DivideCurve(Curve=move_3.Geometry, Count=number_slider_2, Kinks=False)  # -> Points, Tangents, Parameters
pline_2 = PolyLine(Vertices=divide_3.Points, Closed=invert(False))
displaycrv_3 = DisplayCurve(curve=crv, color=ColourSwatch(SwatchColor=RGB(255, 255, 255)), weight=Slider(2.93, range=0.1..5))  # -> out; inputs curve: Curve, color: Color, weight: Int32; same code as displaycrv
pline_3 = PolyLine(Vertices=move_4.Geometry, Closed=False)
mesh_breps = MeshBreps(
    Brep=graft(move_3.Geometry),
    InclusionPoints=flip,
    MeshResolution="1.50",
    EdgeRefinementFactor=0.67,
    PointReduction=False,
    SmoothingStepSize=0,
    SmoothingIterations=5)  # -> Mesh, Info
crosecrselect = CrossSectionRangeSelectorKaramba3D(MaximumHeight_cm=-1, MaximumWidth_cm=-1, menu=[dropdown(0), dropdown(0), dropdown(30)])
explode = Explode(Curve=pline_3, Recursive=True)  # -> Segments, Vertices
end = EndPoints(Curve=pline_3)  # -> Start, End
cull_i_2 = CullIndex(List=flatten(mesh_breps.Mesh), Indices="0", Wrap=True)
pt = Point(end.Start)
cross_section = CrossSectionKaramba3D(FamilyNameOfCrossSection="DefaultCroSec", Material=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, Height_cm="35", mode="Shell - Const")
item_2 = ListItem(List=crosecrselect, Index=Slider(180, range=1..273), Wrap=True)
toggle = BooleanToggle(False)
loads = LoadsKaramba3D(Vector=Vector(0, 0, -1), LCase=0, mode="Gravity")
supp = SupportKaramba3D(PosInd=pt, menu=[buttons(on, on, on, on, on, off)])
linetobeam = LineToBeamKaramba3D(Line=explode.Segments, Identifier="Columns", CrossSection=item_2, New=True, Remove=True, LimitDistance_m=0.005)  # -> Element, Points, Info
meshtoshell = MeshToShellKaramba3D(Mesh=cull_i_2, CrossSection=cross_section, LimitDistance_m=0.005)  # -> Element, Points, Info
assemble = AssembleModelKaramba3D(Elem=flatten([linetobeam.Element, meshtoshell.Element]), Support=flatten(supp), Load=loads, LimitDistance_m=0.005)  # -> Model, Info, Mass_kg, CenterOfGravity
analyze = AnalyzeKaramba3D(Model=assemble.Model)  # -> CalculatedModel, MaximumDisplacement_cm, ResultingForceOfGravity_kN, ElasticEnergy_kNm
button = Button()
timer = Timer(TimerInterval=20, Target=counter)  # disabled
counter = Counter(Reset=Toggle(False))
nvibes = NaturalVibrationsKaramba3D(Model=analyze.CalculatedModel, FromIndex=1, NumberOfModes="4", MaximumNumberOfIterations=30, Epsilon=1e-05)  # -> ModelWithVibrationModesAsLoadCaseResults, NaturalFrequencies_Hz, ModalMass_kg, ParticipationFactorInGlobalXYAndZDirection
multiplication = Multiplication(A=counter, B="0.12")
sin = Sine(Value=multiplication)
rec = DataRecorder(sin, DataLimit=-10, RecordData=True)
graph = QuickGraph(rec, SortOrder=0)
colours = LegendColour()
modelview = ModelViewKaramba3D(
    Model=nvibes.ModelWithVibrationModesAsLoadCaseResults,
    LoadCaseFactorsForLinearSuperposition=sin,
    IndexOfVisibleLoadcase=-1,
    ListOfColorsForColoringPlots=colours)  # -> Model, DeformedMesh, DeformedAxes, DeformedModel
beamview = BeamViewKaramba3D(Model=modelview.Model)  # -> Model, MeshesOfRenderedBeams, DeformedBeamAxes, LegendColors, LegendTags
shellview = ShellViewKaramba3D(Model=modelview.Model, IndexOfLayer=0)  # -> Model, MeshesOfRenderedShells, LegendColors, LegendTags
number_slider_3 = Slider(0, range=0..1)
medges = MeshEdges(Mesh=beamview.MeshesOfRenderedBeams)  # -> NakedEdges, InteriorEdges, NonManifoldEdges
medges_2 = MeshEdges(Mesh=shellview.MeshesOfRenderedShells)  # -> NakedEdges, InteriorEdges, NonManifoldEdges
displaycrv_4 = DisplayCurve(curve=[medges.NakedEdges, medges.InteriorEdges])  # -> out; inputs curve: Curve, color: Color, weight: Int32; same code as displaycrv
crv_2 = Curve(medges_2.NakedEdges)
disassemble = DisassembleModelKaramba3D(Model=modelview.DeformedModel)  # -> Model, Point, Beam, Shell, Support, Load, Line, Mesh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
crv_3 = Curve(disassemble.Line)
crv_4 = Curve(crv_3)
join = JoinCurves(Curves=crv_4, Preserve=False)
sortc = SortCurvesAlongCrv(Curves=join, GuideCrv=crv, CrvParam="0.00")  # -> SortedCurves, CurveIndex
item_3 = ListItem(List=sortc.SortedCurves, Index=0, Wrap=True)
number_slider_4 = Slider(5, range=1..50)
meshloft = MeshLoft2(polys=[sortc.SortedCurves, item_3])  # -> out, result; inputs polys: list of Polyline
# ---------- meshloft: C# ----------
    result = MeshLoft(polys);
# ---------- meshloft: C# additional code ----------
  //
  Mesh MeshLoft(IList<Polyline> polys)
  {
    if(Enumerable.All(polys, p => p.IsClosed))
      return MeshLoftClosed(polys);
    else
      return MeshLoftOpen(polys);
  }


  //
  Mesh MeshLoftOpen(IList<Polyline> polys)
  {
    Mesh result = new Mesh();
    var verts = result.Vertices;
    var faces = result.Faces;

    int ny = polys.Count;
    int nx = Enumerable.Min(polys, p => p.Count);
    int n;

    // add vertices
    for(int i = 0; i < ny; i++)
    {
      var poly = polys[i];

      for(int j = 0; j < nx; j++)
        verts.Add(poly[j]);
    }

    // add faces
    for(int i = 0; i < ny - 1; i++)
    {
      n = i * nx;

      for(int j = 0; j < nx - 1; j++)
        faces.AddFace(n + j, n + j + 1, n + j + nx + 1, n + j + nx);
    }

    return result;
  }


  //
  Mesh MeshLoftClosed(IList<Polyline> polys)
  {
    Mesh result = new Mesh();
    var verts = result.Vertices;
    var faces = result.Faces;

    int ny = polys.Count;
    int nx = Enumerable.Min(polys, p => p.Count) - 1;
    int n;

    // add vertices
    for(int i = 0; i < ny; i++)
    {
      var poly = polys[i];

      for(int j = 0; j < nx; j++)
        verts.Add(poly[j]);
    }

    // add faces
    for(int i = 0; i < ny - 1; i++)
    {
      n = i * nx;

      for(int j0 = 0; j0 < nx; j0++)
      {
        int j1 = (j0 + 1) % nx;
        faces.AddFace(n + j0, n + j1, n + j1 + nx, n + j0 + nx);
      }
    }

    return result;
  }
# ---------- end meshloft ----------
wbwindow = WeaverbirdsMeshWindow(MeshPolylines=meshloft.result, Distance=number_slider_4, InsetType=0)
wbframe = WeaverbirdsPictureFrame(MeshPolylines=meshloft.result, Distance=number_slider_4, InsetType=0)
wbthicken = WeaverbirdsMeshThicken(MeshCurves=wbframe, Distance=expr("-x", Slider(0.124, range=0.01..0.5)), OffsetType=0)
wbthicken_2 = WeaverbirdsMeshThicken(MeshCurves=wbwindow, Distance=Slider(0.023, range=0.01..0.5), OffsetType=0)
preview = CustomPreview(Geometry=wbthicken_2, Material=ColourSwatch(SwatchColor=RGBA(176, 0, 176, 74)))
preview_2 = CustomPreview(Geometry=wbthicken, Material=ColourSwatch(SwatchColor=RGB(255, 255, 255)))

# ==== cluster LegendColour: Legend colour for Karamba
merge = Merge(
    Data1=ColourSwatch(SwatchColor=RGB(255, 0, 0)),
    Data2=ColourSwatch(SwatchColor=RGB(255, 179, 0)),
    Data3=ColourSwatch(SwatchColor=RGB(255, 255, 0)),
    Data4=ColourSwatch(SwatchColor=RGB(0, 255, 0)),
    Data5=ColourSwatch(SwatchColor=RGB(0, 255, 255)),
    Data6=ColourSwatch(SwatchColor=RGB(4, 177, 255)),
    Data7=ColourSwatch(SwatchColor=RGB(0, 0, 255)),
    Data8=ColourSwatch(SwatchColor=RGB(129, 0, 190)),
    Data9=ColourSwatch(SwatchColor=RGB(75, 0, 130)))  # -> reverse(Result)
legend = ClusterOutput(merge)  # List of colours to plug on Karamba Legend
