# Grasshopper definition ShapeFromModalShape.gh (Grasshopper 1.0.7)
# plug-ins: Aggregations, Kangaroo Components, Dodo, Weaverbird, Kangaroo2 Components, karambaGH

pt = ConstructPoint(XCoordinate=0, YCoordinate=0, ZCoordinate=Slider(3.57, range=1..20))
rectangle = Rectangle(Plane=PlaneXY(0, 0, 0), XSize="-1.00 to 1.00", YSize="-1.00 to 1.00", Radius=0)  # -> Rectangle, Length
rectangle_2 = Rectangle(Plane=pt, XSize="-1.00 to 1.00", YSize="-1.00 to 1.00", Radius=0)  # -> Rectangle, Length
scale = Scale(Geometry=rectangle_2.Rectangle, Center=pt, Factor=Slider(1.74, range=1..5))  # -> Geometry, Transform
explode = Explode(Curve=rectangle.Rectangle, Recursive=True)  # -> Segments, Vertices
explode_2 = Explode(Curve=scale.Geometry, Recursive=True)  # -> Segments, Vertices
merge = Merge(Data1=graft(explode.Segments), Data2=graft(explode_2.Segments))
boundary = BoundarySurfaces(Edges=rectangle.Rectangle)
loft = Loft(Curves=merge, Options={Adjust=False, Closed=False, LoftEnds=0, LoftSimp=0, LoftType=0, Rebuild=10, Refit=0.01})  # -> flatten(Loft)
merge_2 = Merge(Data1=loft, Data2=boundary)
join = BrepJoin(Breps=merge_2)  # -> Breps, Closed
smesh = SimpleMesh(Brep=join.Breps)
refine = Refine(Mesh=smesh, Level="1")
clean = CombineClean(Meshes=refine)
wbcatmullclark = WeaverbirdsCatmullClarkSubdivision(MeshCurves=clean, Level=Slider(2, range=1..3), SmoothNakedEdges=1)
tri = Triangulate(Mesh=wbcatmullclark)  # -> Mesh, Count
wbloop = WeaverbirdsLoopSubdivision(MeshCurves=tri.Mesh, Level="1", SmoothNakedEdges=1)
mesh = Mesh(wbloop)
mcol = MeshColours(Mesh=mesh, Colours=ColourSwatch(SwatchColor=RGB(255, 255, 255)))
demesh = DeconstructMesh(Mesh=tri.Mesh)  # -> Vertices, Faces, Colours, Normals

number_slider = Slider(1, range=0..1)
vec = VectorXYZ(XComponent=0, YComponent=number_slider, ZComponent=number_slider)  # -> Vector, Length
medges = MeshEdges(Mesh=mcol)  # -> NakedEdges, InteriorEdges, NonManifoldEdges
number_slider_2 = Slider(1, range=1..20)
normshade = NormalShader(
    mesh=mcol,
    direction=vec.Vector,
    color=ColourSwatch(SwatchColor=RGB(158, 158, 158)),
    intensity=Slider(0.23, range=0..1),
    Reference="C:\USERS\MARCO\DESKTOP\old personal google drive\AA_Aarhus_Workshop_Folder\Grasshopper Resources\Libraries\SpatialSlur.dll")  # -> out, result; inputs mesh: Mesh, direction: Vector3d, color: Color, intensity: Double
# ---------- normshade: C# ----------
    if(mesh.Normals.Count != mesh.Vertices.Count)
      mesh.Normals.ComputeNormals();

    if(mesh.VertexColors.Count != mesh.Vertices.Count)
      mesh.VertexColors.CreateMonotoneMesh(Color.White);

    NormalShader(mesh, direction, color, intensity);
    result = mesh;
# ---------- normshade: C# additional code ----------
  //
  void NormalShader(Mesh mesh, Vector3d direction, Color color, double intensity)
  {
    if(!direction.Unitize())
      throw new System.ArgumentException("the direction vector cannot be zero length");

    Color[] vc = mesh.VertexColors.ToArray();

    var chunks = System.Collections.Concurrent.Partitioner.Create(0, mesh.Vertices.Count);
    System.Threading.Tasks.Parallel.ForEach(chunks, range =>
      {
      for (int i = range.Item1; i < range.Item2; i++)
      {
        double t = direction * mesh.Normals[i] * 0.5 + 0.5;
        vc[i] = vc[i].LerpTo(color, t * intensity);
      }
      });

    mesh.VertexColors.SetColors(vc);
  }
# ---------- end normshade ----------
displaycrv = DisplayCurve(curve=medges.NakedEdges, color=ColourSwatch(SwatchColor=RGB(0, 0, 0)), weight=Slider(6, range=1..20))  # -> out; inputs curve: Curve, color: Color, weight: Int32
# ---------- displaycrv: C# ----------
    // silently skip null curves
    if(curve == null) return;

    // add to display cache
    _curves.Add(curve);
    _colors.Add(color);
    _weights.Add(weight);
    _clippingBox.Union(curve.GetBoundingBox(false));
# ---------- displaycrv: C# additional code ----------
  List<Curve> _curves;
  List<Color> _colors;
  List<int> _weights;
  BoundingBox _clippingBox;


  /// <summary>
  /// This method will be called once every solution, before any calls to RunScript.
  /// </summary>
  public override void BeforeRunScript()
  {
    _curves = new List<Curve>();
    _colors = new List<Color>();
    _weights = new List<int>();
    _clippingBox = new BoundingBox();
  }


  //
  public override BoundingBox ClippingBox
  {
    get{return _clippingBox;}
  }


  //
  public override void DrawViewportWires(IGH_PreviewArgs args)
  {
    base.DrawViewportWires(args);

    for(int i = 0; i < _curves.Count; i++)
      args.Display.DrawCurve(_curves[i], _colors[i], _weights[i]);
  }
# ---------- end displaycrv ----------

medges_2 = MeshEdges()  # -> NakedEdges, InteriorEdges, NonManifoldEdges
pt_2 = Point(demesh.Vertices)
duppt = RemoveDuplicatePts(Points=pt_2, Tolerance=0.01)
pdecon = Deconstruct(Point=duppt)  # -> XComponent, YComponent, ZComponent
bnd = Bounds(Numbers=flatten(pdecon.ZComponent))
dedomain = DeconstructDomain(Domain=bnd)  # -> Start, End
addition = Addition(A=dedomain.Start, B="0.1")
smaller = SmallerThan(FirstNumber=pdecon.ZComponent, SecondNumber=addition)  # -> SmallerThan, OrEqualTo
cull = CullPattern(List=duppt, CullPattern=smaller.SmallerThan)
loads = LoadsKaramba3D(Vector=Vector(0, 0, -1), LCase=0, mode="Gravity")
supp = SupportKaramba3D(PosInd=cull, menu=[buttons(on, on, on, off, off, off)])
meshtoshell = MeshToShellKaramba3D(Mesh=tri.Mesh, LimitDistance_m=0.005)  # -> Element, Points, Info
assemble = AssembleModelKaramba3D(Elem=meshtoshell.Element, Support=supp, Load=loads, LimitDistance_m=0.005)  # -> Model, Info, Mass_kg, CenterOfGravity
nvibes = NaturalVibrationsKaramba3D(Model=assemble.Model, FromIndex=1, NumberOfModes="36", MaximumNumberOfIterations=30, Epsilon=1e-05)  # -> ModelWithVibrationModesAsLoadCaseResults, NaturalFrequencies_Hz, ModalMass_kg, ParticipationFactorInGlobalXYAndZDirection
series = Series(Start=0, Step=1, Count="8")
modelview = ModelViewKaramba3D(
    Model=nvibes.ModelWithVibrationModesAsLoadCaseResults,
    LoadCaseFactorsForLinearSuperposition=1,
    IndexOfVisibleLoadcase=series)  # -> Model, DeformedMesh, DeformedAxes, DeformedModel
shellview = ShellViewKaramba3D(Model=modelview.Model, IndexOfLayer=0)  # -> Model, MeshesOfRenderedShells, LegendColors, LegendTags
bbox = BoundingBox(Content=tri.Mesh, Plane=PlaneXY(0, 0, 0))  # -> Box, Box_2
debox = DeconstructBox(Box=bbox.Box)  # -> Plane, X, Y, Z
debrep = DeconstructBrep(Brep=bbox.Box)  # -> Faces, Edges, Vertices
dedomain_2 = DeconstructDomain(Domain=[debox.X, debox.Y])  # -> Start, End
item = ListItem(List=debrep.Faces, Index=0, Wrap=True)  # -> Item, Item1, Item2, Item3, Item4
abs = Absolute(Value=[dedomain_2.Start, dedomain_2.End])
srf = Surface(item.Item4)
sort = SortList(Keys=abs)  # -> reverse(Keys), ValuesA
clean_2 = CombineClean(Meshes=shellview.MeshesOfRenderedShells)
item_2 = ListItem(List=sort.Keys, Index=0, Wrap=True)
area = Area(Geometry=srf)  # -> Area, Centroid
multiplication = Multiplication(A=item_2, B=Slider(3, range=1..3))
multiplication_2 = Multiplication(A=multiplication, B=Slider(1.69, range=1..3))
recgrid = Rectangular(Plane=PlaneXY(0, 0, 0), SizeX=multiplication, SizeY=multiplication_2, ExtentX="4", ExtentY="2")  # -> flatten(Cells), Points
wbloop_2 = WeaverbirdsLoopSubdivision(MeshCurves=clean_2, Level="1", SmoothNakedEdges=1)
explode_3 = Explode(Curve=recgrid.Cells, Recursive=True)  # -> Segments, Vertices
area_2 = Area(Geometry=recgrid.Cells)  # -> Area, Centroid
pt_3 = Point(recgrid.Points)
subtraction = Subtraction(A=flatten(area_2.Centroid), B=flatten(area.Centroid))
move = Move(Geometry=flatten(wbloop_2), Motion=subtraction)  # -> Geometry, Transform
mesh_2 = Mesh(move.Geometry)
serieslist = SeriesFromList(List=move.Geometry, Start=0, Step=1)
item_3 = ListItem(List=explode_3.Vertices, Index=0, Wrap=True)
rotate = Rotate(Geometry=mesh_2, Angle=degrees(Slider(360, range=0..360)), Plane=area_2.Centroid)  # -> Geometry, Transform
xy = XYPlane(Origin=item_3)
Y = UnitY(Factor=Slider(1.561, range=0..30))
concat = Concatenate(FragmentA="Modal Shape: ", FragmentB=serieslist)
mcol_2 = MeshColours(Mesh=rotate.Geometry, Colours=ColourSwatch(SwatchColor=RGB(255, 255, 255)))
move_2 = Move(Geometry=xy, Motion=Y)  # -> Geometry, Transform
Z = UnitZ(Factor=Slider(6.644, range=0..100))
preview = CustomPreview(Geometry=mcol_2, Material=ColourSwatch(SwatchColor=RGB(255, 255, 255)))

number_slider_3 = Slider(1, range=0..1)
vec_2 = VectorXYZ(XComponent=0, YComponent=number_slider_3, ZComponent=number_slider_3)  # -> Vector, Length
medges_3 = MeshEdges(Mesh=mcol_2)  # -> NakedEdges, InteriorEdges, NonManifoldEdges
number_slider_4 = Slider(1, range=1..20)
normshade_2 = NormalShader(
    mesh=mcol_2,
    direction=vec_2.Vector,
    color=ColourSwatch(SwatchColor=RGB(158, 158, 158)),
    intensity=Slider(0.23, range=0..1),
    Reference="C:\USERS\MARCO\DESKTOP\old personal google drive\AA_Aarhus_Workshop_Folder\Grasshopper Resources\Libraries\SpatialSlur.dll")  # -> out, result; inputs mesh: Mesh, direction: Vector3d, color: Color, intensity: Double; same code as normshade
displaycrv_2 = DisplayCurve(curve=medges_3.NakedEdges, color=ColourSwatch(SwatchColor=RGB(0, 0, 0)), weight=Slider(6, range=1..20))  # -> out; inputs curve: Curve, color: Color, weight: Int32; same code as displaycrv

medges_4 = MeshEdges()  # -> NakedEdges, InteriorEdges, NonManifoldEdges
modelview_2 = ModelViewKaramba3D(
    Model=nvibes.ModelWithVibrationModesAsLoadCaseResults,
    LoadCaseFactorsForLinearSuperposition=1,
    IndexOfVisibleLoadcase=Slider(7, range=0..8))  # -> Model, DeformedMesh, DeformedAxes, DeformedModel
shellview_2 = ShellViewKaramba3D(Model=modelview_2.Model, IndexOfLayer=0)  # -> Model, MeshesOfRenderedShells, LegendColors, LegendTags
clean_3 = CombineClean(Meshes=shellview_2.MeshesOfRenderedShells)
wbloop_3 = WeaverbirdsLoopSubdivision(MeshCurves=clean_3, Level="1", SmoothNakedEdges=1)
bbox_2 = BoundingBox(Content=wbloop_3, Plane=PlaneXY(0, 0, 0))  # -> Box, Box_2
mesh_3 = Mesh(wbloop_3)
volume = Volume(Geometry=bbox_2.Box)  # -> Volume, Centroid
cir = Circle(Plane=volume.Centroid, Radius=Slider(13.79, range=1..20))
move_3 = Move(Geometry=cir, Motion=Z)  # -> Geometry, Transform
crv = Curve(reparameterize(move_3.Geometry))
seam = Seam(Curve=crv, Seam=Slider(0.1, range=0..1))
mcol_3 = MeshColours(Mesh=mesh_3, Colours=ColourSwatch(SwatchColor=RGB(255, 255, 255)))
pt_4 = Point(volume.Centroid)
eval = EvaluateLength(Curve=seam, Length=Slider(0, range=0..1), Normalized=True)  # -> Point, Tangent, Parameter
c_script = CSharpScript(points=pt_4, index="0", newLocation=eval.Point)  # -> out, A, cameraPosition; inputs points: list of Point3d, index: Int32, newLocation: Point3d
# ---------- c_script: C# ----------
    int myIndex = index > (points.Count - 1) ? points.Count - 1 : index;
    Point3d camPos = new Point3d();
    Point3d myPoint = points[myIndex];



    camPos = Rhino.RhinoDoc.ActiveDoc.Views.ActiveView.ActiveViewport.CameraLocation;
    Rhino.RhinoDoc.ActiveDoc.Views.ActiveView.ActiveViewport.SetCameraTarget(myPoint, true);
    Rhino.RhinoDoc.ActiveDoc.Views.ActiveView.ActiveViewport.SetCameraLocations(myPoint, newLocation);


    A = myPoint;

    cameraPosition = camPos;
# ---------- end c_script ----------
text = Text(Size=1, Bold=False, HorizontalAlignment=0, VerticalAlignment=0)

number_slider_5 = Slider(1, range=0..1)
vec_3 = VectorXYZ(XComponent=0, YComponent=number_slider_5, ZComponent=number_slider_5)  # -> Vector, Length
medges_5 = MeshEdges(Mesh=mcol_3)  # -> NakedEdges, InteriorEdges, NonManifoldEdges
number_slider_6 = Slider(1, range=1..20)
normshade_3 = NormalShader(
    mesh=mcol_3,
    direction=vec_3.Vector,
    color=ColourSwatch(SwatchColor=RGB(158, 158, 158)),
    intensity=Slider(0.23, range=0..1),
    Reference="C:\USERS\MARCO\DESKTOP\old personal google drive\AA_Aarhus_Workshop_Folder\Grasshopper Resources\Libraries\SpatialSlur.dll")  # -> out, result; inputs mesh: Mesh, direction: Vector3d, color: Color, intensity: Double; same code as normshade
displaycrv_3 = DisplayCurve(curve=medges_5.NakedEdges, color=ColourSwatch(SwatchColor=RGB(0, 0, 0)), weight=Slider(6, range=1..20))  # -> out; inputs curve: Curve, color: Color, weight: Int32; same code as displaycrv

medges_6 = MeshEdges()  # -> NakedEdges, InteriorEdges, NonManifoldEdges
tag = TextTag3D(
    Location=flatten(move_2.Geometry),
    Text=concat,
    Size=Slider(0.45, range=0..1),
    Colour=ColourSwatch(SwatchColor=RGB(255, 255, 255)),
    Justification=7)
panel = Panel(c_script.cameraPosition)
panel_2 = Panel(c_script.A)
