# Grasshopper definition Pressure.gh (Grasshopper 1.0.7)
# plug-ins: K2Engineering, MeshEdit Components, treesloth01, Pufferfish, Human, Kangaroo Components, LunchBox, Weaverbird, Kangaroo2 Components, plankton

platoocta = PlatonicOctahedron(Plane=PlaneXY(0, 0, 0), Radius="1", Truncation=0)
platotetra = PlatonicTetrahedron(Plane=PlaneXY(0, 0, 0), Radius="1", Truncation="0.25")
debrep = DeconstructBrep(Brep=platoocta)  # -> Faces, Edges, Vertices
debrep_2 = DeconstructBrep(Brep=debrep.Faces)  # -> Faces, Edges, Vertices
box = DomainBox(Base=PlaneXY(0, 0, 0), X="1", Y="2", Z="1")
boundary = BoundarySurfaces(Edges=debrep_2.Edges)  # -> flatten(Surfaces)
smesh = SimpleMesh(Brep=box)
join = BrepJoin(Breps=boundary)  # -> Breps, Closed
smesh_2 = SimpleMesh(Brep=join.Breps)
explode = MeshExplode(Mesh=smesh, Interpolate=False)
refine = Refine(Mesh=explode, Level="3")
unifynormals = MeshUnifyNormals(Mesh=refine)

panel = Panel("1")  # disabled
box_2 = DomainBox(Base=PlaneXY(0, 0, 0), X=panel, Y=panel, Z=panel)  # disabled
smesh_3 = SimpleMesh(Brep=box_2)  # disabled
explode_2 = MeshExplode(Mesh=smesh_3, Interpolate=False)  # disabled
panel_2 = Panel("4")  # disabled
refine_2 = Refine(Mesh=explode_2, Level=panel_2)  # disabled
unifynormals_2 = MeshUnifyNormals(Mesh=refine_2)  # disabled
mesh = Mesh(unifynormals_2)  # disabled
wbnaked = WeaverbirdsNakedBoundary(MeshClosedPolylines=mesh)  # disabled
explode_3 = Explode(Curve=wbnaked, Recursive=True)  # -> flatten(Segments), Vertices; disabled
tri = Triangulate(Mesh=mesh)  # -> Mesh, Count; disabled
dupln = RemoveDuplicateLines(Lines=explode_3.Segments, Tolerance=0.01)  # disabled
pmesh = PlanktonMesh(tri.Mesh)  # disabled
panel_3 = Panel("0.2")  # disabled
facen = FaceNormals(Mesh=tri.Mesh)  # -> Centers, Normals; disabled
medges = MeshEdges(Mesh=mesh)  # -> NakedEdges, InteriorEdges, NonManifoldEdges; disabled
vdis = VectorDisplay(Anchor=facen.Centers, Vector=facen.Normals)  # disabled
crv = Curve(medges.InteriorEdges)  # disabled
number_slider = Slider(1.929, range=0.2..5)  # disabled
number_slider_2 = Slider(8.36, range=0.1..100)  # disabled
show = Show(G=mesh)  # disabled
dupln_2 = RemoveDuplicateLines(Lines=flatten(crv), Tolerance=0.01)  # disabled
len = Length(Curve=dupln)  # disabled
panel_4 = Panel("100")  # disabled
pressure = Pressure(M=pmesh, Strength=number_slider_2)  # disabled
len_2 = Length(Curve=dupln_2)  # disabled
length_line = LengthLine(Line=dupln, Length=len, Strength=panel_4)  # disabled
length_line_2 = LengthLine(Line=dupln_2, Length=len_2, Strength=panel_4)  # disabled
entwine = Entwine(Branch00=show, Branch02=length_line, Branch03=length_line_2, Branch04=pressure, FlattenInputs=True)  # disabled
toggle = BooleanToggle(True)  # disabled
button = Button()  # disabled
solver = Solver(GoalObjects=entwine, Reset=button, Threshold=1e-15, Tolerance=0.01, On=toggle)  # -> I, V, O; disabled
unflatten = UnflattenTree(Tree=solver.O, Guide=entwine)  # disabled
bang = ExplodeTree(Data=unflatten)  # -> Branch0, Branch1, Branch2, Branch3; disabled
mesh_2 = Mesh(bang.Branch0)  # disabled
toggle_2 = BooleanToggle(True)  # disabled
filter = StreamFilter(Gate=toggle_2, Stream1=mesh_2)  # disabled
mesh_3 = Mesh(filter)  # disabled
wbnaked_2 = WeaverbirdsNakedBoundary(MeshClosedPolylines=mesh_3)  # disabled
explode_4 = Explode(Curve=wbnaked_2, Recursive=True)  # -> flatten(Segments), Vertices; disabled
tri_2 = Triangulate(Mesh=mesh_3)  # -> Mesh, Count; disabled
dupln_3 = RemoveDuplicateLines(Lines=explode_4.Segments, Tolerance=0.01)  # disabled
disc = Discontinuity(Curve=wbnaked_2, Level=1)  # -> Points, Parameters; disabled
facen_2 = FaceNormals(Mesh=tri_2.Mesh)  # -> Centers, Normals; disabled
duppt = RemoveDuplicatePts(Points=flatten(disc.Points), Tolerance=0.01)  # disabled
pmesh_2 = PlanktonMesh(tri_2.Mesh)  # disabled
panel_5 = Panel("10")  # disabled
panel_6 = Panel("1")  # disabled
mat = Materials(MaterialIndex=0)  # -> MaterialName, Density, YoungsModulus, ShearModulus, Strength; disabled
circle = CircularCS(Diameter=panel_6)  # -> A, I, Z, It; disabled
medges_2 = MeshEdges(Mesh=mesh_3)  # -> NakedEdges, InteriorEdges, NonManifoldEdges; disabled
vdis_2 = VectorDisplay(Anchor=facen_2.Centers, Vector=facen_2.Normals)  # disabled
support = Support(PinnedSupportPt=duppt, XFixed=True, YFixed=True, ZFixed=True, Strength=1e+15)  # disabled
show_2 = Show(G=mesh_3)  # disabled
toggle_3 = BooleanToggle(True)  # disabled
crv_2 = Curve(medges_2.InteriorEdges)  # disabled
panel_7 = Panel("1000")  # disabled
pressure_2 = Pressure(PMesh=pmesh_2, Pressure=panel_5, PressureOption=toggle_3)  # disabled
dupln_4 = RemoveDuplicateLines(Lines=flatten(crv_2), Tolerance=0.01)  # disabled
cable = Cable(Line=dupln_3, EModulus=mat.YoungsModulus, Area=circle.A, PreTension=panel_7)  # disabled
cable_2 = Cable(Line=dupln_4, EModulus=mat.YoungsModulus, Area=circle.A, PreTension=panel_7)  # disabled
entwine_2 = Entwine(Branch00=show_2, Branch01=support, Branch02=[cable, cable_2], Branch04=pressure_2, FlattenInputs=True)  # disabled
toggle_4 = BooleanToggle(True)  # disabled
button_2 = Button()  # disabled
panel_8 = Panel("1e-14")  # disabled
panel_9 = Panel("10000")  # disabled
zombiesolver = ZombieSolver(GoalObjects=entwine_2, Threshold=panel_8, Tolerance=0.01, MaxIterations=panel_9)  # -> I, V, O; disabled
solver_2 = Solver(GoalObjects=entwine_2, Reset=button_2, Threshold=1e-15, Tolerance=0.01, On=toggle_4)  # -> I, V, O; disabled
unflatten_2 = UnflattenTree(Tree=solver_2.O, Guide=entwine_2)  # disabled
bang_2 = ExplodeTree(Data=unflatten_2)  # -> Branch0, Branch1, Branch2, Branch3; disabled
baroutput = BarOutput(BarData=bang_2.Branch2)  # -> Line, AxialForce, AxialStress; disabled
axialdisplay = AxialVisualisation(Line=baroutput.Line, AxialForces=baroutput.AxialForce, ThicknessMax=10)  # disabled

mesh_4 = Mesh(unifynormals)
explode_5 = MeshExplode(Mesh=mesh_4, Interpolate=False)
demesh = DeconstructMesh(Mesh=explode_5)  # -> Vertices, Faces, Colours, Normals
item = ListItem(List=demesh.Vertices, Index=0, Wrap=True)  # -> Item, Item1, Item2, Item3
ln = Line(StartPoint=item.Item1, EndPoint=item.Item3)
ln_2 = Line(StartPoint=item.Item, EndPoint=item.Item2)
wbnaked_3 = WeaverbirdsNakedBoundary(MeshClosedPolylines=mesh_4)
explode_6 = Explode(Curve=wbnaked_3, Recursive=True)  # -> flatten(Segments), Vertices
tri_3 = Triangulate(Mesh=mesh_4)  # -> Mesh, Count
disc_2 = Discontinuity(Curve=wbnaked_3, Level=1)  # -> Points, Parameters
facen_3 = FaceNormals(Mesh=tri_3.Mesh)  # -> Centers, Normals
duppt_2 = RemoveDuplicatePts(Points=flatten(disc_2.Points), Tolerance=0.01)
dupln_5 = RemoveDuplicateLines(Lines=explode_6.Segments, Tolerance=0.01)
pmesh_3 = PlanktonMesh(tri_3.Mesh)
mat_2 = Materials(MaterialIndex=0)  # -> MaterialName, Density, YoungsModulus, ShearModulus, Strength
circle_2 = CircularCS(Diameter="1")  # -> A, I, Z, It
circle_3 = CircularCS(Diameter="5")  # -> A, I, Z, It
medges_3 = MeshEdges(Mesh=mesh_4)  # -> NakedEdges, InteriorEdges, NonManifoldEdges
vdis_3 = VectorDisplay(Anchor=facen_3.Centers, Vector=facen_3.Normals)
support_2 = Support(PinnedSupportPt=duppt_2, XFixed=True, YFixed=True, ZFixed=True, Strength=1e+15)
crv_3 = Curve(medges_3.InteriorEdges)
pressure_3 = Pressure(PMesh=pmesh_3, Pressure="1", PressureOption=Toggle(True))
dupln_6 = RemoveDuplicateLines(Lines=flatten(crv_3), Tolerance=0.01)
mjoin = MeshJoin(Meshes=mesh_4)
cable_3 = Cable(Line=dupln_6, EModulus=mat_2.YoungsModulus, Area=circle_2.A)
cable_4 = Cable(Line=dupln_5, EModulus=mat_2.YoungsModulus, Area=circle_3.A, PreTension="50000")
clean = CombineClean(Meshes=mjoin)
cable_5 = Cable(Line=[ln_2, ln], EModulus=mat_2.YoungsModulus, Area=circle_2.A)
demesh_2 = DeconstructMesh(Mesh=clean)  # -> Vertices, Faces, Colours, Normals
show_3 = Show(G=clean)
show_4 = Show(G=demesh_2.Vertices)
show_5 = Show(G=dupln_5)
show_6 = Show(G=dupln_6)
transformmoment = TransformMoment()
entwine_3 = Entwine(
    Branch00=show_3,
    Branch01=show_4,
    Branch02=cable_4,
    Branch03=cable_3,
    Branch04=pressure_3,
    Branch05=cable_5,
    Branch06=show_5,
    Branch07=show_6,
    FlattenInputs=True)
solver_3 = Solver(GoalObjects=entwine_3, Reset=Button(), Threshold=1e-15, Tolerance=0.01, On=Toggle(False))  # -> I, V, O
zombiesolver_2 = ZombieSolver(GoalObjects=entwine_3, Threshold="1e-15", Tolerance=0.01, MaxIterations="20000")  # -> I, V, O
unflatten_3 = UnflattenTree(Tree=zombiesolver_2.O, Guide=entwine_3)
panel_10 = Panel("0.0000001")
bang_3 = ExplodeTree(Data=solver_3.O)  # -> Branch0, Branch1, Branch2, Branch3, Branch4, Branch5, Branch6, Branch7
baroutput_2 = BarOutput(BarData=bang_3.Branch2)  # -> Line, AxialForce, AxialStress
mesh_5 = Mesh(bang_3.Branch0)
previewmat = CustomPreviewMaterials(Geometry=mesh_5, DiffuseColor=ColourSwatch(SwatchColor=RGB(0, 0, 0)), Transparency=Slider(0.13, range=0..1))
baroutput_3 = BarOutput(BarData=bang_3.Branch5)  # -> Line, AxialForce, AxialStress
larger = LargerThan(FirstNumber=baroutput_2.AxialForce, SecondNumber="-1")  # -> LargerThan, OrEqualTo
baroutput_4 = BarOutput(BarData=bang_3.Branch3)  # -> Line, AxialForce, AxialStress
larger_2 = LargerThan(FirstNumber=baroutput_3.AxialForce, SecondNumber="-1")  # -> LargerThan, OrEqualTo
larger_3 = LargerThan(FirstNumber=baroutput_4.AxialForce, SecondNumber="-1")  # -> LargerThan, OrEqualTo
cull_multiple = CullMultiple(L0=baroutput_2.Line, L1=baroutput_2.AxialForce, P=larger.LargerThan)  # -> L0, L1
cull_multiple_2 = CullMultiple(List0=baroutput_4.Line, List1=baroutput_4.AxialForce, CullPattern=larger_3.LargerThan)  # -> List0, List1
cull_multiple_3 = CullMultiple(List0=baroutput_3.Line, List1=baroutput_3.AxialForce, CullPattern=larger_2.LargerThan)  # -> List0, List1
merge = Merge(
    Data1=ColourSwatch(SwatchColor=RGB(161, 224, 255)),
    Data2=ColourSwatch(SwatchColor=RGB(0, 88, 219)),
    Data3=ColourSwatch(SwatchColor=RGB(0, 30, 255)))
entwine_4 = Entwine(Branch00=cull_multiple.L0, Branch01=cull_multiple_2.List0, Branch02=cull_multiple_3.List0, FlattenInputs=True)
entwine_5 = Entwine(Branch00=cull_multiple.L1, Branch01=cull_multiple_2.List1, Branch02=cull_multiple_3.List1, FlattenInputs=True)
ahsv = SplitAHSV(Colour=merge)  # -> Alpha, Hue, Saturation, Value
num = Number(entwine_5)

mesh_6 = Mesh(mesh_2)  # disabled
number_slider_3 = Slider(1, range=0..1)  # disabled
vec = VectorXYZ(XComponent=0, YComponent=number_slider_3, ZComponent=number_slider_3)  # -> Vector, Length; disabled
swatch = ColourSwatch(SwatchColor=RGB(255, 255, 255))  # disabled
number_slider_4 = Slider(0.34, range=0..1)  # disabled
medges_4 = MeshEdges(Mesh=mesh_6)  # -> NakedEdges, InteriorEdges, NonManifoldEdges; disabled
number_slider_5 = Slider(6, range=1..20)  # disabled
number_slider_6 = Slider(1, range=1..20)  # disabled
swatch_2 = ColourSwatch(SwatchColor=RGB(0, 0, 0))  # disabled
normshade = NormalShader(
    mesh=mesh_6,
    direction=vec.Vector,
    color=swatch,
    intensity=number_slider_4,
    Reference="C:\USERS\MARCO\DESKTOP\old personal google drive\AA_Aarhus_Workshop_Folder\Grasshopper Resources\Libraries\SpatialSlur.dll")  # -> out, result; inputs mesh: Mesh, direction: Vector3d, color: Color, intensity: Double; disabled
# ---------- normshade: C# ----------
    if(mesh.Normals.Count != mesh.Vertices.Count)
      mesh.Normals.ComputeNormals();

    if(mesh.VertexColors.Count != mesh.Vertices.Count)
      mesh.VertexColors.CreateMonotoneMesh(Color.White);

    NormalShader(mesh, direction, color, intensity);
    result = mesh;
# ---------- normshade: C# additional code ----------
  //
  void NormalShader(Mesh mesh, Vector3d direction, Color color, double intensity)
  {
    if(!direction.Unitize())
      throw new System.ArgumentException("the direction vector cannot be zero length");

    Color[] vc = mesh.VertexColors.ToArray();

    var chunks = System.Collections.Concurrent.Partitioner.Create(0, mesh.Vertices.Count);
    System.Threading.Tasks.Parallel.ForEach(chunks, range =>
      {
      for (int i = range.Item1; i < range.Item2; i++)
      {
        double t = direction * mesh.Normals[i] * 0.5 + 0.5;
        vc[i] = vc[i].LerpTo(color, t * intensity);
      }
      });

    mesh.VertexColors.SetColors(vc);
  }
# ---------- end normshade ----------
displaycrv = DisplayCurve(curve=medges_4.NakedEdges, color=swatch_2, weight=number_slider_5)  # -> out; inputs curve: Curve, color: Color, weight: Int32; disabled
# ---------- displaycrv: C# ----------
    // silently skip null curves
    if(curve == null) return;

    // add to display cache
    _curves.Add(curve);
    _colors.Add(color);
    _weights.Add(weight);
    _clippingBox.Union(curve.GetBoundingBox(false));
# ---------- displaycrv: C# additional code ----------
  List<Curve> _curves;
  List<Color> _colors;
  List<int> _weights;
  BoundingBox _clippingBox;


  /// <summary>
  /// This method will be called once every solution, before any calls to RunScript.
  /// </summary>
  public override void BeforeRunScript()
  {
    _curves = new List<Curve>();
    _colors = new List<Color>();
    _weights = new List<int>();
    _clippingBox = new BoundingBox();
  }


  //
  public override BoundingBox ClippingBox
  {
    get{return _clippingBox;}
  }


  //
  public override void DrawViewportWires(IGH_PreviewArgs args)
  {
    base.DrawViewportWires(args);

    for(int i = 0; i < _curves.Count; i++)
      args.Display.DrawCurve(_curves[i], _colors[i], _weights[i]);
  }
# ---------- end displaycrv ----------
displaycrv_2 = DisplayCurve(curve=medges_4.InteriorEdges, color=swatch_2, weight=number_slider_6)  # -> out; inputs curve: Curve, color: Color, weight: Int32; disabled; same code as displaycrv

panel_11 = Panel("10 to 50")
dom = ConstructDomain(DomainStart=Slider(1, range=1..20), DomainEnd=Slider(8, range=5..20))
bnd = Bounds(Numbers=flatten(num))
addition = Addition(A=ahsv.Hue, B=Slider(0.51, range=0..1))
argb = SplitARGB(Colour=merge, IntegerChannels=True)  # -> Alpha, Red, Green, Blue
remap = RemapNumbers(Value=num, Source=bnd, Target=Domain(0, 1))  # -> Mapped, Clipped

mesh_7 = Mesh(mesh_5)
number_slider_7 = Slider(1, range=0..1)
vec_2 = VectorXYZ(XComponent=0, YComponent=number_slider_7, ZComponent=number_slider_7)  # -> Vector, Length
medges_5 = MeshEdges(Mesh=mesh_7)  # -> NakedEdges, InteriorEdges, NonManifoldEdges
swatch_3 = ColourSwatch(SwatchColor=RGB(0, 0, 0))
normshade_2 = NormalShader(
    mesh=mesh_7,
    direction=vec_2.Vector,
    color=ColourSwatch(SwatchColor=RGB(255, 255, 255)),
    intensity=Slider(0.34, range=0..1),
    Reference="C:\USERS\MARCO\DESKTOP\old personal google drive\AA_Aarhus_Workshop_Folder\Grasshopper Resources\Libraries\SpatialSlur.dll")  # -> out, result; inputs mesh: Mesh, direction: Vector3d, color: Color, intensity: Double; same code as normshade
displaycrv_3 = DisplayCurve(curve=bang_3.Branch7, color=swatch_3, weight=Slider(1, range=1..20))  # -> out; inputs curve: Curve, color: Color, weight: Int32; same code as displaycrv
displaycrv_4 = DisplayCurve(curve=baroutput_2.Line, color=swatch_3, weight=Slider(6, range=1..20))  # -> out; inputs curve: Curve, color: Color, weight: Int32; same code as displaycrv

remap_2 = RemapNumbers(Value=num, Source=bnd, Target=dom)  # -> Mapped, Clipped
subtraction = Subtraction(A=argb.Blue, B=Slider(255, range=0..255))
hsv = ColourHSV(Alpha=1, Hue=addition, Saturation=ahsv.Saturation, Value=ahsv.Value)
rgb = ColourRGB(Alpha=255, Red=argb.Red, Green=argb.Green, Blue=subtraction)
twnthrucols = TweenThroughColors(
    Colors=hsv,
    Factor=remap.Mapped,
    Normalized=True,
    Equalized=False,
    Weighted=False,
    Degree=3,
    InterpolationType=0,
    Alpha=True)
previewlw = CustomPreviewLineweights(Geometry=entwine_4, Shader=twnthrucols, Thickness=remap_2.Mapped, Absolute=False)

mesh_8 = Mesh(bang_2.Branch0)  # disabled
number_slider_8 = Slider(1, range=0..1)  # disabled
vec_3 = VectorXYZ(XComponent=0, YComponent=number_slider_8, ZComponent=number_slider_8)  # -> Vector, Length; disabled
swatch_4 = ColourSwatch(SwatchColor=RGB(255, 255, 255))  # disabled
number_slider_9 = Slider(0.34, range=0..1)  # disabled
medges_6 = MeshEdges(Mesh=mesh_8)  # -> NakedEdges, InteriorEdges, NonManifoldEdges; disabled
number_slider_10 = Slider(6, range=1..20)  # disabled
number_slider_11 = Slider(1, range=1..20)  # disabled
swatch_5 = ColourSwatch(SwatchColor=RGB(0, 0, 0))  # disabled
normshade_3 = NormalShader(
    mesh=mesh_8,
    direction=vec_3.Vector,
    color=swatch_4,
    intensity=number_slider_9,
    Reference="C:\USERS\MARCO\DESKTOP\old personal google drive\AA_Aarhus_Workshop_Folder\Grasshopper Resources\Libraries\SpatialSlur.dll")  # -> out, result; inputs mesh: Mesh, direction: Vector3d, color: Color, intensity: Double; disabled; same code as normshade
displaycrv_5 = DisplayCurve(curve=medges_6.NakedEdges, color=swatch_5, weight=number_slider_10)  # -> out; inputs curve: Curve, color: Color, weight: Int32; disabled; same code as displaycrv
displaycrv_6 = DisplayCurve(curve=medges_6.InteriorEdges, color=swatch_5, weight=number_slider_11)  # -> out; inputs curve: Curve, color: Color, weight: Int32; disabled; same code as displaycrv
