# Grasshopper definition space truss structures.gh (Grasshopper 0.9.76)
# plug-ins: Karamba, LunchBox, Weaverbird

pt = ConstructPoint(XCoordinate=0, YCoordinate=Slider(14, range=10..20), ZCoordinate=0)
pt_2 = ConstructPoint(XCoordinate=0, YCoordinate=0, ZCoordinate=0)
x_span = Slider(7, range=5..14)
ln = Line(StartPoint=pt_2, EndPoint=pt)
series = Series(Start=0, Step=x_span, Count="3")
X = UnitX(Factor=series)
move = Move(Geometry=ln, Motion=X)  # -> Geometry, Transform
item = ListItem(List=move.Geometry, Index=0, Wrap=True)  # -> Item, Item1, Item2
eval = EvaluateCurve(Curve=reparameterize(item.Item1), Parameter="0.5")  # -> Point, Tangent, Angle
end = EndPoints(Curve=item.Item1)  # -> Start, End
Z = UnitZ(Factor=Slider(0, range=0..5))
move_2 = Move(Geometry=eval.Point, Motion=Z)  # -> Geometry, Transform
intcrv = Interpolate(Vertices=[end.Start, move_2.Geometry, end.End], Degree=3, Periodic=False, KnotStyle=1)  # -> Curve, Length, Domain
merge = Merge(Data1=item.Item, Data2=intcrv.Curve, Data3=item.Item2)
loft = Loft(Curves=merge, Options={Adjust=False, Closed=False, LoftEnds=0, LoftSimp=0, LoftType=0, Rebuild=10, Refit=0.01})

# ---- group: Plug the Surface
srf = Surface(loft)

# ----
crv = Curve(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)
seam = Seam(Curve=reparameterize(crv), Seam=Slider(0.12, range=0..1))
spacetruss_1 = SpaceTrussStructure1(
    Surface=srf,
    UDivisions=Slider(8, range=1..10),
    VDivisions=Slider(8, range=1..10),
    TrussDepth=expr("-x", Slider(2.2, range=2..4)))  # -> LinesA, LinesB, Web, Nodes
eval_2 = EvaluateLength(Curve=seam, Length=Slider(1, range=0..1), Normalized=True)  # -> Point, Tangent, Parameter
Z_2 = UnitZ(Factor=expr("-x", Slider(20, range=0..100)))
c_script = CSharpScript(points=eval.Point, newLocation=eval_2.Point)  # -> out, A, cameraPosition; inputs points: list of Point3d, index: Int32, newLocation: Point3d
# ---------- c_script: C# ----------
    int myIndex = index > (points.Count - 1) ? points.Count - 1 : index;
    Point3d camPos = new Point3d();
    Point3d myPoint = points[myIndex];



    camPos = Rhino.RhinoDoc.ActiveDoc.Views.ActiveView.ActiveViewport.CameraLocation;
    Rhino.RhinoDoc.ActiveDoc.Views.ActiveView.ActiveViewport.SetCameraTarget(myPoint, true);
    Rhino.RhinoDoc.ActiveDoc.Views.ActiveView.ActiveViewport.SetCameraLocations(myPoint, newLocation);


    A = myPoint;

    cameraPosition = camPos;
# ---------- end c_script ----------
amp = Amplitude(Vector=Z_2, Amplitude=Slider(2, range=1..5))
wbweave = WeaverbirdsMeshFromLinesWeaveBack(Lines=spacetruss_1.LinesA, MaximumValence=4)
entwine = Entwine(Branch00=spacetruss_1.LinesA, Branch01=spacetruss_1.LinesB, Branch02=spacetruss_1.Web, FlattenInputs=True)
wbweave_2 = WeaverbirdsMeshFromLinesWeaveBack(Lines=spacetruss_1.LinesB, MaximumValence=4)
demesh = DeconstructMesh(Mesh=wbweave)  # -> Vertices, Faces, Colours, Normals
rev = Reverse(Vector=amp)
corners = Corners(mesh=wbweave_2)
move_3 = Move(Geometry=demesh.Vertices, Motion=rev)  # -> Geometry, Transform
panel = Panel("""Lines A
Lines B
Web""")
vdisex = VectorDisplayEx(Point=move_3.Geometry, Vector=amp, Colour=ColourSwatch(SwatchColor=RGB(219, 0, 0)), Width=2)
cross_sections = CrossSectionsKaramba(Diameter_cm=Slider(17, range=11..50), WallThickness_cm=0.4, mode="Circular Hollow")
linetobeam = LineToBeamKaramba(Line=entwine, New=True, Remove=True, LimitDistance_m=0.005, BeamIdentifier=graft(panel))  # -> Points, Element, Info
loads = LoadsKaramba(ForceVector=Z_2, Local=False, PosInd=demesh.Vertices, LCase=0, mode="Point")
supp = SupportKaramba(PosInd=corners, menu=[buttons(on, on, on, off, off, off)])
modifyelem = ModifyElementKaramba(Beam=linetobeam.Element, Bending=Toggle(False), mode="Beam")
assemble = AssembleModelKaramba(Elem=flatten(modifyelem), Support=supp, Load=loads, CrossSection=cross_sections, LimitDistance_m=0.005)  # -> Model, Info, Mass_kg, CenterOfGravity
analyzethi = AnalyzeThIKaramba(Model=assemble.Model)  # -> CalculatedModel, MaximumDisplacement_m, ResultingForceOfGravity_kN, ElasticEnergy_kNm
merge_2 = Merge(
    Data1=ColourSwatch(SwatchColor=RGB(255, 0, 0)),
    Data2=ColourSwatch(SwatchColor=RGB(255, 179, 0)),
    Data3=ColourSwatch(SwatchColor=RGB(255, 255, 0)),
    Data4=ColourSwatch(SwatchColor=RGB(0, 255, 0)),
    Data5=ColourSwatch(SwatchColor=RGB(0, 255, 255)),
    Data6=ColourSwatch(SwatchColor=RGB(4, 177, 255)),
    Data7=ColourSwatch(SwatchColor=RGB(0, 0, 255)),
    Data8=ColourSwatch(SwatchColor=RGB(129, 0, 190)),
    Data9=ColourSwatch(SwatchColor=RGB(75, 0, 130)))  # -> reverse(Result)
modelview = ModelViewKaramba(
    Model=analyzethi.CalculatedModel,
    LoadCaseFactorsForLinearSuperposition=1,
    IndexIncrementOfVisibleLoadcase=0,
    ListOfColorsForColoringPlots=merge_2)  # -> Model, DeformedMesh, DeformedAxes, DeformedModel
beamview = BeamViewKaramba(Model=modelview.Model)  # -> Model, MeshesOfRenderedBeams, DeformedBeamAxes, LegendColors, LegendTags
legend = Legend(Colour=beamview.LegendColors, Tags=beamview.LegendTags, LegendType=1)

# ==== cluster Corners: Find the boundary corner points of a quad mesh
mesh = ClusterInput()
mesh_2 = Mesh(mesh)
nv = NakedVertices(Mesh=mesh_2)  # -> ClothedIndex, NakedIndex, ClothedPts, NakedPts
vn = VertexNeighbours(Mesh=mesh_2, VertexNumber=nv.NakedIndex)  # -> graft(Vertex), Neighbours, Normal
lng = ListLength(List=vn.Neighbours)
equals = Equality(FirstNumber=lng, SecondNumber=3)  # -> Equality, Inequality
cull = CullPattern(List=vn.Vertex, CullPattern=equals.Inequality)
pshift = ShiftPaths(Data=cull, Offset=-1)
D = ClusterOutput(pshift)
