# Grasshopper definition StiffenedBeam.gh (Grasshopper 1.0.7)
# plug-ins: Kangaroo Components, karambaGH

# Ingegneria Parametrica
# Multi Supported Beam
# Author: Marco Pellegrino
# Contact: ingegneria.parametrica.ltd@gmail.com
pt = ConstructPoint(XCoordinate=0, YCoordinate=0, ZCoordinate=0)
beam_length = Slider(11.518, range=6..13)
X = UnitX(Factor=beam_length)
move = Move(Geometry=pt, Motion=X)  # -> Geometry, Transform
space_between_struts = Slider(5.941, range=1..6)
ln = Line(StartPoint=pt, EndPoint=move.Geometry)
crv = Curve(ln)
curvepoint = PointOnCurve(crv, parameter=0.5)
Y = UnitY(Factor=1)
circle = CircleCNR(Center=curvepoint, Normal=Y, Radius=expr("x/2", space_between_struts))
clx = CurveLine(Curve=circle, Line=crv)  # -> Points, Params, Count
merge = Merge(Data1=pt, Data2=move.Geometry, Data3=clx.Points)  # -> flatten(Result)
panel = Panel("""0
3
2
1""")
item = ListItem(List=flatten(merge), Index=panel, Wrap=True)

# ----
# Higher nodes
panel_2 = Panel("""1
2""")
pt_2 = Point(item)
item_2 = ListItem(List=pt_2, Index=panel_2, Wrap=True)

# ----
# Bottom nodes
height_struts = Slider(1.4, range=0.5..5)
Z = UnitZ(Factor=expr("-x", height_struts))
move_2 = Move(Geometry=item_2, Motion=Z)  # -> Geometry, Transform

# ----
# trave superiore
pline = PolyLine(Vertices=item, Closed=False)
explode = Explode(Curve=pline, Recursive=True)  # -> Segments, Vertices
divide = DivideCurve(Curve=explode.Segments, Count="10", Kinks=False)  # -> Points, Tangents, Parameters
pline_2 = PolyLine(Vertices=divide.Points, Closed=False)
explode_2 = Explode(Curve=pline_2, Recursive=True)  # -> Segments, Vertices

# ----
# tirante
pt_3 = Point([pt, move_2.Geometry, move.Geometry])
pline_3 = PolyLine(Vertices=pt_3, Closed=False)
explode_3 = Explode(Curve=pline_3, Recursive=True)  # -> Segments, Vertices

# ----
# Struts
ln_2 = Line(StartPoint=item_2, EndPoint=move_2.Geometry)

# ----
# Load
point_load_kn = Slider(100, range=0..100)
distributed_load_kn_m2 = Slider(7.4, range=0..60)
Z_2 = UnitZ(Factor=expr("-x", point_load_kn))
duppt = RemoveDuplicatePts(Points=flatten(divide.Points), Tolerance=0.01)
lng = ListLength(List=duppt)
series = Series(Start=0, Step=1, Count=lng)
Z_3 = UnitZ(Factor=expr("-x", distributed_load_kn_m2))
loads = LoadsKaramba3D(Vector=Z_3, BeamIdentifiers="Beam", LCase=-1, mode="Uniform Line", menu=[buttons(off, on, off)])
loads_2 = LoadsKaramba3D(Vector=Vector(0, 0, -1), LCase=-1, mode="Gravity")
loads_3 = LoadsKaramba3D(ForceVector=Z_2, Local=False, PosInd=duppt, LCase=series, mode="Point")
load = LoadKaramba3D(flatten([loads_2, loads, loads_3]))

crv_2 = Curve(explode_3.Segments)
cross_section = CrossSectionKaramba3D(
    FamilyNameOfCrossSection="DefaultCroSec",
    Material=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,
    Diameter_cm=Slider(13.7, range=10..20),
    WallThickness_cm=0.4,
    mode="Circular Hollow")
linetobeam = LineToBeamKaramba3D(
    Line=crv_2,
    Identifier="Cable",
    CrossSection=cross_section,
    New=True,
    Remove=True,
    LimitDistance_m=0.005,
    Bending=Toggle(False))  # -> Element, Points, Info

# ----
# Line to Beam
number_slider = Slider(12, range=0..20)
crv_3 = Curve(explode_2.Segments)
crosecrselect = CrossSectionRangeSelectorKaramba3D(MaximumHeight_cm=-1, MaximumWidth_cm=-1, menu=[dropdown(1), dropdown(0), dropdown(3)])
crosecselect = CrossSectionSelectorKaramba3D(CrossSections=crosecrselect, NameOrListIndexOfCrossSection=number_slider)  # -> CrossSection, Info
linetobeam_2 = LineToBeamKaramba3D(Line=crv_3, Identifier="Beam", CrossSection=crosecselect.CrossSection, New=True, Remove=True, LimitDistance_m=0.005)  # -> Element, Points, Info

# ----
# Line to Beam
crosecrselect_2 = CrossSectionRangeSelectorKaramba3D(MaximumHeight_cm=-1, MaximumWidth_cm=-1, menu=[dropdown(1), dropdown(0), dropdown(3)])
crv_4 = Curve(ln_2)
crosecselect_2 = CrossSectionSelectorKaramba3D(CrossSections=crosecrselect_2, NameOrListIndexOfCrossSection="HEA200")  # -> CrossSection, Info
linetobeam_3 = LineToBeamKaramba3D(Line=crv_4, Identifier="Struts", CrossSection=crosecselect_2.CrossSection, New=True, Remove=True, LimitDistance_m=0.005)  # -> Element, Points, Info

# ----
# Support
pt_4 = Point(flatten(linetobeam_3.Points))
rdpoints = RemoveDuplicatePointsKaramba3D(Point=pt_4, LimitDistance=0.005)  # -> OutPoint, Info, Indexes
end = EndPoints(Curve=ln)  # -> Start, End
supp = SupportKaramba(PosInd=[end.Start, end.End], menu=[buttons(on, on, on, on, off, on)])
supp_2 = SupportKaramba(PosInd=rdpoints.OutPoint, menu=[buttons(off, on, off, on, off, off)])
support = SupportKaramba3D(flatten([supp_2, supp]))

element = ElementKaramba3D(flatten([linetobeam_2.Element, linetobeam.Element, linetobeam_3.Element]))

assemble = AssembleModelKaramba(Elem=flatten(element), Support=flatten(support), Load=flatten(load), LimitDistance_m=0.005)  # -> Model, Info, Mass_kg, CenterOfGravity
analyze = AnalyzeKaramba3D(Model=assemble.Model)  # -> CalculatedModel, MaximumDisplacement_cm, ResultingForceOfGravity_kN, ElasticEnergy_kNm
modelview = ModelViewKaramba3D(
    Model=analyze.CalculatedModel,
    ResultFactors=1,
    ResultCase=Slider(15, range=0..30),
    Colors=[RGB(204, 0, 71), RGB(255, 182, 71), RGB(206, 255, 115), RGB(26, 180, 214), RGB(0, 0, 207)])  # -> Model, DeformedMesh, DeformedAxes, DeformedModel
beamview = BeamViewKaramba(Model=modelview.Model)  # -> Model, MeshesOfRenderedBeams, DeformedBeamAxes, LegendColors, LegendTags
b_res_force = BeamResultantForcesKaramba(
    AnalyzedModel=beamview.Model,
    BeamIdentifiers="Beam",
    LoadCase=-1,
    MaximumProbingDistance_m=-1,
    NumberOfProbingPointsPerElement=3)  # -> AnalyzedModel, NormalForce_kN, simplify(ResultantBendingMoment_kNm), ResultantShearForce_kN
mcol = MeshColours(Mesh=beamview.MeshesOfRenderedBeams, Colours=ColourSwatch(SwatchColor=RGB(255, 255, 255)))
viewer = ParamViewer(b_res_force.NormalForce_kN)
panel_3 = Panel(b_res_force.NormalForce_kN)
