# Grasshopper definition Arc.gh (Grasshopper 1.0.7)
# plug-ins: karambaGH

# ----
# Geometry
span = Slider(20, range=5..20)
tangent_angle = Slider(36.08, range=0..60)
# Ingegneria Parametrica
# Arc
# Author: Marco Pellegrino
# Contact: ingegneria.parametrica.ltd@gmail.com
pt = ConstructPoint(XCoordinate=0, YCoordinate=0, ZCoordinate=0)
rad = Radians(Degrees=expr("-x", tangent_angle))
X = UnitX(Factor=span)
X_2 = UnitX(Factor=1)
Y = UnitY(Factor=1)
move = Move(Geometry=pt, Motion=X)  # -> Geometry, Transform
vrot = Rotate(Vector=X_2, Axis=Y, Angle=rad)
arc = ArcSED(Start=pt, End=move.Geometry, Direction=vrot)  # -> Arc, Plane, Radius
divide = DivideCurve(Curve=arc.Arc, Count="20", Kinks=False)  # -> Points, Tangents, Parameters
shatter = Shatter(Curve=arc.Arc, Parameters=divide.Parameters)

# ----
# Load
pos_load = Slider(0, range=0..40)
force_kn = Slider(20, range=20..190)
Z = UnitZ(Factor=expr("-x", force_kn))
item = ListItem(List=divide.Points, Index=pos_load, Wrap=True)
loads = LoadsKaramba3D(ForceVector=Z, Local=False, PosInd=item, LCase=0, mode="Point")
loads_2 = LoadsKaramba3D(Vector=Vector(0, 0, -1), LCase=0, mode="Gravity")
load = LoadKaramba3D(flatten([loads_2, loads]))

# ----
# Line to Beam
number_slider = Slider(20, range=0..100)
crosecrselect = CrossSectionRangeSelectorKaramba3D(MaximumHeight_cm=-1, MaximumWidth_cm=-1, menu=[dropdown(1), dropdown(0), dropdown(3)])
crosecselect = CrossSectionSelectorKaramba3D(CrossSections=crosecrselect, NameOrListIndexOfCrossSection=number_slider)  # -> CrossSection, Info
linetobeam = LineToBeamKaramba3D(Line=shatter, Identifier="Beam", CrossSection=crosecselect.CrossSection, New=True, Remove=True, LimitDistance_m=0.005)  # -> Element, Points, Info

# ----
# Support
join = JoinCurves(Curves=shatter, Preserve=False)
explode = Explode(Curve=join, Recursive=True)  # -> Segments, Vertices

item_2 = ListItem(List=explode.Vertices, Index=0, Wrap=True)  # -> Item1, Item

supp = SupportKaramba(PosInd=item_2.Item1, menu=[buttons(on, on, on, on, off, on)])
supp_2 = SupportKaramba(PosInd=item_2.Item, menu=[buttons(on, on, on, on, off, on)])
support = SupportKaramba3D([supp, supp_2])

# ----
# Assemble
assemble = AssembleModelKaramba(Elem=linetobeam.Element, Support=support, Load=load, LimitDistance_m=0.005)  # -> Model, Info, Mass_kg, CenterOfGravity
panel = Panel(assemble.Mass_kg)

# ----
# Analyses
analyze = AnalyzeKaramba3D(Model=assemble.Model)  # -> CalculatedModel, MaximumDisplacement_cm, ResultingForceOfGravity_kN, ElasticEnergy_kNm
panel_2 = Panel(analyze.MaximumDisplacement_cm)

# ----
# Model View
modelview = ModelViewKaramba3D(
    Model=analyze.CalculatedModel,
    ResultFactors=1,
    ResultCase=-1,
    Colors=[RGB(204, 0, 71), RGB(255, 182, 71), RGB(206, 255, 115), RGB(26, 180, 214), RGB(0, 0, 207)])  # -> Model, DeformedMesh, DeformedAxes, DeformedModel
beamview = BeamViewKaramba(Model=modelview.Model)  # -> Model, MeshesOfRenderedBeams, DeformedBeamAxes, LegendColors, LegendTags

react = ReactionForcesKaramba3D(AnalyzedModel=beamview.Model, ResultCase=0)  # -> AnalyzedModel, ReactionForces_kN, ReactionMoments_kNm, SupportPosition, SumOfReactionForces_kN, SumOfReactionMoments_kNm
mcol = MeshColours(Mesh=beamview.MeshesOfRenderedBeams, Colours=ColourSwatch(SwatchColor=RGB(255, 255, 255)))
panel_3 = Panel(react.ReactionForces_kN)
