# Grasshopper definition Truss.gh (Grasshopper 1.0.7)
# plug-ins: BullAnt, Kangaroo Components, karambaGH

# ----
# Geometry
z_top_chord = Slider(0, range=0..0.8)
z_bottom_chord = Slider(-0.43, range=-1..0)
# Ingegneria Parametrica
# Truss
# Author: Marco Pellegrino
# Contact: ingegneria.parametrica.ltd@gmail.com
pt = ConstructPoint(XCoordinate=0, YCoordinate=0, ZCoordinate=z_top_chord)
pt_2 = ConstructPoint(XCoordinate=0, YCoordinate=0, ZCoordinate=z_bottom_chord)
alfa1 = Slider(14.91, range=0..20)
span = Slider(3.85, range=3.5..5)
alfa_inf = Slider(0, range=0..20)
X = UnitX(Factor=span)
X_2 = UnitX(Factor=span)
move = Move(Geometry=pt, Motion=X)  # -> Geometry, Transform
neg = Negative(Value=alfa1)
move_2 = Move(Geometry=pt_2, Motion=X_2)  # -> Geometry, Transform
rad = Radians(Degrees=alfa_inf)
X_3 = UnitX(Factor=1)
Y = UnitY(Factor=1)
rad_2 = Radians(Degrees=neg)
X_4 = UnitX(Factor=1)
Y_2 = UnitY(Factor=1)
vrot = Rotate(Vector=X_4, Axis=Y_2, Angle=rad_2)
vrot_2 = Rotate(Vector=X_3, Axis=Y, Angle=rad)
arc = ArcSED(Start=pt, End=move.Geometry, Direction=vrot)  # -> Arc, Plane, Radius
arc_2 = ArcSED(Start=pt_2, End=move_2.Geometry, Direction=vrot_2)  # -> Arc, Plane, Radius
truss_type = Slider(0, range=0..4)
ggtc = GgTrussFromCurves(FirstCurve=arc.Arc, SecondCurve=arc_2.Arc, NumberDivision=Slider(4, range=4..10), TrussType=truss_type, Frames=False)  # -> ChordACurves, ChordBCurves, Diagonals, Verticals

# ----
# Load
explode = Explode(Curve=ggtc.ChordACurves, Recursive=True)  # -> Segments, Vertices
force_kn = Slider(23, range=10..100)
point_load = Slider(8, range=0..11)
trim = TrimTree(Tree=explode.Vertices, Depth=1)
duppt = RemoveDuplicatePts(Points=trim, Tolerance=0.01)
neg_2 = Negative(Value=force_kn)
item = ListItem(List=duppt, Index=point_load, Wrap=True)
Z = UnitZ(Factor=neg_2)
loads = LoadsKaramba3D(Vector=Vector(0, 0, -1), LCase=0, mode="Gravity")
loads_2 = LoadsKaramba3D(ForceVector=Z, Local=False, PosInd=item, LCase=0, mode="Point")
load = LoadKaramba3D(flatten([loads, loads_2]))

# ----
# Line to Beam
number_slider = Slider(0, range=0..100)
crv = Curve(ggtc.ChordACurves)
crosecrselect = CrossSectionRangeSelectorKaramba3D(MaximumHeight_cm=-1, MaximumWidth_cm=-1, menu=[dropdown(1), dropdown(0), dropdown(3)])
crosecselect = CrossSectionSelectorKaramba3D(CrossSections=crosecrselect, NameOrListIndexOfCrossSection=number_slider)  # -> CrossSection, Info
linetobeam = LineToBeamKaramba3D(
    Line=crv,
    Identifier="Top_Chord",
    CrossSection=crosecselect.CrossSection,
    New=True,
    Remove=True,
    LimitDistance_m=0.005,
    Bending=Toggle(False))  # -> Element, Points, Info

# ----
# Line to Beam
crv_2 = Curve(ggtc.ChordBCurves)
cross_section = CrossSectionKaramba3D(
    FamilyNameOfCrossSection="DefaultCroSec",
    Material=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,
    Diameter_cm=11.43,
    WallThickness_cm=0.4,
    mode="Circular Hollow")
linetobeam_2 = LineToBeamKaramba3D(
    Line=crv_2,
    Identifier="Bottom_Chord",
    CrossSection=cross_section,
    New=True,
    Remove=True,
    LimitDistance_m=0.005,
    Bending=Toggle(False))  # -> Element, Points, Info

# ----
# Line to Beam
crv_3 = Curve([ggtc.Diagonals, ggtc.Verticals])
cross_section_2 = CrossSectionKaramba3D(
    FamilyNameOfCrossSection="DefaultCroSec",
    Material=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,
    Height_cm=10,
    UpperFlangeWidth_cm=5,
    LowerFlangeWidth_cm=5,
    UpperFlangeThickness_cm=0.4,
    LowerFlangeThickness_cm=0.4,
    SidewallsThickness_cm=0.4,
    FilletRadius_cm=0.6,
    mode="Box")
linetobeam_3 = LineToBeamKaramba3D(Line=crv_3, Identifier="Diagonal", CrossSection=cross_section_2, New=True, Remove=True, LimitDistance_m=0.005)  # -> Element, Points, Info

end = EndPoints(Curve=arc_2.Arc)  # -> Start, End

# ----
# Support
pt_3 = Point([end.Start, end.End])
supp = SupportKaramba(PosInd=pt_3, menu=[buttons(on, on, on, on, off, on)])
support = SupportKaramba3D(supp)

element = ElementKaramba3D(flatten([linetobeam.Element, linetobeam_2.Element, linetobeam_3.Element]))

# ----
# Assemble
assemble = AssembleModelKaramba(Elem=element, Support=support, Load=load, LimitDistance_m=0.005)  # -> Model, Info, Mass_kg, CenterOfGravity
panel = Panel(assemble.Mass_kg)

# ----
# Analyses
analyze = AnalyzeKaramba3D(Model=assemble.Model)  # -> CalculatedModel, MaximumDisplacement_cm, ResultingForceOfGravity_kN, ElasticEnergy_kNm
panel_2 = Panel(analyze.MaximumDisplacement_cm)

# ----
# Model View
modelview = ModelViewKaramba3D(
    Model=analyze.CalculatedModel,
    ResultFactors=1,
    ResultCase=-1,
    Colors=[RGB(204, 0, 71), RGB(255, 182, 71), RGB(206, 255, 115), RGB(26, 180, 214), RGB(0, 0, 207)])  # -> Model, DeformedMesh, DeformedAxes, DeformedModel
beamview = BeamViewKaramba(Model=modelview.Model)  # -> Model, MeshesOfRenderedBeams, DeformedBeamAxes, LegendColors, LegendTags

utilization = UtilizationOfElementsKaramba3D(
    AnalyzedModel=beamview.Model,
    ResultCase=-1,
    NumberOfSamplePoints=3,
    ElasticDesign=True,
    GammaM0=1,
    GammaM1=1,
    WithDetails=False,
    mode="Beams")  # -> AnalyzedModel, Utilization, SigMax_kN_cm2, SigMin_kN_cm2, TauMax_kN_cm2, UtilN, UtilVy, UtilVz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
bnd = Bounds(Numbers=utilization.Utilization)
panel_3 = Panel(bnd)
