# Grasshopper definition SpaceTruss.gh (Grasshopper 1.0.7)
# plug-ins: LunchBox, Weaverbird, karambaGH

# ----
# Geometry
number_slider = Slider(15, range=10..20)
x_span = Slider(8, range=5..14)
# Ingegneria Parametrica
# Space Truss
# Author: Marco Pellegrino
# Contact: ingegneria.parametrica.ltd@gmail.com
pt = ConstructPoint(XCoordinate=0, YCoordinate=0, ZCoordinate=0)
pt_2 = ConstructPoint(XCoordinate=0, YCoordinate=number_slider, ZCoordinate=0)
series = Series(Start=0, Step=x_span, Count="3")
X = UnitX(Factor=series)
ln = Line(StartPoint=pt, EndPoint=pt_2)
move = Move(Geometry=ln, Motion=X)  # -> Geometry, Transform
item = ListItem(List=move.Geometry, Index=0, Wrap=True)  # -> Item, Item1, Item2
eval = EvaluateCurve(Curve=reparameterize(item.Item1), Parameter="0.5")  # -> Point, Tangent, Angle
Z = UnitZ(Factor=Slider(2.41, range=0..5))
move_2 = Move(Geometry=eval.Point, Motion=Z)  # -> Geometry, Transform
end = EndPoints(Curve=item.Item1)  # -> Start, End
merge = Merge(Data1=end.Start, Data2=move_2.Geometry, Data3=end.End)
intcrv = Interpolate(Vertices=merge, Degree=3, Periodic=False, KnotStyle=1)  # -> Curve, Length, Domain
merge_2 = Merge(Data1=item.Item, Data2=intcrv.Curve, Data3=item.Item2)
loft = Loft(Curves=merge_2, Options={Adjust=False, Closed=False, LoftEnds=0, LoftSimp=0, LoftType=0, Rebuild=10, Refit=0.01})

srf = Surface(loft)
spacetruss_1 = SpaceTrussStructure1(
    Surface=srf,
    UDivisions=Slider(6, range=1..10),
    VDivisions=Slider(6, range=1..10),
    TrussDepth=expr("-x", Slider(2.5, range=2..4)))  # -> LinesA, LinesB, Web, Nodes
entwine = Entwine(Branch00=spacetruss_1.LinesA, Branch01=spacetruss_1.LinesB, Branch02=spacetruss_1.Web, FlattenInputs=True)

# ----
# Line to Beam
crv = Curve(entwine)
cross_section = CrossSectionKaramba3D(
    FamilyNameOfCrossSection="DefaultCroSec",
    Material=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,
    Height_cm=10,
    UpperFlangeWidth_cm=5,
    LowerFlangeWidth_cm=5,
    mode="Trapezoid")
panel = Panel("""LinesA
LinesB
Web""")
graft = GraftTree(Tree=panel, IncludeEmptyLists=True, IncludeNullItems=True)
linetobeam = LineToBeamKaramba3D(Line=crv, Identifier=graft, CrossSection=cross_section, New=True, Remove=True, LimitDistance_m=0.005)  # -> Element, Points, Info
element = ElementKaramba3D(flatten(linetobeam.Element))

# ----
# Support
wbweave = WeaverbirdsMeshFromLinesWeaveBack(Lines=spacetruss_1.LinesA, MaximumValence=4)
corners = Corners(mesh=wbweave)
supp = SupportKaramba(PosInd=corners, menu=[buttons(on, on, on, off, off, off)])

# ----
# Load
wbweave_2 = WeaverbirdsMeshFromLinesWeaveBack(Lines=spacetruss_1.LinesA, MaximumValence=4)
panel_2 = Panel("-5")  # "kN/mq"
Z_2 = UnitZ(Factor=panel_2)
loads = LoadsKaramba3D(Vector=Z_2, Mesh=wbweave_2, LCase=0, mode="MeshLoad -Const.", menu=[buttons(off, on, off), buttons(on, on)])
loads_2 = LoadsKaramba3D(Vector=Vector(0, 0, -1), LCase=0, mode="Gravity")
load = LoadKaramba3D(flatten([loads_2, loads]))

# ----
# Assemble
assemble = AssembleModelKaramba(Elem=element, Support=supp, Load=load, LimitDistance_m=0.005)  # -> Model, Info, Mass_kg, CenterOfGravity
panel_3 = Panel(assemble.Mass_kg)

# ----
# Analyses
analyze = AnalyzeKaramba3D(Model=assemble.Model)  # -> CalculatedModel, MaximumDisplacement_cm, ResultingForceOfGravity_kN, ElasticEnergy_kNm
panel_4 = Panel(analyze.MaximumDisplacement_cm)

# ----
# Model View
modelview = ModelViewKaramba3D(
    Model=analyze.CalculatedModel,
    ResultFactors=1,
    ResultCase=-1,
    Colors=[RGB(204, 0, 71), RGB(255, 182, 71), RGB(206, 255, 115), RGB(26, 180, 214), RGB(0, 0, 207)])  # -> Model, DeformedMesh, DeformedAxes, DeformedModel
beamview = BeamViewKaramba(Model=modelview.Model)  # -> Model, MeshesOfRenderedBeams, DeformedBeamAxes, LegendColors, LegendTags

beamdisp = BeamDisplacementsKaramba3D(AnalyzedModel=beamview.Model, LoadCase=-1, MaximumDistanceBetweenResults_m=-1, NumberOfResultsPerElement=2)  # -> AnalyzedModel, Translations_m, Rotations_rad
devec = DeconstructVector(Vector=beamdisp.Translations_m)  # -> XComponent, YComponent, ZComponent
bnd = Bounds(Numbers=devec.ZComponent)
panel_5 = Panel(bnd)

# ==== cluster Corners: Find the boundary corner points of a quad mesh
mesh = ClusterInput()
mesh_2 = Mesh(mesh)
nv = NakedVertices(Mesh=mesh_2)  # -> ClothedIndex, NakedIndex, ClothedPts, NakedPts
vn = VertexNeighbours(Mesh=mesh_2, VertexNumber=nv.NakedIndex)  # -> graft(Vertex), Neighbours, Normal
lng = ListLength(List=vn.Neighbours)
equals = Equality(FirstNumber=lng, SecondNumber=3)  # -> Equality, Inequality
cull = CullPattern(List=vn.Vertex, CullPattern=equals.Inequality)
pshift = ShiftPaths(Data=cull, Offset=-1)
D = ClusterOutput(pshift)
