# Grasshopper definition Slab.gh (Grasshopper 1.0.7)
# plug-ins: Kangaroo Components, karambaGH

# Ingegneria Parametrica
# Slab
# Author: Marco Pellegrino
# Contact: ingegneria.parametrica.ltd@gmail.com
rectangle = Rectangle(Plane=PlaneXY(0, 0, 0), XSize=Slider(20, range=5..20), YSize=Slider(25, range=5..25), Radius=Slider(0, range=0..10))  # -> Rectangle, Length
number_slider = Slider(0.75, range=0..1)
srf = Surface(rectangle.Rectangle)
boundary = BoundarySurfaces(Edges=srf)
custom_mesh_settings = SettingsCustom(
    StitchSeams=True,
    SimplePlanes=False,
    Refine=True,
    MinCount=16,
    MaxCount=400,
    AspectRatio=20,
    MaxDistance=0,
    MaxAngle=20,
    MinEdge=number_slider,
    MaxEdge=number_slider)
mesh = MeshBrep(Brep=boundary, Settings=custom_mesh_settings)
md_slider = MDSlider(
    SliderMode=0,
    slider_value=Point(0.6287994385, 0.3520755768, 0.5),
    x_domain=Domain(0.05, 0.95),
    y_domain=Domain(0.05, 0.95),
    z_domain=Domain(0, 1))
evalsrf = EvaluateSurface(Surface=reparameterize(boundary), Point=md_slider)  # -> Point, Normal, UDirection, VDirection, Frame
demesh = DeconstructMesh(Mesh=mesh)  # -> Vertices, Faces, Colours, Normals
cp = ClosestPoint(Point=evalsrf.Point, Cloud=demesh.Vertices)  # -> ClosestPoint, CPIndex, Distance

# ----
# Line to Beam
number_slider_2 = Slider(4, range=1..5)
cross_section = CrossSectionKaramba3D(
    FamilyNameOfCrossSection="DefaultCroSec",
    Material=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,
    Height_cm=number_slider_2,
    mode="Shell - Const")
meshtoshell = MeshToShellKaramba3D(Mesh=mesh, CrossSection=cross_section, LimitDistance_m=0.005)  # -> Element, Points, Info

# ----
# Load
force_kn = Slider(100, range=0..100)
Z = UnitZ(Factor=expr("-x", force_kn))
pt = Point(cp.ClosestPoint)
loads = LoadsKaramba3D(ForceVector=Z, Local=False, PosInd=pt, LCase=0, mode="Point")
loads_2 = LoadsKaramba3D(Vector=Vector(0, 0, -1), LCase=0, mode="Gravity")
load = LoadKaramba3D(flatten([loads_2, loads]))

# ----
# Support
nv = NakedVertices(Mesh=mesh)  # -> ClothedIndex, NakedIndex, ClothedPts, NakedPts
pt_2 = Point(nv.NakedPts)
supp = SupportKaramba(PosInd=pt_2, menu=[buttons(on, on, on, off, off, on)])

# ----
# Assemble
assemble = AssembleModelKaramba(Elem=meshtoshell.Element, Support=supp, Load=load, LimitDistance_m=0.005)  # -> Model, Info, Mass_kg, CenterOfGravity
panel = Panel(assemble.Mass_kg)

# ----
# Analyses
analyze = AnalyzeKaramba3D(Model=assemble.Model)  # -> CalculatedModel, MaximumDisplacement_cm, ResultingForceOfGravity_kN, ElasticEnergy_kNm
panel_2 = Panel(analyze.MaximumDisplacement_cm)

# ----
# Model View
modelview = ModelViewKaramba3D(
    Model=analyze.CalculatedModel,
    ResultFactors=1,
    ResultCase=-1,
    Colors=[RGB(204, 0, 71), RGB(255, 182, 71), RGB(206, 255, 115), RGB(26, 180, 214), RGB(0, 0, 207)])  # -> Model, DeformedMesh, DeformedAxes, DeformedModel
shellview = ShellViewKaramba3D(Model=modelview.Model, IndexOfLayer=0)  # -> Model, MeshesOfRenderedShells, LegendColors, LegendTags

popgeo = PopulateGeometry(Geometry=mesh, Count=100, Seed=1)
shelllineresults = LineResultsOnShellsKaramba3D(
    AnalyzedModel=shellview.Model,
    ListOfSourcesOfForceFlowLinesLinesPoints=popgeo,
    SegmentLength_m=0.5,
    DA_deg=5,
    mode="PrincMoment")  # -> AnalyzedModel, Lines1, Lines2
preview = CustomPreview(Geometry=shelllineresults.Lines1, Shader=ColourSwatch(SwatchColor=RGB(255, 0, 0)))
preview_2 = CustomPreview(Geometry=shelllineresults.Lines2, Shader=ColourSwatch(SwatchColor=RGB(33, 100, 255)))
