# Grasshopper definition Genetic Algorithm.gh (Grasshopper 1.0.7)
# plug-ins: karambaGH

# ----
# Geometry
number_slider = Slider(30, range=0..100)
# Ingegneria Parametrica
# Genetic Algorithm
# Author: Marco Pellegrino
# Contact: ingegneria.parametrica.ltd@gmail.com
pt = ConstructPoint(XCoordinate=0, YCoordinate=0, ZCoordinate=0)
X = UnitX(Factor=number_slider)
move = Move(Geometry=pt, Motion=X)  # -> Geometry, Transform
ln = Line(StartPoint=pt, EndPoint=move.Geometry)
divide = DivideCurve(Curve=ln, Count="21", Kinks=False)  # -> Points, Tangents, Parameters
panel = Panel("""0
-1""")
genes = GenePool(
    Decimals=2,
    Maximum=10,
    Minimum=0,
    Value=[2.864100813, 3.599577096, 5.537204792, 5.56, 4.77, 8.793382416, 9.80309525, 6.12, 7.932323086, 7.763080512, 8.77, 9.88, 3.576542201, 8.297032252, 1.197510791, 1.341718515, 5.843785436, 7.79, 4.972104526, 2.531165361])
item = ListItem(List=divide.Points, Index=0, Wrap=True)  # -> Item1, Item
cull_i = CullIndex(List=divide.Points, Indices=panel, Wrap=True)
Z = UnitZ(Factor=genes)
move_2 = Move(Geometry=cull_i, Motion=Z)  # -> Geometry, Transform
merge = Merge(Data1=simplify(flatten(item.Item)), Data2=simplify(flatten(move_2.Geometry)), Data3=simplify(flatten(item.Item1)))
pline = PolyLine(Vertices=merge, Closed=False)
explode = Explode(Curve=pline, Recursive=True)  # -> Segments, Vertices

# ----
# Load
force_kn = Slider(14.35, range=10..20)
Z_2 = UnitZ(Factor=expr("-x", force_kn))
loads = LoadsKaramba3D(Vector=Vector(0, 0, -1), LCase=0, mode="Gravity")
loads_2 = LoadsKaramba3D(Vector=Z_2, LCase=0, mode="Uniform Line", menu=[buttons(off, on, off)])
load = LoadKaramba3D([loads, loads_2])

cross_section = CrossSectionKaramba3D(
    FamilyNameOfCrossSection="DefaultCroSec",
    Material=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,
    Diameter_cm=Slider(53.8, range=11..110),
    WallThickness_cm=0.4,
    mode="Circular Hollow")

# ----
# Line to Beam
panel_2 = Panel("arch")
crv = Curve(explode.Segments)
linetobeam = LineToBeamKaramba3D(Line=crv, Identifier=panel_2, CrossSection=cross_section, New=True, Remove=True, LimitDistance_m=0.005)  # -> Element, Points, Info

# ----
# Support
pt_2 = Point([item.Item1, item.Item])
supp = SupportKaramba(PosInd=flatten(pt_2), menu=[buttons(on, on, on, on, on, on)])

# ----
# Assemble
assemble = AssembleModelKaramba(Elem=linetobeam.Element, Support=supp, Load=load, LimitDistance_m=0.005)  # -> Model, Info, Mass_kg, CenterOfGravity
panel_3 = Panel(assemble.Mass_kg)

galapagos = Galapagos(fitness=num)

# ----
# Analyses
analyze = AnalyzeKaramba3D(Model=assemble.Model)  # -> CalculatedModel, MaximumDisplacement_cm, ResultingForceOfGravity_kN, ElasticEnergy_kNm

num = Number(analyze.MaximumDisplacement_cm)

panel_4 = Panel(num)

# ----
# Model View
modelview = ModelViewKaramba3D(
    Model=analyze.CalculatedModel,
    ResultFactors=1,
    ResultCase=-1,
    Colors=[RGB(204, 0, 71), RGB(255, 182, 71), RGB(206, 255, 115), RGB(26, 180, 214), RGB(0, 0, 207)])  # -> Model, DeformedMesh, DeformedAxes, DeformedModel
beamview = BeamViewKaramba(Model=modelview.Model)  # -> Model, MeshesOfRenderedBeams, DeformedBeamAxes, LegendColors, LegendTags
