# Grasshopper definition arco algoritmi genetici.gh (Grasshopper 0.9.76)
# plug-ins: Karamba, Dodo, Tree8, Silvereye

number_slider = Slider(40, range=0..100)
pt = ConstructPoint(XCoordinate=0, YCoordinate=0, ZCoordinate=0)
X = UnitX(Factor=number_slider)
move = Move(Geometry=pt, Motion=X)  # -> Geometry, Transform
xz = XZPlane(Origin=pt)
rectangle = Rectangle(Plane=xz, XSize=number_slider, YSize=Slider(10, range=0..10), Radius=0)  # -> Rectangle, Length
ln = Line(StartPoint=pt, EndPoint=move.Geometry)
number_slider_2 = Slider(0.6, range=0.1..3)
divide = DivideCurve(Curve=ln, Count="21", Kinks=False)  # -> Points, Tangents, Parameters
Z = UnitZ(Factor=Slider(12, range=0..100))
Z_2 = UnitZ(Factor=1)
dom = ConstructDomain(DomainStart=0, DomainEnd=expr("x/2-0.5", "21"))
move_2 = Move(Geometry=ln, Motion=Z)  # -> Geometry, Transform
line = LineSDL(Start=divide.Points, Direction=Z_2, Length="10")
displaycrv = DisplayCurve(curve=rectangle.Rectangle, color=ColourSwatch(SwatchColor=RGB(112, 112, 112)), weight=number_slider_2)  # -> out; inputs curve: Curve, color: Color, weight: Int32
# ---------- displaycrv: C# ----------
    // silently skip null curves
    if(curve == null) return;

    // add to display cache
    _curves.Add(curve);
    _colors.Add(color);
    _weights.Add(weight);
    _clippingBox.Union(curve.GetBoundingBox(false));
# ---------- displaycrv: C# additional code ----------
  List<Curve> _curves;
  List<Color> _colors;
  List<int> _weights;
  BoundingBox _clippingBox;


  /// <summary>
  /// This method will be called once every solution, before any calls to RunScript.
  /// </summary>
  public override void BeforeRunScript()
  {
    _curves = new List<Curve>();
    _colors = new List<Color>();
    _weights = new List<int>();
    _clippingBox = new BoundingBox();
  }


  //
  public override BoundingBox ClippingBox
  {
    get{return _clippingBox;}
  }


  //
  public override void DrawViewportWires(IGH_PreviewArgs args)
  {
    base.DrawViewportWires(args);

    for(int i = 0; i < _curves.Count; i++)
      args.Display.DrawCurve(_curves[i], _colors[i], _weights[i]);
  }
# ---------- end displaycrv ----------
firstend = FirstEndItem(List=line)  # -> FirstItem, Remainders, EndItem
subset = SubList(List=divide.Points, Domain=dom, Wrap=True)  # -> List, Index
genes = GenePool(Decimals=2, Maximum=10, Minimum=0, Value=[2, 3.36, 3.64, 3.52, 5.72, 5.87, 5.87, 6.51, 5.73, 7.75])
divide_2 = DivideCurve(Curve=move_2.Geometry, Count=Slider(29, range=0..100), Kinks=False)  # -> Points, Tangents, Parameters
Z_3 = UnitZ(Factor=Slider(3, range=1..10))
firstend_2 = FirstEndItem(List=subset.List)  # -> FirstItem, Remainders, EndItem
number_slider_3 = Slider(0, range=0..100)
move_3 = Move(Geometry=divide_2.Points, Motion=Z_3)  # -> Geometry, Transform
expression = Expression(x="21", Expression="x/2-0.5")
displaycrv_2 = DisplayCurve(curve=firstend.Remainders, color=ColourSwatch(SwatchColor=RGB(92, 0, 0)), weight=number_slider_2)  # -> out; inputs curve: Curve, color: Color, weight: Int32; same code as displaycrv
difference = SetDifference(SetA=divide.Points, SetB=subset.List)
Z_4 = UnitZ(Factor=genes)
item = ListItem(List=difference, Index=expression, Wrap=True)
cull_i = CullIndex(List=difference, Indices=expression, Wrap=True)
move_4 = Move(Geometry=[firstend_2.Remainders, firstend_2.EndItem], Motion=Z_4)  # -> Geometry, Transform
move_5 = Move(Geometry=cull_i, Motion=reverse(Z_4))  # -> Geometry, Transform
merge = Merge(Data1=flatten(firstend_2.FirstItem), Data2=flatten(move_4.Geometry), Data3=flatten(move_5.Geometry), Data4=flatten(item))  # -> flatten(Result)
dots = DotDisplay(
    Point=[move_4.Geometry, move_5.Geometry, firstend_2.FirstItem, item],
    Colour=ColourSwatch(SwatchColor=RGB(255, 255, 255)),
    Size=Slider(0.3, range=0.1..1))
pline = PolyLine(Vertices=merge, Closed=False)
explode = Explode(Curve=pline, Recursive=True)  # -> Segments, Vertices
Z_5 = UnitZ(Factor=expr("-x", Slider(14.35, range=10..20)))
linetobeam = LineToBeamKaramba(Line=explode.Segments, New=True, Remove=True, LimitDistance_m=0.005, BeamIdentifier="arch")  # -> Points, Element, Info
supp = SupportKaramba(PosInd=[firstend_2.FirstItem, item], menu=[buttons(on, on, on, off, off, on)])
loads = LoadsKaramba(Vector=Z_5, BeamIdentifierS="arch", LCase=0, mode="Uniform Line", menu=[buttons(off, off, on)])
cross_sections = CrossSectionsKaramba(
    ElementsIdentifiers="arch",
    Diameter_cm=Slider(42, range=0..100),
    WallThickness_cm=Slider(6, range=0..10),
    mode="Circular Hollow")
assemble = AssembleModelKaramba(Elem=linetobeam.Element, Support=supp, Load=loads, CrossSection=cross_sections, LimitDistance_m=0.005)  # -> Model, Info, Mass_kg, CenterOfGravity
analyzethi = AnalyzeThIKaramba(Model=assemble.Model)  # -> CalculatedModel, MaximumDisplacement_m, ResultingForceOfGravity_kN, ElasticEnergy_kNm
merge_2 = Merge(
    Data1=ColourSwatch(SwatchColor=RGB(255, 0, 0)),
    Data2=ColourSwatch(SwatchColor=RGB(255, 179, 0)),
    Data3=ColourSwatch(SwatchColor=RGB(255, 255, 0)),
    Data4=ColourSwatch(SwatchColor=RGB(0, 255, 0)),
    Data5=ColourSwatch(SwatchColor=RGB(0, 255, 255)),
    Data6=ColourSwatch(SwatchColor=RGB(4, 177, 255)),
    Data7=ColourSwatch(SwatchColor=RGB(0, 0, 255)))  # -> reverse(Result)
modelview = ModelViewKaramba(
    Model=analyzethi.CalculatedModel,
    LoadCaseFactorsForLinearSuperposition=1,
    IndexIncrementOfVisibleLoadcase=0,
    ListOfColorsForColoringPlots=merge_2)  # -> Model, DeformedMesh, DeformedAxes, DeformedModel
num = Number(analyzethi.MaximumDisplacement_m)
sgdopt = SGDOptimization(fitness=num, gene=genes)
galapagos = Galapagos(fitness=num, gene=genes)
gh_silvereye = Silvereye(SilvereyeData_fitness_fcn=num, SilvereyeData_parameter=genes)
beamview = BeamViewKaramba(Model=modelview.Model)  # -> Model, MeshesOfRenderedBeams, DeformedBeamAxes, LegendColors, LegendTags
number_slider_4 = Slider(1.46, range=0.1..2)
legend = Legend(Colour=beamview.LegendColors, Tags=beamview.LegendTags, LegendType=1)
vdisex = VectorDisplayEx(Point=move_3.Geometry, Vector=expr("-x", Z_3), Colour=ColourSwatch(SwatchColor=RGB(255, 255, 115)), Width=2)
expression_2 = Expression(x=num, Expression="Format(\"Displacement = {0} mm\", Round(x*1000,3) )")
merge_3 = Merge(Data1="Optimization", Data2="   ", Data3=expression_2)  # -> flatten(Result)
lng = ListLength(List=merge_3)
series = Series(Start=Slider(5, range=0..200), Step=expr("-x*1.5", number_slider_4), Count=lng)
vec = VectorXYZ(XComponent=Slider(53, range=20..200), YComponent=0, ZComponent=series)  # -> Vector, Length
pt_2 = Point(vec.Vector)
xz_2 = XZPlane(Origin=pt_2)

tag = TextTag3D(Location=xz_2, Text=merge_3, Size=number_slider_4, Colour=ColourSwatch(SwatchColor=RGB(255, 255, 255)), Justification=7)

rec = DataRecorder(analyzethi.MaximumDisplacement_m, DataLimit=-10, RecordData=True)
bnd = Bounds(Numbers=rec)
dedomain = DeconstructDomain(Domain=bnd)  # -> Start, End
index = ItemIndex(List=rec, Item=rec)
multiplication = Multiplication(A=dedomain.End, B=Slider(19, range=1..100))
bnd_2 = Bounds(Numbers=index)
dom_2 = ConstructDomain(DomainStart=dedomain.Start, DomainEnd=multiplication)
remap = RemapNumbers(Value=rec, Source=bnd, Target=dom_2)  # -> Mapped, Clipped
dedomain_2 = DeconstructDomain(Domain=bnd_2)  # -> Start, End
multiplication_2 = Multiplication(A=dedomain_2.End, B=Slider(0.4, range=0..1))
dom_3 = ConstructDomain(DomainStart=dedomain_2.Start, DomainEnd=multiplication_2)
remap_2 = RemapNumbers(Value=index, Source=bnd_2, Target=dom_3)  # -> Mapped, Clipped
pt_3 = ConstructPoint(XCoordinate=remap_2.Mapped, YCoordinate=0, ZCoordinate=remap.Mapped)
pline_2 = PolyLine(Vertices=pt_3, Closed=False)
displaycrv_3 = DisplayCurve(curve=pline_2, color=ColourSwatch(SwatchColor=RGB(255, 255, 255)), weight=Slider(0.56, range=0.5..1))  # -> out; inputs curve: Curve, color: Color, weight: Int32; same code as displaycrv
number_slider_5 = Slider(1, range=1..100)
pt_4 = ConstructPoint(XCoordinate=expr("-x", Slider(2, range=1..100)), YCoordinate=0, ZCoordinate=expr("-x", number_slider_5))
pt_5 = ConstructPoint(XCoordinate=expr("-x", Slider(2, range=1..100)), YCoordinate=0, ZCoordinate=expr("-x", number_slider_5))
Z_6 = UnitZ(Factor=1)
X_2 = UnitX(Factor=1)
line_2 = LineSDL(Start=pt_4, Direction=Z_6, Length=Slider(60, range=1..300))
line_3 = LineSDL(Start=pt_5, Direction=X_2, Length=Slider(99, range=1..300))
displaycrv_4 = DisplayCurve(curve=line_2, color=ColourSwatch(SwatchColor=RGB(184, 0, 0)), weight=Slider(4, range=1..100))  # -> out; inputs curve: Curve, color: Color, weight: Int32; same code as displaycrv
displaycrv_5 = DisplayCurve(curve=line_3, color=ColourSwatch(SwatchColor=RGB(61, 184, 0)), weight=Slider(4, range=1..100))  # -> out; inputs curve: Curve, color: Color, weight: Int32; same code as displaycrv
