# Grasshopper definition reticolare non canonica.gh (Grasshopper 0.9.76)
# plug-ins: Karamba, Silvereye

crv = Curve(<curve referenced from the Rhino model>)
genes = GenePool(Decimals=2, Maximum=1, Minimum=0, Value=[0.34, 0.1, 0.86, 0.22, 0.34, 0.79])
genes_2 = GenePool(Decimals=2, Maximum=1, Minimum=0, Value=[0.31, 0.48, 0.71, 0.55, 0, 1])
crv_2 = Curve(<curve referenced from the Rhino model>)
num = Number(genes)
eval = EvaluateCurve(Curve=reparameterize(crv), Parameter=genes_2)  # -> Point, Tangent, Angle
shatter = Shatter(Curve=reparameterize(crv), Parameters=genes_2)
eval_2 = EvaluateCurve(Curve=reparameterize(crv_2), Parameter=num)  # -> Point, Tangent, Angle
shatter_2 = Shatter(Curve=reparameterize(crv_2), Parameters=num)
explode = Explode(Curve=[crv, crv_2], Recursive=True)  # -> Segments, Vertices
ln = Line(StartPoint=eval.Point, EndPoint=eval_2.Point)
panel = Panel("""top
bottom
diagonal""")
merge = Merge(Data1=Slider(30, range=15..45), Data2=Slider(30, range=15..45), Data3=Slider(15, range=15..45))
crv_3 = Curve(ln)
Z = UnitZ(Factor=expr("-x", Slider(10, range=10..20)))
cross_sections = CrossSectionsKaramba(ElementsIdentifiers=graft(panel), Diameter_cm=graft(merge), WallThickness_cm="2", mode="Circular Hollow")
linetobeam = LineToBeamKaramba(Line=shatter, New=True, Remove=True, LimitDistance_m=0.005, BeamIdentifier="top")  # -> Points, Element, Info
supp = SupportKaramba(PosInd=flatten(explode.Vertices), menu=[buttons(on, on, on, on, on, on)])
linetobeam_2 = LineToBeamKaramba(Line=crv_3, New=True, Remove=True, LimitDistance_m=0.005, BeamIdentifier="diagonal")  # -> Points, Element, Info
loads = LoadsKaramba(Vector=Z, BeamIdentifierS="top", LCase=0, mode="Uniform Line", menu=[buttons(on, off, off)])
loads_2 = LoadsKaramba(Vector=Vector(0, 0, -1), LCase=0, mode="Gravity")
linetobeam_3 = LineToBeamKaramba(Line=shatter_2, New=True, Remove=True, LimitDistance_m=0.005, BeamIdentifier="bottom")  # -> Points, Element, Info
element = ElementKaramba(flatten([linetobeam.Element, linetobeam_2.Element, linetobeam_3.Element]))
load = LoadKaramba([loads_2, loads])
crosec = CrossSectionKaramba(flatten(cross_sections))
assemble = AssembleModelKaramba(Elem=element, Support=supp, Load=load, CrossSection=crosec, LimitDistance_m=0.005)  # -> Model, Info, Mass_kg, CenterOfGravity
expression = Expression(Expression="Format(\"Displacement : {0:F2} cm\", x)")  # disabled
expression_2 = Expression(Expression="Format(\"massa : {0:F2} kg\", x)")  # disabled
merge_2 = Merge(
    Data1=ColourSwatch(SwatchColor=RGB(255, 0, 0)),
    Data2=ColourSwatch(SwatchColor=RGB(255, 179, 0)),
    Data3=ColourSwatch(SwatchColor=RGB(255, 255, 0)),
    Data4=ColourSwatch(SwatchColor=RGB(0, 255, 0)),
    Data5=ColourSwatch(SwatchColor=RGB(0, 255, 255)),
    Data6=ColourSwatch(SwatchColor=RGB(4, 177, 255)),
    Data7=ColourSwatch(SwatchColor=RGB(0, 0, 255)),
    Data8=ColourSwatch(SwatchColor=RGB(129, 0, 190)),
    Data9=ColourSwatch(SwatchColor=RGB(75, 0, 130)))  # -> reverse(Result)
analyzethi = AnalyzeThIKaramba(Model=assemble.Model)  # -> CalculatedModel, MaximumDisplacement_m, ResultingForceOfGravity_kN, ElasticEnergy_kNm
expression_3 = Expression(x=analyzethi.MaximumDisplacement_m, Expression="Format(\"Displacement : {0:F2} cm\", x*100)")
num_2 = Number(analyzethi.MaximumDisplacement_m)
merge_3 = Merge(
    Data1=flatten("Trave Reticolare"),
    Data3=flatten(expression_3),
    Data5=flatten(expression_2),
    Data6=flatten(["", expression]))  # -> flatten(Result)
gh_silvereye = Silvereye(SilvereyeData_fitness_fcn=num_2, SilvereyeData_parameter=[genes_2, genes])
panel_2 = Panel(num_2)
modelview = ModelViewKaramba(
    Model=analyzethi.CalculatedModel,
    LoadCaseFactorsForLinearSuperposition=1,
    IndexIncrementOfVisibleLoadcase=0,
    ListOfColorsForColoringPlots=merge_2)  # -> Model, DeformedMesh, DeformedAxes, DeformedModel
number_slider = Slider(0.43, range=0.1..2)
lng = ListLength(List=merge_3)
series = Series(Start=Slider(0, range=0..50), Step=expr("-x*1", number_slider), Count=lng)

# ---- group: insert a point
pt = Point(Point(19, 0, -4))

# ----
beamview = BeamViewKaramba(Model=modelview.Model)  # -> Model, MeshesOfRenderedBeams, DeformedBeamAxes, LegendColors, LegendTags
Z_2 = UnitZ(Factor=series)
move = Move(Geometry=pt, Motion=Z_2)  # -> Geometry, Transform
xz = XZPlane(Origin=move.Geometry)
legend = Legend(Colour=beamview.LegendColors, Tags=beamview.LegendTags, LegendType=1)
tag = TextTag3D(Location=xz, Text=merge_3, Size=number_slider, Colour=ColourSwatch(SwatchColor=RGB(255, 255, 255)), Justification=7)
