# Grasshopper definition Harmonic_Pendulums.ghx (Grasshopper 1.0.5)
# plug-ins: Kangaroo Components

timer = Timer(TimerInterval=5, Target=kangaroo)  # disabled

num_pendula = Slider(5, range=0..100)
length_of_array = Panel("10")
swing_out = Slider(0.71, range=0..1)
base_length = Panel("-20")
reset = BooleanToggle(True)

Z = UnitZ(Factor=base_length)
Y = UnitY(Factor=1)
line = LineSDL(Start="0,0,0", Direction=Y, Length=length_of_array)
n = Series(Start=0, Step=1, Count=expr("x+1", num_pendula))
P = Panel("30")
B = Panel("15")

# ----
# Harmonic Pendulums
# Andrew Heumann 2010
# http://heumanndesigntech.wordpress.com
# Use this however you like.
# Creates a simulation of a sequence of pendulums, the frequencies of which are harmonic. Inspired by this video:
# 
# http://sciencedemonstrations.fas.harvard.edu/icb/icb.do?keyword=k16940&pageid=icb.page80863&pageContentId=icb.pagecontent341734&state=maximize&view=view.do&viewParam_name=indepth.html#a_icb_pagecontent341734
panel = Panel("")

addition = Addition(A=B, B=n)
divide = DivideCurve(Curve=line, Number=num_pendula, Kinks=False)  # -> Points, Tangents, Parameters
cyl = Cylinder(Base=line, Radius=Slider(0.08, range=0.01..0.5), Length=1)
multiplication = Multiplication(A=addition, B="2*Pi")
division = Division(A=P, B=multiplication)
cap = CapHoles(Brep=cyl)
pow = Power(A=division, B="2")
preview = CustomPreview(Geometry=cap, Material=ColourSwatch(SwatchColor=RGB(168, 168, 168)))
multiplication_2 = Multiplication(A=pow, B=base_length)
Z_2 = UnitZ(Factor=multiplication_2)
move = Move(Geometry=divide.Points, Translation=Z_2)  # -> Geometry, Transform
xz = XZPlane(Origin=Point(0, 0, 0))
rotate = Rotate(Geometry=move.Geometry, Angle=expr("-x", swing_out), Plane=xz)  # -> Geometry, Transform
ln = Line(PointA=divide.Points, PointB=rotate.Geometry)
kangaroo_settings = KangarooSettings(
    Tolerance=0.01,
    TimeStep=0.002,
    SubIterations=10,
    Floor=False,
    Drag="0",
    Restitution=0.7,
    StaticFriction=10,
    KineticFriction=10,
    Settle=2,
    Tumble=1,
    Sound=False,
    Solver=0)
uforce = UnaryForce(Point=rotate.Geometry, Force=Z)
springs = SpringsFromLine(Connection=ln, Stiffness="10000", Damping="0", RestLength=ln, Cutoff=0, CompressionFail=0, TensileFail=0, Plasticity=0)
kangaroo = KangarooPhysics(
    ForceObjects=[springs, uforce],
    AnchorPoints=divide.Points,
    Settings=kangaroo_settings,
    Geometry=ln,
    SimulationReset=reset)  # -> Out, Iterations, ParticlesOut, GeometryOut, KE
line_2 = Line(kangaroo.GeometryOut)
end = EndPoints(Curve=kangaroo.GeometryOut)  # -> Start, End
sph = Sphere(Base=end.End, Radius="0.04")
pdecon = Deconstruct(Point=end.End)  # -> XComponent, YComponent, ZComponent
preview_2 = CustomPreview(Geometry=line_2, Shader=ColourSwatch(SwatchColor=RGB(82, 82, 82)))
rotate_2 = Rotate(Geometry=move.Geometry, Angle=expr("-x", Slider(0, range=0..100)), Plane=xz)  # -> Geometry, Transform
pdecon_2 = Deconstruct(Point=rotate_2.Geometry)  # -> XComponent, YComponent, ZComponent
gradient = Gradient(l0="0", l1=graft(pdecon_2.ZComponent), t=graft(pdecon.ZComponent))
preview_3 = CustomPreview(Geometry=sph, Shader=gradient)

# ==== cluster Gradient
l0 = ClusterInput()
l1 = ClusterInput()
t = ClusterInput()
gradient = Gradient(
    LowerLimit=l0,
    UpperLimit=l1,
    Parameter=t,
    stops=[0: RGBA(237, 26, 58, 0), 0: RGBA(209, 0, 118, 0), 0: RGBA(242, 57, 0, 0), 0: RGB(103, 0, 120), 0.141: RGB(39, 72, 161), 0.283: RGB(1, 192, 229), 0.43: RGB(18, 178, 90), 0.56: RGB(79, 186, 8), 0.698: RGB(220, 237, 32), 0.838: RGB(247, 159, 20), 1: RGB(243, 57, 0)])
C = ClusterOutput(gradient)
