# Grasshopper definition Lloyds algorithm.gh (Grasshopper 1.0.7)
# plug-ins: Karamba, Kangaroo Components

xz = XZPlane(Origin=Point(0, 0, 0))
rectangle = Rectangle(Plane=xz, XSize=Slider(3, range=0..10), YSize=Slider(8, range=0..10), Radius=0)  # -> Rectangle, Length
mesh_uv = MeshSurface(
    Surface=rectangle.Rectangle,
    UCount=Slider(15, range=0..100),
    VCount=Slider(40, range=0..100),
    Overhang=True,
    Equalize=False)
nv = NakedVertices(Mesh=mesh_uv)  # -> ClothedIndex, NakedIndex, ClothedPts, NakedPts
corners = Corners(mesh=mesh_uv)
pt = Point(corners)
pdecon = Deconstruct(Point=pt)  # -> XComponent, YComponent, ZComponent
pdecon_2 = Deconstruct(Point=pt)  # -> XComponent, YComponent, ZComponent
pdecon_3 = Deconstruct(Point=pt)  # -> XComponent, YComponent, ZComponent
bnd = Bounds(Numbers=flatten(pdecon.ZComponent))
bnd_2 = Bounds(Numbers=flatten(pdecon_2.ZComponent))
bnd_3 = Bounds(Numbers=flatten(pdecon_3.XComponent))
dedomain = DeconstructDomain(Domain=bnd)  # -> Start, End
dedomain_2 = DeconstructDomain(Domain=bnd_2)  # -> Start, End
dedomain_3 = DeconstructDomain(Domain=bnd_3)  # -> Start, End
subtraction = Subtraction(A=dedomain.End, B="0.1")
addition = Addition(A=dedomain_2.Start, B="0.1")
addition_2 = Addition(A=dedomain_3.Start, B="0.1")
smaller = SmallerThan(FirstNumber=pdecon.ZComponent, SecondNumber=subtraction)  # -> SmallerThan, OrEqualTo
smaller_2 = SmallerThan(FirstNumber=pdecon_2.ZComponent, SecondNumber=addition)  # -> SmallerThan, OrEqualTo
smaller_3 = SmallerThan(FirstNumber=pdecon_3.XComponent, SecondNumber=addition_2)  # -> SmallerThan, OrEqualTo
cull = CullPattern(List=pt, CullPattern=invert(smaller.SmallerThan))
cull_2 = CullPattern(List=pt, CullPattern=smaller_2.SmallerThan)
cull_3 = CullPattern(List=pt, CullPattern=smaller_3.SmallerThan)
duppt = RemoveDuplicatePts(Points=cull, Tolerance=0.01)
duppt_2 = RemoveDuplicatePts(Points=cull_2, Tolerance=0.01)
duppt_3 = RemoveDuplicatePts(Points=cull_3, Tolerance=0.01)
pdecon_4 = Deconstruct(Point=duppt)  # -> XComponent, YComponent, ZComponent
pdecon_5 = Deconstruct(Point=duppt_3)  # -> XComponent, YComponent, ZComponent
expression = Expression(x=pdecon_4.ZComponent, Expression="x^2")
expression_2 = Expression(x=pdecon_5.ZComponent, Expression="x^2")
Z = UnitZ(Factor=expr("-x", expression))
X = UnitX(Factor=expression_2)
supp = SupportKaramba(PosInd=duppt_2, menu=[buttons(on, on, on, on, on, on)])
meshtoshell = MeshToShellKaramba(Mesh=mesh_uv, LimitDistance_m=0.005)  # -> Element, Points, Info
loads = LoadsKaramba(ForceVector=Z, Local=False, PosInd=duppt, LCase=0, mode="Point")
loads_2 = LoadsKaramba(ForceVector=X, Local=False, PosInd=duppt_3, LCase=0, mode="Point")
assemble = AssembleModelKaramba(Elem=flatten(meshtoshell.Element), Support=supp, Load=[loads_2, loads], LimitDistance_m=0.005)  # -> Model, Info, Mass_kg, CenterOfGravity
range = Range(Domain=Domain(0, 1), Steps=Slider(100, range=0..100))
analyzethi = AnalyzeThIKaramba(Model=assemble.Model)  # -> CalculatedModel, MaximumDisplacement_m, ResultingForceOfGravity_kN, ElasticEnergy_kNm
gradient = Gradient(LowerLimit=0, UpperLimit=1, Parameter=range, stops=[0: RGB(255, 255, 255), 1: RGB(0, 0, 0)])
modelview = ModelViewKaramba(
    Model=analyzethi.CalculatedModel,
    LoadCaseFactorsForLinearSuperposition=1,
    IndexOfVisibleLoadcase=-1,
    ListOfColorsForColoringPlots=gradient)  # -> Model, DeformedMesh, DeformedAxes, DeformedModel
shellview = ShellViewKaramba(Model=modelview.Model, IndexOfLayer=0)  # -> Model, MeshesOfRenderedShells, LegendColors, LegendTags
item = ListItem(List=shellview.MeshesOfRenderedShells, Index=0, Wrap=True)

# ==== cluster Corners: Find the boundary corner points of a quad mesh
mesh = ClusterInput()
mesh_2 = Mesh(mesh)
nv = NakedVertices(Mesh=mesh_2)  # -> ClothedIndex, NakedIndex, ClothedPts, NakedPts
vn = VertexNeighbours(Mesh=mesh_2, VertexNumber=nv.NakedIndex)  # -> graft(Vertex), Neighbours, Normal
lng = ListLength(List=vn.Neighbours)
equals = Equality(FirstNumber=lng, SecondNumber=3)  # -> Equality, Inequality
cull = CullPattern(List=vn.Vertex, CullPattern=equals.Inequality)
pshift = ShiftPaths(Data=cull, Offset=-1)
D = ClusterOutput(pshift)
