# Grasshopper definition Singola Lettera.gh (Grasshopper 1.0.7)
# plug-ins: Karamba, Weaverbird, Starling, Kangaroo2 Components

panel = Panel("""a
b
c
d
e
f
g
h
i
j
k
l
m
n
o
p
q
r
s
t
u
v
w
x
y
z""")
number_slider = Slider(0, range=0..25)
chars = Characters(Text="a")  # -> Result, Unicode
fsim = FindSimilarMember(Data=chars.Result, Set=panel)  # -> Hit, Index
brep = Brep([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])
item = ListItem(List=brep, Index=number_slider, Wrap=True)
item_2 = ListItem(List=panel, Index=number_slider, Wrap=True)
lng = ListLength(List=item)
bbox = BoundingBox(Content=item, Plane=PlaneXY(0, 0, 0))  # -> Box, Box_2
series = Series(Start=0, Step=Slider(0.7, range=0.1..20), Count=lng)
debrep = DeconstructBrep(Brep=bbox.Box)  # -> Faces, Edges, Vertices
pt = ConstructPoint(XCoordinate=series, YCoordinate=0, ZCoordinate=0)
item_3 = ListItem(List=debrep.Vertices, Index=Slider(0, range=0..3), Wrap=True)
xz = XZPlane(Origin=item_3)
xz_2 = XZPlane(Origin=pt)
orient = Orient(Geometry=item, Source=flatten(xz), Target=xz_2)  # -> Geometry, Transform
item_4 = ListItem(List=orient.Geometry, Index=0, Wrap=True)
brep_2 = Brep(item_4)
mesh_breps = MeshBreps(
    Brep=brep_2,
    MeshResolution="0.01",
    EdgeRefinementFactor=0.67,
    PointReduction=invert(False),
    SmoothingStepSize=0,
    SmoothingIterations=5)  # -> Mesh, Info
slrelax = SlRelax(Mesh=mesh_breps.Mesh, Steps=Slider(20, range=0..100))
demesh = DeconstructMesh(Mesh=slrelax)  # -> simplify(Vertices), Faces, Colours, Normals
pt_2 = Point(demesh.Vertices)
pdecon = Deconstruct(Point=pt_2)  # -> XComponent, YComponent, ZComponent
bnd = Bounds(Numbers=flatten(pdecon.ZComponent))
dedomain = DeconstructDomain(Domain=bnd)  # -> Start, End
addition = Addition(A=dedomain.Start, B="0.003")
panel_2 = Panel(addition)
smaller = SmallerThan(FirstNumber=pdecon.ZComponent, SecondNumber=addition)  # -> SmallerThan, OrEqualTo
panel_3 = Panel(smaller.SmallerThan)
cull = CullPattern(List=pt_2, CullPattern=smaller.SmallerThan)
Z = UnitZ(Factor=expr("-x", 1))
meshtoshell = MeshToShellKaramba3D(Mesh=graft(slrelax), Color=ColourSwatch(SwatchColor=RGB(255, 255, 255)), Identifier=graft("a"), LimitDistance_m=0.005)  # -> Element, Points, Info
loads = LoadsKaramba3D(ForceVector=Z, Local=False, PosInd=meshtoshell.Points, LCase=0, mode="Point")
duppt = RemoveDuplicatePts(Points=cull, Tolerance=0.01)
supp = SupportKaramba3D(PosInd=duppt, menu=[buttons(on, on, on, on, on, on)])
loads_2 = LoadsKaramba3D(Vector=Vector(0, 0, -1), LCase=0, mode="Gravity")
assemble = AssembleModelKaramba3D(Elem=simplify(meshtoshell.Element), Support=simplify(supp), Load=loads_2, LimitDistance_m=0.005)  # -> Model, Info, Mass_kg, CenterOfGravity
analyzethii = AnalyzeThIIKaramba3D(Model=assemble.Model, LoadCase=-1, RTolerance=1e-07, MaxIterations=50, NoTensionalNII=False)  # -> CalculatedModel, MaximumDisplacement_cm, ResultingForceOfGravity_kN, ElasticEnergy_kNm
division = Division(A="5", B=analyzethii.MaximumDisplacement_cm)
panel_4 = Panel(division)
multiplication = Multiplication(A=Z, B=Slider(0.027, range=0.001..1))
move = Move(Geometry=meshtoshell.Points, Motion=expr("-x", multiplication))  # -> Geometry, Transform
vdisex = VectorDisplayEx(Point=move.Geometry, Vector=multiplication, Colour=ColourSwatch(SwatchColor=RGB(255, 0, 0)), Width=2)
panel_5 = Panel("C:\Users\Marco\Ingegneria Parametrica\30_Text FEM\Image Letter")

mesh = Mesh(slrelax)
wbedges = WeaverbirdsMeshEdges(MeshOrPolylines=mesh)
displaycrv = DisplayCurve(curve=wbedges, color=ColourSwatch(SwatchColor=RGB(0, 0, 0)), weight=Slider(2.12, range=0.1..10))  # -> out; inputs curve: Curve, color: Color, weight: Int32
# ---------- displaycrv: C# ----------
    // silently skip null curves
    if(curve == null) return;

    // add to display cache
    _curves.Add(curve);
    _colors.Add(color);
    _weights.Add(weight);
    _clippingBox.Union(curve.GetBoundingBox(false));
# ---------- displaycrv: C# additional code ----------
  List<Curve> _curves;
  List<Color> _colors;
  List<int> _weights;
  BoundingBox _clippingBox;


  /// <summary>
  /// This method will be called once every solution, before any calls to RunScript.
  /// </summary>
  public override void BeforeRunScript()
  {
    _curves = new List<Curve>();
    _colors = new List<Color>();
    _weights = new List<int>();
    _clippingBox = new BoundingBox();
  }


  //
  public override BoundingBox ClippingBox
  {
    get{return _clippingBox;}
  }


  //
  public override void DrawViewportWires(IGH_PreviewArgs args)
  {
    base.DrawViewportWires(args);

    for(int i = 0; i < _curves.Count; i++)
      args.Display.DrawCurve(_curves[i], _colors[i], _weights[i]);
  }
# ---------- end displaycrv ----------
preview = CustomPreview(Geometry=mesh, Material=ColourSwatch(SwatchColor=RGB(255, 255, 255)))

number_slider_2 = Slider(0.43, range=0.01..1)
X = UnitX(Factor=expr("-x", number_slider_2))
move_2 = Move(Geometry=brep_2, Motion=X)  # -> Geometry, Transform

colours = LegendColour()
modelview = ModelViewKaramba3D(
    Model=analyzethii.CalculatedModel,
    LoadCaseFactorsForLinearSuperposition=division,
    IndexOfVisibleLoadcase=-1,
    ListOfColorsForColoringPlots=colours)  # -> Model, DeformedMesh, DeformedAxes, DeformedModel
shellview = ShellViewKaramba3D(Model=modelview.Model, IndexOfLayer=0)  # -> Model, MeshesOfRenderedShells, LegendColors, LegendTags
number_slider_3 = Slider(0.35, range=0.1..3)
X_2 = UnitX(Factor=number_slider_2)
move_3 = Move(Geometry=shellview.MeshesOfRenderedShells, Motion=X_2)  # -> Geometry, Transform
wbedges_2 = WeaverbirdsMeshEdges(MeshOrPolylines=move_3.Geometry)
displaycrv_2 = DisplayCurve(curve=wbedges_2, color=ColourSwatch(SwatchColor=RGB(0, 0, 0)), weight=Slider(1.6, range=0.1..10))  # -> out; inputs curve: Curve, color: Color, weight: Int32; same code as displaycrv

concat = Concatenate(FragmentA=item_2)
path = FilePath(panel_5)
captureview = Ladybug_CaptureView(fileName=concat, folder=path, viewNames="Front", transparBack=Toggle(False), capture=Toggle(False))  # -> imagePath; plug-in component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

# ==== cluster LegendColour: Legend colour for Karamba
merge = Merge(
    Data1=ColourSwatch(SwatchColor=RGB(255, 0, 0)),
    Data2=ColourSwatch(SwatchColor=RGB(255, 179, 0)),
    Data3=ColourSwatch(SwatchColor=RGB(255, 255, 0)),
    Data4=ColourSwatch(SwatchColor=RGB(0, 255, 0)),
    Data5=ColourSwatch(SwatchColor=RGB(0, 255, 255)),
    Data6=ColourSwatch(SwatchColor=RGB(4, 177, 255)),
    Data7=ColourSwatch(SwatchColor=RGB(0, 0, 255)),
    Data8=ColourSwatch(SwatchColor=RGB(129, 0, 190)),
    Data9=ColourSwatch(SwatchColor=RGB(75, 0, 130)))  # -> reverse(Result)
legend = ClusterOutput(merge)  # List of colours to plug on Karamba Legend
