# Grasshopper definition 33-TopologicalOptimization.gh (Grasshopper 1.0.7)
# plug-ins: Ameba, Human, Weaverbird

surfaces = SurfacesDomain(SurfaceData_Branch0_Path="{0}")
geo = Geometry(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)
surfaces_2 = SurfacesDomain(SurfaceData_Branch0_Path="{0}")
mesh = AmebaMesh(FilePath="C:\Users\Marco\\33_TopologicalOptimization", ProjectName="Mensola", Geometry=geo, Size="3")
optparas = OptParameters(Sensitivity=1, Vf="0.10", Ert="0.04")
support3d = Support3D(Domain=surfaces, Ux="0", Uy="0", Uz="0")
load3d = Load3D(Domain=surfaces_2, Fx=0, Fy=0, Fz="-200")
renderdisplay = RenderDisplay(Geometry=geo, IsWire=Toggle(False))
mat = Material(Mat=0)
number_slider = Slider(2, range=0..2)
preprocessing = PreProcessing(
    AmebaMeshFile=mesh,
    Supports=support3d,
    Loads=load3d,
    Gravity=Vector(0, 0, 0),
    SubDesigndomains="[]",
    Nondesigndomains="[]",
    Symmetry="[]",
    Parameters=optparas,
    Material=mat)
multiplication = Multiplication(A=number_slider, B="15")
Z = UnitZ(Factor=Slider(250, range=50..500))
prot = RotatePlane()
volume = Volume(Geometry=geo)  # -> Volume, Centroid
expression = Expression(x=number_slider, Expression="if(x>0.999,x-1,x)")
panel = Panel("VkZkR2VWa3lPVkZhVjNoeldsZGtlV0ZYTlhaTWVrVjNUSHBKTUV4NlJUTk1la2sx")
expression_2 = Expression(x=multiplication, Expression="if(x=0,1,x)")
pt = Point(volume.Centroid)
move = Move(Geometry=pt, Motion=Z)  # -> Geometry, Transform
cir = Circle(Plane=move.Geometry, Radius=Slider(358, range=0..1000))
division = Division(A="200", B=Slider(30, range=1..30))
step = Slider(1, range=1..200)
number_slider_2 = Slider(4, range=1..30)
crv = Curve(reparameterize(cir))
type = DisplayType({"None": 0, "Mises": 1, "Principal": 10}, selected="Mises")
round = Round(Number=expression_2)  # -> Nearest, Floor, Ceiling
login = Login()
solver = SolverTest(AmebaMeshFile=preprocessing)
seam = Seam(Curve=crv, Seam=Slider(0.63, range=0..1))
display = DisplayMode(AmebaMeshFile=preprocessing, DisplayType=type, Step=round.Ceiling, Scale=0)  # -> Mesh, Value
eval = EvaluateLength(Curve=seam, Length=expression, Normalized=True)  # -> Point, Tangent, Parameter
number_slider_3 = Slider(3, range=0..10)  # disabled
c_script = CSharpScript(points=pt, index=Slider(0, range=0..20), newLocation=eval.Point)  # -> out, A, cameraPosition; inputs points: list of Point3d, index: Int32, newLocation: Point3d; disabled
# ---------- c_script: C# ----------
    int myIndex = index > (points.Count - 1) ? points.Count - 1 : index;
    Point3d camPos = new Point3d();
    Point3d myPoint = points[myIndex];



    camPos = Rhino.RhinoDoc.ActiveDoc.Views.ActiveView.ActiveViewport.CameraLocation;
    Rhino.RhinoDoc.ActiveDoc.Views.ActiveView.ActiveViewport.SetCameraTarget(myPoint, true);
    Rhino.RhinoDoc.ActiveDoc.Views.ActiveView.ActiveViewport.SetCameraLocations(myPoint, newLocation);


    A = myPoint;

    cameraPosition = camPos;
# ---------- end c_script ----------
panel_2 = Panel("C:\Users\Marco\Ingegneria Parametrica\33_TopologicalOptimization\images\")  # disabled
wblaplace = WeaverbirdsLaplacianSmoothing(MeshCurves=display.Mesh, Level=Slider(3, range=0..10), SmoothNakedEdges=1, Thin=1)
mesh_2 = Mesh()  # disabled
panel_3 = Panel(c_script.cameraPosition)  # disabled
panel_4 = Panel(c_script.A)  # disabled
viewports = ViewportProperties(Update=True, AutoUpdate=False)  # -> ViewportNames, ActiveViewportIndex, ViewportBounds, ViewportDisplayMode, CameraLocation, CameraTarget, CameraPlane, CameraLensLength, CameraProjection, CameraUp; disabled
num = Number(expression)  # disabled
panel_5 = Panel("rotateMesh")  # disabled
panel_6 = Panel("1674")  # disabled
panel_7 = Panel("833")  # disabled
txt = Text(num)  # disabled
panel_8 = Panel("Front")  # disabled
multiplication_2 = Multiplication(A=panel_7, B=2)  # disabled
multiplication_3 = Multiplication(A=panel_6, B=2)  # disabled
concat = Concatenate(FragmentB=txt)  # disabled
concat_2 = Concatenate(FragmentA=panel_2, FragmentB=panel_5)  # disabled
toggle = BooleanToggle(False)  # disabled
captureview = Ladybug_CaptureView(
    fileName=concat,
    folder=concat_2,
    viewNames=panel_8,
    imageWidth=multiplication_3,
    imageHeight=multiplication_2,
    capture=toggle)  # -> imagePath; disabled; plug-in component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
