# Grasshopper definition ShellStressPattern.gh (Grasshopper 1.0.7)
# plug-ins: Karamba, Kangaroo Components, LunchBox, Weaverbird, Kangaroo2 Components

rectangle = Rectangle(Plane=PlaneXY(0, 0, 0), XSize="800", YSize="120", Radius=0)  # -> Rectangle, Length
number_slider = Slider(50, range=1..50)
remesh = RemesherSetIterations(
    input_mesh=rectangle.Rectangle,
    edge_length=Slider(2, range=0.5..40),
    iterations="200",
    Reference=["C:\Users\Marco\AppData\Roaming\Grasshopper\Libraries\Kangaroo0099.gha", "C:\Users\Marco\AppData\Roaming\Grasshopper\Libraries\KangarooLib0099.dll", "C:\USERS\MARCO\DESKTOP\old personal google drive\AA_Aarhus_Workshop_Folder\Grasshopper Resources\Libraries\Plankton.gha", "C:\USERS\MARCO\DESKTOP\old personal google drive\AA_Aarhus_Workshop_Folder\Grasshopper Resources\Libraries\Plankton.dll"])  # -> out, output_mesh, e_count, fe_count; inputs input_mesh: Mesh, edge_length: Double, fixed_vertices: list of Point3d, fixed_curves: list of Curve, iterations: Int32
# ---------- remesh: C# ----------
    var M1 = input_mesh;
    var L = edge_length;
    var FV = fixed_vertices;
    var FC = fixed_curves;
    var iter = iterations;

    if (M1 == null)
    {
      this.Component.AddRuntimeMessage(GH_RuntimeMessageLevel.Warning,
        "No input mesh");
      return;
    }

    double tol = 0.01;
    bool flip = false; // true = valence based flipping, false = angle based

    // auto set fv and fc to corner points and boundary curves if both empty
    if (FV.Count == 0 || FC.Count == 0)
    {
      this.Component.AddRuntimeMessage(GH_RuntimeMessageLevel.Remark,
        "Attempting to infer boundary conditions...");
      var edgeCurves = M1.GetNakedEdges();
      foreach (Polyline ec in edgeCurves)
      {
        ec.ReduceSegments(tol);
      }
      FV = edgeCurves.SelectMany(x => x.ToArray()).ToList();
      FC = edgeCurves.SelectMany(x => x.GetSegments()).Select(x => new LineCurve(x) as Curve).ToList();
    }

    // Below is Daniel Piker's code, modified to run a set number of iterations only.

    //if(reset)
    //{
    M1.Faces.ConvertQuadsToTriangles();
    P = M1.ToPlanktonMesh();

    AnchorV.Clear();
    FeatureV.Clear();
    FeatureE.Clear();

    //Mark any vertices or edges lying on features
    for(int i = 0;i < P.Vertices.Count;i++)
    {
      Point3d Pt = P.Vertices[i].ToPoint3d();

      AnchorV.Add(-1);
      for(int j = 0;j < FV.Count;j++)
      {
        if(Pt.DistanceTo(FV[j]) < tol)
        {AnchorV[AnchorV.Count - 1] = j;}
      }

      FeatureV.Add(-1);
      for(int j = 0;j < FC.Count;j++)
      {
        double param = new double();
        FC[j].ClosestPoint(Pt, out param);
        if(Pt.DistanceTo(FC[j].PointAt(param)) < tol)
        {FeatureV[FeatureV.Count - 1] = j; }
      }
    }

    int EdgeCount = P.Halfedges.Count / 2;
    for(int i = 0;i < EdgeCount;i++)
    {
      FeatureE.Add(-1);
      int vStart = P.Halfedges[2 * i].StartVertex;
      int vEnd = P.Halfedges[2 * i + 1].StartVertex;

      Point3d PStart = P.Vertices[vStart].ToPoint3d();
      Point3d PEnd = P.Vertices[vEnd].ToPoint3d();

      for(int j = 0;j < FC.Count;j++)
      {
        double paramS = new double();
        double paramE = new double();
        Curve thisFC = FC[j];
        thisFC.ClosestPoint(PStart, out paramS);
        thisFC.ClosestPoint(PEnd, out paramE);
        if((PStart.DistanceTo(thisFC.PointAt(paramS)) < tol) &&
          (PEnd.DistanceTo(thisFC.PointAt(paramE)) < tol))
        {
          FeatureE[FeatureE.Count - 1] = j;
        }
      }
    }
    //}

    for (int soupdragon = 0; soupdragon < iter; soupdragon++)
    {
      EdgeCount = P.Halfedges.Count / 2;
      double[] EdgeLength = P.Halfedges.GetLengths();
      List<bool> Visited = new List<bool>();
      for(int i = 0; i < P.Vertices.Count;i++)
      {Visited.Add(false);}

      double t = 0.1;     //a tolerance for when to split/collapse edges
      double smooth = 0.5;  //smoothing strength
      double pull = 0.95;  //pull to target mesh strength

      // Split the edges that are too long
      for(int i = 0;i < EdgeCount;i++)
      {
        if(P.Halfedges[2 * i].IsUnused == false)
        {
          int vStart = P.Halfedges[2 * i].StartVertex;
          int vEnd = P.Halfedges[2 * i + 1].StartVertex;

          if((Visited[vStart] == false)
            && (Visited[vEnd] == false)
            && (EdgeLength[2 * i] > (1 + t) * (4f / 3f) * L))
          {
            int SplitHEdge = P.Halfedges.TriangleSplitEdge(2 * i);
            if (SplitHEdge != -1)
            {
              int SplitCenter = P.Halfedges[SplitHEdge].StartVertex;
              P.Vertices.SetVertex(SplitCenter, MidPt(P, i));

              //update the feature information
              FeatureE.Add(FeatureE[i]);
              FeatureV.Add(FeatureE[i]);
              AnchorV.Add(-1);

              //2 additional new edges have also been created (or 1 if split was on a boundary)
              //mark these as non-features
              int CEdgeCount = P.Halfedges.Count / 2;
              while(FeatureE.Count < CEdgeCount)
              {FeatureE.Add(-1);}

              Visited.Add(true);
              int[] Neighbours = P.Vertices.GetVertexNeighbours(SplitCenter);
              foreach (int n in Neighbours)
              {Visited[n] = true;}
            }
          }
        }
      }

      //Collapse the edges that are too short
      for(int i = 0;i < EdgeCount;i++)
      {
        if(P.Halfedges[2 * i].IsUnused == false)
        {
          int vStart = P.Halfedges[2 * i].StartVertex;
          int vEnd = P.Halfedges[2 * i + 1].StartVertex;
          if((Visited[vStart] == false)
            && (Visited[vEnd] == false))
          {
            if(!(AnchorV[vStart] != -1 && AnchorV[vEnd] != -1)) // if both ends are anchored, don't collapse
            {
              int Collapse_option = 0; //0 for none, 1 for collapse to midpt, 2 for towards start, 3 for towards end
              //if neither are anchorV
              if(AnchorV[vStart] == -1 && AnchorV[vEnd] == -1)
              {
                // if both on same feature (or neither on a feature)
                if(FeatureV[vStart] == FeatureV[vEnd])
                {Collapse_option = 1;}
                // if start is on a feature and end isn't
                if((FeatureV[vStart] != -1) && (FeatureV[vEnd] == -1))
                {Collapse_option = 2;}
                // if end is on a feature and start isn't
                if((FeatureV[vStart] == -1) && (FeatureV[vEnd] != -1))
                {Collapse_option = 3;}
              }
              else // so one end must be an anchor
              {
                // if start is an anchor
                if (AnchorV[vStart] != -1)
                {
                  // if both are on same feature, or if the end is not a feature
                  if ( (FeatureE[i] != -1) || (FeatureV[vEnd] == -1))
                  {Collapse_option = 2;}
                }
                // if end is an anchor
                if (AnchorV[vEnd] != -1)
                {
                  // if both are on same feature, or if the start is not a feature
                  if ( (FeatureE[i] != -1) || (FeatureV[vStart] == -1))
                  {Collapse_option = 3;}
                }
              }

              if((Collapse_option != 0) && (EdgeLength[2 * i] < (1 - t) * 4f / 5f * L))
              {
                int Collapsed = -1;
                int CollapseRtn = -1;
                if(Collapse_option == 1)
                {
                  Collapsed = P.Halfedges[2 * i].StartVertex;
                  P.Vertices.SetVertex(Collapsed, MidPt(P, i));
                  CollapseRtn = P.Halfedges.CollapseEdge(2 * i);
                }
                if(Collapse_option == 2)
                {
                  Collapsed = P.Halfedges[2 * i].StartVertex;
                  CollapseRtn = P.Halfedges.CollapseEdge(2 * i);
                }
                if(Collapse_option == 3)
                {
                  Collapsed = P.Halfedges[2 * i + 1].StartVertex;
                  CollapseRtn = P.Halfedges.CollapseEdge(2 * i + 1);
                }
                if(CollapseRtn != -1)
                {
                  int[] Neighbours = P.Vertices.GetVertexNeighbours(Collapsed);
                  foreach (int n in Neighbours)
                  {Visited[n] = true;}
                }
              }
            }
          }
        }
      }

      EdgeCount = P.Halfedges.Count / 2;

      if(flip)
      {
        //Flip edges to reduce valence error
        for(int i = 0;i < EdgeCount;i++)
        {
          if (!P.Halfedges[2 * i].IsUnused
            && (P.Halfedges[2 * i].AdjacentFace != -1)
            && (P.Halfedges[2 * i + 1].AdjacentFace != -1)
            && (FeatureE[i] == -1)  // don't flip feature edges
            )
          {
            int Vert1 = P.Halfedges[2 * i].StartVertex;
            int Vert2 = P.Halfedges[2 * i + 1].StartVertex;
            int Vert3 = P.Halfedges[P.Halfedges[P.Halfedges[2 * i].NextHalfedge].NextHalfedge].StartVertex;
            int Vert4 = P.Halfedges[P.Halfedges[P.Halfedges[2 * i + 1].NextHalfedge].NextHalfedge].StartVertex;

            int Valence1 = P.Vertices.GetValence(Vert1);
            int Valence2 = P.Vertices.GetValence(Vert2);
            int Valence3 = P.Vertices.GetValence(Vert3);
            int Valence4 = P.Vertices.GetValence(Vert4);

            if(P.Vertices.NakedEdgeCount(Vert1) > 0){Valence1 += 2;}
            if(P.Vertices.NakedEdgeCount(Vert2) > 0){Valence2 += 2;}
            if(P.Vertices.NakedEdgeCount(Vert3) > 0){Valence3 += 2;}
            if(P.Vertices.NakedEdgeCount(Vert4) > 0){Valence4 += 2;}

            int CurrentError =
              Math.Abs(Valence1 - 6) +
              Math.Abs(Valence2 - 6) +
              Math.Abs(Valence3 - 6) +
              Math.Abs(Valence4 - 6);
            int FlippedError =
              Math.Abs(Valence1 - 7) +
              Math.Abs(Valence2 - 7) +
              Math.Abs(Valence3 - 5) +
              Math.Abs(Valence4 - 5);
            if(CurrentError > FlippedError)
            {
              P.Halfedges.FlipEdge(2 * i);
            }
          }
        }
      }
      else
      {
        //Flip edges based on angle
        for(int i = 0;i < EdgeCount;i++)
        {
          if (!P.Halfedges[2 * i].IsUnused
            && (P.Halfedges[2 * i].AdjacentFace != -1)
            && (P.Halfedges[2 * i + 1].AdjacentFace != -1)
            && (FeatureE[i] == -1) // don't flip feature edges
            )
          {
            int Vert1 = P.Halfedges[2 * i].StartVertex;
            int Vert2 = P.Halfedges[2 * i + 1].StartVertex;
            int Vert3 = P.Halfedges[P.Halfedges[P.Halfedges[2 * i].NextHalfedge].NextHalfedge].StartVertex;
            int Vert4 = P.Halfedges[P.Halfedges[P.Halfedges[2 * i + 1].NextHalfedge].NextHalfedge].StartVertex;

            Point3d P1 = P.Vertices[Vert1].ToPoint3d();
            Point3d P2 = P.Vertices[Vert2].ToPoint3d();
            Point3d P3 = P.Vertices[Vert3].ToPoint3d();
            Point3d P4 = P.Vertices[Vert4].ToPoint3d();

            double A1 = Vector3d.VectorAngle(new Vector3d(P3 - P1), new Vector3d(P4 - P1))
              + Vector3d.VectorAngle(new Vector3d(P4 - P2), new Vector3d(P3 - P2));

            double A2 = Vector3d.VectorAngle(new Vector3d(P1 - P4), new Vector3d(P2 - P4))
              + Vector3d.VectorAngle(new Vector3d(P2 - P3), new Vector3d(P1 - P3));

            if(A2 > A1)
            {
              P.Halfedges.FlipEdge(2 * i);
            }
          }
        }
      }

      //Relocate mesh vertices
      Vector3d[] Smooth = GhKangaroo.MeshPhysics.LaplacianSmooth(P, 0, smooth);

      for(int i = 0;i < P.Vertices.Count;i++)
      {
        if(AnchorV[i] == -1) // don't smooth feature vertices
        {
          // make it tangential only
          Vector3d VNormal = Normal(P, i);
          double ProjLength = Smooth[i] * VNormal;
          Smooth[i] = Smooth[i] - (VNormal * ProjLength);
          P.Vertices.MoveVertex(i, Smooth[i]);

          if(P.Vertices.NakedEdgeCount(i) != 0)//special smoothing for feature edges
          {
            int[] Neighbours = P.Vertices.GetVertexNeighbours(i);
            int ncount = 0;
            Point3d Avg = new Point3d();

            for(int j = 0;j < Neighbours.Count();j++)
            {
              if(P.Vertices.NakedEdgeCount(Neighbours[j]) != 0)
              {
                ncount++;
                Avg = Avg + P.Vertices[Neighbours[j]].ToPoint3d();
              }
            }
            Avg = Avg * (1.0 / ncount);
            Vector3d move = Avg - P.Vertices[i].ToPoint3d();
            move = move * smooth;
            P.Vertices.MoveVertex(i, move);
          }

          if(FeatureV[i] != -1)//special smoothing for feature edges
          {
            int[] Neighbours = P.Vertices.GetVertexNeighbours(i);
            int ncount = 0;
            Point3d Avg = new Point3d();

            for(int j = 0;j < Neighbours.Count();j++)
            {
              if((FeatureV[Neighbours[j]] == FeatureV[i]) || (AnchorV[Neighbours[j]] != -1))
              {
                ncount++;
                Avg = Avg + P.Vertices[Neighbours[j]].ToPoint3d();
              }
            }
            Avg = Avg * (1.0 / ncount);
            Vector3d move = Avg - P.Vertices[i].ToPoint3d();
            move = move * smooth;
            P.Vertices.MoveVertex(i, move);
          }

          Point3d Point = P.Vertices[i].ToPoint3d();

          //projecting points onto the target along their normals
          Vector3d normal = Normal(P, i);
          Ray3d Ray1 = new Ray3d(Point, normal);
          Ray3d Ray2 = new Ray3d(Point, -normal);
          double RayPt1 = Rhino.Geometry.Intersect.Intersection.MeshRay(M1, Ray1);
          double RayPt2 = Rhino.Geometry.Intersect.Intersection.MeshRay(M1, Ray2);
          Point3d ProjectedPt;

          if((RayPt1 < RayPt2) && (RayPt1 > 0) && (RayPt1 < 1.0))
          {
            ProjectedPt = Point * (1 - pull) + pull * Ray1.PointAt(RayPt1);
          }
          else if((RayPt2 < RayPt1) && (RayPt2 > 0) && (RayPt2 < 1.0))
          {
            ProjectedPt = Point * (1 - pull) + pull * Ray2.PointAt(RayPt2);
          }
          else
          {
            ProjectedPt = Point * (1 - pull) + pull * M1.ClosestPoint(Point);
          }

          P.Vertices.SetVertex(i, ProjectedPt);

          if(FeatureV[i] != -1) //pull feature vertices onto feature curves
          {
            Curve CF = FC[FeatureV[i]];
            double param1 = 0.0;
            Point3d onFeature = new Point3d();
            CF.ClosestPoint(ProjectedPt, out param1);
            onFeature = CF.PointAt(param1);
            P.Vertices.SetVertex(i, onFeature);
          }
        }
        else
        {
          P.Vertices.SetVertex(i, FV[AnchorV[i]]); //pull anchor vertices onto their points
        }
      }

      e_count = P.Halfedges.Count / 2;

      fe_count = FeatureE.Count;

      AnchorV = CompactByVertex(P, AnchorV); //compact the fixed points along with the vertices
      FeatureV = CompactByVertex(P, FeatureV);
      FeatureE = CompactByEdge(P, FeatureE);

      P.Compact(); //this cleans the mesh data structure of unused elements

    }

    output_mesh = P.ToRhinoMesh();
# ---------- remesh: C# additional code ----------
  PlanktonMesh P = new PlanktonMesh();
  List<int> AnchorV = new List<int>();
  List<int> FeatureV = new List<int>();
  List<int> FeatureE = new List<int>();

  public Point3d MidPt (PlanktonMesh P, int E)
  {
    Point3d Pos1 = P.Vertices[P.Halfedges[2 * E].StartVertex].ToPoint3d();
    Point3d Pos2 = P.Vertices[P.Halfedges[2 * E + 1].StartVertex].ToPoint3d();
    return (Pos1 + Pos2) * 0.5;
  }

  public List<int> CompactByVertex (PlanktonMesh P, List<int> L)
  {
    List<int> L2 = new List<int>();

    for(int i = 0;i < P.Vertices.Count;i++)
    {
      if(P.Vertices[i].IsUnused == false)
      {
        L2.Add(L[i]);
      }
    }
    return L2;
  }

  public List<int> CompactByEdge (PlanktonMesh P, List<int> L1)
  {
    List<int> L2 = new List<int>();

    int EdgeCount = P.Halfedges.Count / 2;

    for(int i = 0;i < EdgeCount;i++)
    {
      if(P.Halfedges[2 * i].IsUnused == false)
      {
        L2.Add(L1[i]);
      }
    }
    return L2;
  }

  public Vector3d Normal (PlanktonMesh P, int V)
  {
    Point3d Vertex = P.Vertices[V].ToPoint3d();
    Vector3d Norm = new Vector3d();

    int[] OutEdges = P.Vertices.GetHalfedges(V);
    int[] Neighbours = P.Vertices.GetVertexNeighbours(V);
    Vector3d[] OutVectors = new Vector3d[Neighbours.Length];
    int Valence = P.Vertices.GetValence(V);

    for(int j = 0; j < Valence;j++)
    {
      OutVectors[j] = P.Vertices[Neighbours[j]].ToPoint3d() - Vertex;
    }

    for(int j = 0; j < Valence;j++)
    {
      if(P.Halfedges[OutEdges[(j + 1) % Valence]].AdjacentFace != -1)
      {
        Norm += (Vector3d.CrossProduct(OutVectors[(j + 1) % Valence], OutVectors[j]));
      }
    }

    Norm.Unitize();
    return Norm;
  }
# ---------- end remesh ----------
edges = BrepEdges(Brep=rectangle.Rectangle)  # -> Naked, Interior, NonManifold
nv = NakedVertices(Mesh=remesh.output_mesh)  # -> ClothedIndex, NakedIndex, ClothedPts, NakedPts
crv = Curve(edges.Naked)
pt = Point(nv.NakedPts)
len = Length(Curve=edges.Naked)
mc = MeshCorners(Mesh=remesh.output_mesh, Angle=2.35619449)
item = ListItem(List=crv, Index="2", Wrap=True)
pt_2 = Point(pt)
bnd = Bounds(Numbers=len)
pdecon = Deconstruct(Point=pt_2)  # -> XComponent, YComponent, ZComponent
dedomain = DeconstructDomain(Domain=bnd)  # -> Start, End
Y = UnitY(Factor=Slider(31, range=1..100))
divide = DivideCurve(Curve=item, Count="20", Kinks=False)  # -> Points, Tangents, Parameters
pt_3 = Point(mc)
duppt = RemoveDuplicatePts(Points=pt_3, Tolerance=0.01)
bnd_2 = Bounds(Numbers=flatten(pdecon.XComponent))
move = Move(Geometry=divide.Points, Motion=Y)  # -> Geometry, Transform
dedomain_2 = DeconstructDomain(Domain=bnd_2)  # -> Start, End
pdecon_2 = Deconstruct(Point=duppt)  # -> XComponent, YComponent, ZComponent
division = Division(A=dedomain.End, B="10")
vdisex = VectorDisplayEx(Point=move.Geometry, Vector=expr("-x", Y), Colour=ColourSwatch(SwatchColor=RGB(255, 0, 0)), Width=2)
bnd_3 = Bounds(Numbers=flatten(pdecon_2.YComponent))
dedomain_3 = DeconstructDomain(Domain=bnd_3)  # -> Start, End
subtraction = Subtraction(A=dedomain_2.End, B="0.1")
addition = Addition(A=dedomain_2.Start, B="0.1")
larger = LargerThan(FirstNumber=pdecon.XComponent, SecondNumber=subtraction)  # -> LargerThan, OrEqualTo
smaller = SmallerThan(FirstNumber=pdecon.XComponent, SecondNumber=addition)  # -> SmallerThan, OrEqualTo
addition_2 = Addition(A=dedomain_3.Start, B="0.1")
or = GateOr(A=smaller.SmallerThan)
smaller_2 = SmallerThan(FirstNumber=pdecon_2.YComponent, SecondNumber=addition_2)  # -> SmallerThan, OrEqualTo
division_2 = Division(A=dedomain.Start, B="16")
cull = CullPattern(List=pt_2, CullPattern=or)
cull_2 = CullPattern(List=duppt, CullPattern=smaller_2.SmallerThan)
Y_2 = UnitY(Factor=1)
supp = SupportKaramba3D(PosInd=cull_2, menu=[buttons(on, on, on, on, off, on)])
loads = LoadsKaramba3D(Vector=Y_2, LCase=0, mode="Gravity")
meshtoshell = MeshToShellKaramba3D(Mesh=remesh.output_mesh, LimitDistance_m=0.005)  # -> Element, Points, Info
assemble = AssembleModelKaramba3D(Elem=meshtoshell.Element, Support=supp, Load=loads, LimitDistance_m=0.005)  # -> Model, Info, Mass_kg, CenterOfGravity
analyze = AnalyzeKaramba3D(Model=assemble.Model)  # -> CalculatedModel, MaximumDisplacement_cm, ResultingForceOfGravity_kN, ElasticEnergy_kNm
colours = LegendColour()
modelview = ModelViewKaramba3D(
    Model=analyze.CalculatedModel,
    LoadCaseFactorsForLinearSuperposition=1,
    IndexOfVisibleLoadcase=-1,
    ListOfColorsForColoringPlots=colours)  # -> Model, DeformedMesh, DeformedAxes, DeformedModel
revsrf = ReverseSurfaceDirection(Surface=rectangle.Rectangle, ReverseOption=Slider(3, range=0..3))
trib = TrianglePanelsB(Surface=revsrf, UDivisions=division_2, VDivisions=division)
shellview = ShellViewKaramba3D(Model=modelview.Model, IndexOfLayer=0)  # -> Model, MeshesOfRenderedShells, LegendColors, LegendTags
edges_2 = BrepEdges(Brep=trib)  # -> Naked, Interior, NonManifold
popgeo = PopulateGeometry(Geometry=modelview.DeformedMesh, Count=100, Seed=1)  # disabled
join = JoinCurves(Curves=edges_2.Naked, Preserve=False)
shelllineresults = LineResultsOnShellsKaramba3D(
    AnalyzedModel=shellview.Model,
    Layer=0,
    ListOfIsoValuesValsOrSourcesOfForceFlowLinesLinesPoints=popgeo,
    SegmentLength_m=0,
    Smoothing=invert(False),
    mode="IsoLines",
    menu=[buttons(off, off, on, off, off, off, off)])  # -> AnalyzedModel, Lines, Value; disabled
wbunify = WeaverbirdsUnifyFaceWindings(MeshCurves=join)
disassemble = DisassembleModelKaramba3D(Model=shellview.Model)  # -> Model, Point, Beam, Shell, Support, Load, Line, Mesh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
utilization = UtilizationOfElementsKaramba3D(AnalyzedModel=shellview.Model, LoadCase=-1, mode="Shells")  # -> AnalyzedModel, Utilization
facen = FaceNormals(Mesh=disassemble.Mesh)  # -> Centers, Normals
area = Area(Geometry=wbunify)  # -> Area, simplify(Centroid)
cp = ClosestPoint(Point=area.Centroid, Cloud=facen.Centers)  # -> ClosestPoint, CPIndex, Distance
item_2 = ListItem(List=utilization.Utilization, Index=cp.CPIndex, Wrap=True)
bnd_4 = Bounds(Numbers=flatten(item_2))
crv_2 = Curve(<curve referenced from the Rhino model>)
dedomain_4 = DeconstructDomain(Domain=flatten(bnd_4))  # -> Start, End
crv_cp = CurveClosestPoint(Point=area.Centroid, Curve=crv_2)  # -> Point, Parameter, Distance
gradient = Gradient(l0=expr("x-0.1", dedomain_4.Start), l1=dedomain_4.End, t=item_2)  # -> simplify(C)
list = ValueList({"Curve": 0, "Utilization": 1}, selected="Utilization")
filter = StreamFilter(Gate=list, Stream0=crv_cp.Distance, Stream1=item_2)
num = Number(filter)
dots = DotDisplay(Point=area.Centroid, Colour=gradient, Size="5")
bnd_5 = Bounds(Numbers=flatten(num))
remap = RemapNumbers(Value=num, Source=bnd_5, Target=Domain(0, 1))  # -> Mapped, Clipped
graph = GraphMapper(
    remap.Mapped,
    x0=0,
    x1=1,
    y0=0,
    y1=1,
    container_name="Bezier",
    cpx=[0, 0.1596255153, 0.4863210618, 1],
    cpy=[0, 0.5027205944, 0.8682206273, 1])
remap_2 = RemapNumbers(Value=graph, Source=Domain(0, 1), Target="0.80 to 0.02")  # -> Mapped, Clipped
scale = Scale(Geometry=wbunify, Center=area.Centroid, Factor=remap_2.Mapped)  # -> Geometry, Transform
fillet = Fillet(Curve=wbunify, Radius="0.8")  # -> simplify(Curve)
fillet_2 = Fillet(Curve=scale.Geometry, Radius="0.8")  # -> simplify(Curve)
explode = Explode(Curve=scale.Geometry, Recursive=True)  # -> Segments, Vertices
merge = Merge(Data1=simplify(fillet), Data2=simplify(fillet_2))
merge_2 = Merge(Data1=simplify(wbunify), Data2=simplify(scale.Geometry))
pt_4 = Point(flatten(explode.Vertices))
loft = Loft(Curves=merge_2, Options={Adjust=False, Closed=False, LoftEnds=0, LoftSimp=0, LoftType=0, Rebuild=10, Refit=0.01})  # -> flatten(Loft)
edges_3 = BrepEdges(Brep=loft)  # -> Naked, Interior, NonManifold; disabled
join_2 = BrepJoin(Breps=loft)  # -> Breps, Closed
number_slider_2 = Slider(1, range=0..1)  # disabled
mesh = Mesh(join_2.Breps)
crv_3 = Curve(edges_3.Naked)  # disabled
join_3 = JoinCurves(Curves=crv_3, Preserve=False)  # disabled
tri = Triangulate(Mesh=mesh)  # -> Mesh, Count
len_2 = Length(Curve=join_3)  # disabled
clean = CombineClean(Meshes=tri.Mesh)
sort = SortList(Keys=len_2, ValuesA=join_3)  # -> Keys, ValuesA; disabled
item_3 = ListItem(List=sort.ValuesA, Index=0, Wrap=True)  # disabled
remesh_2 = RemesherSetIterations(
    input_mesh=clean,
    edge_length="0.50",
    fixed_vertices=pt_4,
    iterations="3",
    Reference=["C:\Users\Marco\AppData\Roaming\Grasshopper\Libraries\Kangaroo0099.gha", "C:\Users\Marco\AppData\Roaming\Grasshopper\Libraries\KangarooLib0099.dll", "C:\USERS\MARCO\DESKTOP\old personal google drive\AA_Aarhus_Workshop_Folder\Grasshopper Resources\Libraries\Plankton.gha", "C:\USERS\MARCO\DESKTOP\old personal google drive\AA_Aarhus_Workshop_Folder\Grasshopper Resources\Libraries\Plankton.dll"])  # -> out, output_mesh, e_count, fe_count; inputs input_mesh: Mesh, edge_length: Double, fixed_vertices: list of Point3d, fixed_curves: list of Curve, iterations: Int32; disabled; same code as remesh
displaycrv = DisplayCurve()  # -> out; inputs curve: Curve, color: Color, weight: Int32; disabled
# ---------- displaycrv: C# ----------
    // silently skip null curves
    if(curve == null) return;

    // add to display cache
    _curves.Add(curve);
    _colors.Add(color);
    _weights.Add(weight);
    _clippingBox.Union(curve.GetBoundingBox(false));
# ---------- displaycrv: C# additional code ----------
  List<Curve> _curves;
  List<Color> _colors;
  List<int> _weights;
  BoundingBox _clippingBox;


  /// <summary>
  /// This method will be called once every solution, before any calls to RunScript.
  /// </summary>
  public override void BeforeRunScript()
  {
    _curves = new List<Curve>();
    _colors = new List<Color>();
    _weights = new List<int>();
    _clippingBox = new BoundingBox();
  }


  //
  public override BoundingBox ClippingBox
  {
    get{return _clippingBox;}
  }


  //
  public override void DrawViewportWires(IGH_PreviewArgs args)
  {
    base.DrawViewportWires(args);

    for(int i = 0; i < _curves.Count; i++)
      args.Display.DrawCurve(_curves[i], _colors[i], _weights[i]);
  }
# ---------- end displaycrv ----------
pt_5 = Point(cull_2)  # disabled
Y_3 = UnitY(Factor=1)  # disabled
supp_2 = SupportKaramba3D(PosInd=pt_5, menu=[buttons(on, on, on, on, off, on)])  # disabled
loads_2 = LoadsKaramba3D(Vector=Y_3, LCase=0, mode="Gravity")  # disabled
meshtoshell_2 = MeshToShellKaramba3D(Mesh=remesh_2.output_mesh, LimitDistance_m=0.005)  # -> Element, Points, Info; disabled
assemble_2 = AssembleModelKaramba3D(Elem=meshtoshell_2.Element, Support=supp_2, Load=loads_2, LimitDistance_m=0.005)  # -> Model, Info, Mass_kg, CenterOfGravity; disabled
analyze_2 = AnalyzeKaramba3D(Model=assemble_2.Model)  # -> CalculatedModel, MaximumDisplacement_cm, ResultingForceOfGravity_kN, ElasticEnergy_kNm; disabled
colours_2 = LegendColour()  # disabled
modelview_2 = ModelViewKaramba3D(
    Model=analyze_2.CalculatedModel,
    LoadCaseFactorsForLinearSuperposition=1,
    IndexOfVisibleLoadcase=-1,
    ListOfColorsForColoringPlots=colours_2)  # -> Model, DeformedMesh, DeformedAxes, DeformedModel; disabled
shellview_2 = ShellViewKaramba3D(Model=modelview_2.Model, IndexOfLayer=0)  # -> Model, MeshesOfRenderedShells, LegendColors, LegendTags; disabled

# ==== cluster LegendColour: Legend colour for Karamba
merge = Merge(
    Data1=ColourSwatch(SwatchColor=RGB(255, 0, 0)),
    Data2=ColourSwatch(SwatchColor=RGB(255, 179, 0)),
    Data3=ColourSwatch(SwatchColor=RGB(255, 255, 0)),
    Data4=ColourSwatch(SwatchColor=RGB(0, 255, 0)),
    Data5=ColourSwatch(SwatchColor=RGB(0, 255, 255)),
    Data6=ColourSwatch(SwatchColor=RGB(4, 177, 255)),
    Data7=ColourSwatch(SwatchColor=RGB(0, 0, 255)),
    Data8=ColourSwatch(SwatchColor=RGB(129, 0, 190)),
    Data9=ColourSwatch(SwatchColor=RGB(75, 0, 130)))  # -> reverse(Result)
legend = ClusterOutput(merge)  # List of colours to plug on Karamba Legend

# ==== cluster Gradient
l0 = ClusterInput()
l1 = ClusterInput()
t = ClusterInput()
gradient = Gradient(
    LowerLimit=l0,
    UpperLimit=l1,
    Parameter=t,
    stops=[0: RGBA(237, 26, 58, 0), 0: RGBA(209, 0, 118, 0), 0: RGBA(242, 57, 0, 0), 0: RGB(103, 0, 120), 0.141: RGB(39, 72, 161), 0.283: RGB(1, 192, 229), 0.43: RGB(18, 178, 90), 0.56: RGB(79, 186, 8), 0.698: RGB(220, 237, 32), 0.838: RGB(247, 159, 20), 1: RGB(243, 57, 0)])
C = ClusterOutput(gradient)
