# Grasshopper definition Robot_Dance.gh (Grasshopper 1.0.7)
# plug-ins: Robots

Z = UnitZ(Factor=Slider(673, range=1..1000))
number_slider = Slider(1.3, range=0..4)
xy = XYPlane(Origin=Z)
panel = Panel("0.1")
cir = Circle(Plane=xy, Radius=Slider(425, range=0..1000))
flip = FlipCurve(Curve=cir)  # -> Curve, Flag
addition = Addition(A=Slider(1, range=0..1), B=Slider(6, range=1..10))
pi = Pi(Factor=addition)
series = Series(Start=0, Step=1, Count=10)
divide = DivideCurve(Curve=flip.Curve, Count=Slider(100, range=0..100), Kinks=False)  # -> Points, Tangents, Parameters
lng = ListLength(List=divide.Points)  # -> expr("x-1", Length)
range = Range(Domain=pi, Steps=lng)
sin = Sine(Value=range)
multiplication = Multiplication(A=sin, B=Slider(209, range=1..800))
Z_2 = UnitZ(Factor=multiplication)
move = Move(Geometry=divide.Points, Motion=Z_2)  # -> Geometry, Transform

xy_2 = XYPlane(Origin=move.Geometry)
deplane = DeconstructPlane(Plane=xy_2)  # -> Origin, XAxis, YAxis, ZAxis
neg = Negative(Value=deplane.YAxis)
pl = ConstructPlane(Origin=deplane.Origin, XAxis=deplane.XAxis, YAxis=neg)

pi_2 = Pi(Factor=Slider(2, range=1..4))
lng_2 = ListLength(List=pl)  # -> expr("x-1", Length)
range_2 = Range(Domain=pi_2, Steps=lng_2)
sin_2 = Sine(Value=range_2)
range_3 = Range(Domain=Slider(45, range=10..45), Steps=lng_2)
multiplication_2 = Multiplication(A=sin_2, B=Slider(800, range=1..800))
graph = QuickGraph(sin_2, SortOrder=0)
rot3d = Rotate3D(Geometry=pl, Angle=degrees(multiplication_2), Center=deplane.Origin, Axis=deplane.XAxis)  # -> Geometry, Transform
sin_3 = Sine()

# ---- group: SIMULATION
knob = ControlKnob(Decimals=3, Limit=True, Maximum=1, Minimum=0, Range=1, Value=0)

# ----
list = ValueList({"Bartlett-IRB120", "Bartlett-IRB1600", "Bartlett-KR6", "Bartlett-KR60", "Bartlett-UR10"}, selected="Bartlett-UR10")
load_robot = LoadRobotSystem(Name=list, Base=PlaneXY(0, 0, 0))

# ---- group: TOOLPATH
pln = Plane(flatten(rot3d.Geometry))
viewer = ParamViewer(pln)

# ----
number_slider_2 = Slider(1, range=1..20)

# ---- group: SIMULATION TEST
list_2 = FlagFields({"Shoulder": 1, "Elbow": 2, "Wrist": 4}, selected="Wrist")
list_3 = ValueList({"Joint", "Linear"}, selected="Joint")
target = CreateTarget(
    Plane=pln,
    RobConf=list_2,
    Motion=list_3,
    Speed=Slider(200, range=0..1500),
    Zone=Slider(5, range=0..10),
    IsCartesian=True)
program = CreateProgram(Name="DefaultProgram", RobotSystem=load_robot, Targets1=target, StepSize=Slider(10, range=0..10))  # -> simplify(Program), Code, expr("x/60", Duration), Warnings, Errors
sim = ProgramSimulation(Program=program.Program, Time=knob, Normalized=True)  # -> RobotMeshes, JointRotations, Plane, Index, Time, Program, Errors
item = ListItem(List=sim.Plane, Index=0, Wrap=True)  # -> Item1, Item
preview = CustomPreview(Geometry=sim.RobotMeshes, Shader=ColourSwatch(SwatchColor=RGBA(191, 191, 191, 240)))

# ----
errors = Panel(program.Errors)
# ROBOTIC SIMULATION
item_2 = ListItem(List=target, Index=Slider(61, range=0..100), Wrap=True)
K = Kinematics(RobotSystem=load_robot, Target=item_2, DisplayGeometry=False)  # -> Meshes, Joints, Planes, Errors

# ---- group: TARGET FRAMES
previewtargetframe = BooleanToggle(True)
cluster = Cluster_2(csytem_plane=pln, boolvisulaize=previewtargetframe, visualization_length=Slider(7.958, range=0..400))

# ----
fabrication_time = Panel(program.Duration)
panel_2 = Panel(sim.Plane)
pln_2 = Plane(sim.Plane)

# ---- group: SIMULATION TCP
previewtargetframe_2 = BooleanToggle(True)
cluster_2 = Cluster_2(csytem_plane=item.Item1, boolvisulaize=previewtargetframe_2, visualization_length=Slider(70, range=0..400))

# ---- group: EXPORT PROGRAM
# EXPORT ROBOTIC TOOLPATH
folder = Panel("C:\Users\YOUR_NAME")  # disabled
src_name = Panel("Kuka_Test")  # disabled
saveprog = SaveProgram(Program=program.Program, Folder=folder)  # disabled

# ---- group: TOOLPATH FRAMES
frames = Plane(pln)
preview_2 = CustomPreview(Geometry=frames, Shader=ColourSwatch(SwatchColor=RGB(84, 210, 227)))

# ----
panel_3 = Panel(program.Code)

# ==== cluster Cluster_2
visualization_length = ClusterInput()
csytem_plane = ClusterInput()
boolvisulaize = ClusterInput()

# ----
# RobotBase Frame Preview
number_slider = Slider(2, range=0..5)
cluster = Cluster(csytem=csytem_plane, visualization_length=visualization_length, boolvisulaize=boolvisulaize)  # -> xlines, ylines, zlines
previewlw = CustomPreviewLineweights(Geometry=cluster.ylines, Shader=ColourSwatch(SwatchColor=RGB(98, 255, 0)), Thickness=number_slider)
previewlw_2 = CustomPreviewLineweights(Geometry=cluster.zlines, Shader=ColourSwatch(SwatchColor=RGB(0, 64, 255)), Thickness=number_slider)
previewlw_3 = CustomPreviewLineweights(Geometry=cluster.xlines, Shader=ColourSwatch(SwatchColor=RGB(255, 0, 0)), Thickness=number_slider)

# ==== cluster Cluster
csytem = ClusterInput()
visualization_length = ClusterInput()
csytem_2 = Plane(csytem)
visualization_length_2 = Number(visualization_length)
deplane = DeconstructPlane(Plane=csytem_2)  # -> Origin, XAxis, YAxis, ZAxis
boolvisulaize = ClusterInput()
pt = Point(deplane.Origin)
amp = Amplitude(Vector=deplane.ZAxis, Amplitude=visualization_length_2)
amp_2 = Amplitude(Vector=deplane.YAxis, Amplitude=visualization_length_2)
amp_3 = Amplitude(Vector=deplane.XAxis, Amplitude=visualization_length_2)
addition = Addition(A=pt, B=amp)
addition_2 = Addition(A=pt, B=amp_2)
addition_3 = Addition(A=pt, B=amp_3)

ln = Line(StartPoint=pt, EndPoint=addition)
ln_2 = Line(StartPoint=pt, EndPoint=addition_3)
ln_3 = Line(StartPoint=pt, EndPoint=addition_2)

toggle = BooleanToggle(True)
boolvisulaize_2 = Boolean(boolvisulaize)
dispatch = Dispatch(List=ln_2, DispatchPattern=boolvisulaize_2)  # -> ListA, ListB
dispatch_2 = Dispatch(List=ln_3, DispatchPattern=boolvisulaize_2)  # -> ListA, ListB
dispatch_3 = Dispatch(List=ln, DispatchPattern=boolvisulaize_2)  # -> ListA, ListB
xlines = ClusterOutput(dispatch.ListA)
ylines = ClusterOutput(dispatch_2.ListA)
zlines = ClusterOutput(dispatch_3.ListA)
