# Grasshopper definition trave_irrigidita.gh (Grasshopper 0.9.76)
# plug-ins: Karamba, Kangaroo Components

Z = UnitZ(Factor=expr("-x", Slider(5, range=1..20)))

# ----
# INPUT
lunghezza_trave = Slider(11.518, range=6..13)
distanza_appoggi = Slider(5.941, range=1..6)
altezza_appoggi = Slider(1.4, range=0.5..5)
carico = Slider(24.88, range=0..60)

# ----
# INPUT
lunghezza_trave_2 = Slider(13, range=6..13)
distanza_appoggi_2 = Slider(6, range=1..6)
altezza_appoggi_2 = Slider(1.9, range=0.5..5)
carico_2 = Slider(24.88, range=0..60)

num = Number(altezza_appoggi)
num_2 = Number(distanza_appoggi)
num_3 = Number(lunghezza_trave)
number_slider = Slider(13.7, range=10..20)
number_slider_2 = Slider(2, range=1..2)
expression = Expression(x=number_slider_2, Expression="x-1")
expression_2 = Expression(x=number_slider_2, Expression="x-1")
panel = Panel("""M max_
M min_""")
pt = Point(<point referenced from the Rhino model>)
pt_2 = Point(<point referenced from the Rhino model>)
Z_2 = UnitZ(Factor="-2")
Z_3 = UnitZ(Factor="-2")
xz = XZPlane(Origin=pt)
xz_2 = XZPlane(Origin=pt_2)
move = Move(Geometry=xz_2, Motion=Z_3)  # -> Geometry, Transform

pt_3 = Point(Point(0, 0, 0))
caarico_concentrato = Slider(100, range=0..100)
posizione_del_carico = Slider(15, range=0..30)
X = UnitX(Factor=lunghezza_trave)
move_2 = Move(Geometry=pt_3, Motion=X)  # -> Geometry, Transform
ln = Line(StartPoint=pt_3, EndPoint=move_2.Geometry)
Y = UnitY(Factor=1)
curvepoint = PointOnCurve(ln, parameter=0.5)
circle = CircleCNR(Center=curvepoint, Normal=Y, Radius=expr("x/2", distanza_appoggi))
panel_2 = Panel("""0
3
2
1""")
clx = CurveLine(Curve=circle, Line=ln)  # -> Points, Params, Count
item = ListItem(List=flatten([pt_3, move_2.Geometry, clx.Points]), Index=panel_2, Wrap=True)
pline = PolyLine(Vertices=item, Closed=False)
panel_3 = Panel("""1
2""")
Z_4 = UnitZ(Factor=expr("-x", altezza_appoggi))
number_slider_3 = Slider(10, range=0..10)
crosecrselect = CrossSectionRangeSelectorKaramba(MaximumHeight_cm=-1, MaximumWidth_cm=-1, menu=[dropdown(0), dropdown(1), dropdown(3)])
cross_sections = CrossSectionsKaramba(Diameter_cm=number_slider, WallThickness_cm=0.4, mode="Circular Hollow")
crosecselect = CrossSectionSelectorKaramba(ElementsIdentifiers="trave", NameOrListIndexOfCrossSection=Slider(6, range=1..20), CrossSections=crosecrselect)  # -> CrossSection, Info
crosecrselect_2 = CrossSectionRangeSelectorKaramba(MaximumHeight_cm=-1, MaximumWidth_cm=-1, menu=[dropdown(0), dropdown(1), dropdown(3)])
crosecselect_2 = CrossSectionSelectorKaramba(ElementsIdentifiers="traversi", NameOrListIndexOfCrossSection=Slider(5, range=1..20), CrossSections=crosecrselect_2)  # -> CrossSection, Info
modify_crosecs = ModifyCrossSectionsKaramba(CroSec=cross_sections, ElemIds="tirante", mode="Beam")
Z_5 = UnitZ(Factor=expr("-x", carico))
loads = LoadsKaramba(Vector=Z_5, BeamIdentifierS="trave", LCase="0", mode="Uniform Line", menu=[buttons(on, off, off)])
Z_6 = UnitZ(Factor=expr("-x", caarico_concentrato))
range = Range(Domain=Domain(0, 1), Steps=Slider(10, range=0..10))
gradient = Gradient(
    LowerLimit=0,
    UpperLimit=1,
    Parameter=range,
    stops=[0: RGB(234, 38, 0), 0.25: RGB(234, 126, 0), 0.5: RGB(254, 244, 84), 0.75: RGB(173, 203, 249), 1: RGB(75, 107, 169)])

move_3 = Move(Geometry=pt_3, Motion=Z)  # -> Geometry, Transform
num_4 = Number(posizione_del_carico)

# ----
# nodi superiori
pt_4 = Point(item)

# ----
# trave superiore
explode = Explode(Curve=pline, Recursive=True)  # -> Segments, Vertices

caarico_concentrato_2 = Slider(100, range=0..100)
posizione_del_carico_2 = Slider(15, range=0..30)
pt_5 = Point(move_3.Geometry)
X_2 = UnitX(Factor=num_3)
move_4 = Move(Geometry=pt_5, Motion=X_2)  # -> Geometry, Transform
ln_2 = Line(StartPoint=pt_5, EndPoint=move_4.Geometry)
Y_2 = UnitY(Factor=1)
curvepoint_2 = PointOnCurve(ln_2, parameter=0.5)
circle_2 = CircleCNR(Center=curvepoint_2, Normal=Y_2, Radius=expr("x/2", num_2))
panel_4 = Panel("""0
3
2
1""")
clx_2 = CurveLine(Curve=circle_2, Line=ln_2)  # -> Points, Params, Count
item_2 = ListItem(List=flatten([pt_5, move_4.Geometry, clx_2.Points]), Index=panel_4, Wrap=True)
pline_2 = PolyLine(Vertices=item_2, Closed=False)
panel_5 = Panel("""1
2""")
Z_7 = UnitZ(Factor=expr("-x", num))
crosecrselect_3 = CrossSectionRangeSelectorKaramba(MaximumHeight_cm=-1, MaximumWidth_cm=-1, menu=[dropdown(0), dropdown(1), dropdown(3)])
cross_sections_2 = CrossSectionsKaramba(Diameter_cm=number_slider, WallThickness_cm=0.4, mode="Circular Hollow")
crosecselect_3 = CrossSectionSelectorKaramba(ElementsIdentifiers="trave", NameOrListIndexOfCrossSection=Slider(6, range=1..20), CrossSections=crosecrselect_3)  # -> CrossSection, Info
crosecrselect_4 = CrossSectionRangeSelectorKaramba(MaximumHeight_cm=-1, MaximumWidth_cm=-1, menu=[dropdown(0), dropdown(1), dropdown(3)])
crosecselect_4 = CrossSectionSelectorKaramba(ElementsIdentifiers="traversi", NameOrListIndexOfCrossSection=Slider(5, range=1..20), CrossSections=crosecrselect_4)  # -> CrossSection, Info
modify_crosecs_2 = ModifyCrossSectionsKaramba(CroSec=cross_sections_2, ElemIds="tirante", mode="Beam")
Z_8 = UnitZ(Factor=expr("-x", carico_2))
loads_2 = LoadsKaramba(Vector=Z_8, BeamIdentifierS="trave", LCase="0", mode="Uniform Line", menu=[buttons(on, off, off)])
Z_9 = UnitZ(Factor=expr("-x", caarico_concentrato_2))
range_2 = Range(Domain=Domain(0, 1), Steps=Slider(10, range=0..10))
gradient_2 = Gradient(
    LowerLimit=0,
    UpperLimit=1,
    Parameter=range_2,
    stops=[0: RGB(234, 38, 0), 0.25: RGB(234, 126, 0), 0.5: RGB(254, 244, 84), 0.75: RGB(173, 203, 249), 1: RGB(75, 107, 169)])

# ----
# nodi superiori
pt_6 = Point(item_2)

# ----
# trave superiore
explode_2 = Explode(Curve=pline_2, Recursive=True)  # -> Segments, Vertices

item_3 = ListItem(List=pt_4, Index=panel_3, Wrap=True)
move_5 = Move(Geometry=item_3, Motion=Z_4)  # -> Geometry, Transform
divide = DivideCurve(Curve=explode.Segments, Count="10", Kinks=False)  # -> Points, Tangents, Parameters
duppt = RemoveDuplicatePts(Points=flatten(divide.Points), Tolerance=0.01)
pline_3 = PolyLine(Vertices=divide.Points, Closed=False)
explode_3 = Explode(Curve=pline_3, Recursive=True)  # -> Segments, Vertices
linetobeam = LineToBeamKaramba(Line=explode_3.Segments, New=True, Remove=True, LimitDistance_m=0.005, BeamIdentifier=graft("trave"))  # -> Points, Element, Info
item_4 = ListItem(List=linetobeam.Points, Index=0, Wrap=True)  # -> Item1, Item
supp = SupportKaramba(PosInd=[item_4.Item, item_4.Item1], menu=[buttons(on, on, on, on, off, on)])
item_5 = ListItem(List=duppt, Index=posizione_del_carico, Wrap=True)
loads_3 = LoadsKaramba(ForceVector=Z_6, Local=True, PosInd=item_5, LCase="1", mode="Point")

# ----
# nodi inferiori
pt_7 = Point([pt_3, move_5.Geometry, move_2.Geometry])

# ----
# traversi
ln_3 = Line(StartPoint=item_3, EndPoint=move_5.Geometry)

item_6 = ListItem(List=pt_6, Index=panel_5, Wrap=True)
move_6 = Move(Geometry=item_6, Motion=Z_7)  # -> Geometry, Transform
divide_2 = DivideCurve(Curve=explode_2.Segments, Count="10", Kinks=False)  # -> flatten(Points), Tangents, Parameters
duppt_2 = RemoveDuplicatePts(Points=divide_2.Points, Tolerance=0.01)
pline_4 = PolyLine(Vertices=duppt_2, Closed=False)
explode_4 = Explode(Curve=pline_4, Recursive=True)  # -> Segments, Vertices
linetobeam_2 = LineToBeamKaramba(Line=explode_4.Segments, New=True, Remove=True, LimitDistance_m=0.005, BeamIdentifier="trave")  # -> Points, Element, Info
item_7 = ListItem(List=linetobeam_2.Points, Index=0, Wrap=True)  # -> Item1, Item
supp_2 = SupportKaramba(PosInd=[item_7.Item, item_7.Item1], menu=[buttons(on, on, on, on, off, on)])
item_8 = ListItem(List=duppt_2, Index=num_4, Wrap=True)
loads_4 = LoadsKaramba(ForceVector=Z_9, Local=True, PosInd=item_8, LCase="1", mode="Point")

# ----
# nodi inferiori
pt_8 = Point([pt_5, move_6.Geometry, move_4.Geometry])

# ----
# traversi
ln_4 = Line(StartPoint=item_6, EndPoint=move_6.Geometry)

pline_5 = PolyLine(Vertices=pt_7, Closed=False)
linetobeam_3 = LineToBeamKaramba(Line=ln_3, New=True, Remove=True, LimitDistance_m=0.005, BeamIdentifier="traversi")  # -> Points, Element, Info
modifyelem = ModifyElementKaramba(Beam=linetobeam_3.Element, Bending=False, mode="Beam")

# ----
# tirante
explode_5 = Explode(Curve=pline_5, Recursive=True)  # -> Segments, Vertices

linetobeam_4 = LineToBeamKaramba(Line=explode_5.Segments, New=True, Remove=True, LimitDistance_m=0.005, BeamIdentifier="tirante")  # -> Points, Element, Info
pt_9 = Point(flatten([linetobeam_3.Points, linetobeam_4.Points, linetobeam.Points]))
duppt_3 = RemoveDuplicatePts(Points=pt_9, Tolerance=0.01)
modifyelem_2 = ModifyElementKaramba(Beam=linetobeam_4.Element, Bending=False, mode="Beam")
supp_3 = SupportKaramba(PosInd=duppt_3, menu=[buttons(off, on, off, on, off, on)])
assemble = AssembleModelKaramba(
    Elem=flatten([linetobeam.Element, modifyelem_2, modifyelem]),
    Support=flatten([supp_3, supp]),
    Load=flatten([loads, loads_3]),
    CrossSection=flatten([crosecselect.CrossSection, modify_crosecs, crosecselect_2.CrossSection]),
    LimitDistance_m=0.005)  # -> Model, Info, Mass_kg, CenterOfGravity
analyzethi = AnalyzeThIKaramba(Model=assemble.Model)  # -> CalculatedModel, MaximumDisplacement_m, ResultingForceOfGravity_kN, ElasticEnergy_kNm
modelview = ModelViewKaramba(
    Model=analyzethi.CalculatedModel,
    LoadCaseFactorsForLinearSuperposition=1,
    IndexIncrementOfVisibleLoadcase=number_slider_2,
    ListOfColorsForColoringPlots=reverse(gradient))  # -> Model, DeformedMesh, DeformedAxes, DeformedModel
beamview = BeamViewKaramba(Model=modelview.Model)  # -> Model, MeshesOfRenderedBeams, DeformedBeamAxes, LegendColors, LegendTags

b_forces = BeamForcesKaramba(
    AnalyzedModel=beamview.Model,
    BeamIdentifiers="trave",
    LCase=-1,
    MaximumDistanceBetweenResults_m=-1,
    NumberOfResultsPerBeamElement=2)  # -> AnalyzedModel, NormalForce_kN, ShearForceVz_kN, ShearForceVy_kN, BendingMomentMt_kNm, simplify(BendingMomentMy_kNm), BendingMomentMz_kNm
b_res_force = BeamResultantForcesKaramba(
    AnalyzedModel=beamview.Model,
    BeamIdentifiers="trave",
    LoadCase=-1,
    MaximumProbingDistance_m=-1,
    NumberOfProbingPointsPerElement=3)  # -> AnalyzedModel, NormalForce_kN, simplify(ResultantBendingMoment_kNm), ResultantShearForce_kN
trim = TrimTree(Tree=b_forces.BendingMomentMy_kNm, Depth=1)
branch = TreeBranch(Tree=trim, Path=expression_2, MaintainPaths=True)
bnd = Bounds(Numbers=branch)
dedomain = DeconstructDomain(Domain=bnd)  # -> Start, End
concat = Concatenate(FragmentA=graft(panel), FragmentB=graft([dedomain.Start, dedomain.End]), FragmentC=" kNm")
tag = TextTag3D(
    Location=graft([xz_2, move.Geometry]),
    Text=concat,
    Size=Slider(0.46, range=0.1..1),
    Colour=ColourSwatch(SwatchColor=RGB(255, 255, 255)),
    Justification=7)

pline_6 = PolyLine(Vertices=pt_8, Closed=False)
linetobeam_5 = LineToBeamKaramba(Line=ln_4, New=True, Remove=True, LimitDistance_m=0.005, BeamIdentifier="traversi")  # -> Points, Element, Info
modifyelem_3 = ModifyElementKaramba(Beam=linetobeam_5.Element, Bending=False, mode="Beam")

# ----
# tirante
explode_6 = Explode(Curve=pline_6, Recursive=True)  # -> Segments, Vertices

linetobeam_6 = LineToBeamKaramba(Line=explode_6.Segments, New=True, Remove=True, LimitDistance_m=0.005, BeamIdentifier="tirante")  # -> Points, Element, Info
pt_10 = Point(flatten([linetobeam_5.Points, linetobeam_6.Points, linetobeam_2.Points]))
duppt_4 = RemoveDuplicatePts(Points=pt_10, Tolerance=0.01)
modifyelem_4 = ModifyElementKaramba(Beam=linetobeam_6.Element, Bending=False, mode="Beam")
supp_4 = SupportKaramba(PosInd=duppt_4, menu=[buttons(off, on, off, on, off, on)])
assemble_2 = AssembleModelKaramba(
    Elem=flatten([linetobeam_2.Element, modifyelem_4, modifyelem_3]),
    Support=flatten([supp_4, supp_2]),
    Load=flatten([loads_2, loads_4]),
    CrossSection=flatten([crosecselect_3.CrossSection, modify_crosecs_2, crosecselect_4.CrossSection]),
    LimitDistance_m=0.005)  # -> Model, Info, Mass_kg, CenterOfGravity
analyzethi_2 = AnalyzeThIKaramba(Model=assemble_2.Model)  # -> CalculatedModel, MaximumDisplacement_m, ResultingForceOfGravity_kN, ElasticEnergy_kNm
modelview_2 = ModelViewKaramba(
    Model=analyzethi_2.CalculatedModel,
    LoadCaseFactorsForLinearSuperposition=1,
    IndexIncrementOfVisibleLoadcase=number_slider_2,
    ListOfColorsForColoringPlots=reverse(gradient_2))  # -> Model, DeformedMesh, DeformedAxes, DeformedModel
beamview_2 = BeamViewKaramba(Model=modelview_2.Model)  # -> Model, MeshesOfRenderedBeams, DeformedBeamAxes, LegendColors, LegendTags

panel_6 = Panel(analyzethi_2.MaximumDisplacement_m)
item_9 = ListItem(List=analyzethi_2.MaximumDisplacement_m, Index=expression, Wrap=True)
multiplication = Multiplication(A=item_9, B=Slider(100, range=0..100))
concat_2 = Concatenate(FragmentA=graft("displacement Max_"), FragmentB=graft(multiplication), FragmentC=" cm")
tag_2 = TextTag3D(
    Location=graft(xz),
    Text=concat_2,
    Size=Slider(0.46, range=0.1..1),
    Colour=ColourSwatch(SwatchColor=RGB(255, 255, 255)),
    Justification=7)
