# Grasshopper definition isoMesh.gh (Grasshopper 1.0.7)
# plug-ins: MeshEdit Components, Millipede, Weaverbird

msphere = MeshSphere(Base=PlaneXY(0, 0, 0), Radius=10, UCount=10, VCount=20)
bbox = BoundingBox(Content=msphere, Plane=PlaneXY(0, 0, 0))  # -> Box, Box_2
random = Random(Range=Domain(0, 1), Number="1000", Seed=Slider(6, range=1..10))
iso_surface = IsoSurface(
    Box=bbox.Box,
    Values=random,
    XResolution="10",
    YResolution="10",
    ZResolution="10",
    IsoValue=Slider(0.41, range=0..1),
    MergeVertices=Toggle(True))
wbcatmullclark = WeaverbirdsCatmullClarkSubdivision(MeshCurves=iso_surface, Level="2", SmoothNakedEdges=1)
wbloop = WeaverbirdsLoopSubdivision(MeshCurves=iso_surface, Level="2", SmoothNakedEdges=1)

dots = DotDisplay(Colour=RGB(0, 0, 0), Size=1)
disjoint = DisjointMesh(Mesh=wbloop)
area = MeshArea(Mesh=disjoint)  # -> Area, Centroid
sort = SortList(Keys=area.Area, ValuesA=disjoint)  # -> Keys, reverse(ValuesA)
item = ListItem(List=sort.ValuesA, Index=0, Wrap=True)
medges = MeshEdges(Mesh=item)  # -> NakedEdges, InteriorEdges, NonManifoldEdges
swatch = ColourSwatch(SwatchColor=RGB(255, 255, 255))
vec = VectorXYZ(XComponent=0, YComponent=0, ZComponent=Slider(0.845, range=0..1))  # -> Vector, Length
normshade = NormalShader(
    mesh=item,
    direction=vec.Vector,
    color=ColourSwatch(SwatchColor=RGB(0, 0, 0)),
    intensity=Slider(0.44, range=0..1),
    Reference="C:\USERS\MARCO\DESKTOP\old personal google drive\AA_Aarhus_Workshop_Folder\Grasshopper Resources\Libraries\SpatialSlur.dll")  # -> out, result; inputs mesh: Mesh, direction: Vector3d, color: Color, intensity: Double
# ---------- normshade: C# ----------
    if(mesh.Normals.Count != mesh.Vertices.Count)
      mesh.Normals.ComputeNormals();

    if(mesh.VertexColors.Count != mesh.Vertices.Count)
      mesh.VertexColors.CreateMonotoneMesh(Color.White);

    NormalShader(mesh, direction, color, intensity);
    result = mesh;
# ---------- normshade: C# additional code ----------
  //
  void NormalShader(Mesh mesh, Vector3d direction, Color color, double intensity)
  {
    if(!direction.Unitize())
      throw new System.ArgumentException("the direction vector cannot be zero length");

    Color[] vc = mesh.VertexColors.ToArray();

    var chunks = System.Collections.Concurrent.Partitioner.Create(0, mesh.Vertices.Count);
    System.Threading.Tasks.Parallel.ForEach(chunks, range =>
      {
      for (int i = range.Item1; i < range.Item2; i++)
      {
        double t = direction * mesh.Normals[i] * 0.5 + 0.5;
        vc[i] = vc[i].LerpTo(color, t * intensity);
      }
      });

    mesh.VertexColors.SetColors(vc);
  }
# ---------- end normshade ----------
displaycrv = DisplayCurve(curve=medges.NakedEdges, color=ColourSwatch(SwatchColor=RGB(0, 0, 0)), weight=Slider(5, range=1..10))  # -> out; inputs curve: Curve, color: Color, weight: Int32
# ---------- displaycrv: C# ----------
    // silently skip null curves
    if(curve == null) return;

    // add to display cache
    _curves.Add(curve);
    _colors.Add(color);
    _weights.Add(weight);
    _clippingBox.Union(curve.GetBoundingBox(false));
# ---------- displaycrv: C# additional code ----------
  List<Curve> _curves;
  List<Color> _colors;
  List<int> _weights;
  BoundingBox _clippingBox;


  /// <summary>
  /// This method will be called once every solution, before any calls to RunScript.
  /// </summary>
  public override void BeforeRunScript()
  {
    _curves = new List<Curve>();
    _colors = new List<Color>();
    _weights = new List<int>();
    _clippingBox = new BoundingBox();
  }


  //
  public override BoundingBox ClippingBox
  {
    get{return _clippingBox;}
  }


  //
  public override void DrawViewportWires(IGH_PreviewArgs args)
  {
    base.DrawViewportWires(args);

    for(int i = 0; i < _curves.Count; i++)
      args.Display.DrawCurve(_curves[i], _colors[i], _weights[i]);
  }
# ---------- end displaycrv ----------
