# Grasshopper definition Gridshell.gh (Grasshopper 1.0.7)
# plug-ins: K2Engineering, treesloth01, Human, Weaverbird, Kangaroo2 Components

# ---- group: 4 x 5 m gridshell polylines
# K2ENGINEERING - GRIDSHELL
dir0_polylines = Curve([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])
dir1_polylines = Curve([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])

# ----
item = ListItem(List=reverse(dir0_polylines), Index=0, Wrap=True)
item_2 = ListItem(List=dir0_polylines, Index=0, Wrap=True)
end = EndPoints(Curve=[item_2, item])  # -> Start, End
pt = Point(flatten([end.Start, end.End]))
axial = Slider(5000, range=0..5000)
bending = Slider(100, range=0..100)
number_slider = Slider(0, range=0..100)
avr = Average(Input=pt)

# ---- group: Set to 0.0 before running simulation
number_slider_2 = Slider(0.36, range=0..1)

# ----
explode = Explode(Curve=dir0_polylines, Recursive=True)  # -> Segments, Vertices
explode_2 = Explode(Curve=dir1_polylines, Recursive=True)  # -> Segments, Vertices
vec2pt = Vector2Pt(PointA=pt, PointB=avr, Unitize=False)  # -> Vector, Length
dir_0 = Curve(simplify(explode.Segments))
dir_1 = Curve(simplify(explode_2.Segments))
multiplication = Multiplication(A=vec2pt.Vector, B=number_slider_2)
lng = ListLength(List=dir_1)  # -> expr("X-1", Length)
lng_2 = ListLength(List=dir_0)  # -> expr("X-1", Length)
move = Move(Geometry=pt, Motion=multiplication)  # -> Geometry, Transform
duppt = RemoveDuplicatePts(Points=flatten(explode_2.Vertices), Tolerance=0.01)
shift = ShiftList(List=dir_0, Shift=1, Wrap=False)
shift_2 = ShiftList(List=dir_1, Shift=1, Wrap=False)
cull_i = CullIndex(List=dir_1, Indices=lng, Wrap=False)
cull_i_2 = CullIndex(List=dir_0, Indices=lng_2, Wrap=False)
Z = UnitZ(Factor=Slider(0.1, range=0..0.1))
pt_2 = Point(duppt)
anchor = Anchor(Point=pt, Target=move.Geometry, Strength="1e5")
angle = Angle(LineA=cull_i, LineB=shift_2, RestAngle=number_slider, Strength=bending)
angle_2 = Angle(LineA=cull_i_2, LineB=shift, RestAngle=number_slider, Strength=bending)
length_line = LengthLine(Line=dir_1, Strength=axial)
length_line_2 = LengthLine(Line=dir_0, Strength=axial)
show = Show(G=move.Geometry)
# Small upwards load
load = Load(Point=pt_2, ForceVector=Z)
entwine = Entwine(
    Branch00=show,
    Branch01=anchor,
    Branch02=length_line_2,
    Branch03=angle_2,
    Branch04=length_line,
    Branch05=angle,
    Branch06=load,
    FlattenInputs=True)
solver = Solver(GoalObjects=entwine, Reset=Button(), Threshold="1e-15", Tolerance=0.01, On=Toggle(True))  # -> I, V, O; disabled
bouncysolver = BouncySolver(GoalObjects=entwine, Reset=Button(), Threshold=1e-15, Tolerance=0.01, Damping="0.99", Iterations="8", On=Toggle(False))  # -> I, V, O
unflatten = UnflattenTree(Tree=bouncysolver.O, Guide=entwine)
bang = ExplodeTree(Data=unflatten)  # -> Branch0, Branch1, Branch2, Branch3, Branch4, Branch5, Branch6
number_slider_3 = Slider(360, range=0..1000)
larger = LargerThan(FirstNumber=bouncysolver.I, SecondNumber="1500")  # -> LargerThan, OrEqualTo
dir_0_2 = Curve(bang.Branch2)
dir_1_2 = Curve(bang.Branch4)
remap = RemapNumbers(Value=bouncysolver.I, Source="1500", Target=number_slider_3)  # -> Mapped, Clipped
panel = Panel(bouncysolver.I)
filter = StreamFilter(Gate=larger.LargerThan, Stream0=remap.Mapped, Stream1=number_slider_3)
explode_3 = Explode(Curve=dir_0_2, Recursive=True)  # -> Segments, Vertices
avr_2 = Average(Input=flatten(explode_3.Vertices))
rotate = Rotate(Geometry=dir_0_2, Angle=degrees(filter), Plane=avr_2)  # -> Geometry, Transform
rotate_2 = Rotate(Geometry=dir_1_2, Angle=degrees(filter), Plane=avr_2)  # -> Geometry, Transform
rotate_3 = Rotate(Geometry=bang.Branch0, Angle=degrees(filter), Plane=avr_2)  # -> Geometry, Transform
unflatten_2 = UnflattenTree(Tree=rotate.Geometry, Guide=dir_0)
unflatten_3 = UnflattenTree(Tree=rotate_2.Geometry, Guide=dir_1)
supports = Point(rotate_3.Geometry)

structural_analysis = BooleanToggle(True)
filter_2 = StreamFilter(Gate=structural_analysis, Stream1=supports)
filter_3 = StreamFilter(Gate=structural_analysis, Stream1=unflatten_2)
filter_4 = StreamFilter(Gate=structural_analysis, Stream1=unflatten_3)

previewlw = CustomPreviewLineweights(
    Geometry=[unflatten_2, unflatten_3],
    Shader=ColourSwatch(SwatchColor=RGB(255, 255, 255)),
    Thickness=Slider(3, range=1..10),
    Absolute=False)

pt_3 = Point(filter_2)
support = Support(PinnedSupportPt=pt_3, XFixed=True, YFixed=True, ZFixed=True, Strength=1e+15)

structural_analysis_2 = BooleanToggle(False)

dir0 = Curve(filter_3)
dir1 = Curve(filter_4)
mat = Materials(MaterialIndex=Slider(4, range=0..7))  # -> MaterialName, Density, YoungsModulus, ShearModulus, Strength
circle = CircularCS(Diameter=Slider(14, range=0..100))  # -> A, I, Z, It
panel_2 = Panel(mat.MaterialName)

divide = DivideCurve(Curve=dir0, Count="5", Kinks=False)  # -> Points, Tangents, Parameters
pline = PolyLine(Vertices=divide.Points, Closed=False)
divide_2 = DivideCurve(Curve=dir1, Count="5", Kinks=False)  # -> Points, Tangents, Parameters

wbweave = WeaverbirdsMeshFromLinesWeaveBack(Lines=flatten([dir0, dir1]), MaximumValence=4)
wbfacepolys = WeaverbirdsFacePolylines(Mesh=wbweave)
explode_4 = Explode(Curve=wbfacepolys, Recursive=True)  # -> Segments, Vertices
duppt_2 = RemoveDuplicatePts(Points=explode_4.Vertices, Tolerance=0.01)
item_3 = ListItem(List=duppt_2, Index=0, Wrap=True)  # -> Item, Item1, Item2, Item3
ln = Line(StartPoint=item_3.Item, EndPoint=item_3.Item2)
ln_2 = Line(StartPoint=item_3.Item1, EndPoint=item_3.Item3)
cross_bracing = Curve(flatten([ln, ln_2]))
mat_2 = Materials(MaterialIndex=Slider(0, range=0..7))  # -> MaterialName, Density, YoungsModulus, ShearModulus, Strength
circle_2 = CircularCS(Diameter=Slider(3, range=0..10))  # -> A, I, Z, It
panel_3 = Panel(mat_2.MaterialName)
cable = Cable(Line=cross_bracing, EModulus=mat_2.YoungsModulus, Area=circle_2.A, PreTension="1000")

explode_5 = Explode(Curve=pline, Recursive=True)  # -> Segments, Vertices
shift_3 = ShiftPaths(Data=simplify(explode_5.Segments), Offset=-1)

# ---- group: Selfweight cables
cables = Curve(flatten(cross_bracing))
blength = BarLength(Bars=cables)  # -> Points, NodalLengths
bselfweight = BarSelfweight(NodalLengths=blength.NodalLengths, CrossSectionArea=circle_2.A, MaterialDensity=mat_2.Density)
ma = MassAddition(Input=bselfweight)  # -> Result, PartialResults
load_2 = Load(Point=blength.Points, NodalForce=bselfweight)
vdis = VectorDisplay(Anchor=blength.Points, Vector=expr("X*0.5", bselfweight))
vlen = VectorLength(Vector=ma.Result)
num = Number(expr("X/9.82", vlen))
mass_kg = Panel(num)

# ----
pline_2 = PolyLine(Vertices=divide_2.Points, Closed=False)

# ---- group: Selfweight rods
rods = Curve(flatten([filter_3, filter_4]))
blength_2 = BarLength(Bars=rods)  # -> Points, NodalLengths
bselfweight_2 = BarSelfweight(NodalLengths=blength_2.NodalLengths, CrossSectionArea=circle.A, MaterialDensity=mat.Density)
ma_2 = MassAddition(Input=bselfweight_2)  # -> Result, PartialResults
vdis_2 = VectorDisplay(Anchor=blength_2.Points, Vector=expr("X*0.5", bselfweight_2))
load_3 = Load(Point=blength_2.Points, NodalForce=bselfweight_2)
vlen_2 = VectorLength(Vector=ma_2.Result)
num_2 = Number(expr("X/9.82", vlen_2))
mass_kg_2 = Panel(num_2)

# ----
explode_6 = Explode(Curve=pline_2, Recursive=True)  # -> Segments, Vertices
shift_4 = ShiftPaths(Data=simplify(explode_6.Segments), Offset=-1)

lng_3 = ListLength(List=shift_4)  # -> expr("X-1", Length)
lng_4 = ListLength(List=shift_3)  # -> expr("X-1", Length)
shift_5 = ShiftList(List=shift_4, Shift=1, Wrap=False)
cull_i_3 = CullIndex(List=shift_4, Indices=lng_3, Wrap=False)
shift_6 = ShiftList(List=shift_3, Shift=1, Wrap=False)
cull_i_4 = CullIndex(List=shift_3, Indices=lng_4, Wrap=False)
rod = Rod(
    LineA=cull_i_3,
    LineB=shift_5,
    EModulus=mat.YoungsModulus,
    Inertia=circle.I,
    ZDistance=circle.Z,
    RestAngleOption=Slider(0, range=0..1))
rod_2 = Rod(
    LineA=cull_i_4,
    LineB=shift_6,
    EModulus=mat.YoungsModulus,
    Inertia=circle.I,
    ZDistance=circle.Z,
    RestAngleOption=Slider(0, range=0..1))
bar = Bar(Line=shift_4, EModulus=mat.YoungsModulus, Area=circle.A)
bar_2 = Bar(Line=shift_3, EModulus=mat.YoungsModulus, Area=circle.A)

end_2 = EndPoints(Curve=[shift_3, shift_4])  # -> Start, End
duppt_3 = RemoveDuplicatePts(Points=flatten([end_2.Start, end_2.End]), Tolerance=0.01)
allpts = Point(duppt_3)
show_2 = Show(G=allpts)

entwine_2 = Entwine(
    Branch00=show_2,
    Branch01=support,
    Branch02=bar_2,
    Branch03=rod_2,
    Branch04=bar,
    Branch05=rod,
    Branch06=cable,
    Branch07=[load_3, load_2],
    FlattenInputs=True)
solver_2 = Solver(GoalObjects=entwine_2, Reset=Button(), Threshold="1e-17", Tolerance=0.01, On=structural_analysis_2)  # -> I, V, O
unflatten_4 = UnflattenTree(Tree=solver_2.O, Guide=entwine_2)
bang_2 = ExplodeTree(Data=unflatten_4)  # -> Branch0, Branch1, Branch2, Branch3, Branch4, Branch5, Branch6, Branch7

# ---- group: Dir1 forces
number_slider_4 = Slider(0.5, range=0..10)
baroutput = BarOutput(BarData=bang_2.Branch4)  # -> Line, AxialForce, AxialStress
rodoutput = RodOutput(RodData=bang_2.Branch5)  # -> Plane, BendingMoment, BendingStress

# ---- group: Dir0 forces
number_slider_5 = Slider(0.5, range=0..10)
baroutput_2 = BarOutput(BarData=bang_2.Branch2)  # -> Line, AxialForce, AxialStress
rodoutput_2 = RodOutput(RodData=bang_2.Branch3)  # -> Plane, BendingMoment, BendingStress

# ---- group: Reactions
supportoutput = SupportOutput(SupportData=bang_2.Branch1)  # -> SupportPt, ReactionForce; disabled
number_slider_6 = Slider(0.1, range=0..1)  # disabled
vdis_3 = VectorDisplay(Anchor=supportoutput.SupportPt, Vector=supportoutput.ReactionForce)  # disabled
expression = Expression(x=supportoutput.ReactionForce, Expression="Round(x,2)")  # disabled
swatch = ColourSwatch(SwatchColor=RGB(0, 0, 0))  # disabled
xz = XZPlane(Origin=supportoutput.SupportPt)  # disabled
tag = TextTag3D(Location=xz, Text=expression, Size=number_slider_6, Colour=swatch, Justification=5)  # disabled

# ---- group: Cables forces
baroutput_3 = BarOutput(BarData=bang_2.Branch6)  # -> Line, AxialForce, AxialStress

# ----
bendingdisplay = BendingVisualisation(BendingPlanes=rodoutput.Plane, BendingMoments=rodoutput.BendingMoment, ScaleFactor=number_slider_4)
bendingdisplay_2 = BendingVisualisation(BendingPlanes=rodoutput_2.Plane, BendingMoments=rodoutput_2.BendingMoment, ScaleFactor=number_slider_5)
loadoutput = LoadOutput(LoadData=bang_2.Branch7)  # -> Position, Load
ma_3 = MassAddition(Input=supportoutput.ReactionForce)  # -> Result, PartialResults; disabled
panel_4 = Panel(ma_3.Result)
entwine_3 = Entwine(Branch00=baroutput_2.Line, Branch01=baroutput.Line, Branch02=baroutput_3.Line, FlattenInputs=True)  # -> flatten(Result)

# ---- group: Displacements
range = Range(Domain=Domain(0, 1), Steps=20)  # disabled
gradient = Gradient(LowerLimit=0, UpperLimit=1, Parameter=range, stops=[0: RGB(0, 128, 0), 0.5: RGB(255, 255, 0), 1: RGB(255, 0, 0)])  # disabled
displ = Displacements(InitialPositions=allpts, FinalPositions=bang_2.Branch0)  # -> TotalDisplacements, MaximumDisplacementX, MaximumDisplacementY, MaximumDisplacementZ; disabled
vlen_3 = VectorLength(Vector=displ.TotalDisplacements)  # disabled
panel_5 = Panel(displ.MaximumDisplacementZ)  # disabled
displvis = DisplacementVisualisation(Lines=entwine_3, DisplacedNodes=bang_2.Branch0, Displacement=vlen_3, ColourRange=gradient)  # disabled

# ----
entwine_4 = Entwine(Branch00=baroutput_2.AxialForce, Branch01=baroutput.AxialForce, Branch02=baroutput_3.AxialForce, FlattenInputs=True)  # -> flatten(Result)
entwine_5 = Entwine(Branch00=rodoutput_2.BendingStress, Branch01=rodoutput.BendingStress, FlattenInputs=True)  # -> flatten(Result)
ma_4 = MassAddition(Input=loadoutput.Load)  # -> Result, PartialResults
panel_6 = Panel(ma_4.Result)  # disabled
sort = SortList(Keys=entwine_5)  # -> reverse(Keys), ValuesA
preview = CustomPreview(Geometry=entwine_3, Shader=ColourSwatch(SwatchColor=RGB(0, 0, 0)))
pdecon = Deconstruct(Point=ma_4.Result)  # -> XComponent, YComponent, expr("Round(-x*100,2)", ZComponent)
item_4 = ListItem(List=sort.Keys, Index=0, Wrap=True)
num_3 = Number(expr("X*1e3", entwine_4))
max_bending_stress_mpa = Panel(item_4)
axialdisplay = AxialVisualisation(Line=entwine_3, AxialForces=num_3, ThicknessMax=Slider(10, range=0..100))
