# Grasshopper definition Fractured Sphere.gh (Grasshopper 1.0.7)
# plug-ins: Anemone, Weaverbird

wbdodecahedron = WeaverbirdsPolylinesDodecahedron(Plane=PlaneXY(0, 0, 0), Radius=5)
boundary = BoundarySurfaces(Edges=wbdodecahedron)
join = BrepJoin(Breps=boundary)  # -> Breps, Closed
swatch = ColourSwatch(SwatchColor=RGB(255, 255, 255))
swatch_2 = ColourSwatch(SwatchColor=RGB(255, 0, 0))
swatch_3 = ColourSwatch(SwatchColor=RGB(212, 255, 0))
md_slider = MDSlider(SliderMode=0, slider_value=Point(0.5, 0.5, 0.5), x_domain=Domain(0, 1), y_domain=Domain(0, 1), z_domain=Domain(0, 1))
X = UnitX(Factor=1)

xy = XYPlane(Origin=Point(0, 0, 0))
sph = Sphere(Base=PlaneXY(0, 0, 0), Radius="5")
planesrf = PlaneSurface(Plane=xy, XSize=Domain(-10, 10), YSize=Domain(-10, 10))
srf = Surface(planesrf)
md_slider_2 = MDSlider(SliderMode=0, slider_value=Point(0.5, 0.5, 0.5), x_domain=Domain(0, 1), y_domain=Domain(0, 1), z_domain=Domain(0, 1))
panel = Panel("45")

box = DomainBox(Base=PlaneXY(0, 0, 0), X="5", Y="5", Z="5")
preview = CustomPreview(Geometry=sph, Material=ColourSwatch(SwatchColor=RGB(212, 255, 0)))
brep = Brep(sph)

loop_start = LoopStart(N="10", D0=brep, D1=srf)  # -> port, Counter, Data, Data_2
split = SplitBrep(Brep=loop_start.Data, Cutter=loop_start.Data_2)
evalsrf = EvaluateSurface(Surface=loop_start.Data_2, Point=md_slider_2)  # -> Point, Normal, UDirection, VDirection, Frame
pl = PlaneNormal(Origin=evalsrf.Point, ZAxis=evalsrf.Normal)
deplane = DeconstructPlane(Plane=pl)  # -> Origin, XAxis, YAxis, ZAxis
multiplication = Multiplication(A=deplane.XAxis, B="0.50")
move = Move(Geometry=pl, Motion=multiplication)  # -> Geometry, Transform
deplane_2 = DeconstructPlane(Plane=pl)  # -> Origin, XAxis, YAxis, ZAxis
line = LineSDL(Start=deplane_2.Origin, Direction=deplane_2.XAxis, Length=1)

cap = CapHoles(Brep=split)
random = Random(Range="0 to 360", Number=1, Seed=loop_start.Counter)

area = Area(Geometry=cap)  # -> Area, Centroid
srf_cp = SurfaceClosestPoint(Point=area.Centroid, Surface=loop_start.Data_2)  # -> Point, UVPoint, Distance
vec2pt = Vector2Pt(PointA=srf_cp.Point, PointB=area.Centroid, Unitize=False)  # -> Vector, Length
dprod = DotProduct(VectorA=vec2pt.Vector, VectorB=evalsrf.Normal, Unitize=False)
larger = LargerThan(FirstNumber=dprod, SecondNumber="0")  # -> LargerThan, OrEqualTo
dispatch = Dispatch(List=cap, DispatchPattern=larger.LargerThan)  # -> simplify(ListA), simplify(ListB)
move_2 = Move(Geometry=dispatch.ListA, Motion=multiplication)  # -> Geometry, Transform
merge = Merge(Data1=simplify(dispatch.ListB), Data2=simplify(move_2.Geometry))
rotax = RotateAxis(Geometry=pl, Angle=degrees(random), Axis=line)  # -> Geometry, Transform
planesrf_2 = PlaneSurface(Plane=rotax.Geometry, XSize=Domain(-10, 10), YSize=Domain(-10, 10))
loop_end = LoopEnd(
    port=loop_start.port,
    Exit=False,
    Data=simplify(merge),
    Data_2=planesrf_2,
    TimeOutVal=0,
    pausedState=False,
    state="Constant output")  # -> D0, D1
brep_2 = Brep(simplify(loop_end.D0))

item = ListItem(List=[deplane_2.XAxis, deplane_2.YAxis], Index=random, Wrap=True)
debrep = DeconstructBrep(Brep=brep_2)  # -> Faces, Edges, Vertices
planar = IsPlanar(Surface=debrep.Faces, Interior=invert(True))  # -> Planar, Plane
dispatch_2 = Dispatch(List=debrep.Faces, DispatchPattern=planar.Planar)  # -> ListA, ListB
evalsrf_2 = EvaluateSurface(Surface=dispatch_2.ListA, Point=md_slider)  # -> Point, Normal, UDirection, VDirection, Frame
dprod_2 = DotProduct(VectorA=evalsrf_2.Normal, VectorB=X, Unitize=False)
larger_2 = LargerThan(FirstNumber=dprod_2, SecondNumber="0")  # -> LargerThan, OrEqualTo
dispatch_3 = Dispatch(List=dispatch_2.ListA, DispatchPattern=larger_2.OrEqualTo)  # -> ListA, ListB
preview_2 = CustomPreview(Geometry=dispatch_2.ListB, Material=ColourSwatch(SwatchColor=RGB(255, 255, 255)))
preview_3 = CustomPreview(Geometry=dispatch_3.ListB, Material=ColourSwatch(SwatchColor=RGB(255, 0, 255)))
preview_4 = CustomPreview(Geometry=dispatch_3.ListA, Material=ColourSwatch(SwatchColor=RGB(0, 221, 255)))
