# Grasshopper definition ConceptToFem.gh (Grasshopper 1.0.7)
# plug-ins: MeshEdit Components, treesloth01, Human, Kangaroo2 Components, karambaGH

dpipeline = DynamicGeometryPipeline(
    LayerFilter="Layer 01",
    TypeFilter="Curve",
    NameFilter="*",
    GroupByLayer=False,
    GroupByType=False,
    IncludeHidden=True,
    IncludeLocked=True,
    enableFullPath=False,
    listenToAttributes=True)
bbox = BoundingBox(Content=dpipeline, Plane=PlaneXY(0, 0, 0), UnionBox=True)  # -> Box, Box_2
debox = DeconstructBox(Box=bbox.Box)  # -> Plane, X, Y, Z
dedomain = DeconstructDomain(Domain=debox.X)  # -> Start, End
dedomain_2 = DeconstructDomain(Domain=debox.Y)  # -> Start, End
subtraction = Subtraction(A=dedomain.End, B=dedomain.Start)
subtraction_2 = Subtraction(A=dedomain_2.End, B=dedomain_2.Start)
max = Maximum(A=subtraction, B=subtraction_2)
division = Division(A="20", B=max)
scale = Scale(Geometry=dpipeline, Center=Point(0, 0, 0), Factor=division)  # -> Geometry, Transform
bbox_2 = BoundingBox(Content=scale.Geometry, Plane=PlaneXY(0, 0, 0), UnionBox=True)  # -> Box, Box_2
debrep = DeconstructBrep(Brep=bbox_2.Box)  # -> Faces, Edges, Vertices
join = JoinCurves(Curves=debrep.Edges, Preserve=False)
cpoly = ControlPolygon(Curve=join)  # -> Polygon, Points
pt = ConstructPoint(XCoordinate=0, YCoordinate=0, ZCoordinate=0)
cullpt = CullDuplicates(Points=cpoly.Points, Tolerance=0.1, CullMode=3)  # -> Points, Indices, Valence
sort_pt = SortPoints(Points=cullpt.Points)  # -> Points, Indices
# GH to SVG - components & composer
item = ListItem(List=sort_pt.Points, Index=0, Wrap=True)
xy = XYPlane(Origin=item)
xz = XZPlane(Origin=pt)
orient = Orient(Geometry=scale.Geometry, Source=xy, Target=xz)  # -> Geometry, Transform
objatts = ObjectAttributes(ObjectOrAttributes=dpipeline)  # -> Name, LayerName, LayerFullPath, Color, MaterialName, LinetypeName, GroupIndices, PlotWeight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
cset = CreateSet(List=objatts.Color)  # -> Set, Map
panel = Panel(cset.Set)
mindex = MemberIndex(Set=objatts.Color, Member=cset.Set)  # -> Index, Count
item_2 = ListItem(List=panel, Index=Slider(3, range=0..3), Wrap=True)
# Save SVG file
legend = Legend(Colour=cset.Set, Tags=cset.Set, LegendType=1)
# Define a rules to take
# the pinned connection or fixed connection
item_3 = ListItem(List=orient.Geometry, Index=mindex.Index, Wrap=True)
crosecrselect = CrossSectionRangeSelectorKaramba3D(MaximumHeight_cm=-1, MaximumWidth_cm=-1, menu=[dropdown(1), dropdown(2), dropdown(2)])
item_4 = ListItem(List=crosecrselect, Index=0, Wrap=True)
crosec = CrossSectionKaramba3D(crosecrselect)
merge = Merge(
    Data1=ColourSwatch(SwatchColor=RGB(255, 0, 0)),
    Data2=ColourSwatch(SwatchColor=RGB(255, 128, 128)),
    Data3=ColourSwatch(SwatchColor=RGB(255, 255, 255)),
    Data4=ColourSwatch(SwatchColor=RGB(128, 138, 255)),
    Data5=ColourSwatch(SwatchColor=RGB(0, 21, 255)))
pt_2 = ConstructPoint(XCoordinate="20", YCoordinate=0, ZCoordinate=0)
xz_2 = XZPlane(Origin=pt_2)
panel_2 = Panel("""Shear
Bending Moment
Normal Force
Displacement""")
graft = GraftTree(Tree=panel_2, IncludeEmptyLists=True, IncludeNullItems=True)
Y = UnitY(Factor="-100")
# set up an automatic camera
toggle = BooleanToggle(True)
captureview = Ladybug_CaptureView(fileName="ciao", transparBack=Toggle(True), capture=toggle)  # -> imagePath; plug-in component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
panel_3 = Panel(captureview)

# ----
# Defining the Beam
join_2 = JoinCurves(Curves=item_3, Preserve=False)  # -> simplify(Curves)
tmatch = MatchText(Text=cset.Set, Pattern="Black", Case=True)
divide_branches = DivideBranches(DataTree=join_2, DivisionPattern=tmatch, RenumberPaths=False)  # -> Data0, Data1

sort = SortList(Keys=divide_branches.Data1, ValuesA=divide_branches.Data1)  # -> Keys, reverse(ValuesA)
cull_i = CullIndex(List=sort.ValuesA, Indices="0", Wrap=True)

# ----
# Hinge
panel_4 = Panel("243,186,56")
tmatch_2 = MatchText(Text=cset.Set, Pattern=panel_4, Case=True)
divide_branches_2 = DivideBranches(DataTree=join_2, DivisionPattern=tmatch_2, RenumberPaths=False)  # -> Data0, Data1
crv = Curve(divide_branches_2.Data1)
explode = Explode(Curve=crv, Recursive=True)  # -> Segments, Vertices
pline = PolyLine(Vertices=explode.Vertices, Closed=invert(False))
pcen = PolygonCenter(Polyline=pline)  # -> CenterV, CenterE, CenterA
pt_3 = Point(pcen.CenterA)

# ----
# We can have hornster for add the value
panel_5 = Panel("250,127,177")
tmatch_3 = MatchText(Text=cset.Set, Pattern=panel_5, Case=True)
divide_branches_3 = DivideBranches(DataTree=join_2, DivisionPattern=tmatch_3, RenumberPaths=False)  # -> Data0, simplify(Data1)
crv_2 = Curve(divide_branches_3.Data1)
eval = EvaluateCurve(Curve=reparameterize(crv_2), Parameter="0.50")  # -> Point, Tangent, Angle

# ----
# Point Load
panel_6 = Panel("106,192,200")
tmatch_4 = MatchText(Text=cset.Set, Pattern=panel_6, Case=True)
divide_branches_4 = DivideBranches(DataTree=join_2, DivisionPattern=tmatch_4, RenumberPaths=False)  # -> Data0, Data1
crv_3 = Curve(divide_branches_4.Data1)
len = Length(Curve=crv_3)
smaller = SmallerThan(FirstNumber=len, SecondNumber="0.01")  # -> SmallerThan, OrEqualTo
cull = CullPattern(List=crv_3, CullPattern=invert(smaller.SmallerThan))
explode_2 = Explode(Curve=cull, Recursive=True)  # -> Segments, Vertices
pt_4 = Point(explode_2.Vertices)

item_5 = ListItem(List=explode_2.Vertices, Index=0, Wrap=True)  # -> Item, Item1
vec2pt = Vector2Pt(PointA=item_5.Item, PointB=item_5.Item1, Unitize=invert(False))  # -> Vector, Length
multiplication = Multiplication(A=vec2pt.Vector, B="50")

# ----
# Support
panel_7 = Panel("246,102,64")
tmatch_5 = MatchText(Text=cset.Set, Pattern=panel_7, Case=True)
divide_branches_5 = DivideBranches(DataTree=join_2, DivisionPattern=tmatch_5, RenumberPaths=False)  # -> Data0, Data1
crv_4 = Curve(divide_branches_5.Data1)
explode_3 = Explode(Curve=crv_4, Recursive=True)  # -> Segments, Vertices
pline_2 = PolyLine(Vertices=explode_3.Vertices, Closed=invert(False))
pcen_2 = PolygonCenter(Polyline=pline_2)  # -> CenterV, CenterE, CenterA
pt_5 = Point(pcen_2.CenterA)

explode_4 = Explode(Curve=cull_i, Recursive=True)  # -> flatten(Segments), Vertices
fcircle = CircleFit(Points=explode.Vertices)  # -> Circle, Radius, Deviation
avr = Average(Input=flatten(fcircle.Radius))
num = Number(expr("x*2", avr))

explode_5 = Explode(Curve=explode_4.Segments, Recursive=True)  # -> Segments, simplify(Vertices)

dist = Distance(PointA=flatten(explode_5.Vertices), PointB=graft(explode_5.Vertices))
smaller_2 = SmallerThan(FirstNumber=dist, SecondNumber=num)  # -> SmallerThan, OrEqualTo
cull_2 = CullPattern(List=flatten(explode_5.Vertices), CullPattern=smaller_2.SmallerThan)
avr_2 = Average(Input=cull_2)
pshift = ShiftPaths(Data=avr_2, Offset=-1)
pline_3 = PolyLine(Vertices=pshift, Closed=False)
explode_6 = Explode(Curve=pline_3, Recursive=True)  # -> simplify(Segments), Vertices

rdpoints = RemoveDuplicatePointsKaramba3D(Point=flatten(explode_6.Vertices), LimitDistance=0.005)  # -> OutPoint, Info, Indexes
cp = ClosestPoint(Point=pt_3, Cloud=rdpoints.OutPoint)  # -> flatten(ClosestPoint), CPIndex, Distance

rdpoints_2 = RemoveDuplicatePointsKaramba3D(Point=flatten(explode_6.Vertices), LimitDistance=0.005)  # -> OutPoint, Info, Indexes
cp_2 = ClosestPoint(Point=pt_5, Cloud=rdpoints_2.OutPoint)  # -> flatten(ClosestPoint), CPIndex, Distance

rdpoints_3 = RemoveDuplicatePointsKaramba3D(Point=flatten(explode_6.Vertices), LimitDistance=0.005)  # -> OutPoint, Info, Indexes
cp_3 = ClosestPoint(Point=pt_4, Cloud=rdpoints_3.OutPoint)  # -> ClosestPoint, CPIndex, Distance

duppt = RemoveDuplicatePts(Points=cp_3.ClosestPoint, Tolerance=0.01)
loads = LoadsKaramba3D(ForceVector=multiplication, Local=False, PosInd=duppt, LCase=0, mode="Point")  # -> flatten(Load)
tstat = TreeStatistics(Tree=explode_6.Segments)  # -> Paths, Length, Count
graft_2 = GraftTree(Tree=tstat.Paths, IncludeEmptyLists=True, IncludeNullItems=True)

crv_5 = Curve(pline_3)
crv_cp = CurveClosestPoint(Point=graft(eval.Point), Curve=crv_5)  # -> Point, Parameter, Distance
pshift_2 = ShiftPaths(Data=crv_cp.Point, Offset=-1)
pshift_3 = ShiftPaths(Data=crv_cp.Distance, Offset=-1)
pshift_4 = ShiftPaths(Data=graft_2, Offset=-1)
sort_2 = SortList(Keys=pshift_3, ValuesA=pshift_4, ValuesB=pshift_2)  # -> Keys, ValuesA, ValuesB
item_6 = ListItem(List=sort_2.ValuesB, Index=0, Wrap=True)
item_7 = ListItem(List=sort_2.ValuesA, Index=0, Wrap=True)
vec2pt_2 = Vector2Pt(PointA=eval.Point, PointB=item_6, Unitize=invert(False))  # -> Vector, Length
multiplication_2 = Multiplication(A=vec2pt_2.Vector, B="10")
loads_2 = LoadsKaramba3D(Vector=multiplication_2, BeamIdentifiers=item_7, LCase=0, mode="Uniform Line", menu=[buttons(on, off, off)])

load = LoadKaramba3D([loads, loads_2])
joint_agent = BeamJointAgentKaramba3D(
    ToGeometry=cp.ClosestPoint,
    Ct_kN_m=Vector(0, 0, 0),
    Cr_kNm_rad=Vector(0, 0, 0),
    menu=[buttons(off, off, off, off, on, off)])
supp = SupportKaramba3D(PosInd=cp_2.ClosestPoint, menu=[buttons(on, on, on, on, on, on)])
linetobeam = LineToBeamKaramba3D(Line=explode_6.Segments, Identifier=graft_2, CrossSection=item_4, New=True, Remove=True, LimitDistance_m=0.005)  # -> Element, Points, Info
assemble = AssembleModelKaramba3D(Elem=flatten(linetobeam.Element), Support=supp, Load=flatten(load), Joint=joint_agent, LimitDistance_m=0.005)  # -> Model, Info, Mass_kg, CenterOfGravity
analyze = AnalyzeKaramba3D(Model=assemble.Model)  # -> CalculatedModel, MaximumDisplacement_cm, ResultingForceOfGravity_kN, ElasticEnergy_kNm
opticrosec = OptimizeCrossSectionKaramba3D(
    Model=analyze.CalculatedModel,
    CrossSections=crosec,
    MaximumUtilization="0.85",
    MaximumDisplacement_cm=-1,
    UltimateLimitStateIterations=5,
    DisplacementIterations=5,
    NumberOfSamplePoints=3,
    ElasticDesign=True,
    GammaM0=1,
    GammaM1=1)  # -> ModelWithOptimizedCrossSections, Info, Mass_kg, MaximumDisplacement_cm, ElasticEnergy_kNm
division_2 = Division(A="100", B=opticrosec.MaximumDisplacement_cm)
modelview = ModelViewKaramba3D(Model=opticrosec.ModelWithOptimizedCrossSections, ResultFactors=1, ResultCase=-1)  # -> Model, DeformedMesh, DeformedAxes, DeformedModel
modelview_2 = ModelViewKaramba3D(Model=opticrosec.ModelWithOptimizedCrossSections, ResultFactors=1, ResultCase=-1)  # -> Model, DeformedMesh, DeformedAxes, DeformedModel
modelview_3 = ModelViewKaramba3D(Model=opticrosec.ModelWithOptimizedCrossSections, ResultFactors=division_2, ResultCase=-1, Colors=merge)  # -> Model, DeformedMesh, DeformedAxes, DeformedModel
bbox_3 = BoundingBox(Content=modelview.DeformedAxes, Plane=PlaneXY(0, 0, 0), UnionBox=True)  # -> Box, Box_2
beamview = BeamViewKaramba3D(Model=modelview_2.Model)  # -> Model, MeshesOfRenderedBeams, DeformedBeamAxes, LegendColors, LegendTags
beamview_2 = BeamViewKaramba3D(Model=modelview_2.Model)  # -> Model, MeshesOfRenderedBeams, DeformedBeamAxes, LegendColors, LegendTags
beamview_3 = BeamViewKaramba3D(Model=modelview_2.Model)  # -> Model, MeshesOfRenderedBeams, DeformedBeamAxes, LegendColors, LegendTags
beamview_4 = BeamViewKaramba3D(Model=modelview_3.Model)  # -> Model, MeshesOfRenderedBeams, DeformedBeamAxes, LegendColors, LegendTags
area = Area(Geometry=bbox_3.Box)  # -> Area, Centroid
entwine = Entwine(
    Branch00=beamview_2.MeshesOfRenderedBeams,
    Branch01=beamview.MeshesOfRenderedBeams,
    Branch02=beamview_3.MeshesOfRenderedBeams,
    Branch03=beamview_4.MeshesOfRenderedBeams,
    FlattenInputs=True)
crv_6 = Curve(modelview.DeformedAxes)
explode_7 = MeshExplode(Mesh=entwine, Interpolate=False)
bbox_4 = BoundingBox(Content=entwine, Plane=PlaneXY(0, 0, 0), UnionBox=True)  # -> Box, Box_2
pshift_5 = ShiftPaths(Data=explode_7, Offset=-1)
debox_2 = DeconstructBox(Box=bbox_4.Box)  # -> Plane, X, Y, Z
area_2 = Area(Geometry=bbox_4.Box)  # -> Area, Centroid
dedomain_3 = DeconstructDomain(Domain=debox_2.X)  # -> Start, End
dedomain_4 = DeconstructDomain(Domain=debox_2.Z)  # -> Start, End
panel_8 = Panel(debox_2.X)
xz_3 = XZPlane(Origin=area_2.Centroid)
subtraction_3 = Subtraction(A=dedomain_3.Start, B=dedomain_3.End)
subtraction_4 = Subtraction(A=dedomain_4.Start, B=dedomain_4.End)
abs = Absolute(Value=subtraction_3)
abs_2 = Absolute(Value=subtraction_4)
sort_3 = SortList(Keys=flatten(abs_2))  # -> reverse(Keys), ValuesA
sort_4 = SortList(Keys=flatten(abs))  # -> reverse(Keys), ValuesA
item_8 = ListItem(List=sort_4.Keys, Index=0, Wrap=True)
lng = ListLength(List=sort_4.Keys)  # -> expr("x/2", Length)
item_9 = ListItem(List=sort_3.Keys, Index=0, Wrap=True)
lng_2 = ListLength(List=sort_3.Keys)  # -> expr("x/2", Length)
multiplication_3 = Multiplication(A=item_8, B=lng)
multiplication_4 = Multiplication(A=item_9, B=lng_2)
multiplication_5 = Multiplication(A=multiplication_4, B=Slider(1.123, range=1..1.5))
multiplication_6 = Multiplication(A=multiplication_3, B=Slider(1.19, range=1..1.5))
rectangle = Rectangle(Plane=xz_2, XSize=multiplication_6, YSize=multiplication_5, Radius=0)  # -> Rectangle, Length
explode_8 = Explode(Curve=rectangle.Rectangle, Recursive=True)  # -> Segments, Vertices
item_10 = ListItem(List=explode_8.Segments, Index=0, Wrap=True)  # -> Item, Item1, Item2, Item3

num_2 = Number(lng)
num_3 = Number(lng_2)

edgesrf = EdgeSurface(CurveA=item_10.Item, CurveB=item_10.Item1, CurveC=item_10.Item2, CurveD=item_10.Item3)
divide = DivideDomain²(Domain=edgesrf, UCount=num_2, VCount=num_3)
subsrf = Isotrim(Surface=edgesrf, Domain=divide)
debrep_2 = DeconstructBrep(Brep=subsrf)  # -> Faces, Edges, Vertices
area_3 = Area(Geometry=subsrf)  # -> Area, graft(Centroid)
item_11 = ListItem(List=debrep_2.Edges, Index=0, Wrap=True)  # -> Item, Item1, Item2, Item3
crv_7 = Curve(item_11.Item2)
xz_4 = XZPlane(Origin=area_3.Centroid)
xz_5 = XZPlane(Origin=area_3.Centroid)
eval_2 = EvaluateCurve(Curve=reparameterize(crv_7), Parameter="0.80")  # -> Point, Tangent, Angle
orient_2 = Orient(Geometry=crv_6, Source=xz_3, Target=xz_4)  # -> flatten(Geometry), Transform
orient_3 = Orient(Geometry=pshift_5, Source=xz_3, Target=xz_5)  # -> flatten(Geometry), Transform
geo = Geometry(orient_3.Geometry)
preview = CustomPreview(Geometry=orient_2.Geometry, Material=ColourSwatch(SwatchColor=RGB(71, 71, 71)))
screentext = ScreenOrientedText(
    Text=simplify(graft),
    Justification=9,
    Location=simplify(eval_2.Point),
    SizeFactor=Slider(11, range=1..50),
    Color=ColourSwatch(SwatchColor=RGB(0, 0, 0)),
    Depth=0,
    Absolute=False)
bbox_5 = BoundingBox(Content=flatten(subsrf), Plane=PlaneXY(0, 0, 0), UnionBox=True)  # -> Box, Box_2
area_4 = Area(Geometry=bbox_5.Box)  # -> Area, Centroid
move = Move(Geometry=area_4.Centroid, Motion=Y)  # -> Geometry, Transform
num_4 = Number(expr("Round(x,1)", opticrosec.MaximumDisplacement_cm))
c_script = CSharpScript(x=Button(), points=area_4.Centroid, index="0", newLocation=move.Geometry)  # -> out, A, cameraPosition; inputs x: Boolean, points: list of Point3d, index: Int32, newLocation: Point3d
# ---------- c_script: C# usings ----------
using System.IO;
using System.Linq;
using System.Data;
using System.Drawing;
using System.Reflection;
using System.Windows.Forms;
using System.Xml;
using System.Xml.Linq;
using System.Runtime.InteropServices;

using Rhino.DocObjects;
using Rhino.Collections;
using GH_IO;
using GH_IO.Serialization;
# ---------- c_script: C# ----------
    int myIndex = index > (points.Count - 1) ? points.Count - 1 : index;
    Point3d camPos = new Point3d();
    Point3d myPoint = points[myIndex];


    if (x == true)
    {
      camPos = Rhino.RhinoDoc.ActiveDoc.Views.ActiveView.ActiveViewport.CameraLocation;
      Rhino.RhinoDoc.ActiveDoc.Views.ActiveView.ActiveViewport.SetCameraTarget(myPoint, true);
      Rhino.RhinoDoc.ActiveDoc.Views.ActiveView.ActiveViewport.SetCameraLocations(myPoint, newLocation);
    }

    A = myPoint;

    cameraPosition = camPos;
# ---------- end c_script ----------
panel_9 = Panel(c_script.cameraPosition)
panel_10 = Panel(c_script.A)
num_5 = Number(expr("Round(x,2)", opticrosec.Mass_kg))

# ---- group: Performance parameters
header = Panel("""mass: 
deflection: """)
entwine_2 = Entwine(Branch00=num_5, Branch01=num_4, FlattenInputs=True)  # -> flatten(Result)
units = Panel(""" kg
 cm""")
concat = Concatenate(FragmentA=header, FragmentB=entwine_2, FragmentC=units)
txt = Text(concat)
panel_11 = Panel(txt)
lng_3 = ListLength(List=txt)
series = Series(Start=Slider(61, range=0..100), Step=Slider(30, range=0..100), Count=lng_3)
pt_6 = ConstructPoint(XCoordinate=Slider(55, range=0..1000), YCoordinate=series, ZCoordinate=0)
texttoscreen = RenderTextToScreen(Text=txt, Location=pt_6, Size=Slider(17, range=0..100), Color=RGB(0, 0, 0), m_scWithvp=False)
