# Grasshopper definition trave_reticolare.gh (Grasshopper 0.9.76)
# plug-ins: Karamba, BullAnt, Kangaroo Components

h_sup = Slider(0.5, range=0.5..0.8)
pt = ConstructPoint(XCoordinate=graft(0), YCoordinate=0, ZCoordinate=graft(h_sup))
pt_2 = ConstructPoint(XCoordinate=graft(0), YCoordinate=0, ZCoordinate=graft(Slider(0, range=-1..0)))
alfa1 = Slider(14.79, range=0..20)
length = Slider(3.94, range=3.5..5)
alfa_inf = Slider(20, range=0..20)
X = UnitX(Factor=length)
X_2 = UnitX(Factor=length)
move = Move(Geometry=pt, Motion=X)  # -> Geometry, Transform
neg = Negative(Value=alfa1)
move_2 = Move(Geometry=pt_2, Motion=X_2)  # -> Geometry, Transform
rad = Radians(Degrees=alfa_inf)
X_3 = UnitX(Factor=1)
Y = UnitY(Factor=1)
rad_2 = Radians(Degrees=neg)
X_4 = UnitX(Factor=1)
Y_2 = UnitY(Factor=1)
vrot = Rotate(Vector=X_4, Axis=Y_2, Angle=rad_2)
vrot_2 = Rotate(Vector=X_3, Axis=Y, Angle=rad)
arc = ArcSED(Start=pt, End=move.Geometry, Direction=vrot)  # -> Arc, Plane, Radius
arc_2 = ArcSED(Start=pt_2, End=move_2.Geometry, Direction=vrot_2)  # -> Arc, Plane, Radius
truss_type = Slider(0, range=0..4)
ggtc = GgTrussFromCurves(FirstCurve=arc.Arc, SecondCurve=arc_2.Arc, NumberDivision=Slider(10, range=4..10), TrussType=truss_type, Frames=False)  # -> ChordACurves, ChordBCurves, Diagonals, Verticals
explode = Explode(Curve=ggtc.ChordACurves, Recursive=True)  # -> Segments, Vertices
trim = TrimTree(Tree=explode.Vertices, Depth=1)
duppt = RemoveDuplicatePts(Points=trim, Tolerance=0.01)
explode_2 = Explode(Curve=ggtc.ChordBCurves, Recursive=True)  # -> Segments, Vertices
point_load = Slider(8, range=0..11)
trim_2 = TrimTree(Tree=explode_2.Vertices, Depth=1)
duppt_2 = RemoveDuplicatePts(Points=trim_2, Tolerance=0.01)
expression = Expression(x=point_load, Expression="if(x<11, 0, 1)")
item = ListItem(List=duppt, Index=point_load, Wrap=True)
item_2 = ListItem(List=duppt_2, Index=0, Wrap=True)  # -> Item1, Item
supp = SupportKaramba(PosInd=[item_2.Item, item_2.Item1], menu=[buttons(on, on, on, on, on, on)])
linetobeam = LineToBeamKaramba(Line=[ggtc.ChordACurves, ggtc.ChordBCurves], New=True, Remove=True, LimitDistance_m=0.005, BeamIdentifier="correnti")  # -> Points, Element, Info
linetobeam_2 = LineToBeamKaramba(Line=[ggtc.Diagonals, ggtc.Verticals], New=True, Remove=True, LimitDistance_m=0.005, BeamIdentifier="diagonali")  # -> Points, Element, Info
neg_2 = Negative(Value=Slider(23, range=10..100))
filter = StreamFilter(Gate=expression, Stream0=item, Stream1=duppt)
Z = UnitZ(Factor=neg_2)
loads = LoadsKaramba(ForceVector=Z, Local=False, PosInd=filter, LCase="0", mode="Point")

crosecrselect = CrossSectionRangeSelectorKaramba(MaximumHeight_cm=-1, MaximumWidth_cm=-1, menu=[dropdown(0), dropdown(0), dropdown(31)])
crosecrselect_2 = CrossSectionRangeSelectorKaramba(MaximumHeight_cm=-1, MaximumWidth_cm=-1, menu=[dropdown(0), dropdown(0), dropdown(31)])
crosecselect = CrossSectionSelectorKaramba(ElementsIdentifiers="correnti", NameOrListIndexOfCrossSection=Slider(22, range=20..100), CrossSections=crosecrselect_2)  # -> CrossSection, Info
crosecselect_2 = CrossSectionSelectorKaramba(ElementsIdentifiers="diagonali", NameOrListIndexOfCrossSection=Slider(9, range=1..20), CrossSections=crosecrselect)  # -> CrossSection, Info
crosec = CrossSectionKaramba([crosecselect.CrossSection, crosecselect_2.CrossSection])

assemble = AssembleModelKaramba(
    Elem=simplify([linetobeam.Element, linetobeam_2.Element]),
    Support=simplify(supp),
    Load=loads,
    CrossSection=crosec,
    LimitDistance_m=0.005)  # -> Model, Info, Mass_kg, CenterOfGravity
analyzethi = AnalyzeThIKaramba(Model=assemble.Model)  # -> CalculatedModel, MaximumDisplacement_m, ResultingForceOfGravity_kN, ElasticEnergy_kNm
bang = ExplodeTree(Data=analyzethi.CalculatedModel)  # -> Branch0, Branch1
merge = Merge(
    Data1=ColourSwatch(SwatchColor=RGB(255, 0, 0)),
    Data2=ColourSwatch(SwatchColor=RGB(255, 179, 0)),
    Data3=ColourSwatch(SwatchColor=RGB(255, 255, 0)),
    Data4=ColourSwatch(SwatchColor=RGB(0, 255, 0)),
    Data5=ColourSwatch(SwatchColor=RGB(0, 255, 255)),
    Data6=ColourSwatch(SwatchColor=RGB(4, 177, 255)),
    Data7=ColourSwatch(SwatchColor=RGB(0, 0, 255)))
modelview = ModelViewKaramba(
    Model=bang.Branch1,
    LoadCaseFactorsForLinearSuperposition=1,
    IndexIncrementOfVisibleLoadcase=0,
    ListOfColorsForColoringPlots=merge)  # -> Model, DeformedMesh, DeformedAxes, DeformedModel
beamview = BeamViewKaramba(Model=modelview.Model)  # -> Model, MeshesOfRenderedBeams, DeformedBeamAxes, LegendColors, LegendTags
beamview_2 = BeamViewKaramba(Model=bang.Branch0)  # -> Model, MeshesOfRenderedBeams, DeformedBeamAxes, LegendColors, LegendTags
