# Grasshopper definition piastra.gh (Grasshopper 0.9.76)
# plug-ins: Karamba, Kangaroo Components

rectangle = Rectangle(Plane=PlaneXY(0, 0, 0), XSize=Slider(20, range=5..20), YSize=Slider(25, range=5..25), Radius=Slider(0, range=0..10))  # -> Rectangle, Length
srf = Surface(rectangle.Rectangle)
boundary = BoundarySurfaces(Edges=srf)
md_slider = MDSlider(
    slider_value=Point(0.6287994385, 0.3520755768, 0.5),
    SliderMode=0,
    x_domain=Domain(0.05, 0.95),
    y_domain=Domain(0.05, 0.95),
    z_domain=Domain(0, 1))
number_slider = Slider(0.75, range=0..1)
pt = ConstructPoint(XCoordinate=Slider(0.6, range=-0.1..0.9), YCoordinate=Slider(0.3, range=-0.1..0.9), ZCoordinate=0)
custom_mesh_settings = SettingsCustom(
    StitchSeams=True,
    SimplePlanes=False,
    Refine=True,
    MinCount=16,
    MaxCount=400,
    AspectRatio=20,
    MaxDistance=0,
    MaxAngle=20,
    MinEdge=number_slider,
    MaxEdge=number_slider)
evalsrf = EvaluateSurface(Surface=reparameterize(boundary), Point=md_slider)  # -> Point, Normal, Frame
mesh = MeshBrep(Brep=boundary, Settings=custom_mesh_settings)
tri = Triangulate(Mesh=mesh)  # -> Mesh, Count
demesh = DeconstructMesh(Mesh=tri.Mesh)  # -> Vertices, Faces, Colours, Normals
nv = NakedVertices(Mesh=tri.Mesh)  # -> ClothedIndex, NakedIndex, ClothedPts, NakedPts
cp = ClosestPoint(Point=evalsrf.Point, Cloud=demesh.Vertices)  # -> ClosestPoint, CPIndex, Distance
Z = UnitZ(Factor=expr("-x", Slider(100, range=0..100)))
meshtoshell = MeshToShellKaramba(Mesh=tri.Mesh, LDist=0.005)  # -> Point, Element, Info
supp = SupportKaramba(PosInd=nv.NakedPts, menu=[buttons(on, on, on, off, off, on)])
loads = LoadsKaramba(ForceVector=Z, Local=False, PosInd=cp.ClosestPoint, LCase="1", mode="Point")
loads_2 = LoadsKaramba(Vector=Vector(0, 0, -1), LCase="0", mode="Gravity")
assemble = AssembleModelKaramba(Elem=meshtoshell.Element, Support=supp, Load=flatten([loads_2, loads]), LimitDistance_m=0.005)  # -> Model, Info, Mass_kg, CenterOfGravity
analyzethi = AnalyzeThIKaramba(Model=assemble.Model)  # -> CalculatedModel, MaximumDisplacement_m, ResultingForceOfGravity_kN, ElasticEnergy_kNm
merge = Merge(
    Data1=ColourSwatch(SwatchColor=RGB(255, 0, 0)),
    Data2=ColourSwatch(SwatchColor=RGB(255, 179, 0)),
    Data3=ColourSwatch(SwatchColor=RGB(255, 255, 0)),
    Data4=ColourSwatch(SwatchColor=RGB(0, 255, 0)),
    Data5=ColourSwatch(SwatchColor=RGB(0, 255, 255)),
    Data6=ColourSwatch(SwatchColor=RGB(4, 177, 255)),
    Data7=ColourSwatch(SwatchColor=RGB(0, 0, 255)))
modelview = ModelViewKaramba(
    Model=analyzethi.CalculatedModel,
    LoadCaseFactorsForLinearSuperposition=1,
    IndexIncrementOfVisibleLoadcase=0,
    ListOfColorsForColoringPlots=merge)  # -> Model, DeformedMesh, DeformedAxes, DeformedModel
shellview = ShellViewKaramba(Model=modelview.Model)  # -> Model, MeshesOfRenderedShells, LegendColors, LegendTags
popgeo = PopulateGeometry(Geometry=tri.Mesh, Count=100, Seed=1)  # disabled
shelllineresults = LineResultsOnShellsKaramba(
    AnalyzedModel=shellview.Model,
    ListOfSourcesOfForceFlowLinesLinesPoints=popgeo,
    SegmentLength_m=0.5,
    DA_deg=5,
    mode="PrincMoment")  # -> AnalyzedModel, Lines1, Lines2; disabled
swatch = ColourSwatch(SwatchColor=RGB(255, 0, 0))  # disabled
swatch_2 = ColourSwatch(SwatchColor=RGB(33, 100, 255))  # disabled
preview = CustomPreview(Geometry=shelllineresults.Lines2, Shader=swatch_2)  # disabled
preview_2 = CustomPreview(Geometry=shelllineresults.Lines1, Shader=swatch)  # disabled
