# Grasshopper definition 08_HighRiseSystems.gh (Grasshopper 0.9.76)
# plug-ins: Karamba

bays = Slider(5, range=4..7)
storeys = Slider(30, range=2..30)
width_of_bay = Slider(5, range=4..8)
series = Series(Start=0, Step="4", Count=storeys)
# 01 - High Rise Systems
# Difficulty: Moderate (FREE/PRO Versions only)
# Shows the effect of different kinds of horizontal bracing systems. Feel free to alter the number of bays and storeys.
series_2 = Series(Start=0, Step=width_of_bay, Count=bays)
vec = VectorXYZ(XComponent=graft(series_2), YComponent=0, ZComponent=series)  # -> simplify(Vector), Length

Z = UnitZ(Factor=expr("-x", Slider(10, range=5..15)))
merge = Merge(
    Data1=ColourSwatch(SwatchColor=RGB(255, 0, 0)),
    Data2=ColourSwatch(SwatchColor=RGB(255, 179, 0)),
    Data3=ColourSwatch(SwatchColor=RGB(255, 255, 0)),
    Data4=ColourSwatch(SwatchColor=RGB(0, 255, 0)),
    Data5=ColourSwatch(SwatchColor=RGB(0, 255, 255)),
    Data6=ColourSwatch(SwatchColor=RGB(4, 177, 255)),
    Data7=ColourSwatch(SwatchColor=RGB(0, 0, 255)))  # -> reverse(Result)

# ----
# parameters for height and number of bays
# create geometry
# convert line to beam
# assemble model
# analyse model
# view results
# define cross sections
# define supports
# define loads
panel = Panel("140,0,0")
vec_2 = Vector(vec.Vector)
move = Move(Geometry=vec_2, Translation=panel)  # -> Geometry, Transform
series_3 = Series(Start=-1, Step=-3, Count=3)
vec_3 = Vector(panel)
vec_4 = Vector(Vector(0, 0, -5))
flip = FlipMatrix(Data=move.Geometry)
addition = Addition(A=vec_3, B=Z)
Z_2 = UnitZ(Factor=series_3)
pline = PolyLine(Vertices=flip, Closed=False)
pline_2 = PolyLine(Vertices=move.Geometry, Closed=False)
move_2 = Move(Geometry=addition, Motion=Z_2)  # -> Geometry, Transform
explode = Explode(Curve=pline_2, Recursive=True)  # -> flatten(Segments), Vertices
explode_2 = Explode(Curve=pline, Recursive=True)  # -> flatten(Segments), Vertices
xz = XZPlane(Origin=move_2.Geometry)
path_mapper = PathMapper(explode_2.Segments, source="{A}", target="{1}")
path_mapper_2 = PathMapper(explode.Segments, source="{A}", target="{0}")
pt = Point(flatten(move.Geometry))
lng = ListLength(List=[path_mapper_2, path_mapper])  # -> flatten(Length)
ma = MassAddition(Input=["0", lng])  # -> Result, PartialResult
cull_i = CullIndex(List=reverse(ma.PartialResult), Indices=0, Wrap=False)  # -> reverse(List)
cull_i_2 = CullIndex(List=ma.PartialResult, Indices=0, Wrap=False)
pt_2 = Point(flatten(pt))
series_4 = Series(Start=cull_i, Step=1, Count=cull_i_2)  # -> simplify(Series)
item = ListItem(List=flip, Index=0, Wrap=True)  # -> flatten(Item)
panel_2 = Panel("100")
int = Integer(series_4)
concat = Concatenate(FragmentA="E", FragmentB=int)
height = Panel("""30
20""")
vec_5 = VectorXYZ(XComponent=Slider(150, range=0..150), YComponent=0, ZComponent=0)  # -> Vector, Length
lng_2 = ListLength(List=item)
width = Panel("""20
20""")
item_2 = ListItem(List=move.Geometry, Index=0, Wrap=True)  # -> flatten(Item)
division = Division(A=vec_5.Vector, B=lng_2)
t = Panel("""2
2""")
panel_3 = Panel("0,0,-2")
crossecs = CrossSectionsKaramba(
    ElementsIdentifiers=concat,
    Height_cm=graft(height),
    UpperFlangeWidth_cm=graft(width),
    LowerFlangeWidth_cm=graft(width),
    UpperFlangeThickness_cm=graft(t),
    LowerFlangeThickness_cm=graft(t),
    SidewallsThickness_cm=graft(t),
    FilletRadius_cm=0.6,
    mode="Box")
linetobeam = LineToBeamKaramba(Point=pt_2, Line=[path_mapper_2, path_mapper], New=True, Remove=True, LDist=0.005, Identifier=concat)  # -> Point, Beam, Info
loads = LoadsKaramba(ForceVector=division, Local=True, PosInd=item, LCase=0, mode="Point")
supp = SupportKaramba(PosInd=item_2, menu=[buttons(on, on, on, on, on, off)])
assemble = AssembleModelKaramba(
    Point=flatten(linetobeam.Point),
    Elem=flatten(linetobeam.Beam),
    Support=flatten(supp),
    Load=flatten(loads),
    CrossSection=flatten(crossecs),
    LDist=0.005)  # -> Model, Info, Mass, CenterOfGravity
num = Number(flatten(assemble.Mass))
expression = Expression(x=num, Expression="Format(\"Mass = {0} t\", Round(x/1000,2))")
panel_4 = Panel(expression)
analyzethi = AnalyzeThIKaramba(Model=assemble.Model)  # -> ModelWithDisplacements, MaximumDisplacement_m, ResultingForceOfGravity_kN, ElasticEnergy_kNm
num_2 = Number(flatten(analyzethi.MaximumDisplacement_m))
expression_2 = Expression(x=num_2, Expression="Format(\"Displacement = {0} mm\", Int(x*1000))")
tag = TextTag3D(
    Location=graft(xz),
    Text=graft(["Frame", expression_2, expression]),
    Size=Slider(2.2, range=1.6..5),
    Colour=ColourSwatch(SwatchColor=RGB(255, 255, 255)),
    Justification=7)
mass = Panel(assemble.Mass)
displacement = Panel(analyzethi.MaximumDisplacement_m)
modelview = ModelViewKaramba(
    Model=analyzethi.ModelWithDisplacements,
    LoadCaseFactorsForLinearSuperposition=1,
    IndexIncrementOfVisibleLoadcase=0,
    ListOfColorsForColoringPlots=merge)  # -> Model, MeshOfRendering, DeformedStructure, DeformedModel
beamview = BeamViewKaramba(Model=modelview.Model)  # -> Model, MeshOfRendering, DeformedBeamAxes, LegendColors, LegendTags

# ----
# create geometry
# assemble model
# view results
# modify beam
# convert line to beam
# analyse model
# define cross sections
# define supports
# define loads
num_3 = Number(storeys)
vec_6 = Vector(vec.Vector)
larger = LargerThan(FirstNumber=num_3, SecondNumber="7")  # -> LargerThan, OrEqualTo
filter = StreamFilter(Gate=larger.LargerThan, Stream0="1", Stream1="3")
division_2 = Division(A=num_3, B=4)
series_5 = Series(Start=-1, Step=-3, Count=3)
vec_7 = Vector("0,0,0")
vec_8 = Vector(Z)
move_3 = Move(Geometry=vec_6, Translation="0,0,0")  # -> Geometry, Transform
lng_3 = ListLength(List=vec_6)
series_6 = Series(Start=division_2, Step=division_2, Count=filter)
addition_2 = Addition(A=vec_7, B=vec_8)
Z_3 = UnitZ(Factor=series_5)
lng_4 = ListLength(List=flatten(lng_3))
int_2 = Integer(series_6)
flip_2 = FlipMatrix(Data=move_3.Geometry)
move_4 = Move(Geometry=addition_2, Motion=Z_3)  # -> Geometry, Transform
eval = Evaluate(F="Int(x/2-1)", x=lng_4)
addition_3 = Addition(A=int_2, B=1)
pline_3 = PolyLine(Vertices=move_3.Geometry, Closed=False)
pline_4 = PolyLine(Vertices=flip_2, Closed=False)
addition_4 = Addition(A=eval, B=1)
item_3 = ListItem(List=move_3.Geometry, Index=int_2, Wrap=True)
item_4 = ListItem(List=move_3.Geometry, Index=addition_3, Wrap=True)
explode_3 = Explode(Curve=pline_3, Recursive=True)  # -> flatten(Segments), Vertices
explode_4 = Explode(Curve=pline_4, Recursive=True)  # -> flatten(Segments), Vertices
xz_2 = XZPlane(Origin=move_4.Geometry)
branch = TreeBranch(Tree=move_3.Geometry, Path=eval, MaintainPaths=False)
branch_2 = TreeBranch(Tree=move_3.Geometry, Path=addition_4, MaintainPaths=False)
flip_3 = FlipMatrix(Data=item_3)
flip_4 = FlipMatrix(Data=item_4)
cull = CullPattern(List=branch, CullPattern=[False, True])
cull_2 = CullPattern(List=branch_2, CullPattern=[True, False])
merge_2 = Merge(StreamA=flip_3, StreamB=flip_4)
weave = Weave(Pattern=[0, 1], Stream0=cull_2, Stream1=cull, NullGaps=False)
prox = Proximity3D(Points=merge_2, Group=4, MinRadius=6, MaxRadius=10)  # -> Links, Topology
pline_5 = PolyLine(Vertices=weave, Closed=False)
rdlines = RemoveDuplicateLines(Line=flatten(prox.Links), LDist=0.005)  # -> flatten(OutLine), Info, Indexes
explode_5 = Explode(Curve=pline_5, Recursive=True)  # -> flatten(Segments), Vertices
path_mapper_3 = PathMapper(explode_4.Segments, source="{A}", target="{1}")
path_mapper_4 = PathMapper(explode_5.Segments, source="{A}", target="{2}")
path_mapper_5 = PathMapper(rdlines.OutLine, source="{A}", target="{3}")
path_mapper_6 = PathMapper(explode_3.Segments, source="{A}", target="{0}")
pt_3 = Point(flatten(move_3.Geometry))
lng_5 = ListLength(List=[path_mapper_6, path_mapper_3, path_mapper_4, path_mapper_5])  # -> flatten(Length)
ma_2 = MassAddition(Input=["0", lng_5])  # -> Result, PartialResult
cull_i_3 = CullIndex(List=reverse(ma_2.PartialResult), Indices=0, Wrap=False)  # -> reverse(List)
cull_i_4 = CullIndex(List=ma_2.PartialResult, Indices=0, Wrap=False)
series_7 = Series(Start=cull_i_3, Step=1, Count=cull_i_4)  # -> simplify(Series)
int_3 = Integer(series_7)
item_5 = ListItem(List=flip_2, Index=0, Wrap=True)  # -> flatten(Item)
concat_2 = Concatenate(FragmentA="E", FragmentB=int_3)
pt_4 = Point(flatten(pt_3))
item_6 = ListItem(List=move_3.Geometry, Index=0, Wrap=True)  # -> flatten(Item)
vec_9 = VectorXYZ(XComponent="100", YComponent=0, ZComponent=0)  # -> Vector, Length
lng_6 = ListLength(List=item_5)
linetobeam_2 = LineToBeamKaramba(
    Point=pt_4,
    Line=[path_mapper_6, path_mapper_3, path_mapper_4, path_mapper_5],
    New=True,
    Remove=True,
    LDist=0.005,
    Identifier=concat_2)  # -> Point, Beam, Info
members = Panel("""col
slab
core
outr""")
width_2 = Panel("""20
20
15
20""")
height_2 = Panel("""30
20
15
20""")
division_3 = Division(A=vec_9.Vector, B=lng_6)
t_2 = Panel("""2
2
3
3""")
bending = Panel("""0
0
0
0""")
crossecs_2 = CrossSectionsKaramba(
    ElementsIdentifiers=concat_2,
    Height_cm=graft(height_2),
    UpperFlangeWidth_cm=graft(width_2),
    LowerFlangeWidth_cm=graft(width_2),
    UpperFlangeThickness_cm=graft(t_2),
    LowerFlangeThickness_cm=graft(t_2),
    SidewallsThickness_cm=graft(t_2),
    FilletRadius_cm=0.6,
    mode="Box")
modifyelem = ModifyElementKaramba(Beam=linetobeam_2.Beam, Bending=graft(bending), mode="Beam")
loads_2 = LoadsKaramba(ForceVector=division, Local=True, PosInd=item_5, LCase=0, mode="Point")
supp_2 = SupportKaramba(PosInd=item_6, menu=[buttons(on, on, on, on, on, off)])
supp_3 = SupportKaramba(PosInd=pt_3, menu=[buttons(off, on, off, off, off, off)])
assemble_2 = AssembleModelKaramba(
    Point=flatten(pt_4),
    Elem=flatten(modifyelem),
    Support=flatten([supp_2, supp_3]),
    Load=flatten(loads_2),
    CrossSection=flatten(crossecs_2),
    LDist=0.005)  # -> Model, Info, Mass, CenterOfGravity
num_4 = Number(flatten(assemble_2.Mass))
expression_3 = Expression(x=num_4, Expression="Format(\"Mass = {0} t\", Round(x/1000,2))")
analyzethi_2 = AnalyzeThIKaramba(Model=assemble_2.Model)  # -> ModelWithDisplacements, MaximumDisplacement_m, ResultingForceOfGravity_kN, ElasticEnergy_kNm
num_5 = Number(flatten(analyzethi_2.MaximumDisplacement_m))
expression_4 = Expression(x=num_5, Expression="Format(\"Displacement = {0} mm\", Int(x*1000))")
tag_2 = TextTag3D(
    Location=graft(xz_2),
    Text=graft(["Core + Outrigger", expression_4, expression_3]),
    Size=Slider(2.2, range=1.6..5),
    Colour=ColourSwatch(SwatchColor=RGB(255, 255, 255)),
    Justification=7)
mass_2 = Panel(assemble_2.Mass)
displacement_2 = Panel(analyzethi_2.MaximumDisplacement_m)
modelview_2 = ModelViewKaramba(
    Model=analyzethi_2.ModelWithDisplacements,
    LoadCaseFactorsForLinearSuperposition=1,
    IndexIncrementOfVisibleLoadcase=0,
    ListOfColorsForColoringPlots=merge)  # -> Model, MeshOfRendering, DeformedStructure, DeformedModel
beamview_2 = BeamViewKaramba(Model=modelview_2.Model)  # -> Model, MeshOfRendering, DeformedBeamAxes, LegendColors, LegendTags

# ----
# create geometry
# assemble model
# view results
# modify beam
# convert line to beam
# analyse model
# define cross sections
# define supports
# define loads
vec_10 = Vector(vec.Vector)
num_6 = Number(storeys)
num_7 = Number(bays)
series_8 = Series(Start=expr("x-1", num_7), Step=-1, Count=num_7)
series_9 = Series(Start=0, Step=1, Count=num_7)
series_10 = Series(Start=series_8, Step=expr("x-1", num_7), Count=num_6)  # -> simplify(Series)
series_11 = Series(Start=series_9, Step=expr("x-1", num_7), Count=num_6)  # -> simplify(Series)
move_5 = Move(Geometry=vec_10, Translation="-70,0,0")  # -> Geometry, Transform
flip_5 = FlipMatrix(Data=move_5.Geometry)
item_7 = ListItem(List=move_5.Geometry, Index=series_11, Wrap=False)
item_8 = ListItem(List=move_5.Geometry, Index=series_10, Wrap=False)
series_12 = Series(Start=-1, Step=-3, Count=3)
vec_11 = Vector("-70,0,0")
vec_12 = Vector(Z)
flip_6 = FlipMatrix(Data=item_7)
flip_7 = FlipMatrix(Data=item_8)
addition_5 = Addition(A=vec_11, B=vec_12)
Z_4 = UnitZ(Factor=series_12)
pline_6 = PolyLine(Vertices=move_5.Geometry, Closed=False)
pline_7 = PolyLine(Vertices=flip_5, Closed=False)
explode_6 = Explode(Curve=pline_6, Recursive=True)  # -> flatten(Segments), Vertices
explode_7 = Explode(Curve=pline_7, Recursive=True)  # -> flatten(Segments), Vertices
clean = CleanTree(RemoveNulls=True, RemoveInvalid=True, RemoveEmpty=True, Tree=flip_6)
clean_2 = CleanTree(RemoveNulls=True, RemoveInvalid=True, RemoveEmpty=True, Tree=flip_7)
move_6 = Move(Geometry=addition_5, Motion=Z_4)  # -> Geometry, Transform
xz_3 = XZPlane(Origin=move_6.Geometry)
pline_8 = PolyLine(Vertices=clean, Closed=False)
pline_9 = PolyLine(Vertices=clean_2, Closed=False)
clean_3 = CleanTree(Data=[pline_8, pline_9], CleanInvalid=True, CleanEmpty=True)
explode_8 = Explode(Curve=clean_3, Recursive=True)  # -> flatten(Segments), Vertices
path_mapper_7 = PathMapper(explode_6.Segments, source="{A}", target="{0}")
path_mapper_8 = PathMapper(explode_7.Segments, source="{A}", target="{1}")
path_mapper_9 = PathMapper(explode_8.Segments, source="{A}", target="{2}")
pt_5 = Point(flatten(move_5.Geometry))
lng_7 = ListLength(List=[path_mapper_7, path_mapper_8, path_mapper_9])  # -> flatten(Length)
ma_3 = MassAddition(Input=["0", lng_7])  # -> Result, PartialResult
cull_i_5 = CullIndex(List=reverse(ma_3.PartialResult), Indices=0, Wrap=False)  # -> reverse(List)
cull_i_6 = CullIndex(List=ma_3.PartialResult, Indices=0, Wrap=False)
series_13 = Series(Start=cull_i_5, Step=1, Count=cull_i_6)  # -> simplify(Series)
item_9 = ListItem(List=flip_5, Index=0, Wrap=True)  # -> flatten(Item)
int_4 = Integer(series_13)
concat_3 = Concatenate(FragmentA="E", FragmentB=int_4)
pt_6 = Point(flatten(pt_5))
item_10 = ListItem(List=move_5.Geometry, Index=0, Wrap=True)  # -> flatten(Item)
vec_13 = VectorXYZ(XComponent="100", YComponent=0, ZComponent=0)  # -> Vector, Length
lng_8 = ListLength(List=item_9)
members_2 = Panel("""col
slab
bracing""")
division_4 = Division(A=vec_13.Vector, B=lng_8)
linetobeam_3 = LineToBeamKaramba(Point=pt_6, Line=[path_mapper_7, path_mapper_8, path_mapper_9], New=True, Remove=True, LDist=0.005, Identifier=concat_3)  # -> Point, Beam, Info
height_3 = Panel("""30
20
15""")
width_3 = Panel("""20
20
15""")
bending_2 = Panel("""0
0
0""")
t_3 = Panel("""2
2
3""")
crossecs_3 = CrossSectionsKaramba(
    ElementsIdentifiers=concat_3,
    Height_cm=graft(height_3),
    UpperFlangeWidth_cm=graft(width_3),
    LowerFlangeWidth_cm=graft(width_3),
    UpperFlangeThickness_cm=graft(t_3),
    LowerFlangeThickness_cm=graft(t_3),
    SidewallsThickness_cm=graft(t_3),
    FilletRadius_cm=0.6,
    mode="Box")
modifyelem_2 = ModifyElementKaramba(Beam=linetobeam_3.Beam, Bending=graft(bending_2), mode="Beam")
loads_3 = LoadsKaramba(ForceVector=division, Local=True, PosInd=item_9, LCase=0, mode="Point")
supp_4 = SupportKaramba(PosInd=item_10, menu=[buttons(on, on, on, on, off, off)])
supp_5 = SupportKaramba(PosInd=pt_5, menu=[buttons(off, on, off, off, off, off)])
assemble_3 = AssembleModelKaramba(
    Point=flatten(pt_6),
    Elem=flatten(modifyelem_2),
    Support=flatten([supp_4, supp_5]),
    Load=flatten(loads_3),
    CrossSection=flatten(crossecs_3),
    LDist=0.005)  # -> Model, Info, Mass, CenterOfGravity
num_8 = Number(flatten(assemble_3.Mass))
expression_5 = Expression(x=num_8, Expression="Format(\"Mass = {0} t\", Round(x/1000,2))")
analyzethi_3 = AnalyzeThIKaramba(Model=assemble_3.Model)  # -> ModelWithDisplacements, MaximumDisplacement_m, ResultingForceOfGravity_kN, ElasticEnergy_kNm
num_9 = Number(flatten(analyzethi_3.MaximumDisplacement_m))
expression_6 = Expression(x=num_9, Expression="Format(\"Displacement = {0} mm\", Int(x*1000))")
tag_3 = TextTag3D(
    Location=graft(xz_3),
    Text=graft(["Crossbracing", expression_6, expression_5]),
    Size=Slider(2.2, range=1.6..5),
    Colour=ColourSwatch(SwatchColor=RGB(255, 255, 255)),
    Justification=7)
mass_3 = Panel(assemble_3.Mass)
displacement_3 = Panel(analyzethi_3.MaximumDisplacement_m)
modelview_3 = ModelViewKaramba(
    Model=analyzethi_3.ModelWithDisplacements,
    LoadCaseFactorsForLinearSuperposition=1,
    IndexIncrementOfVisibleLoadcase=0,
    ListOfColorsForColoringPlots=merge)  # -> Model, MeshOfRendering, DeformedStructure, DeformedModel
beamview_3 = BeamViewKaramba(Model=modelview_3.Model)  # -> Model, MeshOfRendering, DeformedBeamAxes, LegendColors, LegendTags

# ----
# create geometry
# assemble model
# analyse model
# view results
# modify beam
# convert line to beam
# define cross sections
# define supports
# define loads
vec_14 = Vector(vec.Vector)
move_7 = Move(Geometry=vec_14, Translation="70,0,0")  # -> Geometry, Transform
lng_9 = ListLength(List=vec_14)
series_14 = Series(Start=-1, Step=-3, Count=3)
vec_15 = Vector("70,0,0")
vec_16 = Vector(Vector(0, 0, -5))
lng_10 = ListLength(List=flatten(lng_9))
flip_8 = FlipMatrix(Data=move_7.Geometry)
addition_6 = Addition(A=vec_15, B=Z)
Z_5 = UnitZ(Factor=series_14)
eval_2 = Evaluate(F="Int(x/2-1)", x=lng_10)
move_8 = Move(Geometry=addition_6, Motion=Z_5)  # -> Geometry, Transform
addition_7 = Addition(A=eval_2, B=1)
pline_10 = PolyLine(Vertices=move_7.Geometry, Closed=False)
pline_11 = PolyLine(Vertices=flip_8, Closed=False)
explode_9 = Explode(Curve=pline_10, Recursive=True)  # -> flatten(Segments), Vertices
explode_10 = Explode(Curve=pline_11, Recursive=True)  # -> flatten(Segments), Vertices
xz_4 = XZPlane(Origin=move_8.Geometry)
branch_3 = TreeBranch(Tree=move_7.Geometry, Path=eval_2, MaintainPaths=False)
branch_4 = TreeBranch(Tree=move_7.Geometry, Path=addition_7, MaintainPaths=False)
cull_3 = CullPattern(List=branch_3, CullPattern=[False, True])
cull_4 = CullPattern(List=branch_4, CullPattern=[True, False])
weave_2 = Weave(Pattern=[1, 0], Stream0=cull_3, Stream1=cull_4, NullGaps=False)
pline_12 = PolyLine(Vertices=weave_2, Closed=False)
explode_11 = Explode(Curve=pline_12, Recursive=True)  # -> flatten(Segments), Vertices
path_mapper_10 = PathMapper(explode_10.Segments, source="{A}", target="{1}")
path_mapper_11 = PathMapper(explode_11.Segments, source="{A}", target="{2}")
path_mapper_12 = PathMapper(explode_9.Segments, source="{A}", target="{0}")
pt_7 = Point(flatten(move_7.Geometry))
lng_11 = ListLength(List=[path_mapper_12, path_mapper_10, path_mapper_11])  # -> flatten(Length)
ma_4 = MassAddition(Input=["0", lng_11])  # -> Result, PartialResult
cull_i_7 = CullIndex(List=reverse(ma_4.PartialResult), Indices=0, Wrap=False)  # -> reverse(List)
cull_i_8 = CullIndex(List=ma_4.PartialResult, Indices=0, Wrap=False)
series_15 = Series(Start=cull_i_7, Step=1, Count=cull_i_8)  # -> simplify(Series)
int_5 = Integer(series_15)
concat_4 = Concatenate(FragmentA="E", FragmentB=int_5)
pt_8 = Point(flatten(pt_7))
item_11 = ListItem(List=flip_8, Index=0, Wrap=True)  # -> flatten(Item)
vec_17 = VectorXYZ(XComponent="100", YComponent=0, ZComponent=0)  # -> Vector, Length
lng_12 = ListLength(List=item_11)
linetobeam_4 = LineToBeamKaramba(
    Point=pt_8,
    Line=[path_mapper_12, path_mapper_10, path_mapper_11],
    New=True,
    Remove=True,
    LDist=0.005,
    Identifier=concat_4)  # -> Point, Beam, Info
item_12 = ListItem(List=move_7.Geometry, Index=0, Wrap=True)  # -> flatten(Item)
height_4 = Panel("""30
20
15""")
width_4 = Panel("""20
20
15""")
division_5 = Division(A=vec_17.Vector, B=lng_12)
panel_8 = Panel("""1
1
0""")
t_4 = Panel("""2
2
3""")
crossecs_4 = CrossSectionsKaramba(
    ElementsIdentifiers=concat_4,
    Height_cm=graft(height_4),
    UpperFlangeWidth_cm=graft(width_4),
    LowerFlangeWidth_cm=graft(width_4),
    UpperFlangeThickness_cm=graft(t_4),
    LowerFlangeThickness_cm=graft(t_4),
    SidewallsThickness_cm=graft(t_4),
    FilletRadius_cm=0.6,
    mode="Box")
modifyelem_3 = ModifyElementKaramba(Beam=linetobeam_4.Beam, Bending=graft(panel_8), mode="Beam")
loads_4 = LoadsKaramba(ForceVector=division, Local=True, PosInd=item_11, LCase=0, mode="Point")
supp_6 = SupportKaramba(PosInd=item_12, menu=[buttons(on, on, on, on, on, off)])
supp_7 = SupportKaramba(PosInd=pt_7, menu=[buttons(off, on, off, off, off, off)])
assemble_4 = AssembleModelKaramba(
    Point=flatten(pt_8),
    Elem=flatten(modifyelem_3),
    Support=flatten([supp_6, supp_7]),
    Load=flatten(loads_4),
    CrossSection=flatten(crossecs_4),
    LDist=0.005)  # -> Model, Info, Mass, CenterOfGravity
num_10 = Number(flatten(assemble_4.Mass))
expression_7 = Expression(x=num_10, Expression="Format(\"Mass = {0} t\", Round(x/1000,2))")
analyzethi_4 = AnalyzeThIKaramba(Model=assemble_4.Model)  # -> ModelWithDisplacements, MaximumDisplacement_m, ResultingForceOfGravity_kN, ElasticEnergy_kNm
num_11 = Number(flatten(analyzethi_4.MaximumDisplacement_m))
expression_8 = Expression(x=num_11, Expression="Format(\"Displacement = {0} mm\", Int(x*1000))")
tag_4 = TextTag3D(
    Location=graft(xz_4),
    Text=graft(["Core", expression_8, expression_7]),
    Size=Slider(2.2, range=1.6..5),
    Colour=ColourSwatch(SwatchColor=RGB(255, 255, 255)),
    Justification=7)
mass_4 = Panel(assemble_4.Mass)
displacement_4 = Panel(analyzethi_4.MaximumDisplacement_m)
modelview_4 = ModelViewKaramba(
    Model=analyzethi_4.ModelWithDisplacements,
    LoadCaseFactorsForLinearSuperposition=1,
    IndexIncrementOfVisibleLoadcase=0,
    ListOfColorsForColoringPlots=merge)  # -> Model, MeshOfRendering, DeformedStructure, DeformedModel
beamview_4 = BeamViewKaramba(Model=modelview_4.Model)  # -> Model, MeshOfRendering, DeformedBeamAxes, LegendColors, LegendTags
