# Grasshopper definition pipe shell.gh (Grasshopper 1.0.7)
# plug-ins: Bifocals, karambaGH

yz_plane = YZPlane(Origin=Point(0, 0, 0))
diameter_m = Panel("0.30")
cylinder = Cylinder(Base=yz_plane, Radius=expr("x/2", diameter_m), Length=Slider(1.22, range=1..5))
surface = Surface(<surface referenced from the Rhino model>)
mesh_breps_karamba3d = MeshBrepsKaramba3D(
    Brep=surface,
    MeshResolution="0.05",
    EdgeRefinementFactor=0.67,
    PointReduction=False,
    SmoothingStepSize=0,
    SmoothingIterations=5)  # -> Mesh, Info
deconstruct_brep = DeconstructBrep(Brep=surface)  # -> Faces, Edges, Vertices
deconstruct_mesh = DeconstructMesh(Mesh=mesh_breps_karamba3d.Mesh)  # -> Vertices, Faces, Colours, Normals
curve = Curve(deconstruct_brep.Edges)
list_item = ListItem(List=curve, Index=0, Wrap=True)  # -> Item, Item1, Item2
curve_closest_point = CurveClosestPoint(Point=deconstruct_mesh.Vertices, Curve=list_item.Item1)  # -> Point, Parameter, Distance
smaller_than = SmallerThan(FirstNumber=curve_closest_point.Distance, SecondNumber="0.01")  # -> SmallerThan, OrEqualTo
cull_pattern = CullPattern(List=curve_closest_point.Point, CullPattern=smaller_than.SmallerThan)
curve_2 = Curve(list_item.Item2)
carico_estremità_kn = Panel("30")
material_selection_karamba3d = MaterialSelectionKaramba3D(menu=[dropdown(1), dropdown(4)])
curve_closest_point_2 = CurveClosestPoint(Point=deconstruct_mesh.Vertices, Curve=curve_2)  # -> Point, Parameter, Distance
curve_3 = Curve(reparameterize(<curve referenced from the Rhino model>))
list_length = ListLength(List=cull_pattern)
mm = Slider(20, range=4..20)
evaluate_curve = EvaluateCurve(Curve=curve_3, Parameter="1.00")  # -> Point, Tangent, Angle
division = Division(A=carico_estremità_kn, B=list_length)
smaller_than_2 = SmallerThan(FirstNumber=curve_closest_point_2.Distance, SecondNumber="0.01")  # -> SmallerThan, OrEqualTo
cross_section_karamba3d = CrossSectionKaramba3D(
    FamilyNameOfCrossSection="DefaultCroSec",
    Material=material_selection_karamba3d,
    Height_cm=expr("x/10", mm),
    mode="Shell - Const")
amplitude = Amplitude(Vector=evaluate_curve.Tangent, Amplitude=division)
vector_display = VectorDisplay(Anchor=evaluate_curve.Point, Vector=evaluate_curve.Tangent)
cull_pattern_2 = CullPattern(List=curve_closest_point_2.Point, CullPattern=smaller_than_2.SmallerThan)
reverse = Reverse(Vector=amplitude)
support_karamba3d = SupportKaramba3D(PosInd=cull_pattern_2, menu=[buttons(on, on, on, on, on, on)])
mesh_to_shell_karamba3d = MeshToShellKaramba3D(Mesh=mesh_breps_karamba3d.Mesh, Identifier="pipes", CrossSection=cross_section_karamba3d, LimitDistance_m=0.005)  # -> Element, Points, Info
loads_karamba3d = LoadsKaramba3D(ForceVector=reverse, Local=False, PosInd=cull_pattern, LCase=0, mode="Point")
loads_karamba3d_2 = LoadsKaramba3D(Vector=Vector(0, 0, -1), LCase=0, mode="Gravity")
load_karamba3d = LoadKaramba3D(flatten([loads_karamba3d_2, loads_karamba3d]))
assemble_model_karamba3d = AssembleModelKaramba3D(
    Elem=flatten(mesh_to_shell_karamba3d.Element),
    Support=support_karamba3d,
    Load=flatten(load_karamba3d),
    LimitDistance_m=0.005)  # -> Model, Info, Mass_kg, CenterOfGravity
analyze_karamba3d = AnalyzeKaramba3D(Model=assemble_model_karamba3d.Model)  # -> CalculatedModel, MaximumDisplacement_cm, ResultingForceOfGravity_kN, ElasticEnergy_kNm
model_view_karamba3d = ModelViewKaramba3D(Model=analyze_karamba3d.CalculatedModel, LoadCaseFactorsForLinearSuperposition=1, IndexOfVisibleLoadcase=-1)  # -> Model, DeformedMesh, DeformedAxes, DeformedModel
shell_view_karamba3d = ShellViewKaramba3D(Model=model_view_karamba3d.Model, IndexOfLayer=0)  # -> Model, MeshesOfRenderedShells, LegendColors, LegendTags
