# Grasshopper definition multi curve optimization.gh (Grasshopper 0.9.76)
# plug-ins: Kangaroo Components, LunchBox

# Gene no. = Arc no. -1
genes = GenePool(Decimals=3, Maximum=0.99, Minimum=0.01, Value=[0.507, 0.319, 0.19, 0.756])

# ---- group: Your Curve Here
# Copyright 2017 John Harding
# MIT licence applies
crv = Curve(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)

# ----
sort = SortList(Keys=genes)  # -> Keys, ValuesA
join = JoinCurves(Curves=crv, Preserve=False)  # -> reparameterize(Curves)
# 1
displaycrv = DisplayCurve(curve=crv, color=ColourSwatch(SwatchColor=RGB(255, 255, 255)), weight=Slider(2.18, range=0.5..10))  # -> out; inputs curve: Curve, color: Color, weight: Int32
# ---------- displaycrv: C# ----------
    // silently skip null curves
    if(curve == null) return;

    // add to display cache
    _curves.Add(curve);
    _colors.Add(color);
    _weights.Add(weight);
    _clippingBox.Union(curve.GetBoundingBox(false));
# ---------- displaycrv: C# additional code ----------
  List<Curve> _curves;
  List<Color> _colors;
  List<int> _weights;
  BoundingBox _clippingBox;


  /// <summary>
  /// This method will be called once every solution, before any calls to RunScript.
  /// </summary>
  public override void BeforeRunScript()
  {
    _curves = new List<Curve>();
    _colors = new List<Color>();
    _weights = new List<int>();
    _clippingBox = new BoundingBox();
  }


  //
  public override BoundingBox ClippingBox
  {
    get{return _clippingBox;}
  }


  //
  public override void DrawViewportWires(IGH_PreviewArgs args)
  {
    base.DrawViewportWires(args);

    for(int i = 0; i < _curves.Count; i++)
      args.Display.DrawCurve(_curves[i], _colors[i], _weights[i]);
  }
# ---------- end displaycrv ----------
entwine = Entwine(Branch00="0", Branch01=sort.Keys, Branch02="1", FlattenInputs=True)  # -> flatten(Result)
reb = RebuildCurve(Curve=join, Count=Slider(50, range=0..100), Tangents=False)  # -> reparameterize(Curve)
dcon = DeleteConsecutive(Set=entwine, Wrap=False)  # -> Set, Count
arcdivide = ArcDivide(Curve=reb, TParameters=dcon.Set)  # -> Arcs, Centers
len = Length(Curve=arcdivide.Arcs)

# ---- group: Display curve
swatch = ColourSwatch(SwatchColor=RGB(255, 0, 0))
preview = CustomPreview(Geometry=arcdivide.Arcs, Shader=swatch)

# ----
bnd = Bounds(Numbers=len)
curvepoint = PointOnCurve(arcdivide.Arcs, parameter=0.5)

# ---- group: Integrate error along curves
number_slider = Slider(0.5, range=0..1)
divlength = DivideLength(Curve=join, Length=number_slider)  # -> flatten(Points), Tangents, Parameters
divlength_2 = DivideLength(Curve=arcdivide.Arcs, Length=number_slider)  # -> flatten(Points), Tangents, Parameters
cp = ClosestPoint(Point=divlength.Points, Cloud=divlength_2.Points)  # -> ClosestPoint, CPIndex, Distance
ln = Line(StartPoint=divlength.Points, EndPoint=cp.ClosestPoint)
num = Number(ln)
ma = MassAddition(Input=num)  # -> Result, PartialResults

# ----
eval = EvaluateCurve(Curve=reb, Parameter=dcon.Set)  # -> Point, Tangent, Angle
vec2pt = Vector2Pt(PointA=arcdivide.Centers, PointB=curvepoint, Unitize=False)  # -> unitize(Vector), Length

# ---- group: Radii
darc = DeconstructArc(Arc=arcdivide.Arcs)  # -> BasePlane, Radius, Angle
expression = Expression(x=darc.Radius, Expression="Format(\"{0:0.00}\", x)")
panel = Panel(expression)

# ---- group: Show lengths
multiplication = Multiplication(A=vec2pt.Vector, B="0.3")
len_2 = Length(Curve=arcdivide.Arcs)
move = Move(Geometry=curvepoint, Motion=multiplication)  # -> Geometry, Transform
tag = TextTag3D(Location=move.Geometry, Text=len_2, Size="1", Justification=9)

# ---- group: Display nodes
end = EndPoints(Curve=arcdivide.Arcs)  # -> Start, End
pt = Point(eval.Point)
swatch_2 = ColourSwatch(SwatchColor=RGB(255, 0, 0))
duppt = RemoveDuplicatePts(Points=pt, Tolerance=0.01)
preview_2 = CustomPreview(Geometry=duppt, Shader=swatch_2)

# ----
# Minimise error using simulated annealing solver
galapagos = Galapagos(fitness=ma, gene=genes)
preview_3 = CustomPreview(Geometry=ln, Shader=ColourSwatch(SwatchColor=RGB(0, 106, 255)))
# 2
dots = DotDisplay(Point=duppt, Colour=swatch_2, Size=Slider(0.46, range=0.2..1))
# 3
displaycrv_2 = DisplayCurve(curve=arcdivide.Arcs, color=swatch, weight=Slider(2.18, range=0.5..10))  # -> out; inputs curve: Curve, color: Color, weight: Int32; same code as displaycrv
# 4
preview_4 = CustomPreview(Geometry=ln, Shader=ColourSwatch(SwatchColor=RGB(0, 106, 255)))
expression_2 = Expression(x=ma.Result, Expression="Format(\"Deviazione Integrale : {0:F2} cm\", x)")
number_slider_2 = Slider(1.22, range=0.1..2)

# ---- group: insert a point
pt_2 = Point(Point(51.29320393, -16.39261009, 0))

# ----
join_2 = JoinCurves(Curves=arcdivide.Arcs, Preserve=False)
len_3 = Length(Curve=reb)
len_4 = Length(Curve=join_2)
expression_3 = Expression(x=len_3, y=len_4, Expression="(x-y)/x")
expression_4 = Expression(x=len_3, Expression="Format(\"Lunghezza iniziale : {0:F2} cm\", x)")
expression_5 = Expression(x=len_4, Expression="Format(\"Lunghezza finale : {0:F2} cm\", x)")
expression_6 = Expression(x=expression_3, Expression="Format(\"Differenza : {0:F5} %\", abs(x*100))")
merge = Merge(
    Data1=flatten("Ottimizzazione elemento curvilineo"),
    Data4=flatten(expression_2),
    Data7=flatten(expression_5),
    Data8=flatten(""),
    Data9=flatten(expression_4),
    Data11=flatten(expression_6))  # -> flatten(Result)
lng = ListLength(List=merge)
series = Series(Start=Slider(0, range=0..50), Step=expr("-x*1", number_slider_2), Count=lng)
Y = UnitY(Factor=series)
move_2 = Move(Geometry=pt_2, Motion=Y)  # -> Geometry, Transform
xy = XYPlane(Origin=move_2.Geometry)
# 5
tag_2 = TextTag3D(Location=xy, Text=merge, Size=number_slider_2, Colour=ColourSwatch(SwatchColor=RGB(255, 255, 255)), Justification=7)
