# Grasshopper definition trave su più appoggi.gh (Grasshopper 1.0.7)
# plug-ins: karambaGH

genes = GenePool(Decimals=2, Maximum=1, Minimum=0, Value=[0.22, 0.61, 0.83, 0.47])
galapagos = Galapagos(fitness=analyzethi, gene=genes)

pt = Point(Point(0, 0, 0))
X = UnitX(Factor=Slider(24, range=0..100))
move = Move(Geometry=pt, Motion=X)  # -> Geometry, Transform
ln = Line(StartPoint=pt, EndPoint=move.Geometry)
shatter = Shatter(Curve=reparameterize(ln), Parameters=genes)
join = JoinCurves(Curves=shatter, Preserve=False)
explode = Explode(Curve=join, Recursive=True)  # -> Segments, Vertices
crosecrselect = CrossSectionRangeSelectorKaramba(MaximumHeight_cm=-1, MaximumWidth_cm=-1, menu=[dropdown(1), dropdown(0), dropdown(3)])
Z = UnitZ(Factor="-60")
supp = SupportKaramba(PosInd=explode.Vertices, menu=[buttons(on, on, on, on, off, on)])
linetobeam = LineToBeamKaramba(Line=shatter, New=True, Remove=True, LimitDistance_m=0.005, BeamIdentifier="trave")  # -> Points, Element, Info
loads = LoadsKaramba(Vector=Z, BeamIdentifierS="trave", LCase=0, mode="Uniform Line", menu=[buttons(on, off, off)])
crosecselect = CrossSectionSelectorKaramba(ElementsIdentifiers="trave", NameOrListIndexOfCrossSection=Slider(20, range=0..100), CrossSections=crosecrselect)  # -> CrossSection, Info
assemble = AssembleModelKaramba(Elem=linetobeam.Element, Support=supp, Load=loads, CrossSection=crosecselect.CrossSection, LimitDistance_m=0.005)  # -> Model, Info, Mass_kg, CenterOfGravity
analyzethi = AnalyzeThIKaramba(Model=assemble.Model)  # -> CalculatedModel, MaximumDisplacement_m, ResultingForceOfGravity_kN, ElasticEnergy_kNm
modelview = ModelViewKaramba(
    Model=analyzethi.CalculatedModel,
    LoadCaseFactorsForLinearSuperposition=1,
    IndexIncrementOfVisibleLoadcase=0,
    ListOfColorsForColoringPlots=reverse([ColourSwatch(SwatchColor=RGB(255, 0, 0)), ColourSwatch(SwatchColor=RGB(255, 179, 0)), ColourSwatch(SwatchColor=RGB(255, 255, 0)), ColourSwatch(SwatchColor=RGB(0, 255, 0)), ColourSwatch(SwatchColor=RGB(0, 255, 255)), ColourSwatch(SwatchColor=RGB(4, 177, 255)), ColourSwatch(SwatchColor=RGB(0, 0, 255))]))  # -> Model, DeformedMesh, DeformedAxes, DeformedModel
beamview = BeamViewKaramba(Model=modelview.Model)  # -> Model, MeshesOfRenderedBeams, DeformedBeamAxes, LegendColors, LegendTags
multiplication = Multiplication(A=analyzethi.MaximumDisplacement_m, B=Slider(1000, range=0..1000))
concat = Concatenate(FragmentA="Displacement_", FragmentB=multiplication, FragmentC=" mm")
pt_2 = Point(<point referenced from the Rhino model>)
xz = XZPlane(Origin=pt_2)
tag = TextTag3D(
    Location=xz,
    Text=concat,
    Size=Slider(0.66, range=0.1..1),
    Colour=ColourSwatch(SwatchColor=RGB(255, 255, 255)),
    Justification=7)
