# Grasshopper definition trave arco.gh (Grasshopper 0.9.76)
# plug-ins: Karamba, Tree8

merge = Merge(Data1="0", Data2=Slider(28, range=10..40))
pt = ConstructPoint(XCoordinate=graft(merge), YCoordinate=0, ZCoordinate=0)
neg = Negative(Value=[Slider(12, range=1..30), Slider(24, range=1..30)])
pt_2 = ConstructPoint(XCoordinate=merge, YCoordinate=0, ZCoordinate=graft(neg))
number_slider = Slider(20, range=5..20)
X = UnitX(Factor=number_slider)
move = Move(Geometry=pt, Motion=X)  # -> Geometry, Transform
X_2 = UnitX(Factor=number_slider)
inclinazione_arco = Slider(36.08, range=0..60)
move_2 = Move(Geometry=pt_2, Motion=X_2)  # -> Geometry, Transform
rad = Radians(Degrees=expr("-x", inclinazione_arco))
X_3 = UnitX(Factor=1)
Y = UnitY(Factor=1)
rad_2 = Radians(Degrees=expr("-x", inclinazione_arco))
X_4 = UnitX(Factor=1)
Y_2 = UnitY(Factor=1)
vrot = Rotate(Vector=X_3, Axis=Y, Angle=rad)
vrot_2 = Rotate(Vector=X_4, Axis=Y_2, Angle=rad_2)
arc = ArcSED(Start=pt, End=move.Geometry, Direction=vrot)  # -> Arc, Plane, Radius
arc_2 = ArcSED(Start=pt_2, End=move_2.Geometry, Direction=vrot_2)  # -> Arc, Plane, Radius
divide = DivideCurve(Curve=arc.Arc, Count="40", Kinks=False)  # -> Points, Tangents, Parameters
divide_2 = DivideCurve(Curve=arc_2.Arc, Count="40", Kinks=False)  # -> Points, Tangents, Parameters
pos_del_carico = Slider(9, range=0..40)
number_slider_2 = Slider(20, range=20..190)
crosecrselect = CrossSectionRangeSelectorKaramba(MaximumHeight_cm=-1, MaximumWidth_cm=-1, menu=[dropdown(1), dropdown(1), dropdown(2)])
pline = PolyLine(Vertices=divide.Points, Closed=False)
firstend = FirstEndItem(List=divide.Points)  # -> FirstItem, Remainders, EndItem
crosecrselect_2 = CrossSectionRangeSelectorKaramba(MaximumHeight_cm=-1, MaximumWidth_cm=-1, menu=[dropdown(1), dropdown(1), dropdown(2)])
pline_2 = PolyLine(Vertices=divide_2.Points, Closed=False)
firstend_2 = FirstEndItem(List=divide_2.Points)  # -> FirstItem, Remainders, EndItem
explode = Explode(Curve=pline, Recursive=True)  # -> Segments, Vertices
item = ListItem(List=divide.Points, Index=pos_del_carico, Wrap=True)
merge_2 = Merge(Data1=firstend.FirstItem, Data2=firstend.EndItem)
explode_2 = Explode(Curve=pline_2, Recursive=True)  # -> Segments, Vertices
Z = UnitZ(Factor=expr("-x", number_slider_2))
item_2 = ListItem(List=divide_2.Points, Index=pos_del_carico, Wrap=True)
crosecselect = CrossSectionSelectorKaramba(ElementsIdentifiers="trave", NameOrListIndexOfCrossSection=Slider(10, range=1..24), CrossSections=crosecrselect)  # -> CrossSection, Info
merge_3 = Merge(Data1=firstend_2.FirstItem, Data2=firstend_2.EndItem)
bang = ExplodeTree(Data=merge_2)  # -> Branch0, Branch1
Z_2 = UnitZ(Factor=expr("-x", number_slider_2))
linetobeam = LineToBeamKaramba(Line=explode.Segments, New=True, Remove=True, LimitDistance_m=0.005, BeamIdentifier="trave")  # -> Points, Element, Info
loads = LoadsKaramba(ForceVector=Z, Local=False, PosInd=item, LCase="0", mode="Point")
crosecselect_2 = CrossSectionSelectorKaramba(ElementsIdentifiers="trave", NameOrListIndexOfCrossSection=Slider(10, range=1..24), CrossSections=crosecrselect_2)  # -> CrossSection, Info
bang_2 = ExplodeTree(Data=merge_3)  # -> Branch0, Branch1, Branch2, Branch3
supp = SupportKaramba(PosInd=bang.Branch0, menu=[buttons(on, on, on, on, on, on)])
supp_2 = SupportKaramba(PosInd=bang.Branch1, menu=[buttons(on, on, on, on, off, on)])
linetobeam_2 = LineToBeamKaramba(Line=explode_2.Segments, New=True, Remove=True, LimitDistance_m=0.005, BeamIdentifier="trave")  # -> Points, Element, Info
loads_2 = LoadsKaramba(ForceVector=Z_2, Local=False, PosInd=item_2, LCase="0", mode="Point")
supp_3 = SupportKaramba(PosInd=[bang_2.Branch0, bang_2.Branch2], menu=[buttons(on, on, on, on, on, on)])
supp_4 = SupportKaramba(PosInd=[bang_2.Branch1, bang_2.Branch3], menu=[buttons(on, on, on, on, off, on)])
assemble = AssembleModelKaramba(
    Elem=linetobeam.Element,
    Support=[supp, supp_2],
    Load=loads,
    CrossSection=crosecselect.CrossSection,
    LimitDistance_m=0.005)  # -> Model, Info, Mass_kg, CenterOfGravity
assemble_2 = AssembleModelKaramba(
    Elem=linetobeam_2.Element,
    Support=[supp_3, supp_4],
    Load=loads_2,
    CrossSection=crosecselect_2.CrossSection,
    LimitDistance_m=0.005)  # -> Model, Info, Mass_kg, CenterOfGravity
analyzethi = AnalyzeThIKaramba(Model=assemble.Model)  # -> CalculatedModel, MaximumDisplacement_m, ResultingForceOfGravity_kN, ElasticEnergy_kNm
analyzethi_2 = AnalyzeThIKaramba(Model=assemble_2.Model)  # -> CalculatedModel, MaximumDisplacement_m, ResultingForceOfGravity_kN, ElasticEnergy_kNm
merge_4 = Merge(
    Data1=ColourSwatch(SwatchColor=RGB(255, 0, 0)),
    Data2=ColourSwatch(SwatchColor=RGB(255, 179, 0)),
    Data3=ColourSwatch(SwatchColor=RGB(255, 255, 0)),
    Data4=ColourSwatch(SwatchColor=RGB(0, 255, 0)),
    Data5=ColourSwatch(SwatchColor=RGB(0, 255, 255)),
    Data6=ColourSwatch(SwatchColor=RGB(4, 177, 255)),
    Data7=ColourSwatch(SwatchColor=RGB(0, 0, 255)))
modelview = ModelViewKaramba(Model=analyzethi_2.CalculatedModel, LoadCaseFactorsForLinearSuperposition=1, IndexIncrementOfVisibleLoadcase=0)  # -> Model, DeformedMesh, DeformedAxes, DeformedModel
modelview_2 = ModelViewKaramba(
    Model=analyzethi.CalculatedModel,
    LoadCaseFactorsForLinearSuperposition=1,
    IndexIncrementOfVisibleLoadcase=0,
    ListOfColorsForColoringPlots=merge_4)  # -> Model, DeformedMesh, DeformedAxes, DeformedModel
pt_3 = Point(<point referenced from the Rhino model>)
X_5 = UnitX(Factor=merge)
move_3 = Move(Geometry=pt_3, Motion=X_5)  # -> Geometry, Transform
bang_3 = ExplodeTree(Data=modelview.Model)  # -> _00000, _00100, _01000, _01100
bang_4 = ExplodeTree(Data=modelview.Model)  # -> _00000, _00100
multiplication = Multiplication(A=flatten(analyzethi.MaximumDisplacement_m), B=Slider(100, range=0..100))
xz = XZPlane(Origin=move_3.Geometry)
beamview = BeamViewKaramba(Model=modelview_2.Model)  # -> Model, MeshesOfRenderedBeams, DeformedBeamAxes, LegendColors, LegendTags
concat = Concatenate(FragmentA="displacement ", FragmentB=multiplication, FragmentC=" cm")
beamview_2 = BeamViewKaramba(Model=[bang_4._00000, bang_4._00100])  # -> Model, MeshesOfRenderedBeams, DeformedBeamAxes, LegendColors, LegendTags
beamview_3 = BeamViewKaramba(Model=[bang_3._01000, bang_3._01100])  # -> Model, MeshesOfRenderedBeams, DeformedBeamAxes, LegendColors, LegendTags
tag = TextTag3D(
    Location=xz,
    Text=concat,
    Size=Slider(1, range=1..5),
    Colour=ColourSwatch(SwatchColor=RGB(255, 255, 255)),
    Justification=5)
