# Grasshopper definition analyse parametric arc.gh (Grasshopper 1.0.7)
# plug-ins: Human, Bifocals, karambaGH

crv = Curve(reparameterize(<curve referenced from the Rhino model>))
divide = DivideCurve(Curve=crv, Count=Slider(20, range=5..20), Kinks=False)  # -> Points, Tangents, Parameters
pline = PolyLine(Vertices=divide.Points, Closed=False)
end = EndPoints(Curve=crv)  # -> Start, End
explode = Explode(Curve=pline, Recursive=True)  # -> Segments, Vertices
diameter_cm = Slider(15, range=15..30)
num = Number(expr("x*10", diameter_cm))
num_2 = Number(expr("sin(x)", diameter_cm))
multiplication = Multiplication(A=diameter_cm, B="0.1")
qk_kn_m = Panel("20")
matselect = MaterialSelectionKaramba3D(Color=ColourSwatch(SwatchColor=RGB(213, 0, 255)), menu=[dropdown(0), dropdown(4)])
vec = VectorXYZ(XComponent=0, YComponent=0, ZComponent=expr("-x", qk_kn_m))  # -> Vector, Length
concat = Concatenate(FragmentA="CHS", FragmentB=num, FragmentC=num_2, JoinSeparator="_")
cross_section = CrossSectionKaramba3D(
    FamilyNameOfCrossSection="DefaultCroSec",
    NameOfCrossSection=concat,
    Material=matselect,
    Diameter_cm=diameter_cm,
    WallThickness_cm=multiplication,
    mode="Circular Hollow")

# ---- group: Loads (Karamba3D)
loads = LoadsKaramba3D(Vector=Vector(0, 0, -1), LCase="0", mode="Gravity")

loads_2 = LoadsKaramba3D(Vector=vec.Vector, LCase="0", mode="Uniform Line", menu=[buttons(off, on, off)])

# ----
supp = SupportKaramba3D(PosInd=end.End, menu=[buttons(on, on, on, on, on, on)])
supp_2 = SupportKaramba3D(PosInd=end.Start, menu=[buttons(off, on, on, on, off, on)])

# ---- group: Line to Beam (Karamba3D)
linetobeam = LineToBeamKaramba3D(
    Line=explode.Segments,
    Color=ColourSwatch(SwatchColor=RGB(255, 0, 0)),
    CrossSection=cross_section,
    New=True,
    Remove=True,
    LimitDistance_m=0.005)  # -> Element, Points, Info

# ---- group: Assemble Model (Karamba3D)
assemble = AssembleModelKaramba3D(Elem=linetobeam.Element, Support=[supp, supp_2], Load=[loads, loads_2], LimitDistance_m=0.005)  # -> Model, Info, Mass_kg, CenterOfGravity

# ---- group: Analyze (Karamba3D)
analyze = AnalyzeKaramba3D(Model=assemble.Model)  # -> CalculatedModel, MaximumDisplacement_cm, ResultingForceOfGravity_kN, ElasticEnergy_kNm

# ----
colours = LegendColour()

# ---- group: Model View (Karamba3D)
modelview = ModelViewKaramba3D(
    Model=analyze.CalculatedModel,
    LoadCaseFactorsForLinearSuperposition=1,
    IndexOfVisibleLoadcase=-1,
    ListOfColorsForColoringPlots=colours)  # -> Model, DeformedMesh, DeformedAxes, DeformedModel

# ----
panel = Panel(analyze.MaximumDisplacement_cm)

# ---- group: Beam View (Karamba3D)
beamview = BeamViewKaramba3D(Model=modelview.Model)  # -> Model, MeshesOfRenderedBeams, DeformedBeamAxes, LegendColors, LegendTags

# ----
legend = Legend(Colour=beamview.LegendColors, Tags=beamview.LegendTags, LegendType=1)
preview = CustomPreview(Geometry=beamview.MeshesOfRenderedBeams, Material=ColourSwatch(SwatchColor=RGB(255, 0, 0)))
int = Integer(assemble.Mass_kg)
num_3 = Number(expr("Round(x,0)", assemble.Mass_kg))
num_4 = Number(expr("Round(x*10,1)", analyze.MaximumDisplacement_cm))

# ---- group: Performance parameters
header = Panel("""Mass: 
Deflection: """)
entwine = Entwine(Branch00=int, Branch01=num_4, FlattenInputs=True)  # -> flatten(Result)
units = Panel(""" kg
 mm""")
concat_2 = Concatenate(FragmentA=header, FragmentB=entwine, FragmentC=units)
txt = Text(concat_2)
panel_2 = Panel(txt)
lng = ListLength(List=txt)
series = Series(Start=Slider(68, range=0..100), Step=Slider(31, range=0..100), Count=lng)
pt = ConstructPoint(XCoordinate=Slider(121, range=0..1000), YCoordinate=series, ZCoordinate=0)
texttoscreen = RenderTextToScreen(Text=txt, Location=pt, Size=Slider(15, range=0..100), Color=RGB(0, 0, 0), m_scWithvp=False)

# ==== cluster LegendColour: Legend colour for Karamba
merge = Merge(
    Data1=ColourSwatch(SwatchColor=RGB(255, 0, 0)),
    Data2=ColourSwatch(SwatchColor=RGB(255, 179, 0)),
    Data3=ColourSwatch(SwatchColor=RGB(255, 255, 0)),
    Data4=ColourSwatch(SwatchColor=RGB(0, 255, 0)),
    Data5=ColourSwatch(SwatchColor=RGB(0, 255, 255)),
    Data6=ColourSwatch(SwatchColor=RGB(4, 177, 255)),
    Data7=ColourSwatch(SwatchColor=RGB(0, 0, 255)),
    Data8=ColourSwatch(SwatchColor=RGB(129, 0, 190)),
    Data9=ColourSwatch(SwatchColor=RGB(75, 0, 130)))  # -> reverse(Result)
legend = ClusterOutput(merge)  # List of colours to plug on Karamba Legend
