# Grasshopper definition optimize cross section.gh (Grasshopper 1.0.7)
# plug-ins: Bifocals

construct_point = ConstructPoint(XCoordinate=0, YCoordinate=0, ZCoordinate=0)
vector_xyz = VectorXYZ(XComponent=Slider(8.9, range=2..15), YComponent=0, ZComponent=Slider(0, range=0..15))  # -> Vector, Length
move = Move(Geometry=construct_point, Motion=vector_xyz.Vector)  # -> Geometry, Transform
line = Line(StartPoint=construct_point, EndPoint=move.Geometry)
length = Length(Curve=line)
panel = Panel(length)
discretize_length = Panel("0.30")
division = Division(A=length, B=discretize_length)
divide_curve = DivideCurve(Curve=line, Count=division, Kinks=False)  # -> Points, Tangents, Parameters
polyline = PolyLine(Vertices=divide_curve.Points, Closed=False)
explode = Explode(Curve=polyline, Recursive=True)  # -> Segments, Vertices
