# Grasshopper definition utilization check.gh (Grasshopper 1.0.7)
# plug-ins: Bifocals, karambaGH

construct_point = ConstructPoint(XCoordinate=0, YCoordinate=0, ZCoordinate=0)
vector_xyz = VectorXYZ(XComponent=Slider(11.1, range=2..15), YComponent=0, ZComponent=Slider(0, range=0..15))  # -> Vector, Length
move = Move(Geometry=construct_point, Motion=vector_xyz.Vector)  # -> Geometry, Transform
line = Line(StartPoint=construct_point, EndPoint=move.Geometry)
length = Length(Curve=line)
panel = Panel(length)
number_slider = Slider(12, range=0..100)
discretize_length = Panel("0.15")
material_selection_karamba3d = MaterialSelectionKaramba3D(menu=[dropdown(4), dropdown(2)])
range = Range(Domain="20 to 80", Steps=Slider(60, range=0..100))
division = Division(A=length, B=discretize_length)
divide_curve = DivideCurve(Curve=line, Count=division, Kinks=False)  # -> Points, Tangents, Parameters
unit_z = UnitZ(Factor=expr("-x/2", range))
polyline = PolyLine(Vertices=divide_curve.Points, Closed=False)
cross_section_karamba3d = CrossSectionKaramba3D(
    FamilyNameOfCrossSection="Rectangle",
    Material=material_selection_karamba3d,
    LocalEccentricity_cm=unit_z,
    Height_cm=range,
    UpperFlangeWidth_cm="20",
    LowerFlangeWidth_cm="20",
    mode="Trapezoid")
panel_2 = Panel("15")  # "kN/ml"
explode = Explode(Curve=polyline, Recursive=True)  # -> Segments, Vertices
end_points = EndPoints(Curve=line)  # -> Start, End
cross_section_selector_karamba3d = CrossSectionSelectorKaramba3D(CrossSections=cross_section_karamba3d)  # -> CrossSection, Info
unit_z_2 = UnitZ(Factor=expr("-x", panel_2))
loads_karamba3d = LoadsKaramba3D(Vector=unit_z_2, LCase=0, mode="Uniform Line", menu=[buttons(off, on, off)])
support_karamba3d = SupportKaramba3D(PosInd=end_points.Start, menu=[buttons(on, on, on, on, on, on)])
support_karamba3d_2 = SupportKaramba3D(PosInd=end_points.End, menu=[buttons(on, on, on, on, on, on)])
line_to_beam_karamba3d = LineToBeamKaramba3D(
    Line=explode.Segments,
    CrossSection=cross_section_selector_karamba3d.CrossSection,
    New=True,
    Remove=True,
    LimitDistance_m=0.005)  # -> Element, Points, Info
support_karamba3d_3 = SupportKaramba3D([support_karamba3d, support_karamba3d_2])
assemble_model_karamba3d = AssembleModelKaramba3D(Elem=line_to_beam_karamba3d.Element, Support=support_karamba3d_3, Load=loads_karamba3d, LimitDistance_m=0.005)  # -> Model, Info, Mass_kg, CenterOfGravity
analyze_karamba3d = AnalyzeKaramba3D(Model=assemble_model_karamba3d.Model)  # -> CalculatedModel, MaximumDisplacement_cm, ResultingForceOfGravity_kN, ElasticEnergy_kNm
model_view_karamba3d = ModelViewKaramba3D(Model=assemble_model_karamba3d.Model, LoadCaseFactorsForLinearSuperposition=1, IndexOfVisibleLoadcase=-1)  # -> Model, DeformedMesh, DeformedAxes, DeformedModel
optimize_cross_section_karamba3d = OptimizeCrossSectionKaramba3D(
    Model=analyze_karamba3d.CalculatedModel,
    CrossSections=cross_section_karamba3d,
    MaximumUtilization=1,
    MaximumDisplacement_cm=-1,
    UltimateLimitStateIterations=Slider(25, range=0..100),
    DisplacementIterations=5,
    NumberOfSamplePoints=3,
    ElasticDesign=True,
    GammaM0=1,
    GammaM1=1)  # -> ModelWithOptimizedCrossSections, Info, Mass_kg, MaximumDisplacement_cm, ElasticEnergy_kNm
panel_3 = Panel(optimize_cross_section_karamba3d.ModelWithOptimizedCrossSections)
beam_view_karamba3d = BeamViewKaramba3D(Model=model_view_karamba3d.Model)  # -> Model, MeshesOfRenderedBeams, DeformedBeamAxes, LegendColors, LegendTags
model_view_karamba3d_2 = ModelViewKaramba3D(
    Model=optimize_cross_section_karamba3d.ModelWithOptimizedCrossSections,
    LoadCaseFactorsForLinearSuperposition=1,
    IndexOfVisibleLoadcase=-1)  # -> Model, DeformedMesh, DeformedAxes, DeformedModel
beam_view_karamba3d_2 = BeamViewKaramba3D(Model=model_view_karamba3d_2.Model)  # -> Model, MeshesOfRenderedBeams, DeformedBeamAxes, LegendColors, LegendTags
