# Grasshopper definition copertina immagina FB.gh (Grasshopper 1.0.7)
# plug-ins: Karamba, BullAnt, Human, Kangaroo Components

rectangle = Rectangle(Plane=PlaneXY(0, 0, 0), XSize="0.0 to 1.0", YSize="0.0 to 1.0", Radius=0)  # -> Rectangle, Length
srf = Surface(rectangle.Rectangle)
edges = BrepEdges(Brep=srf)  # -> Naked, Interior, NonManifold
item = ListItem(List=edges.Naked, Index=1, Wrap=True)  # -> Item, Item1, Item2, Item3
crv = Curve(item.Item)
crv_2 = Curve(item.Item2)

genes_a = GenePool(
    Decimals=2,
    Maximum=1,
    Minimum=0,
    Value=[0.1244131043, 0.5435865771, 0.1031987141, 0.7424204688, 0.3907550869, 0.8969109184, 0.9967270871, 0.564713816])

genes_a_2 = GenePool(
    Decimals=2,
    Maximum=1,
    Minimum=0,
    Value=[0.1838005382, 0.3831064329, 0.7429523108, 0.2117494228, 0.055101304, 0.2046375905, 0.5395389776, 0.4617244546])
number_slider = Slider(8, range=0..10)

# ----
# Angolo rette piano {u;v}
genes_b = GenePool(
    Decimals=0,
    Maximum=75,
    Minimum=0,
    Value=[14.74461052, 62.58243435, 66.50301735, 46.89328074, 31.55102093, 14.96922506, 64.35763926, 28.1208048])
number_slider_2 = Slider(30, range=0..75)

# ----
# Punto di inizio spirali
# Angolo rette piano {u;v}
genes_b_2 = GenePool(Decimals=0, Maximum=75, Minimum=0, Value=[10, 73.95698726, 54, 17.01495051, 50, 73.50024283, 18.29485148, 40.04048109])

button = Button()
number_slider_3 = Slider(0, range=0..100)
repeat = RepeatData(Data=genes_b, Length=number_slider)
range = Range(Domain=Domain(0, 1), Steps=number_slider)
# Punto di inizio spirali
panel = Panel("0")
range_2 = Range(Domain=Domain(0, 1), Steps=Slider(6, range=0..10))
neg = Negative(Value=repeat)
cull_i = CullIndex(List=range, Indices=panel, Wrap=True)
cull_i_2 = CullIndex(List=range_2, Indices="0", Wrap=True)
crv_3 = Curve(item.Item3)
crv_4 = Curve([item.Item1, crv])

rad = Radians(Degrees=expr("-x", neg))
X = UnitX(Factor=1)
Z = UnitZ(Factor=1)
eval = EvaluateCurve(Curve=reparameterize(crv_2), Parameter=genes_a)  # -> graft(Point), Tangent, Angle
vrot = Rotate(Vector=X, Axis=Z, Angle=rad)
boundary_curve = Curve(crv_4)
line = LineSDL(Start=eval.Point, Direction=graft(vrot), Length=Slider(2, range=0..10))
ccx = CurveCurve(CurveA=line, CurveB=boundary_curve)  # -> Points, ParamsA, ParamsB
clean = CleanTree(RemoveNulls=True, RemoveInvalid=True, RemoveEmpty=invert(False), Tree=ccx.Points)
ln = Line(StartPoint=eval.Point, EndPoint=clean)

rad_2 = Radians(Degrees=expr("-x", repeat))
X_2 = UnitX(Factor=1)
Z_2 = UnitZ(Factor=1)
eval_2 = EvaluateCurve(Curve=reparameterize(crv_2), Parameter=genes_a_2)  # -> graft(Point), Tangent, Angle
vrot_2 = Rotate(Vector=X_2, Axis=Z_2, Angle=rad_2)
boundary_curve_2 = Curve([item.Item3, crv])
line_2 = LineSDL(Start=eval_2.Point, Direction=graft(vrot_2), Length=Slider(2, range=0..10))
ccx_2 = CurveCurve(CurveA=line_2, CurveB=boundary_curve_2)  # -> Points, ParamsA, ParamsB
clean_2 = CleanTree(RemoveNulls=True, RemoveInvalid=True, RemoveEmpty=invert(False), Tree=ccx_2.Points)
ln_2 = Line(StartPoint=eval_2.Point, EndPoint=clean_2)

degree = Slider(56.44, range=0..75)
degree_2 = Slider(56.44, range=0..75)
degree_3 = Slider(56.44, range=0..75)
degree_4 = Slider(41.16, range=0..75)

degree_5 = Slider(56.44, range=0..75)
degree_6 = Slider(56.44, range=0..75)
degree_7 = Slider(56.44, range=0..75)
degree_8 = Slider(41.16, range=0..75)

rad_3 = Radians(Degrees=expr("-x", neg))
X_3 = UnitX(Factor=1)
Z_3 = UnitZ(Factor=1)
crv_cp = CurveClosestPoint(Point=clean, Curve=crv_3)  # -> Point, Parameter, Distance
vrot_3 = Rotate(Vector=X_3, Axis=Z_3, Angle=rad_3)
line_3 = LineSDL(Start=crv_cp.Point, Direction=graft(vrot_3), Length=Slider(2, range=0..10))
ccx_3 = CurveCurve(CurveA=line_3, CurveB=boundary_curve)  # -> Points, ParamsA, ParamsB
clean_3 = CleanTree(RemoveNulls=True, RemoveInvalid=True, RemoveEmpty=invert(False), Tree=ccx_3.Points)
ln_3 = Line(StartPoint=crv_cp.Point, EndPoint=clean_3)

rad_4 = Radians(Degrees=expr("-x", repeat))
X_4 = UnitX(Factor=1)
Z_4 = UnitZ(Factor=1)
crv_cp_2 = CurveClosestPoint(Point=clean_2, Curve=item.Item1)  # -> Point, Parameter, Distance
vrot_4 = Rotate(Vector=X_4, Axis=Z_4, Angle=rad_4)
line_4 = LineSDL(Start=crv_cp_2.Point, Direction=graft(vrot_4), Length=Slider(2, range=0..10))
ccx_4 = CurveCurve(CurveA=line_4, CurveB=boundary_curve_2)  # -> Points, ParamsA, ParamsB
clean_4 = CleanTree(RemoveNulls=True, RemoveInvalid=True, RemoveEmpty=invert(False), Tree=ccx_4.Points)
ln_4 = Line(StartPoint=crv_cp_2.Point, EndPoint=clean_4)

rad_5 = Radians(Degrees=expr("-x", neg))
X_5 = UnitX(Factor=1)
Z_5 = UnitZ(Factor=1)
crv_cp_3 = CurveClosestPoint(Point=clean_3, Curve=crv_3)  # -> Point, Parameter, Distance
vrot_5 = Rotate(Vector=X_5, Axis=Z_5, Angle=rad_5)
line_5 = LineSDL(Start=crv_cp_3.Point, Direction=graft(vrot_5), Length=Slider(2, range=0..10))
ccx_5 = CurveCurve(CurveA=line_5, CurveB=boundary_curve)  # -> Points, ParamsA, ParamsB
clean_5 = CleanTree(RemoveNulls=True, RemoveInvalid=True, RemoveEmpty=invert(False), Tree=ccx_5.Points)
ln_5 = Line(StartPoint=crv_cp_3.Point, EndPoint=clean_5)

rad_6 = Radians(Degrees=expr("-x", repeat))
X_6 = UnitX(Factor=1)
Z_6 = UnitZ(Factor=1)
crv_cp_4 = CurveClosestPoint(Point=clean_4, Curve=item.Item1)  # -> Point, Parameter, Distance
vrot_6 = Rotate(Vector=X_6, Axis=Z_6, Angle=rad_6)
line_6 = LineSDL(Start=crv_cp_4.Point, Direction=graft(vrot_6), Length=Slider(2, range=0..10))
ccx_6 = CurveCurve(CurveA=line_6, CurveB=boundary_curve_2)  # -> Points, ParamsA, ParamsB
clean_6 = CleanTree(RemoveNulls=True, RemoveInvalid=True, RemoveEmpty=invert(False), Tree=ccx_6.Points)
ln_6 = Line(StartPoint=crv_cp_4.Point, EndPoint=clean_6)

rad_7 = Radians(Degrees=expr("-x", neg))
X_7 = UnitX(Factor=1)
Z_7 = UnitZ(Factor=1)
crv_cp_5 = CurveClosestPoint(Point=clean_5, Curve=crv_3)  # -> Point, Parameter, Distance
vrot_7 = Rotate(Vector=X_7, Axis=Z_7, Angle=rad_7)
line_7 = LineSDL(Start=crv_cp_5.Point, Direction=graft(vrot_7), Length=Slider(2, range=0..10))
ccx_7 = CurveCurve(CurveA=line_7, CurveB=boundary_curve)  # -> Points, ParamsA, ParamsB
clean_7 = CleanTree(RemoveNulls=True, RemoveInvalid=True, RemoveEmpty=invert(False), Tree=ccx_7.Points)
ln_7 = Line(StartPoint=crv_cp_5.Point, EndPoint=clean_7)

rad_8 = Radians(Degrees=expr("-x", repeat))
X_8 = UnitX(Factor=1)
Z_8 = UnitZ(Factor=1)
crv_cp_6 = CurveClosestPoint(Point=clean_6, Curve=item.Item1)  # -> Point, Parameter, Distance
vrot_8 = Rotate(Vector=X_8, Axis=Z_8, Angle=rad_8)
line_8 = LineSDL(Start=crv_cp_6.Point, Direction=graft(vrot_8), Length=Slider(2, range=0..10))
ccx_8 = CurveCurve(CurveA=line_8, CurveB=boundary_curve_2)  # -> Points, ParamsA, ParamsB
clean_8 = CleanTree(RemoveNulls=True, RemoveInvalid=True, RemoveEmpty=invert(False), Tree=ccx_8.Points)
ln_8 = Line(StartPoint=crv_cp_6.Point, EndPoint=clean_8)

rad_9 = Radians(Degrees=expr("-x", neg))
X_9 = UnitX(Factor=1)
Z_9 = UnitZ(Factor=1)
crv_cp_7 = CurveClosestPoint(Point=clean_7, Curve=crv_3)  # -> Point, Parameter, Distance
vrot_9 = Rotate(Vector=X_9, Axis=Z_9, Angle=rad_9)
line_9 = LineSDL(Start=crv_cp_7.Point, Direction=graft(vrot_9), Length=Slider(2, range=0..10))
ccx_9 = CurveCurve(CurveA=line_9, CurveB=boundary_curve)  # -> Points, ParamsA, ParamsB
clean_9 = CleanTree(RemoveNulls=True, RemoveInvalid=True, RemoveEmpty=invert(False), Tree=ccx_9.Points)
ln_9 = Line(StartPoint=crv_cp_7.Point, EndPoint=clean_9)

rad_10 = Radians(Degrees=expr("-x", repeat))
X_10 = UnitX(Factor=1)
Z_10 = UnitZ(Factor=1)
crv_cp_8 = CurveClosestPoint(Point=clean_8, Curve=item.Item1)  # -> Point, Parameter, Distance
vrot_10 = Rotate(Vector=X_10, Axis=Z_10, Angle=rad_10)
line_10 = LineSDL(Start=crv_cp_8.Point, Direction=graft(vrot_10), Length=Slider(2, range=0..10))
ccx_10 = CurveCurve(CurveA=line_10, CurveB=boundary_curve_2)  # -> Points, ParamsA, ParamsB
clean_10 = CleanTree(RemoveNulls=True, RemoveInvalid=True, RemoveEmpty=invert(False), Tree=ccx_10.Points)
ln_10 = Line(StartPoint=crv_cp_8.Point, EndPoint=clean_10)

entwine = Entwine(
    Branch00=flatten(ln_2),
    Branch01=flatten(ln_4),
    Branch02=flatten(ln_6),
    Branch03=flatten(ln_8),
    Branch04=flatten(ln_10),
    FlattenInputs=True)
entwine_2 = Entwine(
    Branch00=flatten(ln),
    Branch01=flatten(ln_3),
    Branch02=flatten(ln_5),
    Branch03=flatten(ln_7),
    Branch04=flatten(ln_9),
    FlattenInputs=True)
merge = Merge(Data1=entwine, Data2=entwine_2)
flip = FlipMatrix(Data=merge)
len = Length(Curve=flip)

# ----
# Torus
number_slider_4 = Slider(22.1, range=0..22.1)
tangent_boundary = Slider(90, range=0..90)
X_11 = UnitX(Factor=1)
rad_11 = Radians(Degrees=tangent_boundary)
Z_11 = UnitZ(Factor=1)
vrot_11 = Rotate(Vector=X_11, Axis=Z_11, Angle=rad_11)
X_12 = UnitX(Factor=expr("x*2", number_slider_4))
arc = ArcSED(Start="{0,0,0}", End=X_12, Direction=vrot_11)  # -> Arc, Plane, Radius
range_3 = Range(Domain=Domain(0, 1), Steps=Slider(1, range=0..100))
eval_3 = EvaluateCurve(Curve=reparameterize(arc.Arc), Parameter=range_3)  # -> Point, Tangent, Angle
pl = PlaneNormal(Origin=eval_3.Point, ZAxis=eval_3.Tangent)
ellipse = Ellipse(Plane=pl, Radius1=Slider(3.25, range=1..5), Radius2=Slider(2.5, range=1..5))  # -> Ellipse, Focus1, Focus2
seam = Seam(Curve=reparameterize(ellipse.Ellipse), Seam="0.00")
swp1 = Sweep1(Rail=arc.Arc, Sections=seam, Miter=1)

equals = Equality(FirstNumber=len, SecondNumber="0.00")  # -> Equality, Inequality
cull = CullPattern(List=flip, CullPattern=equals.Inequality)
clean_11 = CleanTree(RemoveNulls=True, RemoveInvalid=True, RemoveEmpty=invert(False), Tree=cull)
divide = DivideCurve(Curve=clean_11, Count=Slider(1000, range=0..1000), Kinks=False)  # -> Points, Tangents, Parameters
trim = TrimTree(Tree=simplify(divide.Points), Depth=Slider(1, range=0..10))
crvsrf = CurveOnSurface(Surface=reparameterize(swp1), UVCoordinates=simplify(divide.Points), Closed=False)  # -> Curve, Length, Domain

# ----
# Velocity
panel_2 = Panel("100")  # disabled
range_4 = Range(Domain=Domain(0, 1), Steps=panel_2)  # disabled
cdiv = Derivatives(Curve=reparameterize(graft(crvsrf.Curve)), Parameter=range_4)  # -> Point, FirstDerivative; disabled
vlen = VectorLength(Vector=cdiv.FirstDerivative)  # disabled
bnd = Bounds(Numbers=vlen)  # disabled

join = JoinCurves(Curves=flatten(crvsrf.Curve), Preserve=False)  # -> graft(Curves)
number_slider_5 = Slider(62, range=0..100)  # disabled
number_slider_6 = Slider(11, range=0..100)  # disabled
number_slider_7 = Slider(14, range=0..100)  # disabled
panel_3 = Panel("0 to 0.9")  # disabled
tstat = TreeStatistics(Tree=join)  # -> Paths, Length, Count; disabled
range_5 = Range(Domain=panel_3, Steps=expr("x-1", tstat.Length))  # disabled
vec = VectorXYZ(XComponent=number_slider_5, YComponent=number_slider_6, ZComponent=0)  # -> Vector, Length; disabled
hsl = ColourHSL(Alpha=1, Hue=range_5, Saturation=1, Luminance=0.5)  # disabled
graph = QuickGraph(vlen, SortOrder=0)  # disabled
flatten = FlattenTree(Tree=join, Path="{0}")
number_slider_8 = Slider(3, range=1..20)  # disabled
end = EndPoints(Curve=flatten)  # -> Start, End
panel_4 = Panel("0 to 0.9")  # disabled
swatch = ColourSwatch(SwatchColor=RGB(255, 255, 255))  # disabled
fcircle = CircleFit(Points=flatten(end.Start))  # -> Circle, Radius, Deviation
fcircle_2 = CircleFit(Points=flatten(end.End))  # -> Circle, Radius, Deviation
ccx_11 = CurveCurve(CurveA=graft(flatten), CurveB=flatten(flatten))  # -> Points, ParamsA, ParamsB
previewlw = CustomPreviewLineweights(Geometry=crvsrf.Curve, Shader=swatch, Absolute=False)  # disabled
trim_2 = TrimTree(Tree=ccx_11.ParamsA, Depth=1)
ccx_12 = CurveCurve(CurveA=fcircle_2.Circle, CurveB=flatten)  # -> Points, ParamsA, ParamsB
ccx_13 = CurveCurve(CurveA=fcircle.Circle, CurveB=flatten)  # -> Points, ParamsA, ParamsB
number_slider_9 = Slider(3, range=1..20)  # disabled
shatter = Shatter(Curve=graft(flatten), Parameters=trim_2)
shatter_2 = Shatter(Curve=fcircle_2.Circle, Parameters=flatten(ccx_12.ParamsA))
shatter_3 = Shatter(Curve=fcircle.Circle, Parameters=flatten(ccx_13.ParamsA))
number_slider_10 = Slider(4, range=0..10)  # disabled

# ----
# Curve
merge_2 = Merge(Data1=shatter, Data3=shatter_3, Data4=shatter_2)  # -> flatten(Result)

ggcnp = GgNetworkPolygons(Curves=merge_2, PerimOrVoid=number_slider_10)  # disabled
crv_5 = Curve(merge_2)
explode = Explode(Curve=ggcnp, Recursive=True)  # -> Segments, Vertices; disabled
panel_5 = Panel("4")  # disabled
panel_6 = Panel("3")  # disabled

ggcp = GgCatalogueProfile(Region="EuroProfile", Serial="CHS219.1x8.0", Type="Circular Hollow Sections")  # disabled
ggsweep = GgSweepProfile(Rail=flatten, Profile=ggcp, Integer=6)  # disabled

prune = PruneTree(Tree=explode.Segments, Minimum=panel_6, Maximum=panel_6)  # disabled
prune_2 = PruneTree(Tree=explode.Segments, Minimum=panel_5, Maximum=panel_5)  # disabled
divide_2 = DivideCurve(Curve=crv_5, Count=10, Kinks=False)  # -> Points, Tangents, Parameters
item_2 = ListItem(List=prune_2, Index=0, Wrap=True)  # -> Item, Item1, Item2, Item3; disabled
item_3 = ListItem(List=prune, Index=0, Wrap=True)  # -> Item, Item1, Item2; disabled
edgesrf = EdgeSurface(CurveA=item_2.Item, CurveB=item_2.Item1, CurveC=item_2.Item2, CurveD=item_2.Item3)  # disabled
edgesrf_2 = EdgeSurface(CurveA=item_3.Item, CurveB=item_3.Item1, CurveC=item_3.Item2)  # disabled
pline = PolyLine(Vertices=divide_2.Points, Closed=False)
explode_2 = Explode(Curve=pline, Recursive=True)  # -> Segments, Vertices
end_2 = EndPoints(Curve=crv_5)  # -> Start, End
duppt = RemoveDuplicatePts(Points=[end_2.Start, end_2.End], Tolerance=0.01)
end_3 = EndPoints(Curve=flatten)  # -> Start, End

number_slider_11 = Slider(4, range=3..6)
len_2 = Length(Curve=arc.Arc)
lng = ListLength(List=duppt)
expression = Expression(q=number_slider_11, Larc=len_2, largh=Slider(4, range=0..10), N=lng, Expression="(q*Larc*largh)/N")
panel_7 = Panel("""0
2""")
panel_8 = Panel("""1
2""")
Z_12 = UnitZ(Factor=expr("-x", expression))
loads = LoadsKaramba(Vector=Vector(0, 0, -1), LCase=graft(panel_7), mode="Gravity")
loads_2 = LoadsKaramba(ForceVector=Z_12, Local=False, PosInd=duppt, LCase=graft(panel_8), mode="Point")
load = LoadKaramba([loads_2, loads])

duppt_2 = RemoveDuplicatePts(Points=[end_3.Start, end_3.End], Tolerance=0.01)
tstat_2 = TreeStatistics(Tree=explode_2.Segments)  # -> Paths, Length, Count
pdecon = Deconstruct(Point=duppt_2)  # -> XComponent, YComponent, ZComponent
concat = Concatenate(FragmentA="spiral", FragmentB=tstat_2.Paths)  # -> graft(Result)
crosecrselect = CrossSectionRangeSelectorKaramba(MaximumHeight_cm=-1, MaximumWidth_cm=-1, menu=[dropdown(0), dropdown(3), dropdown(4)])
larger = LargerThan(FirstNumber=pdecon.YComponent, SecondNumber=Slider(1, range=0..1))  # -> LargerThan, OrEqualTo
cull_2 = CullPattern(List=duppt_2, CullPattern=invert(larger.LargerThan))
panel_9 = Panel(crosecrselect)
supp = SupportKaramba(PosInd=cull_2, menu=[buttons(on, on, on, off, off, off)])
crosecselect = CrossSectionSelectorKaramba(ElementsIdentifiers="spiral", NameOrListIndexOfCrossSection=Slider(120, range=0..1000), CrossSections=crosecrselect)  # -> CrossSection, Info
linetobeam = LineToBeamKaramba3D(
    Line=explode_2.Segments,
    Identifier=concat,
    CrossSection=crosecselect.CrossSection,
    New=True,
    Remove=True,
    LimitDistance_m=0.005)  # -> Element, Points, Info
panel_10 = Panel(loads)  # disabled
B = Panel("""0
0
0
0
0
255
211
130""")
R = Panel("""255
255
255
255
124
0
148
75""")
G = Panel("""0
0
144
215
252
0
0
0""")
assemble = AssembleModelKaramba(
    Elem=flatten(linetobeam.Element),
    Support=supp,
    Load=flatten(load),
    CrossSection=crosecselect.CrossSection,
    LimitDistance_m=0.005)  # -> Model, Info, Mass_kg, CenterOfGravity
crosecrselect_2 = CrossSectionRangeSelectorKaramba(MaximumHeight_cm=-1, MaximumWidth_cm=-1, menu=[dropdown(0), dropdown(0), dropdown(0)])
analyzethi = AnalyzeThIKaramba(Model=assemble.Model)  # -> CalculatedModel, MaximumDisplacement_m, ResultingForceOfGravity_kN, ElasticEnergy_kNm
rgb = ColourRGB(Alpha=255, Red=R, Green=G, Blue=B)
opticrosec = OptimizeCrossSectionKaramba(
    Model=assemble.Model,
    GroupIdentifiers=flatten(concat),
    CrossSections=crosecrselect_2,
    MaximumUtilization="0.80",
    MaximumDisplacement_m=-1,
    UltimateLimitStateIterations=5,
    DisplacementIterations=5,
    NumberOfSamplePoints=3,
    ElasticDesign=True,
    GammaM0=1,
    GammaM1=1)  # -> ModelWithOptimizedCrossSections, Info, Mass_kg, MaximumDisplacement_m, ElasticEnergy_kNm
panel_11 = Panel(analyzethi.MaximumDisplacement_m)
range_6 = Range(Domain=Domain(0, 1), Steps=Slider(20, range=0..100))
gradient = Gradient(LowerLimit=0, UpperLimit=1, Parameter=range_6, stops=[0: RGB(255, 255, 255), 1: RGB(0, 0, 0)])
num = Number(opticrosec.Mass_kg)
galapagos = Galapagos(fitness=opticrosec, gene=[genes_b, genes_a_2, genes_a])
modelview = ModelViewKaramba3D(
    Model=analyzethi.CalculatedModel,
    LoadCaseFactorsForLinearSuperposition=1,
    IndexOfVisibleLoadcase=-1,
    ListOfColorsForColoringPlots=gradient)  # -> Model, DeformedMesh, DeformedAxes, DeformedModel
panel_12 = Panel(num)
beamview = BeamViewKaramba(Model=modelview.Model)  # -> Model, MeshesOfRenderedBeams, DeformedBeamAxes, LegendColors, LegendTags
preview = CustomPreview(Geometry=beamview.MeshesOfRenderedBeams, Material=ColourSwatch(SwatchColor=RGB(143, 143, 143)))
legend = Legend(Colour=beamview.LegendColors, Tags=beamview.LegendTags, LegendType=1)

# ----
# Spazio uv
number_slider_12 = Slider(20, range=0..100)  # disabled
area = Area(Geometry=srf)  # -> Area, Centroid; disabled
X_13 = UnitX(Factor=number_slider_12)  # disabled
move = Move(Geometry=clean_11, Motion=X_13)  # -> Geometry, Transform; disabled
panel_13 = Panel("0 to 0.9")  # disabled
number_slider_13 = Slider(3, range=1..20)  # disabled

scale = Scale(Geometry=clean_11, Center=area.Centroid, Factor=number_slider_7)  # -> Geometry, Transform; disabled
move_2 = Move(Geometry=scale.Geometry, Motion=vec.Vector)  # -> Geometry, Transform; disabled

tstat_3 = TreeStatistics(Tree=move_2.Geometry)  # -> Paths, Length, Count; disabled
lng_2 = ListLength(List=tstat_3.Paths)  # -> expr("x-1", Length); disabled
range_7 = Range(Domain=panel_13, Steps=lng_2)  # disabled
hsl_2 = ColourHSL(Alpha=1, Hue=range_7, Saturation=1, Luminance=0.5)  # disabled
displaycrv = DisplayCurve(curve=move_2.Geometry, color=graft(hsl_2), weight=number_slider_13)  # -> out; inputs curve: Curve, color: Color, weight: Int32; disabled
# ---------- displaycrv: C# ----------
    // silently skip null curves
    if(curve == null) return;

    // add to display cache
    _curves.Add(curve);
    _colors.Add(color);
    _weights.Add(weight);
    _clippingBox.Union(curve.GetBoundingBox(false));
# ---------- displaycrv: C# additional code ----------
  List<Curve> _curves;
  List<Color> _colors;
  List<int> _weights;
  BoundingBox _clippingBox;


  /// <summary>
  /// This method will be called once every solution, before any calls to RunScript.
  /// </summary>
  public override void BeforeRunScript()
  {
    _curves = new List<Curve>();
    _colors = new List<Color>();
    _weights = new List<int>();
    _clippingBox = new BoundingBox();
  }


  //
  public override BoundingBox ClippingBox
  {
    get{return _clippingBox;}
  }


  //
  public override void DrawViewportWires(IGH_PreviewArgs args)
  {
    base.DrawViewportWires(args);

    for(int i = 0; i < _curves.Count; i++)
      args.Display.DrawCurve(_curves[i], _colors[i], _weights[i]);
  }
# ---------- end displaycrv ----------

displaycrv_2 = DisplayCurve(curve=join, color=graft(hsl_2), weight=number_slider_8)  # -> out; inputs curve: Curve, color: Color, weight: Int32; disabled; same code as displaycrv
tstat_4 = TreeStatistics(Tree=move.Geometry)  # -> Paths, Length, Count; disabled
lng_3 = ListLength(List=tstat_4.Paths)  # -> expr("x-1", Length); disabled
range_8 = Range(Domain=panel_4, Steps=lng_3)  # disabled
hsl_3 = ColourHSL(Alpha=1, Hue=range_8, Saturation=1, Luminance=0.5)  # disabled
displaycrv_3 = DisplayCurve(curve=move.Geometry, color=graft(hsl_3), weight=number_slider_9)  # -> out; inputs curve: Curve, color: Color, weight: Int32; disabled; same code as displaycrv

srfsplit = SurfaceSplit(Surface=swp1, Curves=merge_2)  # disabled
lng_4 = ListLength(List=srfsplit)
random = Random(Range="0 to 0.9", Number=lng_4, Seed=Slider(5, range=1..10))
hsl_4 = ColourHSL(Alpha=1, Hue=random, Saturation=1, Luminance=0.5)
swatch_2 = ColourSwatch(SwatchColor=RGB(0, 0, 0))  # disabled
preview_2 = CustomPreview(Geometry=srfsplit, Shader=hsl_4)
preview_3 = CustomPreview(Geometry=ggsweep, Shader=swatch_2)  # disabled
createatts = CreateAttributes(Color=swatch_2, enableFullPath=False)  # disabled
createatts_2 = CreateAttributes(Color=hsl_4, enableFullPath=False)  # disabled
createatts_3 = CreateAttributes(Color=graft(hsl_2), enableFullPath=False)  # disabled
bake = BakeGeometry(Bake=button, Geometry=ggsweep, Attributes=createatts, DeleteOldBakes=False, PreserveTrees=False)  # disabled
bake_2 = BakeGeometry(Bake=button, Geometry=srfsplit, Attributes=createatts_2, DeleteOldBakes=False, PreserveTrees=False)  # disabled
bake_3 = BakeGeometry(Bake=button, Geometry=move_2.Geometry, Attributes=createatts_3, DeleteOldBakes=False, PreserveTrees=False)  # disabled
