# Grasshopper definition optimization loop.gh (Grasshopper 0.9.76)
# plug-ins: Karamba, Anemone

crv = Curve(<curve referenced from the Rhino model>)
explode = Explode(Curve=crv, Recursive=True)  # -> Segments, Vertices
panel = Panel("""0
2""")
number_slider = Slider(50, range=0..100)
item = ListItem(List=explode.Vertices, Index=panel, Wrap=True)
fastloopstart = FastLoopStart(Iterations="2", Data=Slider(633, range=0..1000))  # -> port, Counter, Data
linetobeam = LineToBeamKaramba(Line=explode.Segments, New=True, Remove=True, LimitDistance_m=0.005)  # -> Points, Element, Info
Z = UnitZ(Factor=expr("-x", Slider(3000, range=0..10000)))
difference = SetDifference(SetA=explode.Vertices, SetB=item)
modifyelem = ModifyElementKaramba(Beam=linetobeam.Element, Bending=Toggle(False), mode="Beam")
supp = SupportKaramba(PosInd=item, menu=[buttons(on, on, on, off, off, on)])
loads = LoadsKaramba(ForceVector=Z, Local=False, PosInd=difference, LCase=0, mode="Point")
cross_sections = CrossSectionsKaramba(Diameter_cm=fastloopstart.Data, WallThickness_cm=0.4, mode="Circular Hollow")
matprops = MaterialPropertiesKaramba(
    YoungsModulus_kN_cm2=21000,
    ShearModulus_kN_cm2=8076,
    SpecificWeight_kN_m3=78.5,
    CoefficientOfThermalExpansion_1_C=1e-05,
    YieldStrength_kN_cm2="25",
    Name="S235")
assemble = AssembleModelKaramba(Elem=modifyelem, Support=supp, Load=loads, CrossSection=cross_sections, Material=matprops, LimitDistance_m=0.005)  # -> Model, Info, Mass_kg, CenterOfGravity
analyzethi = AnalyzeThIKaramba(Model=assemble.Model)  # -> CalculatedModel, MaximumDisplacement_m, ResultingForceOfGravity_kN, ElasticEnergy_kNm
modelview = ModelViewKaramba(Model=analyzethi.CalculatedModel, LoadCaseFactorsForLinearSuperposition=1, IndexIncrementOfVisibleLoadcase=0)  # -> Model, DeformedMesh, DeformedAxes, DeformedModel
beamview = BeamViewKaramba(Model=modelview.Model)  # -> Model, MeshesOfRenderedBeams, DeformedBeamAxes, LegendColors, LegendTags
button = Button()
legend = Legend(Colour=beamview.LegendColors, Tags=beamview.LegendTags, LegendType=1)
utilization = UtilizationOfElementsKaramba(
    AnalyzedModel=beamview.Model,
    LoadCase=-1,
    NumberOfSamplePoints=3,
    ElasticDesign=True,
    GammaM0=1,
    GammaM1=1,
    WithDetails=Toggle(True),
    mode="Beams")  # -> AnalyzedModel, Utilization, SigMax_kN_cm2, SigMin_kN_cm2, TauMax_kN_cm2, UtilN, UtilVy, UtilVz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
panel_2 = Panel(utilization.SigMax_kN_cm2)
division = Division(A=utilization.SigMax_kN_cm2, B="25")
abs = Absolute(Value=division)
multiplication = Multiplication(A=abs, B=fastloopstart.Data)
loop_end = LoopEnd(Exit=False, pausedState=False, state="Output last", TimeOutVal=0)
fastloopend = FastLoopEnd(port=fastloopstart.port, Exit=False, Data=multiplication, RecordData=False, TimeOutVal=0)
panel_3 = Panel(fastloopend)
