# Grasshopper definition torre Hyglass.gh (Grasshopper 0.9.76)
# plug-ins: Karamba, treesloth01, Anemone, Kangaroo Components, PTComponentLibrary, Dodo, Octopus, Silvereye

piedistallo = Brep(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)
X = UnitX(Factor=1)
brep = Brep(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)
normshade = NormalShader(
    mesh=[piedistallo, brep],
    direction=X,
    color=ColourSwatch(SwatchColor=RGB(0, 0, 0)),
    intensity=Slider(0.78, range=0..1),
    Reference="C:\Users\Marco\AppData\Roaming\Grasshopper\Libraries\SpatialSlur.dll")  # -> out, result; inputs mesh: Mesh, direction: Vector3d, color: Color, intensity: Double
# ---------- normshade: C# ----------
    if(mesh.Normals.Count != mesh.Vertices.Count)
      mesh.Normals.ComputeNormals();

    if(mesh.VertexColors.Count != mesh.Vertices.Count)
      mesh.VertexColors.CreateMonotoneMesh(Color.White);

    NormalShader(mesh, direction, color, intensity);
    result = mesh;
# ---------- normshade: C# additional code ----------
  //
  void NormalShader(Mesh mesh, Vector3d direction, Color color, double intensity)
  {
    if(!direction.Unitize())
      throw new System.ArgumentException("the direction vector cannot be zero length");

    Color[] vc = mesh.VertexColors.ToArray();

    var chunks = System.Collections.Concurrent.Partitioner.Create(0, mesh.Vertices.Count);
    System.Threading.Tasks.Parallel.ForEach(chunks, range =>
      {
      for (int i = range.Item1; i < range.Item2; i++)
      {
        double t = direction * mesh.Normals[i] * 0.5 + 0.5;
        vc[i] = vc[i].LerpTo(color, t * intensity);
      }
      });

    mesh.VertexColors.SetColors(vc);
  }
# ---------- end normshade ----------
loop_start = LoopStart(Repeat=Slider(20, range=0..20), Trigger=Toggle(True), Data=brep)  # -> port, Counter, Data
cap = CapHoles(Brep=loop_start.Data)
debrep = DeconstructBrep(Brep=cap)  # -> Faces, Edges, Vertices
item = ListItem(List=debrep.Faces, Index=0, Wrap=True)
item_2 = ListItem(List=debrep.Faces, Index=Slider(3, range=0..3), Wrap=True)
orient = Orient(Geometry=cap, Source=item, Target=item_2)  # -> Geometry, Transform
loop_start_2 = LoopStart(Repeat=Slider(5, range=0..1000), Trigger=Toggle(True), Data=Slider(0.05, range=0..0.1))  # -> port, Counter, Data
thickness = Number(loop_start_2.Data)
loop_end = LoopEnd(port=loop_start.port, Exit=False, Data=orient.Geometry, pausedState=False, state="Constant & Record", TimeOutVal=0)
entwine = Entwine(Branch00=loop_end, FlattenInputs=True)  # -> flatten(Result)
debrep_2 = DeconstructBrep(Brep=entwine)  # -> Faces, Edges, Vertices
duppt = RemoveDuplicatePts(Points=flatten(debrep_2.Vertices), Tolerance=0.01)
pdecon = Deconstruct(Point=duppt)  # -> XComponent, YComponent, ZComponent
gradient = Gradient(
    LowerLimit="0.05",
    UpperLimit="4",
    Parameter=thickness,
    stops=[0: RGB(0, 128, 0), 0.5: RGB(255, 255, 0), 1: RGB(255, 0, 0)])
dupln = RemoveDuplicateLines(Lines=flatten(debrep_2.Edges), Tolerance=0.01)
tstat = TreeStatistics(Tree=simplify(graft(dupln)))  # -> Paths, Length, Count
range = Range(Domain="0.4 to 5.0", Steps=Slider(23, range=0..100))
sort = SortList(Keys=pdecon.ZComponent, ValuesA=duppt)  # -> Keys, ValuesA
item_3 = ListItem(List=duppt, Index=0, Wrap=True)  # -> Item, Item1, Item2
bnd = Bounds(Numbers=sort.Keys)
# Load Display
number_slider = Slider(-17, range=-30..0)
dedomain = DeconstructDomain(Domain=bnd)  # -> Start, End
difference = SetDifference(SetA=duppt, SetB=[item_3.Item, item_3.Item1, item_3.Item2])
vec = VectorXYZ(XComponent=Slider(20, range=0..100), YComponent=0, ZComponent=0)  # -> Vector, Length
concat = Concatenate(FragmentA="beam", FragmentB=tstat.Paths)
first_last = FirstLast(List=sort.ValuesA)  # -> FirstValue, LastValue
fsim = FindSimilarMember(Data=thickness, Set=range)  # -> Hit, Index
cross_sections = CrossSectionsKaramba(
    ElementsIdentifiers=graft(concat),
    Diameter_cm=Slider(14, range=0..100),
    WallThickness_cm=graft(fsim.Hit),
    mode="Circular Hollow")  # -> flatten(CrossSection)
supp = SupportKaramba(PosInd=[item_3.Item, item_3.Item1, item_3.Item2], menu=[buttons(on, on, on, off, off, off)])
loads = LoadsKaramba(ForceVector=vec.Vector, Local=False, PosInd=difference, LCase="1", mode="Point")
dist = Distance(PointA=first_last.FirstValue, PointB=first_last.LastValue)
linetobeam = LineToBeamKaramba(Line=dupln, New=True, Remove=True, LimitDistance_m=0.005, BeamIdentifier=concat)  # -> Points, Element, Info
displaycrv = DisplayCurve(curve=dupln, color=gradient, weight=Slider(1.8, range=1..4))  # -> out; inputs curve: Curve, color: Color, weight: Int32
# ---------- displaycrv: C# ----------
    // silently skip null curves
    if(curve == null) return;

    // add to display cache
    _curves.Add(curve);
    _colors.Add(color);
    _weights.Add(weight);
    _clippingBox.Union(curve.GetBoundingBox(false));
# ---------- displaycrv: C# additional code ----------
  List<Curve> _curves;
  List<Color> _colors;
  List<int> _weights;
  BoundingBox _clippingBox;


  /// <summary>
  /// This method will be called once every solution, before any calls to RunScript.
  /// </summary>
  public override void BeforeRunScript()
  {
    _curves = new List<Curve>();
    _colors = new List<Color>();
    _weights = new List<int>();
    _clippingBox = new BoundingBox();
  }


  //
  public override BoundingBox ClippingBox
  {
    get{return _clippingBox;}
  }


  //
  public override void DrawViewportWires(IGH_PreviewArgs args)
  {
    base.DrawViewportWires(args);

    for(int i = 0; i < _curves.Count; i++)
      args.Display.DrawCurve(_curves[i], _colors[i], _weights[i]);
  }
# ---------- end displaycrv ----------
pt = ConstructPoint(XCoordinate=number_slider, YCoordinate=0, ZCoordinate=dedomain.Start)
Z = UnitZ(Factor=dist)
move = Move(Geometry=pt, Motion=Z)  # -> Geometry, Transform
ln = Line(StartPoint=pt, EndPoint=move.Geometry)
modifyelem = ModifyElementKaramba(Beam=linetobeam.Element, Bending=Toggle(True), ConsiderBuckling=Toggle(True), mode="Beam")
divide = DivideCurve(Curve=ln, Count=Slider(30, range=0..100), Kinks=False)  # -> Points, Tangents, Parameters
ptdividelen = DivideLength(Curve=ln, Distance=Slider(0.7, range=0..1), RoundUp=True, RoundDn=invert(True))
serieslist = SeriesFromList(List=ptdividelen, Start=0, Step=1)
bnd_2 = Bounds(Numbers=serieslist)
remap = RemapNumbers(Value=serieslist, Source=bnd_2, Target=Slider(1, range=1..5))  # -> Mapped, Clipped
bnd_3 = Bounds(Numbers=remap.Mapped)
graph = GraphMapper(
    remap.Mapped,
    x0=0,
    x1=1,
    y0=0,
    y1=1,
    container_name="Bezier",
    cpx=[0, 0.3008130193, 0.4660406411, 1],
    cpy=[0, 0.7613636255, 0.7222914696, 0.8386549354])
assemble = AssembleModelKaramba(Elem=modifyelem, Support=supp, Load=flatten(loads), CrossSection=cross_sections, LimitDistance_m=0.005)  # -> Model, Info, Mass_kg, CenterOfGravity
dedomain_2 = DeconstructDomain(Domain=bnd_3)  # -> Start, End
multiplication = Multiplication(A=graph, B=Slider(2, range=1..4))
analyzethi = AnalyzeThIKaramba(Model=assemble.Model)  # -> CalculatedModel, MaximumDisplacement_m, ResultingForceOfGravity_kN, ElasticEnergy_kNm
X_2 = UnitX(Factor=multiplication)
merge = Merge(
    Data1=ColourSwatch(SwatchColor=RGB(255, 0, 0)),
    Data2=ColourSwatch(SwatchColor=RGB(255, 179, 0)),
    Data3=ColourSwatch(SwatchColor=RGB(255, 255, 0)),
    Data4=ColourSwatch(SwatchColor=RGB(0, 255, 0)),
    Data5=ColourSwatch(SwatchColor=RGB(0, 255, 255)),
    Data6=ColourSwatch(SwatchColor=RGB(4, 177, 255)),
    Data7=ColourSwatch(SwatchColor=RGB(0, 0, 255)),
    Data8=ColourSwatch(SwatchColor=RGB(129, 0, 190)),
    Data9=ColourSwatch(SwatchColor=RGB(75, 0, 130)))  # -> reverse(Result)
gradient_2 = Gradient(
    LowerLimit=Slider(34, range=0..100),
    UpperLimit=dedomain_2.Start,
    Parameter=serieslist,
    stops=[0: RGB(234, 38, 0), 0.25: RGB(234, 126, 0), 0.5: RGB(254, 244, 84), 0.75: RGB(173, 203, 249), 1: RGB(75, 107, 169)])
item_4 = ListItem(List=analyzethi.MaximumDisplacement_m, Index=1, Wrap=True)
modelview = ModelViewKaramba(
    Model=analyzethi.CalculatedModel,
    LoadCaseFactorsForLinearSuperposition=1,
    IndexIncrementOfVisibleLoadcase=0,
    ListOfColorsForColoringPlots=merge)  # -> Model, DeformedMesh, DeformedAxes, DeformedModel
nvibes = NaturalVibrationsKaramba(Model=assemble.Model, FromIndex=1, NumberOfModes=Slider(3, range=0..10), MaximumNumberOfIterations=30, Epsilon=1e-05)  # -> ModelWithVibrationModesAsLoadCaseResults, NaturalFrequencies_Hz, ModalMass_kg, ParticipationFactorInGlobalXYAndZDirection
vdisex = VectorDisplayEx(Point=ptdividelen, Vector=X_2, Colour=gradient_2, Width=2)
one_over_x = OneOverX(Value=nvibes.NaturalFrequencies_Hz)
panel = Panel(one_over_x)
utilization = UtilizationOfElementsKaramba(
    AnalyzedModel=modelview.Model,
    LoadCase=-1,
    NumberOfSamplePoints=3,
    ElasticDesign=True,
    GammaM0=1,
    GammaM1=1,
    WithDetails=False,
    mode="Beams")  # -> AnalyzedModel, Utilization, SigMax_kN_cm2, SigMin_kN_cm2, TauMax_kN_cm2, UtilN, UtilVy, UtilVz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
bnd_4 = Bounds(Numbers=utilization.Utilization)
panel_2 = Panel(bnd_4)
beamview = BeamViewKaramba(Model=modelview.Model)  # -> Model, MeshesOfRenderedBeams, DeformedBeamAxes, LegendColors, LegendTags
modelview_2 = ModelViewKaramba(
    Model=nvibes.ModelWithVibrationModesAsLoadCaseResults,
    LoadCaseFactorsForLinearSuperposition=Slider(0, range=-1.5..1.5),
    IndexIncrementOfVisibleLoadcase=0,
    ListOfColorsForColoringPlots=merge)  # -> Model, DeformedMesh, DeformedAxes, DeformedModel
beamview_2 = BeamViewKaramba(Model=modelview_2.Model)  # -> Model, MeshesOfRenderedBeams, DeformedBeamAxes, LegendColors, LegendTags
disassemble = DisassembleModelKaramba(Model=beamview.Model)  # -> Model, Point, Beam, Shell, Support, Load, Line, Mesh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
avr = Average(Input=utilization.Utilization)
disassemble_2 = DisassembleElementKaramba(Model=beamview.Model, Element=disassemble.Beam)  # -> Element, ElementIdentifier, AxisOfElement, CrossSection, Joints, Material, LocalCoordinateSystem, ElementIsActive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
bnd_5 = Bounds(Numbers=utilization.Utilization)
panel_3 = Panel(bnd_5)
dedomain_3 = DeconstructDomain(Domain=bnd_5)  # -> Start, End
num = Number(avr)
disassemble_3 = DisassembleCrossSectionKaramba(CroSec=disassemble_2.CrossSection)  # -> CrossSection, FamilyNameOfCrossSection, TypeNameOfCrossSection, ElemIdentifiers, LocalEccentricity_cm, Heights_cm, PositionOfCenterOfGravity, PositionOfCenterOfShear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
panel_4 = Panel(num)
smaller = SmallerThan(FirstNumber=dedomain_3.End, SecondNumber=Slider(0.9, range=0..1))  # -> SmallerThan, OrEqualTo
split = TextSplit(Text=disassemble_3.CrossSection, Separators=":[")
subtraction = Subtraction(A=dedomain_3.End, B=Slider(1, range=0..1))
abs = Absolute(Value=subtraction)
item_5 = ListItem(List=split, Index="4", Wrap=True)  # -> flatten(Item)
utilization_2 = Number(abs)
serieslist_2 = SeriesFromList(List=panel, Start=0, Step=1)
expression = Expression(t=flatten(item_5), U=utilization.Utilization, F="0.8", k="1.2", Expression="t*(1+k*(U-F)^3)")
lng = ListLength(List=entwine)

expression_2 = Expression(x=nvibes.NaturalFrequencies_Hz, y=serieslist_2, Expression="Format(\"f {1}: {0} Hz\", Round(x,2),y+1)")
expression_3 = Expression(x=item_4, Expression="Format(\"Displacement : {0} cm \", Round(x*10,1))")

expression_4 = Expression(x=assemble.Mass_kg, Expression="Format(\"mass : {0} kg \", Round(x))")
expression_5 = Expression(x=lng, Expression="Format(\"n° tetraedri : {0}\", x)")

legend = Legend(Colour=beamview.LegendColors, Tags=beamview.LegendTags, LegendType=1)
gh_silvereye = Silvereye()
panel_5 = Panel(expression_2)
expression_6 = Expression(x=expression, Expression="if(x<0.4, 0.4 ,x)")
merge_2 = Merge(
    Data1=flatten("Torre Tetraedrica"),
    Data3=flatten(expression_5),
    Data5=flatten(expression_4),
    Data6=flatten(expression_3),
    Data8=expression_2)  # -> flatten(Result)
lng_2 = ListLength(List=merge_2)
loop_end_2 = LoopEnd(port=loop_start_2.port, Exit=False, Data=expression_6, pausedState=False, state="Constant & Record", TimeOutVal=0)
number_slider_2 = Slider(0.63, range=0.1..2)
series = Series(Start=Slider(10, range=0..50), Step=expr("-x*1.5", number_slider_2), Count=lng_2)
vec_2 = VectorXYZ(XComponent=Slider(10, range=0..100), YComponent=0, ZComponent=series)  # -> Vector, Length
pt_2 = Point(vec_2.Vector)
xz = XZPlane(Origin=pt_2)
target_frequency = Panel("5.00")

tag = TextTag3D(Location=xz, Text=merge_2, Size=number_slider_2, Colour=ColourSwatch(SwatchColor=RGB(255, 255, 255)), Justification=7)

ma = MassAddition()  # -> Result, PartialResults
item_6 = ListItem(List=nvibes.NaturalFrequencies_Hz, Index=0, Wrap=True)
mass = Number(ma.Result)
subtraction_2 = Subtraction(A=target_frequency, B=item_6)
abs_2 = Absolute(Value=subtraction_2)
frequency = Number(abs_2)
octopus = Octopus(OctopusData_obj=[mass, frequency])
