# Grasshopper definition musumeci Bridge da collegare a rhino.gh (Grasshopper 0.9.76)
# plug-ins: Karamba, MeshEdit Components, Kangaroo Components, Dodo, Weaverbird

crv = Curve(<curve referenced from the Rhino model>)
boundary = BoundarySurfaces(Edges=crv)
custom_mesh_settings = SettingsCustom(
    StitchSeams=True,
    SimplePlanes=False,
    Refine=True,
    MinCount=16,
    MaxCount=400,
    AspectRatio=20,
    MaxDistance=0,
    MaxAngle=20,
    MinEdge=Slider(0.25, range=0..1),
    MaxEdge=Slider(0.46, range=0..1))
mesh = MeshBrep(Brep=boundary, Settings=custom_mesh_settings)
quad = Quadrangulate(Mesh=mesh, Angle=0.03490658504, Ratio=0.875)  # -> Mesh, Count
area = MeshArea(Mesh=quad.Mesh)  # -> Area, Centroid
panel = Panel("3")
meshcorners = MeshCorners(M=quad.Mesh, A=0.5235987756)
cps = ClosestPoints(Point=area.Centroid, Cloud=meshcorners, Count="4")  # -> ClosestPoint, CPIndex, Distance
pt = Point(cps.ClosestPoint)
pt_2 = Point([Point(84.09223938, 11.73280144, 0), Point(84.09223938, 11.44832039, 0), Point(84.09223938, 11.16383934, 0), Point(84.09223938, 10.87935925, 0), Point(84.09223938, 10.5948782, 0), Point(84.09223938, 10.3103981, 0)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])
pt_3 = Point([Point(148.7405396, 4.336303234, 0), Point(148.7405396, 4.620783806, 0), Point(148.7405396, 4.905264378, 0), Point(148.7405396, 5.189745426, 0), Point(148.7405396, 5.474225998, 0), Point(148.7405396, 5.75870657, 0)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])
difference = SetDifference(SetA=meshcorners, SetB=pt)
merge = Merge(Data1=pt_2, Data2=pt_3)
number_slider = Slider(4.84, range=0..14)
number_slider_2 = Slider(6.94, range=0..15)
Z = UnitZ(Factor=number_slider)
Z_2 = UnitZ(Factor=number_slider_2)
move = Move(Geometry=merge, Motion=Z)  # -> Geometry, Transform
move_2 = Move(Geometry=difference, Motion=Z_2)  # -> Geometry, Transform
serieslist = SeriesFromList(Start=0, Step=1)
lng = ListLength()

expression = Expression(y=serieslist, Expression="Format(\"f {1}: {0} Hz\", Round(x,2),y+1)")
expression_2 = Expression(Expression="Format(\"Displacement : {0} cm \", Round(x*10,1))")

springsfrommesh = SpringsFromMesh(M=quad.Mesh, stiffness=Slider(2000, range=500..7000), B=Slider(0.6, range=0.1..3))

expression_3 = Expression(Expression="Format(\"mass : {0} kg \", Round(x))")
expression_4 = Expression(x=lng, Expression="Format(\"n° tetraedri : {0}\", x)")

gravity = Gravity(M=quad.Mesh, F=-9.8)
merge_2 = Merge(Data1=springsfrommesh, Data2=gravity)  # -> flatten(Result)
merge_3 = Merge(
    Data1=flatten("Musumeci Bridge"),
    Data2=flatten(""),
    Data3=flatten(expression_4),
    Data4=flatten(""),
    Data5=flatten(expression_3),
    Data6=flatten(expression_2),
    Data7=flatten(""),
    Data8=flatten(expression))  # -> flatten(Result)
lng_2 = ListLength(List=merge_3)
timer = Timer(TimerInterval=20, Target=kangaroo)
kangaroo = KangarooPhysics(
    ForceObjects=flatten(merge_2),
    AnchorPoints=flatten([pt, move_2.Geometry, move.Geometry]),
    Settings=null,
    Geometry=quad.Mesh,
    SimulationReset=Toggle(False))  # -> Out, Iterations, ParticlesOut, GeometryOut, KE
number_slider_3 = Slider(0.63, range=0.1..2)
mesh_2 = Mesh(kangaroo.GeometryOut)
vec = VectorXYZ(XComponent=Slider(1, range=0..1), YComponent=Slider(0.33, range=0..1), ZComponent=Slider(1, range=0..1))  # -> Vector, Length
series = Series(Start=Slider(10, range=0..50), Step=expr("-x*1.5", number_slider_3), Count=lng_2)
del = DelaunayMesh(Points=move_2.Geometry, Plane=PlaneXY(0, 0, 0))
panel_2 = Panel(kangaroo.Iterations)  # disabled
vec_2 = VectorXYZ(XComponent=Slider(100, range=0..100), YComponent=0, ZComponent=series)  # -> Vector, Length
mesh_3 = Mesh(mesh_2)
pt_4 = Point(vec_2.Vector)
wbcatmullclark = WeaverbirdsCatmullClarkSubdivision(MeshCurves=del, Level=Slider(4, range=0..4), SmoothNakedEdges=0)
xz = XZPlane(Origin=pt_4)
tri = Triangulate(Mesh=wbcatmullclark)  # -> Mesh, Count

# ----
# Path on Bridge
number_slider_4 = Slider(1, range=0..1)
crv_2 = Curve(<curve referenced from the Rhino model>)
eval = EvaluateCurve(Curve=reparameterize(crv_2), Parameter=number_slider_4)  # -> Point, Tangent, Angle
cir = Circle(Plane=eval.Point, Radius="1.25")
rotate = Rotate(Geometry=cir, Angle=degrees("45"), Plane=eval.Point)  # -> Geometry, Transform
divide = DivideCurve(Curve=rotate.Geometry, Count="4", Kinks=False)  # -> Points, Tangents, Parameters
demesh = DeconstructMesh(Mesh=tri.Mesh)  # -> Vertices, Faces, Colours, Normals
cp = ClosestPoint(Point=divide.Points, Cloud=demesh.Vertices)  # -> ClosestPoint, CPIndex, Distance

normshade = NormalShader2(
    mesh=[kangaroo.GeometryOut, tri.Mesh],
    direction=vec.Vector,
    color=ColourSwatch(SwatchColor=RGB(120, 120, 120)),
    intensity=Slider(0.467, range=0..1),
    power=Slider(0.375, range=0..1),
    Reference="C:\Users\Marco\AppData\Roaming\Grasshopper\Libraries\SpatialSlur.dll")  # -> out, result; inputs mesh: Mesh, direction: Vector3d, color: Color, intensity: Double, power: Double
# ---------- normshade: C# ----------
    if(mesh.Normals.Count != mesh.Vertices.Count)
      mesh.Normals.ComputeNormals();

    if(mesh.VertexColors.Count != mesh.Vertices.Count)
      mesh.VertexColors.CreateMonotoneMesh(Color.White);

    NormalShader(mesh, direction, color, intensity, power);
    result = mesh;
# ---------- normshade: C# additional code ----------
  //
  void NormalShader(Mesh mesh, Vector3d direction, Color color, double intensity, double power)
  {
    if(!direction.Unitize())
      throw new System.ArgumentException("the direction vector cannot be zero length");

    Color[] vc = mesh.VertexColors.ToArray();

    var chunks = System.Collections.Concurrent.Partitioner.Create(0, mesh.Vertices.Count);
    System.Threading.Tasks.Parallel.ForEach(chunks, range =>
      {
      for (int i = range.Item1; i < range.Item2; i++)
      {
        double t = direction * mesh.Normals[i] * 0.5 + 0.5;
        vc[i] = vc[i].LerpTo(color, Math.Pow(t * intensity, power));
      }
      });

    mesh.VertexColors.SetColors(vc);
  }
# ---------- end normshade ----------

tag = TextTag3D(Location=xz, Text=merge_3, Size=number_slider_3, Colour=ColourSwatch(SwatchColor=RGB(255, 255, 255)), Justification=7)

panel_3 = Panel("""sotto struttura
impalcato""")
merge_4 = Merge(Data1=Slider(100, range=30..100), Data2=Slider(30, range=30..100))
number_slider_5 = Slider(1.848, range=1..10)
supp = SupportKaramba(PosInd=[move.Geometry, pt], menu=[buttons(on, on, on, off, off, off)])
loads = LoadsKaramba(Vector=Vector(0, 0, -1), LCase=0, mode="Gravity")
meshtoshell = MeshToShellKaramba(Mesh=tri.Mesh, LDist=0.005, Identifier="impalcato")  # -> Point, Element, Info
cross_sections = CrossSectionsKaramba(ElementsIdentifiers=graft(panel_3), Heights_cm=graft(merge_4), mode="Shell")  # -> flatten(CrossSection)
meshtoshell_2 = MeshToShellKaramba(Mesh=mesh_3, LDist=0.005, Identifier="sotto struttura")  # -> Point, Element, Info
meshcp = MeshClosestPoint(Point=divide.Points, Mesh=tri.Mesh)  # -> Point, Index, Parameter
Z_3 = UnitZ(Factor=expr("-x", number_slider_5))
Z_4 = UnitZ(Factor=number_slider_5)
move_3 = Move(Geometry=meshcp.Point, Motion=Z_4)  # -> Geometry, Transform
vdisex = VectorDisplayEx(Point=move_3.Geometry, Vector=Z_3, Colour=ColourSwatch(SwatchColor=RGB(222, 58, 58)), Width=Slider(4.59, range=1..10))
Z_5 = UnitZ(Factor=expr("-x", Slider(600, range=0..1000)))
loads_2 = LoadsKaramba(ForceVector=Z_5, Local=False, PosInd=cp.ClosestPoint, LCase="1", mode="Point")
assemble = AssembleModelKaramba(
    Elem=flatten([meshtoshell_2.Element, meshtoshell.Element]),
    Support=flatten(supp),
    Load=flatten([loads, loads_2]),
    CrossSection=cross_sections,
    LimitDistance_m=0.005)  # -> Model, Info, Mass_kg, CenterOfGravity
analyzethi = AnalyzeThIKaramba(Model=assemble.Model)  # -> CalculatedModel, MaximumDisplacement_m, ResultingForceOfGravity_kN, ElasticEnergy_kNm
merge_5 = Merge(
    Data1=ColourSwatch(SwatchColor=RGB(255, 0, 0)),
    Data2=ColourSwatch(SwatchColor=RGB(255, 179, 0)),
    Data3=ColourSwatch(SwatchColor=RGB(255, 255, 0)),
    Data4=ColourSwatch(SwatchColor=RGB(0, 255, 0)),
    Data5=ColourSwatch(SwatchColor=RGB(0, 255, 255)),
    Data6=ColourSwatch(SwatchColor=RGB(4, 177, 255)),
    Data7=ColourSwatch(SwatchColor=RGB(0, 0, 255)),
    Data8=ColourSwatch(SwatchColor=RGB(129, 0, 190)),
    Data9=ColourSwatch(SwatchColor=RGB(75, 0, 130)))  # -> reverse(Result)
modelview = ModelViewKaramba(
    Model=analyzethi.CalculatedModel,
    LoadCaseFactorsForLinearSuperposition=1,
    IndexIncrementOfVisibleLoadcase=0,
    ListOfColorsForColoringPlots=merge_5)  # -> Model, DeformedMesh, DeformedAxes, DeformedModel
shellview = ShellViewKaramba(Model=modelview.Model)  # -> Model, MeshesOfRenderedShells, LegendColors, LegendTags
legend = Legend(Colour=shellview.LegendColors, Tags=shellview.LegendTags, LegendType=1)

# ==== cluster SpringsFromMesh: Turns all edges of a mesh into springs
M = ClusterInput()
medges = MeshEdges(Mesh=M)  # -> NakedEdges, InteriorEdges, NonManifoldEdges
crv = Curve([medges.NakedEdges, medges.InteriorEdges])
B = ClusterInput()
len = Length(Curve=crv)
multiplication = Multiplication(A=len, B=B)
stiffness = ClusterInput()
springs = SpringsFromLine(Connection=crv, Stiffness=stiffness, Damping=10, RestLength=multiplication, UpperCutoff=0, LowerCutoff=0, Plasticity=0)
S = ClusterOutput(springs)

# ==== cluster Gravity: Apply gravity to vertices of a mesh
M = ClusterInput()
F = ClusterInput()
mcomp = Decompose(Mesh=M)  # -> Vertices, Faces, Colours, Normals
Z = UnitZ(Factor=F)
duppt = RemoveDuplicatePts(Points=mcomp.Vertices, Tolerance=0.01)
uforce = UnaryForce(Point=duppt, Force=Z)
U = ClusterOutput(uforce)

# ==== cluster MeshCorners: Finds the corners of the boundary of a mesh
M = ClusterInput()
medges = MeshEdges(Mesh=M)  # -> NakedEdges, InteriorEdges, NonManifoldEdges
join = JoinCurves(Curves=medges.NakedEdges, Preserve=False)
explode = Explode(Curve=join, Recursive=True)  # -> simplify(Segments), Vertices
shift = ShiftList(List=explode.Segments, Shift=1, Wrap=True)  # -> simplify(List)
end = EndPoints(Curve=explode.Segments)  # -> Start, End
angle = Angle(VectorA=explode.Segments, VectorB=shift)  # -> Angle, Reflex
A = ClusterInput()
smaller = SmallerThan(FirstNumber=A, SecondNumber=angle.Angle)  # -> SmallerThan, OrEqualTo
cull = CullPattern(List=end.End, CullPattern=smaller.SmallerThan)  # -> flatten(List)
L = ClusterOutput(cull)
