# Grasshopper definition musumeci Bridge.gh (Grasshopper 0.9.76)
# plug-ins: Karamba, MeshEdit Components, Kangaroo Components, Weaverbird

crv = Curve(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)
boundary = BoundarySurfaces(Edges=crv)
custom_mesh_settings = SettingsCustom(
    StitchSeams=True,
    SimplePlanes=False,
    Refine=True,
    MinCount=16,
    MaxCount=400,
    AspectRatio=20,
    MaxDistance=0,
    MaxAngle=20,
    MinEdge=Slider(0.25, range=0..1),
    MaxEdge=Slider(0.46, range=0..1))
mesh = MeshBrep(Brep=boundary, Settings=custom_mesh_settings)
quad = Quadrangulate(Mesh=mesh, Angle=0.03490658504, Ratio=0.875)  # -> Mesh, Count
area = MeshArea(Mesh=quad.Mesh)  # -> Area, Centroid
panel = Panel("3")
meshcorners = MeshCorners(M=quad.Mesh, A=0.5235987756)
cps = ClosestPoints(Point=area.Centroid, Cloud=meshcorners, Count="4")  # -> ClosestPoint, CPIndex, Distance

# ---- group: Fixed point
pt = Point(cps.ClosestPoint)

# ----
nv = NakedVertices(Mesh=quad.Mesh)  # -> ClothedIndex, NakedIndex, ClothedPts, NakedPts
difference = SetDifference(SetA=meshcorners, SetB=pt)
Z = UnitZ(Factor=Slider(7, range=0..15))
pt_2 = Point([Point(148.7405396, 4.336303234, 0), Point(148.7405396, 4.620783806, 0), Point(148.7405396, 4.905264378, 0), Point(148.7405396, 5.189745426, 0), Point(148.7405396, 5.474225998, 0), Point(148.7405396, 5.75870657, 0)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])
pt_3 = Point([Point(84.09223938, 11.73280144, 0), Point(84.09223938, 11.44832039, 0), Point(84.09223938, 11.16383934, 0), Point(84.09223938, 10.87935925, 0), Point(84.09223938, 10.5948782, 0), Point(84.09223938, 10.3103981, 0)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])
move = Move(Geometry=difference, Motion=Z)  # -> Geometry, Transform
merge = Merge(Data1=pt_3, Data2=pt_2)
del = DelaunayMesh(Points=move.Geometry, Plane=PlaneXY(0, 0, 0))
Z_2 = UnitZ(Factor=Slider(5, range=0..15))
move_2 = Move(Geometry=merge, Motion=Z_2)  # -> Geometry, Transform
springsfrommesh = SpringsFromMesh(M=quad.Mesh, stiffness=Slider(2000, range=500..7000), B=Slider(0.6, range=0.1..3))
gravity = Gravity(M=quad.Mesh, F=-9.8)
merge_2 = Merge(Data1=springsfrommesh, Data2=gravity)  # -> flatten(Result)
kangaroo = KangarooPhysics(
    ForceObjects=flatten(merge_2),
    AnchorPoints=[pt, move.Geometry, move_2.Geometry],
    Settings=null,
    Geometry=quad.Mesh,
    SimulationReset=Toggle(False))  # -> Out, Iterations, ParticlesOut, GeometryOut, KE
timer = Timer(TimerInterval=20, Target=kangaroo)  # disabled
mesh_2 = Mesh(kangaroo.GeometryOut)
panel_2 = Panel(kangaroo.Iterations)
dam = DataDam(DataA=mesh_2, BufferDelay=10000000, BufferMode=0)
wbthicken = WeaverbirdsMeshThicken(MeshCurves=dam, Distance=Slider(0.3, range=0..1), OffsetType=0)
mesh_3 = Mesh(dam)
supp = SupportKaramba(PosInd=[move_2.Geometry, pt], menu=[buttons(on, on, on, off, off, off)])
loads = LoadsKaramba(Vector=Vector(0, 0, -1), LCase=0, mode="Gravity")
meshtoshell = MeshToShellKaramba(Mesh=mesh_3, LDist=0.005)  # -> Point, Element, Info
assemble = AssembleModelKaramba(Elem=meshtoshell.Element, Support=supp, Load=loads, LimitDistance_m=0.005)  # -> Model, Info, Mass_kg, CenterOfGravity
analyzethi = AnalyzeThIKaramba(Model=assemble.Model)  # -> CalculatedModel, MaximumDisplacement_m, ResultingForceOfGravity_kN, ElasticEnergy_kNm
merge_3 = Merge(
    Data1=ColourSwatch(SwatchColor=RGB(255, 0, 0)),
    Data2=ColourSwatch(SwatchColor=RGB(255, 179, 0)),
    Data3=ColourSwatch(SwatchColor=RGB(255, 255, 0)),
    Data4=ColourSwatch(SwatchColor=RGB(0, 255, 0)),
    Data5=ColourSwatch(SwatchColor=RGB(0, 255, 255)),
    Data6=ColourSwatch(SwatchColor=RGB(4, 177, 255)),
    Data7=ColourSwatch(SwatchColor=RGB(0, 0, 255)),
    Data8=ColourSwatch(SwatchColor=RGB(129, 0, 190)),
    Data9=ColourSwatch(SwatchColor=RGB(75, 0, 130)))  # -> reverse(Result)
modelview = ModelViewKaramba(
    Model=analyzethi.CalculatedModel,
    LoadCaseFactorsForLinearSuperposition=1,
    IndexIncrementOfVisibleLoadcase=0,
    ListOfColorsForColoringPlots=merge_3)  # -> Model, DeformedMesh, DeformedAxes, DeformedModel
shellview = ShellViewKaramba(Model=modelview.Model)  # -> Model, MeshesOfRenderedShells, LegendColors, LegendTags

# ==== cluster SpringsFromMesh: Turns all edges of a mesh into springs
M = ClusterInput()
medges = MeshEdges(Mesh=M)  # -> NakedEdges, InteriorEdges, NonManifoldEdges
crv = Curve([medges.NakedEdges, medges.InteriorEdges])
B = ClusterInput()
len = Length(Curve=crv)
multiplication = Multiplication(A=len, B=B)
stiffness = ClusterInput()
springs = SpringsFromLine(Connection=crv, Stiffness=stiffness, Damping=10, RestLength=multiplication, UpperCutoff=0, LowerCutoff=0, Plasticity=0)
S = ClusterOutput(springs)

# ==== cluster Gravity: Apply gravity to vertices of a mesh
M = ClusterInput()
F = ClusterInput()
mcomp = Decompose(Mesh=M)  # -> Vertices, Faces, Colours, Normals
Z = UnitZ(Factor=F)
duppt = RemoveDuplicatePts(Points=mcomp.Vertices, Tolerance=0.01)
uforce = UnaryForce(Point=duppt, Force=Z)
U = ClusterOutput(uforce)

# ==== cluster MeshCorners: Finds the corners of the boundary of a mesh
M = ClusterInput()
medges = MeshEdges(Mesh=M)  # -> NakedEdges, InteriorEdges, NonManifoldEdges
join = JoinCurves(Curves=medges.NakedEdges, Preserve=False)
explode = Explode(Curve=join, Recursive=True)  # -> simplify(Segments), Vertices
shift = ShiftList(List=explode.Segments, Shift=1, Wrap=True)  # -> simplify(List)
end = EndPoints(Curve=explode.Segments)  # -> Start, End
angle = Angle(VectorA=explode.Segments, VectorB=shift)  # -> Angle, Reflex
A = ClusterInput()
smaller = SmallerThan(FirstNumber=A, SecondNumber=angle.Angle)  # -> SmallerThan, OrEqualTo
cull = CullPattern(List=end.End, CullPattern=smaller.SmallerThan)  # -> flatten(List)
L = ClusterOutput(cull)
