# Grasshopper definition Growing tree.gh (Grasshopper 0.9.76)
# plug-ins: Karamba, Anemone

Z = UnitZ(Factor=1)
Y = UnitY(Factor=1)
pt = ConstructPoint(XCoordinate=0, YCoordinate=0, ZCoordinate=0)
vrot = Rotate(Vector=Z, Axis=Y, Angle=degrees(Slider(-19.2, range=-20..20)))
line = LineSDL(Start=pt, Direction=vrot, Length=Slider(3.7, range=1.5..3.7))
crv = Curve(line)
loop_start = LoopStart(Repeat=Slider(5, range=1..10), Trigger=Button(), Data=flatten(crv))  # -> port, Counter, Data
vec = Vector(loop_start.Data)
end = EndPoints(Curve=loop_start.Data)  # -> Start, End
len = Length(Curve=loop_start.Data)
multiplication = Multiplication(A=len, B=Slider(0.83, range=0.7..0.99))
expression = Expression(
    x=loop_start.Counter,
    angle=Slider(18.62, range=0..35),
    percent=Slider(0.1, range=0..0.5),
    Expression="(1-percent*x)*angle")
Y_2 = UnitY(Factor=1)
vrot_2 = Rotate(Vector=vec, Axis=Y_2, Angle=expr("-x", degrees(expression)))
vrot_3 = Rotate(Vector=vec, Axis=Y_2, Angle=degrees(expression))
line_2 = LineSDL(Start=end.End, Direction=vrot_3, Length=multiplication)
line_3 = LineSDL(Start=end.End, Direction=vrot_2, Length=multiplication)
merge = Merge(Data1=line_2, Data2=line_3)  # -> graft(Result)
loop_end = LoopEnd(port=loop_start.port, Exit=False, Data=merge, pausedState=False, state="Constant & Record", TimeOutVal=0)
entwine = Entwine(Branch00=crv, Branch01=loop_end, FlattenInputs=True)
lng = ListLength(List=flatten(entwine))
expression_2 = Expression(x=lng, Expression="Format(\"n° di rami : {0}\", x)")
end_2 = EndPoints(Curve=loop_end)  # -> Start, End
lng_2 = ListLength(List=flatten(end_2.End))  # -> expr("x/1.5", Length)
reduce = RandomReduce(List=flatten(end_2.End), Reduction=flatten(lng_2), Seed=Slider(17, range=2..100))
Z_2 = UnitZ(Factor=expr("-x", Slider(0.1, range=0..0.1)))
matselect = MaterialSelectionKaramba(menu=[dropdown(3), dropdown(1)])
linetobeam = LineToBeamKaramba(Line=flatten(entwine), New=True, Remove=True, LimitDistance_m=0.005)  # -> Points, Element, Info
number_slider = Slider(0.57, range=0.1..2)
supp = SupportKaramba(PosInd=pt, menu=[buttons(on, on, on, on, on, on)])
loads = LoadsKaramba(Vector=Vector(0, 0, -1), LCase=0, mode="Gravity")
loads_2 = LoadsKaramba(ForceVector=Z_2, Local=False, PosInd=reduce, LCase=0, mode="Point")

# ---- group: insert a point
pt_2 = Point(<point referenced from the Rhino model>)

# ----
assemble = AssembleModelKaramba(Elem=linetobeam.Element, Support=supp, Load=flatten([loads, loads_2]), Material=matselect, LimitDistance_m=0.005)  # -> Model, Info, Mass_kg, CenterOfGravity
expression_3 = Expression(x=assemble.Mass_kg, Expression="Format(\"massa : {0:F2} kg\", x)")
analyzethi = AnalyzeThIKaramba(Model=assemble.Model)  # -> CalculatedModel, MaximumDisplacement_m, ResultingForceOfGravity_kN, ElasticEnergy_kNm
expression_4 = Expression(x=analyzethi.MaximumDisplacement_m, Expression="Format(\"Displacement : {0:F2} cm\", x)")  # disabled
merge_2 = Merge(
    Data1=flatten("Albero dell'ingegneria"),
    Data3=flatten(expression_2),
    Data5=flatten(expression_3),
    Data6=flatten(["", expression_4]))  # -> flatten(Result)
lng_3 = ListLength(List=merge_2)
series = Series(Start=Slider(0, range=0..50), Step=expr("-x*1.5", number_slider), Count=lng_3)
Z_3 = UnitZ(Factor=series)
move = Move(Geometry=pt_2, Motion=Z_3)  # -> Geometry, Transform
xz = XZPlane(Origin=move.Geometry)
tag = TextTag3D(Location=xz, Text=merge_2, Size=number_slider, Colour=ColourSwatch(SwatchColor=RGB(255, 255, 255)), Justification=7)
num = Number(analyzethi.MaximumDisplacement_m)
panel = Panel(num)
merge_3 = Merge(
    Data1=ColourSwatch(SwatchColor=RGB(255, 0, 0)),
    Data2=ColourSwatch(SwatchColor=RGB(255, 179, 0)),
    Data3=ColourSwatch(SwatchColor=RGB(255, 255, 0)),
    Data4=ColourSwatch(SwatchColor=RGB(0, 255, 0)),
    Data5=ColourSwatch(SwatchColor=RGB(0, 255, 255)),
    Data6=ColourSwatch(SwatchColor=RGB(4, 177, 255)),
    Data7=ColourSwatch(SwatchColor=RGB(0, 0, 255)),
    Data8=ColourSwatch(SwatchColor=RGB(129, 0, 190)),
    Data9=ColourSwatch(SwatchColor=RGB(75, 0, 130)))  # -> reverse(Result)
modelview = ModelViewKaramba(
    Model=analyzethi.CalculatedModel,
    LoadCaseFactorsForLinearSuperposition=1,
    IndexIncrementOfVisibleLoadcase=0,
    ListOfColorsForColoringPlots=merge_3)  # -> Model, DeformedMesh, DeformedAxes, DeformedModel
beamview = BeamViewKaramba(Model=modelview.Model)  # -> Model, MeshesOfRenderedBeams, DeformedBeamAxes, LegendColors, LegendTags
