# Grasshopper definition response spectrum WIP.gh (Grasshopper 0.9.76)

c_script = CSharpScript(Ss="A", St="T12")  # -> out, S, n, Tb, Tc, Td; inputs Vn: Int32, Cu: Double, ag: Double, Tc1: Double, q0h: Double, q0v: Double, Ss: String, St: String
# ---------- c_script: C# ----------
    switch(Ss)
    {
      case "A":
        Ss = 1.ToString();
        
        S = Ss * Sc;
        break;

      case "B":
        Print("ciao2222222");
        break;

      case "C":
        Print("scacascas3");
        break;

      case "D":
        Print("caoo4");
        break;
    }

    S = Ss;
# ---------- end c_script ----------
panel = Panel(c_script.S)
panel_2 = Panel(c_script.out)
