# Grasshopper definition Cantina Antinori.gh (Grasshopper 0.9.76)
# plug-ins: Karamba, Kangaroo Components, Weaverbird

cir = Circle(Plane=PlaneXY(0, 0, 0), Radius=Slider(7, range=3..7))
divide = DivideCurve(Curve=cir, Count=Slider(40, range=0..100), Kinks=False)  # -> Points, Tangents, Parameters
panel = Panel("0")
dup = DuplicateData(Data=divide.Points, Number=Slider(2, range=1..4), Order=True)
dom = ConstructDomain(DomainStart=0, DomainEnd=Slider(10, range=0.1..10))
panel_2 = Panel("0.0 to 8.0")
lng = ListLength(List=dup)
range = Range(Domain=dom, Steps=expr("x-1", lng))
Z = UnitZ(Factor=range)
move = Move(Geometry=dup, Motion=Z)  # -> Geometry, Transform
bnd = Bounds(Numbers=range)
pdecon = Deconstruct(Point=move.Geometry)  # -> XComponent, YComponent, ZComponent
remap = RemapNumbers(Value=range, Source=bnd, Target=Domain(0, 1))  # -> Mapped, Clipped
pt = ConstructPoint(XCoordinate=0, YCoordinate=0, ZCoordinate=pdecon.ZComponent)
graph = GraphMapper(
    remap.Mapped,
    x0=0,
    x1=1,
    y0=0.3,
    y1=1.5,
    container_name="Bezier",
    cpx=[0, 0.8333333135, 0.496833235, 1],
    cpy=[0.4382611513, 0.3840579987, 0.7513577938, 0.4197104573])
scale = Scale(Geometry=move.Geometry, Center=pt, Factor=graph)  # -> Geometry, Transform
duppt = RemoveDuplicatePts(Points=move.Geometry, Tolerance=0.01)
pdecon_2 = Deconstruct(Point=duppt)  # -> XComponent, YComponent, ZComponent
pt_2 = ConstructPoint(XCoordinate=0, YCoordinate=0, ZCoordinate=pdecon_2.ZComponent)
panel_3 = Panel(graph)
subtraction = Subtraction(A=panel_3, B=Slider(0.29, range=0..0.29))
scale_2 = Scale(Geometry=duppt, Center=pt_2, Factor=subtraction)  # -> Geometry, Transform
pt_3 = Point(scale.Geometry)
pline = PolyLine(Vertices=pt_3, Closed=False)

# ----
# Parte Superiore
ln = Line(StartPoint=scale.Geometry, EndPoint=scale_2.Geometry)
meshloft = MeshLoft2(polys=ln)  # -> out, result; inputs polys: list of Polyline
# ---------- meshloft: C# ----------
    result = MeshLoft(polys);
# ---------- meshloft: C# additional code ----------
  //
  Mesh MeshLoft(IList<Polyline> polys)
  {
    if(Enumerable.All(polys, p => p.IsClosed))
      return MeshLoftClosed(polys);
    else
      return MeshLoftOpen(polys);
  }


  //
  Mesh MeshLoftOpen(IList<Polyline> polys)
  {
    Mesh result = new Mesh();
    var verts = result.Vertices;
    var faces = result.Faces;

    int ny = polys.Count;
    int nx = Enumerable.Min(polys, p => p.Count);
    int n;

    // add vertices
    for(int i = 0; i < ny; i++)
    {
      var poly = polys[i];

      for(int j = 0; j < nx; j++)
        verts.Add(poly[j]);
    }

    // add faces
    for(int i = 0; i < ny - 1; i++)
    {
      n = i * nx;

      for(int j = 0; j < nx - 1; j++)
        faces.AddFace(n + j, n + j + 1, n + j + nx + 1, n + j + nx);
    }

    return result;
  }


  //
  Mesh MeshLoftClosed(IList<Polyline> polys)
  {
    Mesh result = new Mesh();
    var verts = result.Vertices;
    var faces = result.Faces;

    int ny = polys.Count;
    int nx = Enumerable.Min(polys, p => p.Count) - 1;
    int n;

    // add vertices
    for(int i = 0; i < ny; i++)
    {
      var poly = polys[i];

      for(int j = 0; j < nx; j++)
        verts.Add(poly[j]);
    }

    // add faces
    for(int i = 0; i < ny - 1; i++)
    {
      n = i * nx;

      for(int j0 = 0; j0 < nx; j0++)
      {
        int j1 = (j0 + 1) % nx;
        faces.AddFace(n + j0, n + j1, n + j1 + nx, n + j0 + nx);
      }
    }

    return result;
  }
# ---------- end meshloft ----------
number_slider = Slider(1, range=1..3)
wbcatmullclark = WeaverbirdsCatmullClarkSubdivision(MeshCurves=meshloft.result, Level=number_slider, SmoothNakedEdges=0)

# ----
# Parte Interna
graph_2 = GraphMapper(
    remap.Mapped,
    x0=0,
    x1=1,
    y0=0.5,
    y1=3,
    container_name="Bezier",
    cpx=[0, 0.2391304374, 0.8594210148, 1],
    cpy=[0.2809377313, 0, 0.734782815, 0.2453206182])
pline_2 = PolyLine(Vertices=scale_2.Geometry, Closed=False)
Z_2 = UnitZ(Factor=expr("-x", graph_2))
move_2 = Move(Geometry=scale_2.Geometry, Motion=Z_2)  # -> Geometry, Transform
pline_3 = PolyLine(Vertices=move_2.Geometry, Closed=False)
meshloft_2 = MeshLoft(polyA=pline_2, polyB=pline_3)  # -> out, result; inputs polyA: Polyline, polyB: Polyline
# ---------- meshloft_2: C# ----------
    result = MeshLoft(polyA, polyB);
# ---------- meshloft_2: C# additional code ----------
  //
  Mesh MeshLoft(Polyline polyA, Polyline polyB)
  {
    if(polyA.IsClosed && polyB.IsClosed)
      return MeshLoftClosed(polyA, polyB);
    else
      return MeshLoftOpen(polyA, polyB);
  }


  //
  Mesh MeshLoftOpen(Polyline polyA, Polyline polyB)
  {
    Mesh result = new Mesh();
    var verts = result.Vertices;
    var faces = result.Faces;

    int n = polyA.Count;

    // add vertices
    verts.AddVertices(polyA);
    verts.AddVertices(polyB);

    // add faces
    for(int i = 0; i < n - 1; i++)
      faces.AddFace(i, i + 1, i + n + 1, i + n);
    
    return result;
  }


  //
  Mesh MeshLoftClosed(Polyline polyA, Polyline polyB)
  {
    Mesh result = new Mesh();
    var verts = result.Vertices;
    var faces = result.Faces;

    int n = polyA.Count - 1;

    verts.AddVertices(polyA.Skip(1));
    verts.AddVertices(polyB.Skip(1));

    // add faces
    for(int i = 0, j = 1; i < n; i++, j++)
    {
      if(j == n) j = 0;
      faces.AddFace(i, j, j + n, i + n);
    }
    
    return result;
  }
# ---------- end meshloft_2 ----------
wbcatmullclark_2 = WeaverbirdsCatmullClarkSubdivision(MeshCurves=meshloft_2.result, Level=number_slider, SmoothNakedEdges=0)

meshloft_3 = MeshLoft(polyA=pline, polyB=pline_3)  # -> out, result; inputs polyA: Polyline, polyB: Polyline; same code as meshloft_2
wbcatmullclark_3 = WeaverbirdsCatmullClarkSubdivision(MeshCurves=meshloft_3.result, Level=number_slider, SmoothNakedEdges=0)

# ---- group: Parte interna
mesh = Mesh(wbcatmullclark_2)

# ---- group: parte superiore
mesh_2 = Mesh(wbcatmullclark)

# ----
mesh_3 = Mesh(wbcatmullclark_3)
medges = MeshEdges(Mesh=[mesh_3, mesh, mesh_2])  # -> NakedEdges, InteriorEdges, NonManifoldEdges
mjoin = MeshJoin(Meshes=[mesh_2, mesh, mesh_3])
clean = CombineClean(Meshes=mjoin)
nv = NakedVertices(Mesh=clean)  # -> ClothedIndex, NakedIndex, ClothedPts, NakedPts
Z_3 = UnitZ(Factor=1)
toggle = BooleanToggle(True)
pt_4 = Point(nv.NakedPts)
ggsteel = GgSAPCreateSteel(StandardStructureSteel="EN100252_S275")
normshade = NormalShader(
    mesh=clean,
    direction=Z_3,
    color=ColourSwatch(SwatchColor=RGB(0, 0, 0)),
    intensity=Slider(0.22, range=0.1..1),
    Reference="C:\USERS\MARCO\DESKTOP\old personal google drive\AA_Aarhus_Workshop_Folder\Grasshopper Resources\Libraries\SpatialSlur.dll")  # -> out, result; inputs mesh: Mesh, direction: Vector3d, color: Color, intensity: Double
# ---------- normshade: C# ----------
    if(mesh.Normals.Count != mesh.Vertices.Count)
      mesh.Normals.ComputeNormals();

    if(mesh.VertexColors.Count != mesh.Vertices.Count)
      mesh.VertexColors.CreateMonotoneMesh(Color.White);

    NormalShader(mesh, direction, color, intensity);
    result = mesh;
# ---------- normshade: C# additional code ----------
  //
  void NormalShader(Mesh mesh, Vector3d direction, Color color, double intensity)
  {
    if(!direction.Unitize())
      throw new System.ArgumentException("the direction vector cannot be zero length");

    Color[] vc = mesh.VertexColors.ToArray();

    var chunks = System.Collections.Concurrent.Partitioner.Create(0, mesh.Vertices.Count);
    System.Threading.Tasks.Parallel.ForEach(chunks, range =>
      {
      for (int i = range.Item1; i < range.Item2; i++)
      {
        double t = direction * mesh.Normals[i] * 0.5 + 0.5;
        vc[i] = vc[i].LerpTo(color, t * intensity);
      }
      });

    mesh.VertexColors.SetColors(vc);
  }
# ---------- end normshade ----------
concat = Concatenate(FragmentA="sp.", FragmentB="0.10", FragmentC=" cm")
ggnr = GgSAPPointRestraint(RestraintX=toggle, RestraintY=toggle, RestraintZ=toggle, RestraintXX=toggle, RestraintYY=toggle, RestraintZZ=toggle)
ggsa = GgSAPPointAtts(
    Restraint=ggnr,
    LocalAxis=Plane(origin=(-1.234321012e+308, -1.234321012e+308, -1.234321012e+308), x=(0, 0, 0), y=(0, 0, 0)),
    LowNodeID=1,
    MergeNumber=0)
Z_4 = UnitZ(Factor=Slider(-3, range=-3..-1))
ggap = GgSAPCreateShellProp(Name=concat, Thickness="0.10", Material=ggsteel, ShellType=1, MaterialAngle=0, DrillingDegreesOfFreedom=True)
supp = SupportKaramba(PosInd=pt_4, menu=[buttons(on, on, on, on, on, on)])
cross_sections = CrossSectionsKaramba(
    FamilyNameOfCrossSection="DefaultCroSec",
    MaterialsOrNamesOfMaterial="Steel",
    LocalEccentricities_cm=0,
    Heights_cm=Slider(10, range=1..10),
    mode="Shell")
meshtoshell = MeshToShellKaramba(Mesh=clean, LDist=0.005)  # -> Point, Element, Info
loads = LoadsKaramba(Vector=Z_4, LCase=0, mode="Gravity")
ggpoint = GgSAPCreateOrFindPoint(Location=pt_4, Atts=ggsa, DetectTol=0)
ggbake = GgSAPBakeModel(ClipSummary=False, NewFile=True, TagReplace=True, Units="kN_m_C")
ggmfe = GgSAPMeshConvertFiniteElements(Prop=ggap, Mesh=clean, Angle=0)  # -> StructureModelAreas, StructureModelNodes, MeshIdentifyingFacesBreachingShapeChecks
assemble = AssembleModelKaramba(Elem=meshtoshell.Element, Support=supp, Load=loads, CrossSection=cross_sections, LimitDistance_m=0.005)  # -> Model, Info, Mass_kg, CenterOfGravity
analyzethi = AnalyzeThIKaramba(Model=assemble.Model)  # -> CalculatedModel, MaximumDisplacement_m, ResultingForceOfGravity_kN, ElasticEnergy_kNm
merge = Merge(
    Data1=ColourSwatch(SwatchColor=RGB(255, 0, 0)),
    Data2=ColourSwatch(SwatchColor=RGB(255, 179, 0)),
    Data3=ColourSwatch(SwatchColor=RGB(255, 255, 0)),
    Data4=ColourSwatch(SwatchColor=RGB(0, 255, 0)),
    Data5=ColourSwatch(SwatchColor=RGB(0, 255, 255)),
    Data6=ColourSwatch(SwatchColor=RGB(4, 177, 255)),
    Data7=ColourSwatch(SwatchColor=RGB(0, 0, 255)),
    Data8=ColourSwatch(SwatchColor=RGB(129, 0, 190)),
    Data9=ColourSwatch(SwatchColor=RGB(75, 0, 130)))  # -> reverse(Result)
panel_4 = Panel("""1
2
3""")
modelview = ModelViewKaramba(
    Model=analyzethi.CalculatedModel,
    LoadCaseFactorsForLinearSuperposition=1,
    IndexIncrementOfVisibleLoadcase=0,
    ListOfColorsForColoringPlots=merge)  # -> Model, DeformedMesh, DeformedAxes, DeformedModel
nvibes = NaturalVibrationsKaramba(
    Model=analyzethi.CalculatedModel,
    FromIndex=1,
    NumberOfModes=Slider(3, range=0..10),
    MaximumNumberOfIterations=30,
    Epsilon=1e-05)  # -> ModelWithVibrationModesAsLoadCaseResults, NaturalFrequencies_Hz, ModalMass_kg, ParticipationFactorInGlobalXYAndZDirection

expression = Expression(x=analyzethi.MaximumDisplacement_m, Expression="Format(\"displacement : {0:0.0} cm \", (x*100))")
expression_2 = Expression(x=nvibes.NaturalFrequencies_Hz, y=panel_4, Expression="Format(\"Modo {1} : {0:0.0} Hz \", x,y)")
expression_3 = Expression(x=assemble.Mass_kg, Expression="Format(\"massa : {0:0} ton\", x/100)")

modelview_2 = ModelViewKaramba(
    Model=nvibes.ModelWithVibrationModesAsLoadCaseResults,
    LoadCaseFactorsForLinearSuperposition=1,
    IndexIncrementOfVisibleLoadcase=-1,
    ListOfColorsForColoringPlots=merge)  # -> Model, DeformedMesh, DeformedAxes, DeformedModel
shellview = ShellViewKaramba(Model=modelview.Model, IndexOfLayer=0)  # -> Model, MeshesOfRenderedShells, LegendColors, LegendTags
merge_2 = Merge(Data1=flatten("Rampa Spiroidale"), Data3=flatten(expression_3), Data5=flatten(expression), Data8=expression_2)  # -> flatten(Result)
shellview_2 = ShellViewKaramba(Model=modelview_2.Model, IndexOfLayer=0)  # -> Model, MeshesOfRenderedShells, LegendColors, LegendTags
lng_2 = ListLength(List=merge_2)
number_slider_2 = Slider(0.35, range=0.1..2)
series = Series(Start=Slider(0, range=-5..5), Step=expr("-x*1.5", number_slider_2), Count=lng_2)
vec = VectorXYZ(XComponent=Slider(-10.55, range=-14..10), YComponent=0, ZComponent=series)  # -> Vector, Length
pt_5 = Point(vec.Vector)
xz = XZPlane(Origin=pt_5)

tag = TextTag3D(Location=xz, Text=merge_2, Size=number_slider_2, Colour=ColourSwatch(SwatchColor=RGB(255, 255, 255)), Justification=7)
