# Grasshopper definition mesh dinamica.gh (Grasshopper 0.9.76)
# plug-ins: Karamba, Kangaroo Components, PlanktonGh, LunchBox

cyl = Cylinder(Base=PlaneXY(0, 0, 0), Radius=0.5, Length=1)
_3dsupershape = _3DSupershape(
    UDivisions=80,
    VDivisions=80,
    MParameter=14.074,
    AParameter=-0.06,
    BParameter=2.75,
    N1Parameter=3.75,
    N2Parameter=-0.48,
    N3Parameter=1.46,
    ScaleParameter=10,
    D1Interval=Domain(-3.141592654, 3.141592654),
    D2Interval=Domain(-1.570796327, 1.570796327))
sph = Sphere(Base=PlaneXY(0, 0, 0), Radius=1)
cilinder = Brep(cyl)
sphere = Brep(sph)
scale = Scale(Geometry=_3dsupershape, Center=Point(0, 0, 0), Factor=Slider(0.07, range=0.01..0.5))  # -> Geometry, Transform
brep = Brep([<brep referenced from the Rhino model> x3])
cap = CapHoles(Brep=brep)
mesh_breps = MeshBreps(
    Brep=graft(cap),
    MeshResolution="0.1",
    EdgeRefinementFactor=0.67,
    PointReduction=False,
    SmoothingStepSize=0,
    SmoothingIterations=5)  # -> Mesh, Info
debrep = DeconstructBrep(Brep=cap)  # -> Faces, Edges, Vertices
mjoin = MeshJoin(Meshes=mesh_breps.Mesh)
bang = ExplodeTree(Data=debrep.Vertices)  # -> Branch0, Branch1, Branch2
bang_2 = ExplodeTree(Data=debrep.Edges)  # -> Branch0, Branch1, Branch2
clean = CombineClean(Meshes=mjoin)
bang_3 = ExplodeTree(Data=clean)  # -> Branch0, Branch1, Branch2
number_slider = Slider(0.1, range=0..0.1)
number_slider_2 = Slider(0.1, range=0..0.1)
number_slider_3 = Slider(0.1, range=0..0.1)
preview = CustomPreview(Geometry=cap, Shader=ColourSwatch(SwatchColor=RGB(255, 255, 255)))
button = Button()
meshmachine = MeshMachine(
    Geometry=bang_3.Branch0,
    Length="0.1",
    FixCurves=bang_2.Branch0,
    FixVertices=bang.Branch0,
    Flip=Slider(1, range=0..1),
    PullStrength=0.8,
    CurvatureAdaptivity=0,
    BoundaryScale=Slider(0.46, range=0.2..1),
    BoundaryDistance=5,
    Exponent=2,
    Background=0.5,
    Iterations="10",
    Reset=Toggle(False))
meshmachine_2 = MeshMachine(
    Geometry=bang_3.Branch1,
    Length="0.1",
    FixCurves=bang_2.Branch1,
    FixVertices=bang.Branch1,
    Flip=Slider(1, range=0..1),
    PullStrength=0.8,
    CurvatureAdaptivity=0,
    BoundaryScale=Slider(0.46, range=0.2..1),
    BoundaryDistance=5,
    Exponent=2,
    Background=0.5,
    Iterations="10",
    Reset=Toggle(False))
meshmachine_3 = MeshMachine(
    Geometry=bang_3.Branch2,
    Length="0.1",
    FixCurves=bang_2.Branch2,
    FixVertices=bang.Branch2,
    Flip=Slider(1, range=0..1),
    PullStrength=0.8,
    CurvatureAdaptivity=0,
    BoundaryScale=Slider(0.46, range=0.2..1),
    BoundaryDistance=5,
    Exponent=2,
    Background=0.5,
    Iterations="10",
    Reset=Toggle(False))
pmesh = PlanktonMesh(meshmachine)
pmesh_2 = PlanktonMesh(meshmachine_2)
pmesh_3 = PlanktonMesh(meshmachine_3)
mesh = Mesh(pmesh)
mesh_2 = Mesh(pmesh_2)
mesh_3 = Mesh(pmesh_3)
vec = VectorXYZ(XComponent=Slider(0, range=0..1), YComponent=Slider(1, range=0..1), ZComponent=0)  # -> Vector, Length
normshade = NormalShader(
    mesh=clean,
    direction=vec.Vector,
    color=ColourSwatch(SwatchColor=RGB(0, 0, 0)),
    intensity=Slider(0.26, range=0..1),
    Reference="C:\USERS\MARCO\DESKTOP\old personal google drive\AA_Aarhus_Workshop_Folder\Grasshopper Resources\Libraries\SpatialSlur.dll")  # -> out, result; inputs mesh: Mesh, direction: Vector3d, color: Color, intensity: Double
# ---------- normshade: C# ----------
    if(mesh.Normals.Count != mesh.Vertices.Count)
      mesh.Normals.ComputeNormals();

    if(mesh.VertexColors.Count != mesh.Vertices.Count)
      mesh.VertexColors.CreateMonotoneMesh(Color.White);

    NormalShader(mesh, direction, color, intensity);
    result = mesh;
# ---------- normshade: C# additional code ----------
  //
  void NormalShader(Mesh mesh, Vector3d direction, Color color, double intensity)
  {
    if(!direction.Unitize())
      throw new System.ArgumentException("the direction vector cannot be zero length");

    Color[] vc = mesh.VertexColors.ToArray();

    var chunks = System.Collections.Concurrent.Partitioner.Create(0, mesh.Vertices.Count);
    System.Threading.Tasks.Parallel.ForEach(chunks, range =>
      {
      for (int i = range.Item1; i < range.Item2; i++)
      {
        double t = direction * mesh.Normals[i] * 0.5 + 0.5;
        vc[i] = vc[i].LerpTo(color, t * intensity);
      }
      });

    mesh.VertexColors.SetColors(vc);
  }
# ---------- end normshade ----------
vec_2 = VectorXYZ(XComponent=Slider(0, range=0..1), YComponent=Slider(1, range=0..1), ZComponent=0)  # -> Vector, Length
entwine = Entwine(Branch00=mesh, Branch01=mesh_2, Branch02=mesh_3, FlattenInputs=True)
normshade_2 = NormalShader(
    mesh=entwine,
    direction=vec_2.Vector,
    color=ColourSwatch(SwatchColor=RGB(0, 0, 0)),
    intensity=Slider(0.26, range=0..1),
    Reference="C:\USERS\MARCO\DESKTOP\old personal google drive\AA_Aarhus_Workshop_Folder\Grasshopper Resources\Libraries\SpatialSlur.dll")  # -> out, result; inputs mesh: Mesh, direction: Vector3d, color: Color, intensity: Double; same code as normshade
ggsteel = GgSAPCreateSteel(StandardStructureSteel="ASTM_A36")
ggbake = GgSAPBakeModel(ClipSummary=False, NewFile=True, TagReplace=True, Units="kN_m_C")
ggap = GgSAPCreateShellProp(
    Name="shell",
    Thickness=Slider(0.05, range=0..0.1),
    Material=ggsteel,
    ShellType=1,
    MaterialAngle=0,
    DrillingDegreesOfFreedom=True)
ggmfe = GgSAPMeshConvertFiniteElements(Prop=ggap, Mesh=entwine, Angle=0)  # -> StructureModelAreas, StructureModelNodes, MeshIdentifyingFacesBreachingShapeChecks
