# Grasshopper definition analisi con spettro.gh (Grasshopper 0.9.76)
# plug-ins: Tree8

panel = Panel("""ID,Longitude,Latitude,ag30,F030,Tcs30,ag50,F050,Tcs50,ag72,F072,Tcs72,ag101,F0101,Tcs101,ag140,F0140,Tcs140,ag201,F0201,Tcs201,ag475,F0475,Tcs475,ag975,F0975,Tcs975,ag2475,F02475,Tcs2475
10007,6.748225,45.84826,0.030647,2.3926,0.199,0.039405,2.4482,0.22027,0.0479,2.393,0.24278,0.056091,2.4445,0.2487,0.065463,2.4581,0.25712,0.07743,2.4429,0.26201,0.11414,2.3868,0.2736,0.15296,2.3518,0.2821,0.22107,2.2686,0.29531
10008,6.81972,45.8522,0.032088,2.3874,0.20293,0.041456,2.4308,0.22265,0.05029,2.3888,0.24334,0.058561,2.4605,0.25039,0.068788,2.4448,0.25812,0.080817,2.4459,0.26221,0.11797,2.3937,0.27561,0.15794,2.3485,0.2839,0.22744,2.2507,0.30106
10009,6.891132,45.85609,0.033362,2.3935,0.20523,0.043426,2.4125,0.23418,0.05232,2.3998,0.24265,0.060856,2.4615,0.25204,0.071469,2.4447,0.25838,0.08393,2.4439,0.26366,0.12075,2.4039,0.27735,0.1622,2.3375,0.28585,0.23084,2.26,0.30289
10010,6.962605,45.85994,0.034473,2.3998,0.20691,0.045119,2.4005,0.23583,0.05408,2.4125,0.24183,0.063248,2.4477,0.25342,0.073846,2.4476,0.25927,0.086744,2.4484,0.26414,0.12499,2.3876,0.27847,0.16724,2.3231,0.28736,0.23355,2.2854,0.30391
10011,7.034051,45.86375,0.035374,2.4054,0.20809,0.046471,2.3931,0.23704,0.0555,2.4189,0.24684,0.065156,2.4417,0.25428,0.075803,2.4517,0.25994,0.089313,2.443,0.26525,0.12901,2.3757,0.27888,0.17242,2.3104,0.28838,0.23686,2.3082,0.30419
10012,7.105528,45.86752,0.036012,2.4098,0.20885,0.047381,2.3901,0.23779,0.05641,2.4184,0.24784,0.06633,2.4358,0.25746,0.076937,2.4526,0.26128,0.091068,2.4347,0.2666,0.13142,2.3697,0.27972,0.17297,2.3344,0.28994,0.23354,2.3683,0.30401
10013,7.177008,45.87124,0.036375,2.4139,0.20928,0.047818,2.3936,0.23794,0.05678,2.42,0.24881,0.066681,2.4282,0.25932,0.077141,2.4482,0.26359,0.090409,2.4594,0.26848,0.12863,2.4233,0.28153,0.16716,2.4107,0.29151,0.22456,2.4494,0.30422
10014,7.248435,45.87493,0.036472,2.4176,0.20934,0.047819,2.4003,0.23784,0.05666,2.4289,0.24877,0.066337,2.4231,0.26126,0.076588,2.4376,0.26686,0.089435,2.4539,0.2722,0.1247,2.4765,0.28365,0.15974,2.4944,0.29324,0.2129,2.5442,0.30443
10015,7.319813,45.87858,0.036316,2.4206,0.20909,0.047435,2.4086,0.23758,0.05612,2.4385,0.24844,0.065451,2.4385,0.2593,0.075489,2.4375,0.26872,0.087837,2.4447,0.27616,0.12179,2.4929,0.28614,0.15574,2.5194,0.295,0.20827,2.5613,0.30516
10016,7.391329,45.88218,0.035906,2.4231,0.20857,0.046666,2.4189,0.23703,0.05517,2.4478,0.24291,0.06401,2.4563,0.25925,0.073829,2.4537,0.26885,0.08559,2.4621,0.27703,0.1184,2.49,0.29051,0.15125,2.5336,0.29763,0.20274,2.573,0.30718
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""")
split = TextSplit(Text=panel, Separators=",")
flip = FlipMatrix(Data=split)
panel_2 = Panel("""1
2
6
7
8""")
tbranch = TreeBranch(Tree=simplify(flip), Path=panel_2, MaintainPaths=True, SplitTree=False)
cull_i = CullIndex(List=tbranch, Indices=0, Wrap=True)
panel_3 = Panel(split)
bang = ExplodeTree(Data=cull_i)  # -> Branch0, Branch1, Branch2, Branch3, Branch4
longitudine = Panel(bang.Branch0)
latitudine = Panel(bang.Branch1)
ag_50 = Panel(bang.Branch2)
fo50 = Panel(bang.Branch3)
tc50 = Panel(bang.Branch4)
