# Grasshopper definition posizione colonne.gh (Grasshopper 0.9.76)
# plug-ins: Karamba, Kangaroo Components, plankton

crv = Curve(<curve referenced from the Rhino model>)
boundary = BoundarySurfaces(Edges=crv)
genes = GenePool(Decimals=2, Maximum=1, Minimum=0, Value=[0.8142058658, 0.3614110301, 0.2738683183, 0.5390336423])
genes_2 = GenePool(Decimals=2, Maximum=1, Minimum=0, Value=[0.3049101598, 0.6055420817, 0.656327674, 0.9635249162])
planesrf = PlaneSurface(Plane=PlaneXY(0, 0, 0), XSize=Slider(10, range=0..10), YSize=Slider(10, range=0..10))
genes_3 = GenePool(Decimals=2, Maximum=1, Minimum=0, Value=[0.967708468, 0.8060992443, 0.5653321992, 0.4163524962])
genes_4 = GenePool(Decimals=2, Maximum=1, Minimum=0, Value=[0.3592752886, 0.1724753604, 0.8938418929, 0.681385625])
pt = ConstructPoint(XCoordinate=genes_2, YCoordinate=genes, ZCoordinate=0)
pt_2 = ConstructPoint(XCoordinate=genes_4, YCoordinate=genes_3, ZCoordinate=0)
duppt = RemoveDuplicatePts(Points=pt, Tolerance=0.01)
duppt_2 = RemoveDuplicatePts(Points=pt_2, Tolerance=0.01)
evalsrf = EvaluateSurface(Surface=reparameterize(boundary), Point=duppt_2)  # -> Point, Normal, Frame
evalsrf_2 = EvaluateSurface(Surface=reparameterize(planesrf), Point=duppt)  # -> Point, Normal, Frame
debrep = DeconstructBrep(Brep=boundary)  # -> Faces, Edges, Vertices
short = ShortestList(ListA=evalsrf_2.Point, ListB=evalsrf.Point, TrimMode=2)  # -> ListA, ListB
mesh_breps = MeshBreps(
    Brep=boundary,
    InclusionPoints=evalsrf.Point,
    MeshResolution="0.3",
    EdgeRefinementFactor=0.67,
    PointReduction=False,
    SmoothingStepSize=0,
    SmoothingIterations=5)  # -> Mesh, Info
debrep_2 = DeconstructBrep(Brep=boundary)  # -> Faces, Edges, Vertices
ln = Line(StartPoint=short.ListA, EndPoint=short.ListB)
pt_3 = Point([evalsrf.Point, debrep_2.Vertices])
meshmachine = MeshMachine(
    Geometry=mesh_breps.Mesh,
    Length="0.3",
    FixCurves=debrep_2.Edges,
    FixVertices=pt_3,
    Flip=1,
    PullStrength=0.8,
    CurvatureAdaptivity=0,
    BoundaryScale=1,
    BoundaryDistance=5,
    Exponent=2,
    Background=0.5,
    Iterations="50",
    Reset=Button())
pmesh = PlanktonMesh(meshmachine)
linetobeam = LineToBeamKaramba(Line=ln, Identifier="column", New=True, Remove=True, LimitDistance_m=0.005)  # -> Element, Points, Info
cross_sections = CrossSectionsKaramba(
    FamilyNameOfCrossSection="DefaultCroSec",
    ElementsIdentifiers="column",
    MaterialOrNameOfMaterial=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,
    Diameter_cm=11.43,
    WallThickness_cm=0.4,
    mode="Circular Hollow")
supp = SupportKaramba(PosInd=evalsrf_2.Point, menu=[buttons(on, on, on, on, on, on)])
meshtoshell = MeshToShellKaramba(Mesh=pmesh, LDist=0.005, Identifier="slab")  # -> Point, Element, Info
cross_sections_2 = CrossSectionsKaramba(
    FamilyNameOfCrossSection="DefaultCroSec",
    ElementsIdentifiers="slab",
    MaterialOrNameOfMaterial=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,
    Height_cm=1,
    mode="Shell - Const.")
matselect = MaterialSelectionKaramba(menu=[dropdown(2), dropdown(6)])
assemble = AssembleModelKaramba(
    Elem=flatten([linetobeam.Element, meshtoshell.Element]),
    Support=supp,
    CrossSection=[cross_sections_2, cross_sections],
    Material=matselect,
    LimitDistance_m=0.005)  # -> Model, Info, Mass_kg, CenterOfGravity
