# Grasshopper definition christmas tree.gh (Grasshopper 0.9.76)
# plug-ins: Karamba, Kangaroo Components, plankton

crv = Curve([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])
crv_2 = Curve([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])
reb = RebuildCurve(Curve=crv, Degree=Slider(1, range=0..1), Count=10, Tangents=False)
explode = Explode(Curve=crv_2, Recursive=True)  # -> Segments, Vertices
pline = PolyLine(Vertices=explode.Vertices, Closed=False)  # -> flatten(Polyline)
join = JoinCurves(Curves=reb, Preserve=False)
join_2 = JoinCurves(Curves=pline, Preserve=False)
boundary = BoundarySurfaces(Edges=join)
boundary_2 = BoundarySurfaces(Edges=join_2)
debrep = DeconstructBrep(Brep=boundary)  # -> Faces, Edges, Vertices
crv_3 = Curve(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)
debrep_2 = DeconstructBrep(Brep=boundary_2)  # -> Faces, Edges, Vertices
divide = DivideCurve(Curve=crv_3, Count=Slider(20, range=0..100), Kinks=False)  # -> Points, Tangents, Parameters
pt = Point(flatten([divide.Points, debrep.Vertices]))
pt_2 = Point(flatten([debrep_2.Vertices, divide.Points]))
mesh_breps = MeshBreps(
    Brep=boundary_2,
    InclusionPoints=pt_2,
    MeshResolution="0.1",
    EdgeRefinementFactor=0.67,
    PointReduction=False,
    SmoothingStepSize=0,
    SmoothingIterations=5)  # -> Mesh, Info
mesh_breps_2 = MeshBreps(
    Brep=boundary,
    InclusionPoints=pt,
    MeshResolution="0.1",
    EdgeRefinementFactor=0.67,
    PointReduction=False,
    SmoothingStepSize=0,
    SmoothingIterations=5)  # -> Mesh, Info
button = Button()
meshmachine = MeshMachine(
    Geometry=mesh_breps_2.Mesh,
    Length="0.05",
    FixCurves=debrep.Edges,
    FixVertices=pt,
    Flip=1,
    PullStrength=0.8,
    CurvatureAdaptivity=0,
    BoundaryScale=1,
    BoundaryDistance=5,
    Exponent=2,
    Background=0.5,
    Iterations="30",
    Reset=button)
meshmachine_2 = MeshMachine(
    Geometry=mesh_breps.Mesh,
    Length="0.05",
    FixCurves=debrep_2.Edges,
    FixVertices=pt_2,
    Flip=1,
    PullStrength=0.8,
    CurvatureAdaptivity=0,
    BoundaryScale=1,
    BoundaryDistance=5,
    Exponent=2,
    Background=0.5,
    Iterations="30",
    Reset=button)
pmesh = PlanktonMesh(meshmachine)
pmesh_2 = PlanktonMesh(meshmachine_2)
entwine = Entwine(Branch00=pmesh, Branch01=pmesh_2, FlattenInputs=True)
mesh = Mesh(entwine)
mjoin = MeshJoin(Meshes=flatten(mesh))
clean = CombineClean(Meshes=mjoin)
meshcorners = MeshCorners(M=clean, A=0.5235987756)
demesh = DeconstructMesh(Mesh=clean)  # -> Vertices, Faces, Colours, Normals
pdecon = Deconstruct(Point=demesh.Vertices)  # -> XComponent, YComponent, ZComponent
bnd = Bounds(Numbers=flatten(pdecon.ZComponent))
dedomain = DeconstructDomain(Domain=bnd)  # -> Start, End
smaller = SmallerThan(FirstNumber=pdecon.ZComponent, SecondNumber=dedomain.Start)  # -> SmallerThan, OrEqualTo
cull = CullPattern(List=demesh.Vertices, CullPattern=smaller.OrEqualTo)
duppt = RemoveDuplicatePts(Points=flatten(cull), Tolerance=0.01)
larger = LargerThan(FirstNumber=pdecon.ZComponent, SecondNumber=dedomain.End)  # -> LargerThan, OrEqualTo
meshtoshell = MeshToShellKaramba(Mesh=clean, LDist=0.005)  # -> Point, Element, Info
cull_2 = CullPattern(List=demesh.Vertices, CullPattern=larger.OrEqualTo)
supp = SupportKaramba(PosInd=duppt, menu=[buttons(on, on, on, on, on, on)])
duppt_2 = RemoveDuplicatePts(Points=flatten(cull_2), Tolerance=0.01)
Z = UnitZ(Factor=expr("-x", Slider(10, range=1..100)))
loads = LoadsKaramba(ForceVector=Z, Local=False, PosInd=duppt_2, LCase=0, mode="Point")
assemble = AssembleModelKaramba(Elem=flatten(meshtoshell.Element), Support=supp, Load=loads, LimitDistance_m=0.005)  # -> Model, Info, Mass_kg, CenterOfGravity
analyzethi = AnalyzeThIKaramba(Model=assemble.Model)  # -> CalculatedModel, MaximumDisplacement_m, ResultingForceOfGravity_kN, ElasticEnergy_kNm
analyzethii = AnalyzeThIIKaramba(Model=assemble.Model, LoadCase=-1, RTolerance=1e-07, MaxIterations=50, NoTensionalNII=False)  # -> CalculatedModel, MaximumDisplacement_m, ResultingForceOfGravity_kN, ElasticEnergy_kNm
bmodes = BucklingModesKaramba(
    Model=analyzethii.CalculatedModel,
    FromIndex=1,
    NumberOfModes=Slider(5, range=0..10),
    MaximumNumberOfIterations=300,
    Epsilon=1e-07)  # -> ModelWithBucklingModesAsLoadCaseResults, BucklingLoadFactors
merge = Merge(
    Data1=ColourSwatch(SwatchColor=RGB(255, 0, 0)),
    Data2=ColourSwatch(SwatchColor=RGB(255, 179, 0)),
    Data3=ColourSwatch(SwatchColor=RGB(255, 255, 0)),
    Data4=ColourSwatch(SwatchColor=RGB(0, 255, 0)),
    Data5=ColourSwatch(SwatchColor=RGB(0, 255, 255)),
    Data6=ColourSwatch(SwatchColor=RGB(4, 177, 255)),
    Data7=ColourSwatch(SwatchColor=RGB(0, 0, 255)),
    Data8=ColourSwatch(SwatchColor=RGB(129, 0, 190)),
    Data9=ColourSwatch(SwatchColor=RGB(75, 0, 130)))  # -> reverse(Result)
modelview = ModelViewKaramba(
    Model=bmodes.ModelWithBucklingModesAsLoadCaseResults,
    LoadCaseFactorsForLinearSuperposition=Slider(0.51, range=-1..1),
    IndexOfVisibleLoadcase=-1,
    ListOfColorsForColoringPlots=merge)  # -> Model, DeformedMesh, DeformedAxes, DeformedModel
shellview = ShellViewKaramba(Model=modelview.Model, IndexOfLayer=0)  # -> Model, MeshesOfRenderedShells, LegendColors, LegendTags

# ==== cluster MeshCorners: Finds the corners of the boundary of a mesh
M = ClusterInput()
medges = MeshEdges(Mesh=M)  # -> NakedEdges, InteriorEdges, NonManifoldEdges
join = JoinCurves(Curves=medges.NakedEdges, Preserve=False)
explode = Explode(Curve=join, Recursive=True)  # -> simplify(Segments), Vertices
shift = ShiftList(List=explode.Segments, Shift=1, Wrap=True)  # -> simplify(List)
end = EndPoints(Curve=explode.Segments)  # -> Start, End
angle = Angle(VectorA=explode.Segments, VectorB=shift)  # -> Angle, Reflex
A = ClusterInput()
smaller = SmallerThan(FirstNumber=A, SecondNumber=angle.Angle)  # -> SmallerThan, OrEqualTo
cull = CullPattern(List=end.End, CullPattern=smaller.SmallerThan)  # -> flatten(List)
L = ClusterOutput(cull)
