# Grasshopper definition aggregation.gh (Grasshopper 0.9.76)
# plug-ins: Karamba, MeshEdit Components, Python Interpreter, Human, Kangaroo Components, Kangaroo2 Components

number_slider = Slider(11, range=0..100)
mplane = MeshPlane(
    Boundary={Plane=PlaneXY(0, 0, 0), Size=Domain2(u=-10..10, v=-10..10)},
    WidthCount=number_slider,
    HeightCount=number_slider)  # -> Mesh, Area
corners = Corners(mesh=mplane.Mesh)
vertexloads = VertexLoads(Mesh=mplane.Mesh, Strength=Slider(0.1, range=0..0.1))
show = Show(G=mplane.Mesh)
edgelengths = EdgeLengths(Mesh=mplane.Mesh, LengthFactor=Slider(1, range=0.5..2), Strength=Slider(100, range=1..100))
anchor = Anchor(Point=corners, Strength=Slider(100, range=1..100))
entwine = Entwine(Branch00=show, Branch01=vertexloads, Branch02=edgelengths, Branch03=anchor, FlattenInputs=True)
toggle = BooleanToggle(False)
button = Button()
number_slider_2 = Slider(10, range=0..10)
solver = Solver(GoalObjects=entwine, Reset=button, Threshold=1e-15, Tolerance=0.01, On=toggle)  # -> I, V, O
bouncysolver = BouncySolver(
    GoalObjects=entwine,
    Reset=button,
    Threshold=1e-15,
    Tolerance=0.01,
    Damping=Slider(0.99, range=-0.1..0.99),
    Iterations=Slider(6, range=0..100),
    On=toggle)  # -> I, V, O
bang = ExplodeTree(Data=solver.O)
item = ListItem(List=bouncysolver.O, Index=0, Wrap=True)
medges = MeshEdges(Mesh=item)  # -> NakedEdges, InteriorEdges, NonManifoldEdges
merge = Merge(Data1=medges.NakedEdges, Data2=medges.InteriorEdges)
dam = DataDam(DataA=item, BufferDelay=10000000, BufferMode=0)

Z = UnitZ(Factor=1)
normshade = NormalShader(
    mesh=item,
    direction=Z,
    color=ColourSwatch(SwatchColor=RGB(0, 0, 0)),
    intensity=Slider(0.432, range=0..1),
    Reference="C:\USERS\MARCO\DESKTOP\OLD PERSONAL GOOGLE DRIVE\AA_AARHUS_WORKSHOP_FOLDER\GRASSHOPPER RESOURCES\LIBRARIES\SpatialSlur.dll")  # -> out, flatten(result); inputs mesh: Mesh, direction: Vector3d, color: Color, intensity: Double
# ---------- normshade: C# ----------
    if(mesh.Normals.Count != mesh.Vertices.Count)
      mesh.Normals.ComputeNormals();

    if(mesh.VertexColors.Count != mesh.Vertices.Count)
      mesh.VertexColors.CreateMonotoneMesh(Color.White);

    NormalShader(mesh, direction, color, intensity);
    result = mesh;
# ---------- normshade: C# additional code ----------
  //
  void NormalShader(Mesh mesh, Vector3d direction, Color color, double intensity)
  {
    if(!direction.Unitize())
      throw new System.ArgumentException("the direction vector cannot be zero length");

    Color[] vc = mesh.VertexColors.ToArray();

    var chunks = System.Collections.Concurrent.Partitioner.Create(0, mesh.Vertices.Count);
    System.Threading.Tasks.Parallel.ForEach(chunks, range =>
      {
      for (int i = range.Item1; i < range.Item2; i++)
      {
        double t = direction * mesh.Normals[i] * 0.5 + 0.5;
        vc[i] = vc[i].LerpTo(color, t * intensity);
      }
      });

    mesh.VertexColors.SetColors(vc);
  }
# ---------- end normshade ----------
displaycrv = DisplayCurve(curve=merge, color=ColourSwatch(SwatchColor=RGB(255, 255, 255)), weight=Slider(3.19, range=0.1..10))  # -> out; inputs curve: Curve, color: Color, weight: Int32
# ---------- displaycrv: C# ----------
    // silently skip null curves
    if(curve == null) return;

    // add to display cache
    _curves.Add(curve);
    _colors.Add(color);
    _weights.Add(weight);
    _clippingBox.Union(curve.GetBoundingBox(false));
# ---------- displaycrv: C# additional code ----------
  List<Curve> _curves;
  List<Color> _colors;
  List<int> _weights;
  BoundingBox _clippingBox;


  /// <summary>
  /// This method will be called once every solution, before any calls to RunScript.
  /// </summary>
  public override void BeforeRunScript()
  {
    _curves = new List<Curve>();
    _colors = new List<Color>();
    _weights = new List<int>();
    _clippingBox = new BoundingBox();
  }


  //
  public override BoundingBox ClippingBox
  {
    get{return _clippingBox;}
  }


  //
  public override void DrawViewportWires(IGH_PreviewArgs args)
  {
    base.DrawViewportWires(args);

    for(int i = 0; i < _curves.Count; i++)
      args.Display.DrawCurve(_curves[i], _colors[i], _weights[i]);
  }
# ---------- end displaycrv ----------

demesh = DeconstructMesh(Mesh=item)  # -> Vertices, Faces, Colours, Normals
refine = Refine(Mesh=dam, Level=Slider(2, range=0..10))
Z_2 = UnitZ(Factor=1)
vdisex = VectorDisplayEx(Point=demesh.Vertices, Vector=Z_2, Colour=ColourSwatch(SwatchColor=RGB(255, 0, 0)), Width=Slider(2, range=0.1..2))
move = Move(Geometry=demesh.Vertices, Motion=Z_2)  # -> Geometry, Transform
corners_2 = Corners(mesh=dam)
vdisex_2 = VectorDisplayEx(
    Point=move.Geometry,
    Vector=expr("-x", Z_2),
    Colour=ColourSwatch(SwatchColor=RGB(255, 251, 0)),
    Width=Slider(2, range=0.1..2))
supp = SupportKaramba(PosInd=corners_2, menu=[buttons(on, on, on, off, off, off)])
loads = LoadsKaramba(Vector=Vector(0, 0, -1), LCase=0, mode="Gravity")
meshtoshell = MeshToShellKaramba(Mesh=dam, LDist=0.005)  # -> Point, Element, Info
assemble = AssembleModelKaramba(Elem=meshtoshell.Element, Support=supp, Load=loads, LimitDistance_m=0.005)  # -> Model, Info, Mass_kg, CenterOfGravity
analyzethi = AnalyzeThIKaramba(Model=assemble.Model)  # -> CalculatedModel, MaximumDisplacement_m, ResultingForceOfGravity_kN, ElasticEnergy_kNm
colours = LegendColour()
modelview = ModelViewKaramba(
    Model=analyzethi.CalculatedModel,
    LoadCaseFactorsForLinearSuperposition=1,
    IndexOfVisibleLoadcase=-1,
    ListOfColorsForColoringPlots=colours)  # -> Model, DeformedMesh, DeformedAxes, DeformedModel
shellview = ShellViewKaramba(Model=modelview.Model, IndexOfLayer=0)  # -> Model, MeshesOfRenderedShells, LegendColors, LegendTags
quad = Quadrangulate(Mesh=shellview.MeshesOfRenderedShells, Angle=Slider(1.012, range=0.001..3), Ratio=Slider(1.95, range=0.1..2))  # -> Mesh, Count
medges_2 = MeshEdges(Mesh=quad.Mesh)  # -> NakedEdges, InteriorEdges, NonManifoldEdges
merge_2 = Merge(Data1=medges_2.NakedEdges, Data2=medges_2.InteriorEdges)

swatch = ColourSwatch(SwatchColor=RGB(255, 255, 255))
Z_3 = UnitZ(Factor=1)
normshade_2 = NormalShader(
    mesh=modelview.DeformedMesh,
    direction=Z_3,
    color=swatch,
    intensity=Slider(0.432, range=0..1),
    Reference="C:\USERS\MARCO\DESKTOP\OLD PERSONAL GOOGLE DRIVE\AA_AARHUS_WORKSHOP_FOLDER\GRASSHOPPER RESOURCES\LIBRARIES\SpatialSlur.dll")  # -> out, flatten(result); inputs mesh: Mesh, direction: Vector3d, color: Color, intensity: Double; same code as normshade
displaycrv_2 = DisplayCurve(curve=merge_2, color=swatch, weight=Slider(3.19, range=0.1..10))  # -> out; inputs curve: Curve, color: Color, weight: Int32; same code as displaycrv

number_slider_3 = Slider(33, range=10..100)
popgeo = PopulateGeometry(Geometry=dam, Count=Slider(10, range=0..10), Seed=1)
shelllineresults = LineResultsOnShellsKaramba(
    AnalyzedModel=shellview.Model,
    ListOfSourcesOfForceFlowLinesLinesPoints=popgeo,
    SegmentLength_m=0.5,
    DA_deg=5,
    mode="PrincMoment")  # -> AnalyzedModel, Lines1, Lines2
join = JoinCurves(Curves=shelllineresults.Lines1, Preserve=False)
join_2 = JoinCurves(Curves=shelllineresults.Lines2, Preserve=False)
smoothpline = SmoothPolyline(Polyline=join_2, Strength=1, Times=Slider(100, range=0..100))
smoothpline_2 = SmoothPolyline(Polyline=join, Strength=1, Times=Slider(100, range=0..100))
merge_3 = Merge(Data1=smoothpline_2, Data2=smoothpline)  # -> flatten(Result)
Z_4 = UnitZ(Factor=Slider(0.1, range=0.01..0.1))
dam_2 = DataDam(DataA=merge_3, BufferDelay=10000000, BufferMode=0)
move_2 = Move(Geometry=dam_2, Motion=Z_4)  # -> Geometry, Transform
previewlw = CustomPreviewLineweights(
    Geometry=smoothpline_2,
    Shader=ColourSwatch(SwatchColor=RGB(255, 149, 0)),
    Thickness=Slider(5.5, range=1..10),
    Absolute=False)
previewlw_2 = CustomPreviewLineweights(
    Geometry=smoothpline,
    Shader=ColourSwatch(SwatchColor=RGB(168, 214, 0)),
    Thickness=Slider(5.5, range=1..10),
    Absolute=False)

# ----
# EXAMPLE_06: Aggregation along Curve
# 0. Setup Wasp
# Before using any of Wasp components,
# the SetupWasp component must be run
# to initialize all classes and shared variables
toggle_2 = BooleanToggle(True)
waspsetup = Wasp_Setup(RUN=toggle_2)  # -> log; inputs RUN: Boolean; plug-in component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
# # Wasp: Discrete Design with Grasshopper plug-in (GPL) initiated by Andrea Rossi
# 
# 
# This file is part of Wasp.
# 
# Copyright (c) 2017, Andrea Rossi <a.rossi.andrea@gmail.com>
# 
# Wasp is free software; you can redistribute it and/or modify it under the terms of the GNU General Public License as published by the Free Software Foundation; either version 3 of the License, or (at your option) any later version.
# 
# Wasp is distributed in the hope that it will be useful, but WITHOUT ANY WARRANTY; without even the implied warranty of MERCHANTABILITY or FITNESS FOR A PARTICULAR PURPOSE. See the GNU General Public License for more details. You should have received a copy of the GNU General Public License
#  along with Wasp; If not, see <http://www.gnu.org/licenses/>.
# 
# license GPL-3.0 <https://www.gnu.org/licenses/gpl.html>
# 
# Significant parts of Wasp have been developed by Andrea Rossi as part of research on digital materials and discrete design at DDU Digital Design Unit - Prof. Oliver Tessmann - Technische Universität Darmstadt
panel = Panel(waspsetup)

curve_path = Curve(dam_2)
number_slider_4 = Slider(0.25, range=0..1)

# ----
# 2. Construct Scalar Field
# The field is generated by assigning values to the cells relative to their distance from the selected curve.
# In this way, the aggregation reconstruct the curve geometry by following the field gradients.
bbox = BoundingBox(Content=curve_path, Plane=PlaneXY(0, 0, 0), UnionBox=True)  # -> Box, Box_2
volume = Volume(Geometry=bbox.Box)  # -> Volume, Centroid
number_slider_5 = Slider(0.5, range=0..1)
scale_nu = ScaleNU(
    Geometry=bbox.Box,
    Plane=volume.Centroid,
    ScaleX=Slider(1.25, range=0..10),
    ScaleY=Slider(1.25, range=0..10),
    ScaleZ=Slider(1.5, range=0..10))  # -> Geometry, Transform
fieldpts = Wasp_FieldPoints(BOU=scale_nu.Geometry, RES=number_slider_4)  # -> PTS, COUNT; inputs BOU: list of GeometryBase; plug-in component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
pt = Point(fieldpts.PTS)
pull = PullPoint(Point=pt, Geometry=curve_path, ClosestOnly=True)  # -> ClosestPoint, Distance
bnd = Bounds(Numbers=pull.Distance)
remap = RemapNumbers(Value=pull.Distance, Source=bnd, Target=Domain(0, 1))  # -> Mapped, Clipped
graph = GraphMapper(remap.Mapped, x0=0, x1=1, y0=0, y1=1, container_name="Bezier", cpx=[0, 0, 0.4736814499, 1], cpy=[1, 0.5187824965, 0, 0])
field = Wasp_Field(BOU=scale_nu.Geometry, PTS=fieldpts.PTS, COUNT=fieldpts.COUNT, RES=number_slider_4, VAL=graph)  # -> FIELD; inputs BOU: list of GeometryBase, PTS: list of Point3d, COUNT: Vector3d, VAL: list; plug-in component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

# ----
# Visualize Field Isolines
number_slider_6 = Slider(10, range=0..10)
plane = ValueList({"XY": 0, "YZ": 1, "XZ": 2}, selected="XY")
range = Range(Domain=Domain(0, 1), Steps=number_slider_6)
fieldiso = Wasp_FieldIsolines(FIELD=field, PLN=plane, t=graft(Slider(0.464, range=0..1)), ISO=range)  # -> CRV; plug-in component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
gradient = Gradient(LowerLimit=0, UpperLimit=1, Parameter=range, stops=[0: RGB(0, 128, 0), 0.5: RGB(255, 255, 0), 1: RGB(255, 0, 0)])
preview = CustomPreview(Geometry=fieldiso, Shader=graft(gradient))

# ----
# Visualize Field
gradient_2 = Gradient(LowerLimit=0, UpperLimit=1, Parameter=graph, stops=[0: RGB(0, 128, 0), 0.5: RGB(255, 255, 0), 1: RGB(255, 0, 0)])
preview_2 = CustomPreview(Geometry=fieldpts.PTS, Shader=gradient_2)

Z_5 = UnitZ(Factor=1)
number_slider_7 = Slider(1, range=0..1)
list = ValueList({"beam": 0, "shell": 1}, selected="shell")
loads_2 = LoadsKaramba(Vector=Vector(0, 0, -1), LCase=0, mode="Gravity")
merge_4 = Merge(
    Data1=ColourSwatch(SwatchColor=RGB(255, 0, 0)),
    Data2=ColourSwatch(SwatchColor=RGB(255, 179, 0)),
    Data3=ColourSwatch(SwatchColor=RGB(255, 255, 0)),
    Data4=ColourSwatch(SwatchColor=RGB(0, 255, 0)),
    Data5=ColourSwatch(SwatchColor=RGB(0, 255, 255)),
    Data6=ColourSwatch(SwatchColor=RGB(4, 177, 255)),
    Data7=ColourSwatch(SwatchColor=RGB(0, 0, 255)),
    Data8=ColourSwatch(SwatchColor=RGB(129, 0, 190)),
    Data9=ColourSwatch(SwatchColor=RGB(75, 0, 130)))  # -> reverse(Result)

# ----
# 1. Build Part
# Parts are the building blocks of Wasp.
# The most basic way of initializing a part is to define t he geometry (as brep or mesh),
# and the connection faces (center and orientation - with a line). Parts must be named
# to be identifyed in the aggregation rules.
brep = Brep(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)
pt_2 = Point([Point(-0.2236067984, -0.2236067951, 0.2236067984), Point(0.2236067951, -0.2236067984, 0.2236067984), Point(0.2236067984, 0.2236067951, 0.2236067984), Point(-0.2236067904, 0.2236068031, 0.2236067984), Point(-0.2236067951, -0.2236067984, -0.2236067984), Point(0.2236067984, -0.2236067951, -0.2236067984), Point(0.2236067951, 0.2236067984, -0.2236067984), Point(-0.2236067984, 0.2236067951, -0.2236067984)])
crv = Curve([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])
conndir = Wasp_ConnectionFromDirection(GEO=brep, CEN=pt_2, UP=crv)  # -> CONN, PLN_OUT; inputs GEO: Brep, CEN: list of Point3d, UP: list of Curve, T: list; plug-in component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
points = PointList(Points=pt_2, Size="0.20")
part_name = Panel("P")

# ----
# !!! Adding the brep geometry as attribute
# allows to carry it with the aggregation
toggle_3 = BooleanToggle(True)
attribute = Wasp_Attribute(ID="baseGeo", VAL=brep, TR=toggle_3)  # -> ATTR; inputs VAL: list, TR: Boolean; plug-in component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

part = Wasp_BasicPart(NAME=part_name, GEO=brep, CONN=flatten(conndir.CONN), ATTR=attribute)  # -> PART; inputs GEO: Mesh, CONN: list, COLL: Mesh, ATTR: list; plug-in component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

rulegen = Wasp_RulesGenerator(PART=part)  # -> R; inputs PART: list, SELF_P: Boolean, SELF_C: Boolean, GR: list; plug-in component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

swatch_2 = ColourSwatch(SwatchColor=RGB(0, 0, 0))
Z_6 = UnitZ(Factor=1)
debrep = DeconstructBrep(Brep=brep)  # -> Faces, Edges, Vertices
normshade_3 = NormalShader(
    mesh=brep,
    direction=Z_6,
    color=swatch_2,
    intensity=Slider(0.432, range=0..1),
    Reference="C:\USERS\MARCO\DESKTOP\OLD PERSONAL GOOGLE DRIVE\AA_AARHUS_WORKSHOP_FOLDER\GRASSHOPPER RESOURCES\LIBRARIES\SpatialSlur.dll")  # -> out, flatten(result); inputs mesh: Mesh, direction: Vector3d, color: Color, intensity: Double; same code as normshade
displaycrv_3 = DisplayCurve(curve=debrep.Edges, color=swatch_2, weight=Slider(3.19, range=0.1..10))  # -> out; inputs curve: Curve, color: Color, weight: Int32; same code as displaycrv

# ----
# 3. Aggregate!
# Field Aggregation adds at every step one part that is the closest to
# the highest reachable value point in the field. If COLL is set to True,
# collisions between parts are avoided. The component adds parts additively
# over the already aggregated parts. If a new aggregation has to be created,
# the RESET button allows to reset the aggregation and restart.
# 
# NEW: the THRES input allows to set a threshold value for the aggregation,
# which allows to define what is an acceptable value in the field for placing a part.
# Lower threshold values increase speed, but lead to a less accurate
# field reconstruction.
button_2 = Button()
fieldaggregation = Wasp_FieldDrivenAggregation(
    PART=flatten(part),
    N=Slider(500, range=0..1000),
    RULES=rulegen,
    FIELD=field,
    THRES=Slider(0.9, range=0..1),
    RESET=button_2)  # -> PART_OUT; inputs PART: list, PREV: list, N: Int32, RULES: list, COLL: Boolean, MODE: Int32, RESET: Boolean; plug-in component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

rndaggr = Wasp_StochasticAggregation(PART=flatten(part), N=Slider(15, range=0..100), RULES=rulegen, RESET=Button())  # -> PART_OUT; inputs PART: list, PREV: list, N: Int32, RULES: list, COLL: Boolean, MODE: Int32, RESET: Boolean; plug-in component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

displaycrv_4 = DisplayCurve(curve=crv, color=ColourSwatch(SwatchColor=RGB(255, 0, 0)), weight=Slider(3.19, range=0.1..10))  # -> out; inputs curve: Curve, color: Color, weight: Int32; same code as displaycrv

depart = Wasp_DeconstructPart(PART=fieldaggregation)  # -> NAME, GEO, CONN, CONN_PLN, TR, CHILD, ATTR; inputs PART: list; plug-in component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
depart_2 = Wasp_DeconstructPart(PART=rndaggr)  # -> NAME, GEO, CONN, CONN_PLN, TR, CHILD, ATTR; inputs PART: list; plug-in component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

# ----
# Extracting the attribute containing
# the base brep geometry
panel_2 = Panel("baseGeo")
getattr = Wasp_GetAttributeByName(ATTR=depart.ATTR, ID=panel_2)  # -> VAL; inputs ATTR: list; plug-in component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
transformed_breps = Brep(getattr)

# ----
# Extracting the attribute containing
# the base brep geometry
panel_3 = Panel("baseGeo")
getattr_2 = Wasp_GetAttributeByName(ATTR=depart_2.ATTR, ID=panel_3)  # -> VAL; inputs ATTR: list; plug-in component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
transformed_breps_2 = Brep(getattr_2)

mesh = Mesh(transformed_breps_2)
mesh_2 = Mesh(transformed_breps)
lng = ListLength(List=flatten(transformed_breps))
series = Series(Start=0, Step=1, Count=lng)
normshade_4 = NormalShader(
    mesh=mesh_2,
    direction=Z_5,
    color=ColourSwatch(SwatchColor=RGB(0, 0, 0)),
    intensity=Slider(0.432, range=0..1),
    Reference="C:\USERS\MARCO\DESKTOP\OLD PERSONAL GOOGLE DRIVE\AA_AARHUS_WORKSHOP_FOLDER\GRASSHOPPER RESOURCES\LIBRARIES\SpatialSlur.dll")  # -> out, flatten(result); inputs mesh: Mesh, direction: Vector3d, color: Color, intensity: Double; same code as normshade
gradient_3 = Gradient(
    LowerLimit=0,
    UpperLimit=lng,
    Parameter=series,
    stops=[0: RGBA(237, 26, 58, 0), 0: RGBA(209, 0, 118, 0), 0: RGBA(242, 57, 0, 0), 0: RGB(103, 0, 120), 0.141: RGB(39, 72, 161), 0.283: RGB(1, 192, 229), 0.43: RGB(18, 178, 90), 0.56: RGB(79, 186, 8), 0.698: RGB(220, 237, 32), 0.838: RGB(247, 159, 20), 1: RGB(243, 57, 0)])
preview_3 = CustomPreview(Geometry=transformed_breps, Shader=graft(gradient_3))
lng_2 = ListLength(List=normshade_4.result)
lng_3 = ListLength(List=normshade_4.result)
multiplication = Multiplication(A=lng_2, B=number_slider_7)
multiplication_2 = Multiplication(A=lng_3, B=number_slider_7)
split = SplitList(List=flatten(transformed_breps), Index=multiplication)  # -> ListA, ListB
split_2 = SplitList(List=flatten(mesh_2), Index=multiplication_2)  # -> ListA, ListB
mesh_3 = Mesh(split_2.ListA)
area = MeshArea(Mesh=mesh_3)  # -> Area, Centroid
cps = ClosestPoints(Point=graft(area.Centroid), Cloud=area.Centroid, Count=Slider(5, range=0..10))  # -> ClosestPoint, CPIndex, Distance
smaller = SmallerThan(FirstNumber=cps.Distance, SecondNumber="0.78")  # -> SmallerThan, OrEqualTo
cull = CullPattern(List=cps.ClosestPoint, CullPattern=smaller.SmallerThan)
ln = Line(StartPoint=graft(area.Centroid), EndPoint=cull)
crv_2 = Curve(ln)
demesh_2 = DeconstructMesh(Mesh=mesh_2)  # -> Vertices, Faces, Colours, Normals
explode = Explode(Curve=crv_2, Recursive=True)  # -> Segments, Vertices
filter = StreamFilter(Gate=list, Stream0=explode.Vertices, Stream1=demesh_2.Vertices)
pt_3 = Point(flatten(filter))
pdecon = Deconstruct(Point=pt_3)  # -> XComponent, YComponent, ZComponent
bnd_2 = Bounds(Numbers=flatten(pdecon.ZComponent))
dedomain = DeconstructDomain(Domain=bnd_2)  # -> Start, End
addition = Addition(A=dedomain.Start, B="1")
smaller_2 = SmallerThan(FirstNumber=pdecon.ZComponent, SecondNumber=addition)  # -> SmallerThan, OrEqualTo
cull_2 = CullPattern(List=pt_3, CullPattern=smaller_2.SmallerThan)
weld = WeldMesh(Mesh=mesh_3, Angle=3.141592654)
duppt = RemoveDuplicatePts(Points=cull_2, Tolerance=0.01)
linetobeam = LineToBeamKaramba(Line=flatten(explode.Segments), New=True, Remove=True, LimitDistance_m=0.005)  # -> Element, Points, Info
supp_2 = SupportKaramba(PosInd=duppt, menu=[buttons(on, on, on, on, on, on)])
meshtoshell_2 = MeshToShellKaramba(Mesh=weld, LDist=0.005)  # -> Point, Element, Info
filter_2 = StreamFilter(Gate=list, Stream0=linetobeam.Element, Stream1=meshtoshell_2.Element)
assemble_2 = AssembleModelKaramba(Elem=flatten(filter_2), Support=flatten(supp_2), Load=flatten(loads_2), LimitDistance_m=0.005)  # -> Model, Info, Mass_kg, CenterOfGravity
analyzethi_2 = AnalyzeThIKaramba(Model=assemble_2.Model)  # -> CalculatedModel, MaximumDisplacement_m, ResultingForceOfGravity_kN, ElasticEnergy_kNm
modelview_2 = ModelViewKaramba(
    Model=analyzethi_2.CalculatedModel,
    LoadCaseFactorsForLinearSuperposition=1,
    IndexOfVisibleLoadcase=-1,
    ListOfColorsForColoringPlots=merge_4)  # -> Model, DeformedMesh, DeformedAxes, DeformedModel
mesh_4 = Mesh(mesh_3)

Z_7 = UnitZ(Factor=1)
normshade_5 = NormalShader(
    mesh=modelview_2.DeformedMesh,
    direction=Z_7,
    color=ColourSwatch(SwatchColor=RGB(0, 0, 0)),
    intensity=Slider(0.432, range=0..1),
    Reference="C:\USERS\MARCO\DESKTOP\OLD PERSONAL GOOGLE DRIVE\AA_AARHUS_WORKSHOP_FOLDER\GRASSHOPPER RESOURCES\LIBRARIES\SpatialSlur.dll")  # -> out, flatten(result); inputs mesh: Mesh, direction: Vector3d, color: Color, intensity: Double; same code as normshade

Z_8 = UnitZ(Factor=1)
debrep_2 = DeconstructBrep(Brep=split.ListA)  # -> Faces, Edges, Vertices
normshade_6 = NormalShader(
    mesh=mesh_4,
    direction=Z_8,
    color=ColourSwatch(SwatchColor=RGB(0, 0, 0)),
    intensity=Slider(0.432, range=0..1),
    Reference="C:\USERS\MARCO\DESKTOP\OLD PERSONAL GOOGLE DRIVE\AA_AARHUS_WORKSHOP_FOLDER\GRASSHOPPER RESOURCES\LIBRARIES\SpatialSlur.dll")  # -> out, flatten(result); inputs mesh: Mesh, direction: Vector3d, color: Color, intensity: Double; same code as normshade
displaycrv_5 = DisplayCurve(curve=debrep_2.Edges, color=swatch_2, weight=Slider(3.19, range=0.1..10))  # -> out; inputs curve: Curve, color: Color, weight: Int32; same code as displaycrv

beamview = BeamViewKaramba(Model=modelview_2.Model)  # -> Model, MeshesOfRenderedBeams, DeformedBeamAxes, LegendColors, LegendTags
shellview_2 = ShellViewKaramba(Model=modelview_2.Model, IndexOfLayer=0)  # -> Model, MeshesOfRenderedShells, LegendColors, LegendTags
demesh_3 = DeconstructMesh(Mesh=mesh_4)  # -> Vertices, Faces, Colours, Normals
move_3 = Move(Geometry=demesh_3.Vertices, Motion=Z_2)  # -> Geometry, Transform

Z_9 = UnitZ(Factor=1)
normshade_7 = NormalShader(
    mesh=shellview_2.MeshesOfRenderedShells,
    direction=Z_9,
    color=ColourSwatch(SwatchColor=RGB(0, 0, 0)),
    intensity=Slider(0.432, range=0..1),
    Reference="C:\USERS\MARCO\DESKTOP\OLD PERSONAL GOOGLE DRIVE\AA_AARHUS_WORKSHOP_FOLDER\GRASSHOPPER RESOURCES\LIBRARIES\SpatialSlur.dll")  # -> out, flatten(result); inputs mesh: Mesh, direction: Vector3d, color: Color, intensity: Double; same code as normshade

vdisex_3 = VectorDisplayEx(
    Point=move_3.Geometry,
    Vector=expr("-x", Z_2),
    Colour=ColourSwatch(SwatchColor=RGB(255, 251, 0)),
    Width=Slider(0.51, range=0.1..2))

# ==== cluster Corners: Find the boundary corner points of a quad mesh
mesh = ClusterInput()
mesh_2 = Mesh(mesh)
nv = NakedVertices(Mesh=mesh_2)  # -> ClothedIndex, NakedIndex, ClothedPts, NakedPts
vn = VertexNeighbours(Mesh=mesh_2, VertexNumber=nv.NakedIndex)  # -> graft(Vertex), Neighbours, Normal
lng = ListLength(List=vn.Neighbours)
equals = Equality(FirstNumber=lng, SecondNumber=3)  # -> Equality, Inequality
cull = CullPattern(List=vn.Vertex, CullPattern=equals.Inequality)
pshift = ShiftPaths(Data=cull, Offset=-1)
D = ClusterOutput(pshift)

# ==== cluster LegendColour: Legend colour for Karamba
merge = Merge(
    Data1=ColourSwatch(SwatchColor=RGB(255, 0, 0)),
    Data2=ColourSwatch(SwatchColor=RGB(255, 179, 0)),
    Data3=ColourSwatch(SwatchColor=RGB(255, 255, 0)),
    Data4=ColourSwatch(SwatchColor=RGB(0, 255, 0)),
    Data5=ColourSwatch(SwatchColor=RGB(0, 255, 255)),
    Data6=ColourSwatch(SwatchColor=RGB(4, 177, 255)),
    Data7=ColourSwatch(SwatchColor=RGB(0, 0, 255)),
    Data8=ColourSwatch(SwatchColor=RGB(129, 0, 190)),
    Data9=ColourSwatch(SwatchColor=RGB(75, 0, 130)))  # -> reverse(Result)
legend = ClusterOutput(merge)  # List of colours to plug on Karamba Legend
