# Grasshopper definition pizza slice.gh (Grasshopper 1.0.5)
# plug-ins: Karamba, Human, Tree8, Weaverbird, Kangaroo2 Components

pt = Point(graft([Point(4.975196135, 13.90903498, 0), Point(9.932933505, 15.38682209, 0), Point(14.98601198, 14.00437609, 0)]))
firstend = FirstEndList(Tree=pt)  # -> FirstList, Remainders, EndList
Z = UnitZ(Factor=Slider(3.115, range=0..6))
material = CreateMaterial(Diffuse=RGB(255, 105, 180), Specular=RGB(255, 255, 255), Emission=RGB(0, 0, 0), Transparency=0, Shine=0)
move = Move(Geometry=[firstend.FirstList, firstend.EndList], Motion=Z)  # -> Geometry, Transform
merge = Merge(Data1=move.Geometry, Data2=firstend.Remainders)  # -> flatten(Result)
intcrv = Interpolate(Vertices=merge, Degree=3, Periodic=False, KnotStyle=1)  # -> Curve, Length, Domain
pt_2 = Point(Point(9.677731371, 1.077123258, 0))
number_slider = Slider(0.2, range=0..1)
crv = Curve(intcrv.Curve)
extr = ExtrudePoint(Base=crv, Point=pt_2)
scale = Scale(Geometry=extr, Center=Point(0, 0, 0), Factor=Slider(0.03, range=0..0.1))  # -> Geometry, Transform
debrep = DeconstructBrep(Brep=scale.Geometry)  # -> Faces, Edges, Vertices
item = ListItem(List=debrep.Edges, Index="2", Wrap=True)
mesh_breps = MeshBreps(
    Brep=scale.Geometry,
    MeshResolution="0.05",
    EdgeRefinementFactor=0.67,
    PointReduction=False,
    SmoothingStepSize=0,
    SmoothingIterations=5)  # -> Mesh, Info
mesh = Mesh(extr)
displaycrv = DisplayCurve(curve=item, color=ColourSwatch(SwatchColor=RGB(196, 106, 106)), weight=Slider(16, range=1..100))  # -> out; inputs curve: Curve, color: Color, weight: Int32
# ---------- displaycrv: C# ----------
    // silently skip null curves
    if(curve == null) return;

    // add to display cache
    _curves.Add(curve);
    _colors.Add(color);
    _weights.Add(weight);
    _clippingBox.Union(curve.GetBoundingBox(false));
# ---------- displaycrv: C# additional code ----------
  List<Curve> _curves;
  List<Color> _colors;
  List<int> _weights;
  BoundingBox _clippingBox;


  /// <summary>
  /// This method will be called once every solution, before any calls to RunScript.
  /// </summary>
  public override void BeforeRunScript()
  {
    _curves = new List<Curve>();
    _colors = new List<Color>();
    _weights = new List<int>();
    _clippingBox = new BoundingBox();
  }


  //
  public override BoundingBox ClippingBox
  {
    get{return _clippingBox;}
  }


  //
  public override void DrawViewportWires(IGH_PreviewArgs args)
  {
    base.DrawViewportWires(args);

    for(int i = 0; i < _curves.Count; i++)
      args.Display.DrawCurve(_curves[i], _colors[i], _weights[i]);
  }
# ---------- end displaycrv ----------
wbloop = WeaverbirdsLoopSubdivision(MeshCurves=mesh_breps.Mesh, Level=2, SmoothNakedEdges=0)
nv = NakedVertices(Mesh=wbloop)  # -> ClothedIndex, NakedIndex, ClothedPts, NakedPts
crv_2 = Curve(debrep.Edges)
panel = Panel("""0.2
0.5
0.8""")
item_2 = ListItem(List=crv_2, Index=0, Wrap=True)  # -> Item, Item1, Item2
eval = EvaluateCurve(Curve=reparameterize(item_2.Item2), Parameter=panel)  # -> Point, Tangent, Angle
pt_3 = Point(nv.NakedPts)
cp = ClosestPoint(Point=eval.Point, Cloud=pt_3)  # -> ClosestPoint, CPIndex, Distance
mc = MeshCorners(Mesh=wbloop, Angle=2.35619449)
item_3 = ListItem(List=mc, Index="1", Wrap=True)
Z_2 = UnitZ(Factor=expr("-x", Slider(0.3, range=0.1..3)))
supp = SupportKaramba(PosInd=cp.ClosestPoint, menu=[buttons(on, on, on, on, on, on)])
meshtoshell = MeshToShellKaramba(Mesh=wbloop, LimitDistance_m=0.005)  # -> Element, Points, Info
loads = LoadsKaramba(ForceVector=Z_2, Local=False, PosInd=item_3, LCase=0, mode="Point")
loads_2 = LoadsKaramba(Vector=Vector(0, 0, -1), LCase=0, mode="Gravity")
assemble = AssembleModelKaramba(Elem=meshtoshell.Element, Support=supp, Load=flatten([loads_2, loads]), LimitDistance_m=0.005)  # -> Model, Info, Mass_kg, CenterOfGravity
colours = LegendColour()
analyzethi = AnalyzeThIKaramba(Model=assemble.Model)  # -> CalculatedModel, MaximumDisplacement_m, ResultingForceOfGravity_kN, ElasticEnergy_kNm
panel_2 = Panel(analyzethi.MaximumDisplacement_m)
modelview = ModelViewKaramba(
    Model=analyzethi.CalculatedModel,
    LoadCaseFactorsForLinearSuperposition=1,
    IndexOfVisibleLoadcase=-1,
    ListOfColorsForColoringPlots=colours)  # -> Model, DeformedMesh, DeformedAxes, DeformedModel
shellview = ShellViewKaramba(Model=modelview.Model, IndexOfLayer=0)  # -> Model, MeshesOfRenderedShells, LegendColors, LegendTags
popgeo = PopulateGeometry(Geometry=wbloop, Count=100, Seed=1)
num = Number(expr("Round(x*1000)", analyzethi.MaximumDisplacement_m))
shelllineresults = LineResultsOnShellsKaramba(
    AnalyzedModel=shellview.Model,
    ListOfSourcesOfForceFlowLinesLinesPoints=popgeo,
    SegmentLength_m=0.5,
    DA_deg=5,
    mode="PrincMoment")  # -> AnalyzedModel, Lines1, Lines2
xyz = ColourXYZ(Alpha=1, X=0, Y=0, Z=0)
argb = SplitARGB()  # -> Alpha, Red, Green, Blue
rgb = ColourRGB(Alpha=255, Red=0, Green=0, Blue=0)
preview = CustomPreview(Geometry=shelllineresults.Lines1, Material=ColourSwatch(SwatchColor=RGB(255, 0, 0)))
preview_2 = CustomPreview(Geometry=shelllineresults.Lines2, Material=ColourSwatch(SwatchColor=RGB(0, 51, 255)))
hsl = ColourHSL(Alpha=1, Hue=0, Saturation=1, Luminance=0.5)

# ---- group: Performance parameters
header = Panel("Displacement: ")
entwine = Entwine(Branch00=num, FlattenInputs=True)  # -> flatten(Result)
units = Panel(" mm")
concat = Concatenate(FragmentA=header, FragmentB=entwine, FragmentC=units)
txt = Text(concat)
panel_3 = Panel(txt)
lng = ListLength(List=txt)
series = Series(Start=Slider(87, range=0..100), Step=Slider(30, range=0..100), Count=lng)
pt_4 = ConstructPoint(XCoordinate=Slider(204, range=0..1000), YCoordinate=series, ZCoordinate=0)
texttoscreen = RenderTextToScreen(
    Text=txt,
    Location=pt_4,
    Size=Slider(15, range=0..100),
    Color=ColourSwatch(SwatchColor=RGB(255, 255, 255)),
    m_scWithvp=False)

# ==== cluster LegendColour: Legend colour for Karamba
merge = Merge(
    Data1=ColourSwatch(SwatchColor=RGB(255, 0, 0)),
    Data2=ColourSwatch(SwatchColor=RGB(255, 179, 0)),
    Data3=ColourSwatch(SwatchColor=RGB(255, 255, 0)),
    Data4=ColourSwatch(SwatchColor=RGB(0, 255, 0)),
    Data5=ColourSwatch(SwatchColor=RGB(0, 255, 255)),
    Data6=ColourSwatch(SwatchColor=RGB(4, 177, 255)),
    Data7=ColourSwatch(SwatchColor=RGB(0, 0, 255)),
    Data8=ColourSwatch(SwatchColor=RGB(129, 0, 190)),
    Data9=ColourSwatch(SwatchColor=RGB(75, 0, 130)))  # -> reverse(Result)
legend = ClusterOutput(merge)  # List of colours to plug on Karamba Legend
