# Grasshopper definition trave su più appoggi.gh (Grasshopper 1.0.7)
# plug-ins: Karamba

# Trave su più appoggi
pt = Point(Point(0, 0, 0))

# ---- group: muovi questo Slider
lunghezza_trave = Slider(24, range=0..100)

# ----
X = UnitX(Factor=lunghezza_trave)
# di Marco Pellegrino
move = Move(Geometry=pt, Motion=X)  # -> Geometry, Transform
ln = Line(StartPoint=pt, EndPoint=move.Geometry)

# ---- group: posizione degli appoggi
genes = GenePool(Decimals=2, Maximum=1, Minimum=0, Value=[0.22, 0.61, 0.83, 0.47])

# ----
shatter = Shatter(Curve=reparameterize(ln), Parameters=genes)
join = JoinCurves(Curves=shatter, Preserve=False)
explode = Explode(Curve=join, Recursive=True)  # -> Segments, Vertices

# ---- group: elemento strutturale
crosecrselect = CrossSectionRangeSelectorKaramba3D(MaximumHeight_cm=-1, MaximumWidth_cm=-1, menu=[dropdown(1), dropdown(1), dropdown(3)])
crosecselect = CrossSectionSelectorKaramba3D(CrossSections=crosecrselect, NameOrListIndexOfCrossSection="14")  # -> CrossSection, Info
linetobeam = LineToBeamKaramba3D(Line=shatter, Identifier="trave", CrossSection=crosecselect.CrossSection, New=True, Remove=True, LimitDistance_m=0.005)  # -> Element, Points, Info

# ---- group: Carichi
Z = UnitZ(Factor="-60")
loads = LoadsKaramba3D(Vector=Z, BeamIdentifiers="trave", LCase=0, mode="Uniform Line", menu=[buttons(on, off, off)])

# ---- group: Condizioni di Vincolo
supp = SupportKaramba(PosInd=explode.Vertices, menu=[buttons(on, on, on, on, off, on)])

# ---- group: assemblaggio
assemble = AssembleModelKaramba(Elem=linetobeam.Element, Support=supp, Load=loads, LimitDistance_m=0.005)  # -> Model, Info, Mass_kg, CenterOfGravity

# ---- group: Analisi
analyze = AnalyzeKaramba3D(Model=assemble.Model)  # -> CalculatedModel, MaximumDisplacement_cm, ResultingForceOfGravity_kN, ElasticEnergy_kNm

# ----
colours = LegendColour()

# ---- group: Visualizza modello
modelview = ModelViewKaramba3D(
    Model=analyze.CalculatedModel,
    LoadCaseFactorsForLinearSuperposition=1,
    IndexOfVisibleLoadcase=-1,
    ListOfColorsForColoringPlots=colours)  # -> Model, DeformedMesh, DeformedAxes, DeformedModel

# ---- group: Visualizza elementi trave
beamview = BeamViewKaramba(Model=modelview.Model)  # -> Model, MeshesOfRenderedBeams, DeformedBeamAxes, LegendColors, LegendTags

# ==== cluster LegendColour: Legend colour for Karamba
merge = Merge(
    Data1=ColourSwatch(SwatchColor=RGB(255, 0, 0)),
    Data2=ColourSwatch(SwatchColor=RGB(255, 179, 0)),
    Data3=ColourSwatch(SwatchColor=RGB(255, 255, 0)),
    Data4=ColourSwatch(SwatchColor=RGB(0, 255, 0)),
    Data5=ColourSwatch(SwatchColor=RGB(0, 255, 255)),
    Data6=ColourSwatch(SwatchColor=RGB(4, 177, 255)),
    Data7=ColourSwatch(SwatchColor=RGB(0, 0, 255)),
    Data8=ColourSwatch(SwatchColor=RGB(129, 0, 190)),
    Data9=ColourSwatch(SwatchColor=RGB(75, 0, 130)))  # -> reverse(Result)
legend = ClusterOutput(merge)  # List of colours to plug on Karamba Legend
