# Grasshopper definition trave_irrigidita.gh (Grasshopper 1.0.7)
# plug-ins: Karamba, Kangaroo Components

lunghezza_trave = Slider(11.518, range=6..13)
# Trave irrigidita
pt = Point(Point(0, 0, 0))
X = UnitX(Factor=lunghezza_trave)
move = Move(Geometry=pt, Motion=X)  # -> Geometry, Transform
distanza_appoggi = Slider(5.941, range=1..6)
# di Marco Pellegrino
ln = Line(StartPoint=pt, EndPoint=move.Geometry)
curvepoint = PointOnCurve(ln, parameter=0.5)
Y = UnitY(Factor=1)
circle = CircleCNR(Center=curvepoint, Normal=Y, Radius=expr("x/2", distanza_appoggi))
clx = CurveLine(Curve=circle, Line=ln)  # -> Points, Params, Count
panel = Panel("""0
3
2
1""")
item = ListItem(List=flatten([pt, move.Geometry, clx.Points]), Index=panel, Wrap=True)
pt_2 = Point(item)
altezza_appoggi = Slider(1.4, range=0.5..5)
panel_2 = Panel("""1
2""")
pline = PolyLine(Vertices=pt_2, Closed=False)
item_2 = ListItem(List=pt_2, Index=panel_2, Wrap=True)
Z = UnitZ(Factor=expr("-x", altezza_appoggi))
move_2 = Move(Geometry=item_2, Motion=Z)  # -> Geometry, Transform

# ----
# trave superiore
explode = Explode(Curve=pline, Recursive=True)  # -> Segments, Vertices
divide = DivideCurve(Curve=explode.Segments, Count="10", Kinks=False)  # -> Points, Tangents, Parameters
duppt = RemoveDuplicatePts(Points=flatten(divide.Points), Tolerance=0.01)
pline_2 = PolyLine(Vertices=divide.Points, Closed=False)
explode_2 = Explode(Curve=pline_2, Recursive=True)  # -> Segments, Vertices
crosecrselect = CrossSectionRangeSelectorKaramba3D(MaximumHeight_cm=-1, MaximumWidth_cm=-1, menu=[dropdown(0), dropdown(1), dropdown(2)])
crosecselect = CrossSectionSelectorKaramba3D(CrossSections=crosecrselect, NameOrListIndexOfCrossSection=Slider(6, range=1..20))  # -> CrossSection, Info
linetobeam = LineToBeamKaramba3D(
    Line=explode_2.Segments,
    Identifier="trave",
    CrossSection=crosecselect.CrossSection,
    New=True,
    Remove=True,
    LimitDistance_m=0.005)  # -> Element, Points, Info

# ----
# tirante
pline_3 = PolyLine(Vertices=[pt, move_2.Geometry, move.Geometry], Closed=False)
explode_3 = Explode(Curve=pline_3, Recursive=True)  # -> Segments, Vertices
cross_section = CrossSectionKaramba3D(
    FamilyNameOfCrossSection="DefaultCroSec",
    Material=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,
    Diameter_cm=Slider(13.7, range=10..20),
    WallThickness_cm=0.4,
    mode="Circular Hollow")
linetobeam_2 = LineToBeamKaramba3D(Line=explode_3.Segments, Identifier="tirante", CrossSection=cross_section, New=True, Remove=True, LimitDistance_m=0.005)  # -> Element, Points, Info

# ---- group: Carichi
posizione_del_carico = Slider(15, range=0..30)
caarico_concentrato = Slider(100, range=0..100)
carico = Slider(24.88, range=0..60)
Z_2 = UnitZ(Factor=expr("-x", carico))
Z_3 = UnitZ(Factor=expr("-x", caarico_concentrato))
item_3 = ListItem(List=duppt, Index=posizione_del_carico, Wrap=True)
loads = LoadsKaramba3D(Vector=Z_2, BeamIdentifiers="trave", LCase="0", mode="Uniform Line", menu=[buttons(on, off, off)])
loads_2 = LoadsKaramba3D(ForceVector=Z_3, Local=False, PosInd=item_3, LCase="1", mode="Point")

# ----
# traversi
number_slider = Slider(5, range=1..20)
crosecrselect_2 = CrossSectionRangeSelectorKaramba3D(MaximumHeight_cm=-1, MaximumWidth_cm=-1, menu=[dropdown(0), dropdown(1), dropdown(2)])
ln_2 = Line(StartPoint=item_2, EndPoint=move_2.Geometry)
crosecselect_2 = CrossSectionSelectorKaramba3D(CrossSections=crosecrselect_2, NameOrListIndexOfCrossSection=number_slider)  # -> CrossSection, Info
linetobeam_3 = LineToBeamKaramba3D(Line=ln_2, Identifier="traversi", CrossSection=crosecselect_2.CrossSection, New=True, Remove=True, LimitDistance_m=0.005)  # -> Element, Points, Info

# ---- group: Condizioni di Vincolo
item_4 = ListItem(List=flatten(linetobeam.Points), Index=0, Wrap=True)  # -> Item1, Item
supp = SupportKaramba(PosInd=[item_4.Item, item_4.Item1], menu=[buttons(on, on, on, on, on, on)])

# ---- group: assemblaggio della matrice
assemble = AssembleModelKaramba3D(
    Elem=flatten([linetobeam.Element, linetobeam_2.Element, linetobeam_3.Element]),
    Support=flatten(supp),
    Load=flatten([loads, loads_2]),
    LimitDistance_m=0.005)  # -> Model, Info, Mass_kg, CenterOfGravity

# ---- group: analisi del primo ordine
analyze = AnalyzeKaramba3D(Model=assemble.Model)  # -> CalculatedModel, MaximumDisplacement_cm, ResultingForceOfGravity_kN, ElasticEnergy_kNm

# ---- group: Visualizza modello
modelview = ModelViewKaramba3D(Model=analyze.CalculatedModel, LoadCaseFactorsForLinearSuperposition=1, IndexOfVisibleLoadcase=-1)  # -> Model, DeformedMesh, DeformedAxes, DeformedModel

# ---- group: Visualizza trave
beamview = BeamViewKaramba(Model=modelview.Model)  # -> Model, MeshesOfRenderedBeams, DeformedBeamAxes, LegendColors, LegendTags
