# Grasshopper definition London Eye.gh (Grasshopper 1.0.7)
# plug-ins: Karamba, MeshEdit Components, Weaverbird, Kangaroo2 Components

xz = XZPlane(Origin=Point(0, 0, 0))
cir = Circle(Plane=xz, Radius=Slider(30, range=10..30))
seam = Seam(Curve=reparameterize(cir), Seam=Slider(0, range=0..1))
divide = DivideCurve(Curve=seam, Count=Slider(62, range=6..62), Kinks=False)  # -> Points, Tangents, Parameters
Y = UnitY(Factor=Slider(5.88, range=1..10))
shatter = Shatter(Curve=seam, Parameters=divide.Parameters)
move = Move(Geometry=shatter, Motion=Y)  # -> Geometry, Transform
end = EndPoints(Curve=shatter)  # -> Start, End
end_2 = EndPoints(Curve=move.Geometry)  # -> Start, End
ln = Line(StartPoint=end.Start, EndPoint=end.End)
ln_2 = Line(StartPoint=end_2.Start, EndPoint=end_2.End)
join = JoinCurves(Curves=ln, Preserve=False)
join_2 = JoinCurves(Curves=ln_2, Preserve=False)
explode = Explode(Curve=join, Recursive=True)  # -> Segments, Vertices
explode_2 = Explode(Curve=join_2, Recursive=True)  # -> Segments, Vertices
shift = ShiftList(List=explode_2.Vertices, Shift=1, Wrap=invert(True))
shift_2 = ShiftList(List=explode.Vertices, Shift=1, Wrap=invert(True))
meshloft = MeshLoft(polyA=join, polyB=join_2)  # -> out, result; inputs polyA: Polyline, polyB: Polyline
# ---------- meshloft: C# ----------
    result = MeshLoft(polyA, polyB);
# ---------- meshloft: C# additional code ----------
  //
  Mesh MeshLoft(Polyline polyA, Polyline polyB)
  {
    if(polyA.IsClosed && polyB.IsClosed)
      return MeshLoftClosed(polyA, polyB);
    else
      return MeshLoftOpen(polyA, polyB);
  }


  //
  Mesh MeshLoftOpen(Polyline polyA, Polyline polyB)
  {
    Mesh result = new Mesh();
    var verts = result.Vertices;
    var faces = result.Faces;

    int n = polyA.Count;

    // add vertices
    verts.AddVertices(polyA);
    verts.AddVertices(polyB);

    // add faces
    for(int i = 0; i < n - 1; i++)
      faces.AddFace(i, i + 1, i + n + 1, i + n);
    
    return result;
  }


  //
  Mesh MeshLoftClosed(Polyline polyA, Polyline polyB)
  {
    Mesh result = new Mesh();
    var verts = result.Vertices;
    var faces = result.Faces;

    int n = polyA.Count - 1;

    verts.AddVertices(polyA.Skip(1));
    verts.AddVertices(polyB.Skip(1));

    // add faces
    for(int i = 0, j = 1; i < n; i++, j++)
    {
      if(j == n) j = 0;
      faces.AddFace(i, j, j + n, i + n);
    }
    
    return result;
  }
# ---------- end meshloft ----------
short = ShortestList(ListA=explode_2.Vertices, ListB=shift_2, TrimMode=2)  # -> ListA, ListB
short_2 = ShortestList(ListA=explode.Vertices, ListB=shift, TrimMode=2)  # -> ListA, ListB
ln_3 = Line(StartPoint=short.ListA, EndPoint=short.ListB)
ln_4 = Line(StartPoint=short_2.ListA, EndPoint=short_2.ListB)
explode_3 = MeshExplode(Mesh=meshloft.result, Interpolate=False)
merge = Merge(Data1=Toggle(True), Data2=Toggle(False))
facen = FaceNormals(Mesh=explode_3)  # -> Centers, Normals
mesh = Mesh(explode_3)
merge_2 = Merge(Data1=Toggle(True), Data2=Toggle(False))
cull = CullPattern(List=mesh, CullPattern=merge_2)
multiplication = Multiplication(A=facen.Normals, B=Slider(2.62, range=1..6))
cull_2 = CullPattern(List=ln_4, CullPattern=invert(merge))
cull_3 = CullPattern(List=ln_3, CullPattern=merge)
facen_2 = FaceNormals(Mesh=cull)  # -> Centers, Normals
scale = Scale(Geometry=cull, Center=flatten(facen_2.Centers), Factor=Slider(0.39, range=0.2..0.8))  # -> Geometry, Transform
demesh = DeconstructMesh(Mesh=explode_3)  # -> simplify(Vertices), Faces, Colours, Normals
move_2 = Move(Geometry=facen.Centers, Motion=multiplication)  # -> simplify(Geometry), Transform
fcircle = CircleFit(Points=flatten(move_2.Geometry))  # -> Circle, Radius, Deviation
crv_cp = CurveClosestPoint(Point=flatten(move_2.Geometry), Curve=fcircle.Circle)  # -> Point, Parameter, Distance
neg = Negative(Value=Slider(1.04, range=0.5..3))
multiplication_2 = Multiplication(A=facen_2.Normals, B=neg)
move_3 = Move(Geometry=scale.Geometry, Motion=flatten(multiplication_2))  # -> simplify(Geometry), Transform
fcircle_2 = CircleFit(Points=flatten(crv_cp.Point))  # -> Circle, Radius, Deviation
ln_5 = Line(StartPoint=move_2.Geometry, EndPoint=demesh.Vertices)
wbfacepolys = WeaverbirdsFacePolylines(Mesh=move_3.Geometry)  # -> simplify(Polygons)
wbfacepolys_2 = WeaverbirdsFacePolylines(Mesh=cull)
shatter_2 = Shatter(Curve=fcircle.Circle, Parameters=crv_cp.Parameter)
number_slider = Slider(2.76, range=0.5..5)
pt = Point(fcircle_2.Circle)
meshloft_2 = MeshLoft(polyA=wbfacepolys_2, polyB=wbfacepolys)  # -> out, result; inputs polyA: Polyline, polyB: Polyline; same code as meshloft
neg_2 = Negative(Value=number_slider)
medges = MeshEdges(Mesh=meshloft_2.result)  # -> NakedEdges, InteriorEdges, NonManifoldEdges
Y_2 = UnitY(Factor=[neg_2, number_slider])
crv = Curve(simplify(medges.InteriorEdges))
explode_4 = Explode(Curve=wbfacepolys, Recursive=True)  # -> simplify(Segments), Vertices
move_4 = Move(Geometry=pt, Motion=Y_2)  # -> Geometry, Transform
ln_6 = Line(StartPoint=fcircle_2.Circle, EndPoint=crv_cp.Point)
item = ListItem(List=move_4.Geometry, Index=0, Wrap=True)  # -> Item, Item1
pline = PolyLine(Vertices=move_4.Geometry, Closed=False)
xz_2 = XZPlane(Origin=item.Item1)
xz_3 = XZPlane(Origin=item.Item)
cir_2 = Circle(Plane=xz_2, Radius=1)
cir_3 = Circle(Plane=xz_3, Radius=1)
dispatch = Dispatch(List=crv_cp.Point, DispatchPattern=[True, False])  # -> ListA, ListB
lng = ListLength(List=dispatch.ListA)
divide_2 = DivideCurve(Curve=cir_3, Count=lng, Kinks=False)  # -> Points, Tangents, Parameters
lng_2 = ListLength(List=dispatch.ListB)
divide_3 = DivideCurve(Curve=cir_2, Count=lng_2, Kinks=False)  # -> Points, Tangents, Parameters
number_slider_2 = Slider(0, range=0..5)
loft = Loft(Curves=[cir_2, cir_3], Options={Adjust=False, Closed=False, LoftEnds=0, LoftSimp=0, LoftType=0, Rebuild=10, Refit=0.01})
shift_3 = ShiftList(List=divide_2.Points, Shift=number_slider_2, Wrap=True)
cap = CapHoles(Brep=loft)
shift_4 = ShiftList(List=divide_3.Points, Shift=number_slider_2, Wrap=True)
mesh_breps = MeshBreps(
    Brep=cap,
    InclusionPoints=flatten([divide_2.Points, divide_3.Points]),
    MeshResolution=1,
    EdgeRefinementFactor=0.67,
    PointReduction=False,
    SmoothingStepSize=0,
    SmoothingIterations=5)  # -> Mesh, Info
ln_7 = Line(StartPoint=dispatch.ListA, EndPoint=shift_3)
ln_8 = Line(StartPoint=dispatch.ListB, EndPoint=shift_4)
number_slider_3 = Slider(8, range=3..8)
polygon = Polygon(Plane=PlaneXY(0, 0, 0), Radius="12", Segments="3", FilletRadius=0)  # -> Polygon, Length
rotate = Rotate(Geometry=polygon.Polygon, Angle=1.570796327, Plane=PlaneXY(0, 0, 0))  # -> Geometry, Transform
pt_2 = Point(Point(0, 26, -38))
orient = Orient(Geometry=rotate.Geometry, Source=PlaneXY(0, 0, 0), Target=pt_2)  # -> Geometry, Transform
explode_5 = Explode(Curve=orient.Geometry, Recursive=True)  # -> Segments, Vertices
duppt = RemoveDuplicatePts(Points=explode_5.Vertices, Tolerance=0.01)
ln_9 = Line(StartPoint=duppt, EndPoint=xz_2)
item_2 = ListItem(List=ln_9, Index=0, Wrap=True)  # -> Item, Item1, Item2

inner_circle = Curve(shatter_2)
cable = Curve(item_2.Item)
colonne = Curve([item_2.Item1, item_2.Item2])
brace = Curve([cull_3, cull_2])
truss = Curve(ln_5)
cell = Data([crv, explode_4.Segments])
mesh_2 = Mesh(mesh_breps.Mesh)
circle = Curve([shatter, move.Geometry])
cable_2 = Curve([ln_7, ln_8])

divide_4 = DivideCurve(Curve=colonne, Count="20", Kinks=False)  # -> Points, Tangents, Parameters
pline_2 = PolyLine(Vertices=divide_4.Points, Closed=False)
explode_6 = Explode(Curve=pline_2, Recursive=True)  # -> Segments, Vertices
number_slider_4 = Slider(8, range=0..10)
E = YoungsModulusKNCm2(21000)
g12 = InPlaneShearModulusKNCm2(8076)
g3 = TransverseShearModulusKNCm2(8076)
fy = YieldStrengthKNCm2(23.5)
multiplication_3 = Multiplication(A=E, B="20")
multiplication_4 = Multiplication(A=g12, B="20")
multiplication_5 = Multiplication(A=g3, B="20")
multiplication_6 = Multiplication(A=fy, B="20")
matprops = MaterialPropertiesKaramba3D(
    FamilyOfMaterial="Steel",
    Name="cable material",
    YoungsModulus_kN_cm2=multiplication_3,
    InPlaneShearModulus_kN_cm2=multiplication_4,
    TransverseShearModulus_kN_cm2=multiplication_5,
    SpecificWeight_kN_m3=78.5,
    CoefficientOfThermalExpansion_1_C=1e-05,
    YieldStrength_kN_cm2=multiplication_6,
    mode="Isotrop")
cross_section = CrossSectionKaramba3D(
    FamilyNameOfCrossSection="cable",
    Material=matprops,
    Diameter_cm=number_slider_4,
    WallThickness_cm=expr("x/2", number_slider_4),
    mode="Circular Hollow")
cross_section_2 = CrossSectionKaramba3D(
    FamilyNameOfCrossSection="cable",
    Material=matprops,
    Diameter_cm="100",
    WallThickness_cm=expr("x/2", "100"),
    mode="Circular Hollow")
crosecrselect = CrossSectionRangeSelectorKaramba3D(MaximumHeight_cm=-1, MaximumWidth_cm=-1, menu=[dropdown(0), dropdown(3), dropdown(4)])

E_2 = YoungsModulusKNCm2(21000)
g12_2 = InPlaneShearModulusKNCm2(8076)
g3_2 = TransverseShearModulusKNCm2(8076)
fy_2 = YieldStrengthKNCm2(23.5)
multiplication_7 = Multiplication(A=E_2, B=1000)
multiplication_8 = Multiplication(A=g12_2, B=1000)
multiplication_9 = Multiplication(A=g3_2, B=1000)
multiplication_10 = Multiplication(A=fy_2, B=1000)
matprops_2 = MaterialPropertiesKaramba3D(
    FamilyOfMaterial="Steel",
    Name="shell Material",
    YoungsModulus_kN_cm2=multiplication_7,
    InPlaneShearModulus_kN_cm2=multiplication_8,
    TransverseShearModulus_kN_cm2=multiplication_9,
    SpecificWeight_kN_m3=78.5,
    CoefficientOfThermalExpansion_1_C=1e-05,
    YieldStrength_kN_cm2=multiplication_10,
    mode="Isotrop")
cross_section_3 = CrossSectionKaramba3D(FamilyNameOfCrossSection="DefaultCroSec", Material=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, Height_cm="20", mode="Shell - Const")
modify_crosecs = ModifyCrossSectionsKaramba3D(CroSec=cross_section_3, Materials=matprops_2, mode="Shell")
meshtoshell = MeshToShellKaramba3D(Mesh=mesh_2, CrossSection=modify_crosecs, LimitDistance_m=0.005)  # -> Element, Points, Info

toggle = BooleanToggle(False)
item_3 = ListItem(List=crosecrselect, Index=0, Wrap=True)
linetobeam = LineToBeamKaramba3D(
    Line=cable_2,
    Identifier="bikeCable",
    CrossSection=cross_section,
    New=True,
    Remove=True,
    LimitDistance_m=0.005,
    Bending=toggle)  # -> Element, Points, Info
linetobeam_2 = LineToBeamKaramba3D(
    Line=cable,
    Identifier="supportCable",
    CrossSection=cross_section_2,
    New=True,
    Remove=True,
    LimitDistance_m=0.005,
    Bending=toggle)  # -> Element, Points, Info
explode_7 = Explode(Curve=wbfacepolys, Recursive=True)  # -> Segments, Vertices
pt_3 = Point(flatten([explode.Vertices, explode_2.Vertices, explode_7.Vertices]))
Z = UnitZ(Factor=expr("-x", "10"))
neg_3 = Negative(Value="0.3")
neg_4 = Negative(Value="10")
duppt_2 = RemoveDuplicatePts(Points=pt_3, Tolerance=0.01)
modifyelem = ModifyElementKaramba3D(Beam=linetobeam.Element, ConsiderBuckling=Toggle(False), mode="Beam")
linetobeam_3 = LineToBeamKaramba3D(Line=brace, CrossSection=item_3, New=True, Remove=True, LimitDistance_m=0.005)  # -> Element, Points, Info
linetobeam_4 = LineToBeamKaramba3D(Line=inner_circle, CrossSection=item_3, New=True, Remove=True, LimitDistance_m=0.005)  # -> Element, Points, Info
linetobeam_5 = LineToBeamKaramba3D(Line=circle, CrossSection=item_3, New=True, Remove=True, LimitDistance_m=0.005)  # -> Element, Points, Info
linetobeam_6 = LineToBeamKaramba3D(Line=cell, CrossSection=item_3, New=True, Remove=True, LimitDistance_m=0.005)  # -> Element, Points, Info
linetobeam_7 = LineToBeamKaramba3D(Line=truss, CrossSection=item_3, New=True, Remove=True, LimitDistance_m=0.005)  # -> Element, Points, Info
linetobeam_8 = LineToBeamKaramba3D(Line=explode_6.Segments, CrossSection=item_3, New=True, Remove=True, LimitDistance_m=0.005)  # -> Element, Points, Info
modifyelem_2 = ModifyElementKaramba3D(Beam=linetobeam_2.Element, ConsiderBuckling=Toggle(False), mode="Beam")
supp = SupportKaramba3D(PosInd=duppt, menu=[buttons(on, on, on, off, off, off)])
loads = LoadsKaramba3D(Eps0=neg_3, ElementIdentifiers="bikeCable", LCase=0, mode="InitialStrain")
loads_2 = LoadsKaramba3D(Vector=Vector(0, 0, -1), LCase=0, mode="Gravity")
loads_3 = LoadsKaramba3D(Eps0=neg_4, ElementIdentifiers="supportCable", LCase=0, mode="InitialStrain")
loads_4 = LoadsKaramba3D(ForceVector=Z, Local=False, PosInd=duppt_2, LCase=0, mode="Point")
load = LoadKaramba3D(flatten([loads_2, loads, loads_3, loads_4]))
assemble = AssembleModelKaramba3D(
    Elem=flatten([linetobeam_3.Element, linetobeam_4.Element, linetobeam_5.Element, linetobeam_6.Element, linetobeam_7.Element, modifyelem, modifyelem_2, linetobeam_8.Element, meshtoshell.Element]),
    Support=supp,
    Load=flatten(load),
    LimitDistance_m=0.005)  # -> Model, Info, Mass_kg, CenterOfGravity
analyze = AnalyzeKaramba3D(Model=assemble.Model)  # -> CalculatedModel, MaximumDisplacement_cm, ResultingForceOfGravity_kN, ElasticEnergy_kNm; disabled
opticrosec = OptimizeCrossSectionKaramba3D(
    Model=assemble.Model,
    CrossSections=crosecrselect,
    MaximumUtilization=1,
    MaximumDisplacement_cm=Slider(10, range=0..10),
    UltimateLimitStateIterations=Slider(2, range=0..100),
    DisplacementIterations=5,
    NumberOfSamplePoints=3,
    ElasticDesign=True,
    GammaM0=1,
    GammaM1=1)  # -> ModelWithOptimizedCrossSections, Info, Mass_kg, MaximumDisplacement_cm, ElasticEnergy_kNm
panel = Panel(analyze.MaximumDisplacement_cm)  # disabled
cm = Panel(opticrosec.MaximumDisplacement_cm)
panel_2 = Panel("bikeCable")
colours = LegendColour()
modelview = ModelViewKaramba3D(
    Model=opticrosec.ModelWithOptimizedCrossSections,
    LoadCaseFactorsForLinearSuperposition=1,
    IndexOfVisibleLoadcase=-1,
    ListOfColorsForColoringPlots=colours)  # -> Model, DeformedMesh, DeformedAxes, DeformedModel
shellview = ShellViewKaramba3D(Model=modelview.Model, IndexOfLayer=0)  # -> Model, MeshesOfRenderedShells, LegendColors, LegendTags
beamview = BeamViewKaramba3D(Model=modelview.Model)  # -> Model, MeshesOfRenderedBeams, DeformedBeamAxes, LegendColors, LegendTags

# ==== cluster LegendColour: Legend colour for Karamba
merge = Merge(
    Data1=ColourSwatch(SwatchColor=RGB(255, 0, 0)),
    Data2=ColourSwatch(SwatchColor=RGB(255, 179, 0)),
    Data3=ColourSwatch(SwatchColor=RGB(255, 255, 0)),
    Data4=ColourSwatch(SwatchColor=RGB(0, 255, 0)),
    Data5=ColourSwatch(SwatchColor=RGB(0, 255, 255)),
    Data6=ColourSwatch(SwatchColor=RGB(4, 177, 255)),
    Data7=ColourSwatch(SwatchColor=RGB(0, 0, 255)),
    Data8=ColourSwatch(SwatchColor=RGB(129, 0, 190)),
    Data9=ColourSwatch(SwatchColor=RGB(75, 0, 130)))  # -> reverse(Result)
legend = ClusterOutput(merge)  # List of colours to plug on Karamba Legend
