# Grasshopper definition DesignExploreTest.gh (Grasshopper 1.0.7)
# plug-ins: MeshEdit Components, NGon, Kangaroo Components, Spectacles.GrasshopperExporter, Colibri

crv = Curve(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)
z1 = Slider(1, range=-1..1)
z3 = Slider(-2, range=-3..-2)
z2 = Slider(-4, range=-5..-4)
z4 = Slider(6, range=6..7)
explode = Explode(Curve=crv, Recursive=True)  # -> Segments, Vertices
duppt = RemoveDuplicatePts(Points=explode.Vertices, Tolerance=0.01)
Z = UnitZ(Factor=[z1, z2, z4, z3])
move = Move(Geometry=duppt, Motion=Z)  # -> Geometry, Transform
pline = PolyLine(Vertices=move.Geometry, Closed=invert(False))
explode_2 = Explode(Curve=pline, Recursive=True)  # -> Segments, Vertices
item = ListItem(List=explode_2.Segments, Index=0, Wrap=True)  # -> Item, Item1, Item2, Item3
edgesrf = EdgeSurface(CurveA=item.Item, CurveB=item.Item1, CurveC=item.Item2, CurveD=item.Item3)
srf = Surface(edgesrf)
mesh_uv = MeshSurface(Surface=srf, UCount="20", VCount="20", Overhang=True, Equalize=False)
merge = Merge(
    Data1=ColourSwatch(SwatchColor=RGB(0, 255, 255)),
    Data2=ColourSwatch(SwatchColor=RGB(255, 255, 255)),
    Data3=ColourSwatch(SwatchColor=RGB(255, 0, 255)))
mesh_curvature = MeshCurvature(Mesh=mesh_uv, CurvatureType=3, Radius=Slider(10, range=1..20), Method=1, Interval=Domain(0, 0), _3Colors=merge, On=True)  # -> Mesh, CurvatureValues
bnd = Bounds(Numbers=mesh_curvature.CurvatureValues)
len = Length(Curve=pline)
area = MeshArea(Mesh=mesh_curvature.Mesh)  # -> Area, Centroid
path = FilePath("C:\Users\Marco\Ingegneria Parametrica\32_DesignExplorer\")
dedomain = DeconstructDomain(Domain=bnd)  # -> Start, End
iterator = ColibriIterator(z1=z1, z2=z2, z3=z3, z4=z4, RemoteFly=False, ignoreAllWarningMsg=False)  # -> z1, z2, z3, z4, Value_N, Genome
concat = Concatenate(FragmentA=path, FragmentB="Picture")
parameters = ColibriParameters(A=flatten(area.Area), L=flatten(len), S=flatten(dedomain.Start), E=flatten(dedomain.End))
spectacles_meshcoloredvertices = Spectacles_MeshColoredVertices(Mesh=mesh_curvature.Mesh)
_3dobjects = SpectaclesColibri_3DObjects(Elements=flatten(spectacles_meshcoloredvertices))
aggregator = ColibriAggregator(
    Folder=concat,
    IterationGenomeID=iterator.Genome,
    IterationPhenomeResults=parameters,
    _3DObjects=flatten(_3dobjects),
    Write=Toggle(False),
    recordingMode=3)
