# Grasshopper definition BridgeResonance.gh (Grasshopper 1.0.7)
# plug-ins: Karamba, Kangaroo Components, Weaverbird, Kangaroo2 Components

number_slider = Slider(60, range=0..100)
pt = ConstructPoint(XCoordinate=0, YCoordinate=0, ZCoordinate=0)
pt_2 = ConstructPoint(XCoordinate=number_slider, YCoordinate=0, ZCoordinate=0)
pt_3 = ConstructPoint(XCoordinate=expr("x/2", number_slider), YCoordinate=0, ZCoordinate=Slider(16, range=10..30))
arc = Arc3Pt(PointA=pt, PointB=pt_3, PointC=pt_2)  # -> Arc, Plane, Radius
divide = DivideCurve(Curve=arc.Arc, Count="20", Kinks=False)  # -> Points, Tangents, Parameters
pline = PolyLine(Vertices=divide.Points, Closed=False)
Y = UnitY(Factor=Slider(6, range=0..10))
move = Move(Geometry=pline, Motion=Y)  # -> Geometry, Transform
entwine = Entwine(Branch00=pline, Branch01=move.Geometry, FlattenInputs=True)
end = EndPoints(Curve=entwine)  # -> Start, End
meshloft = MeshLoft2(polys=flatten(entwine))  # -> out, result; inputs polys: list of Polyline
# ---------- meshloft: C# ----------
    result = MeshLoft(polys);
# ---------- meshloft: C# additional code ----------
  //
  Mesh MeshLoft(IList<Polyline> polys)
  {
    if(Enumerable.All(polys, p => p.IsClosed))
      return MeshLoftClosed(polys);
    else
      return MeshLoftOpen(polys);
  }


  //
  Mesh MeshLoftOpen(IList<Polyline> polys)
  {
    Mesh result = new Mesh();
    var verts = result.Vertices;
    var faces = result.Faces;

    int ny = polys.Count;
    int nx = Enumerable.Min(polys, p => p.Count);
    int n;

    // add vertices
    for(int i = 0; i < ny; i++)
    {
      var poly = polys[i];

      for(int j = 0; j < nx; j++)
        verts.Add(poly[j]);
    }

    // add faces
    for(int i = 0; i < ny - 1; i++)
    {
      n = i * nx;

      for(int j = 0; j < nx - 1; j++)
        faces.AddFace(n + j, n + j + 1, n + j + nx + 1, n + j + nx);
    }

    return result;
  }


  //
  Mesh MeshLoftClosed(IList<Polyline> polys)
  {
    Mesh result = new Mesh();
    var verts = result.Vertices;
    var faces = result.Faces;

    int ny = polys.Count;
    int nx = Enumerable.Min(polys, p => p.Count) - 1;
    int n;

    // add vertices
    for(int i = 0; i < ny; i++)
    {
      var poly = polys[i];

      for(int j = 0; j < nx; j++)
        verts.Add(poly[j]);
    }

    // add faces
    for(int i = 0; i < ny - 1; i++)
    {
      n = i * nx;

      for(int j0 = 0; j0 < nx; j0++)
      {
        int j1 = (j0 + 1) % nx;
        faces.AddFace(n + j0, n + j1, n + j1 + nx, n + j0 + nx);
      }
    }

    return result;
  }
# ---------- end meshloft ----------
explode = Explode(Curve=entwine, Recursive=True)  # -> Segments, Vertices
flip = FlipMatrix(Data=explode.Vertices)
wbfacepolys = WeaverbirdsFacePolylines(Mesh=meshloft.result)
pline_2 = PolyLine(Vertices=flip, Closed=False)
explode_2 = Explode(Curve=wbfacepolys, Recursive=True)  # -> Segments, Vertices
cullpt = CullDuplicates(Points=explode_2.Vertices, Tolerance=0.1, CullMode=3)  # -> Points, Indices, Valence
explode_3 = Explode(Curve=pline_2, Recursive=True)  # -> Segments, Vertices
explode_4 = Explode(Curve=entwine, Recursive=True)  # -> Segments, Vertices
item = ListItem(List=cullpt.Points, Index=0, Wrap=True)  # -> Item, Item1, Item2, Item3
ln = Line(StartPoint=item.Item, EndPoint=item.Item2)
ln_2 = Line(StartPoint=item.Item1, EndPoint=item.Item3)
toggle = BooleanToggle(False)
crosecrselect = CrossSectionRangeSelectorKaramba3D(MaximumHeight_cm=-1, MaximumWidth_cm=-1, menu=[dropdown(1), dropdown(1), dropdown(4)])
supp = SupportKaramba3D(PosInd=[end.Start, end.End], menu=[buttons(on, on, on, off, off, off)])
crosecselect = CrossSectionSelectorKaramba3D(CrossSections=crosecrselect, NameOrListIndexOfCrossSection="23")  # -> CrossSection, Info
linetobeam = LineToBeamKaramba3D(Line=flatten(explode_4.Segments), CrossSection=crosecselect.CrossSection, New=True, Remove=True, LimitDistance_m=0.005)  # -> Element, Points, Info
crosecselect_2 = CrossSectionSelectorKaramba3D(CrossSections=crosecrselect, NameOrListIndexOfCrossSection="10")  # -> CrossSection, Info
linetobeam_2 = LineToBeamKaramba3D(
    Line=flatten(explode_3.Segments),
    CrossSection=crosecselect_2.CrossSection,
    New=True,
    Remove=True,
    LimitDistance_m=0.005,
    Bending=toggle)  # -> Element, Points, Info
loads = LoadsKaramba3D(Vector=Vector(0, 0, -1), LCase=0, mode="Gravity")
linetobeam_3 = LineToBeamKaramba3D(
    Line=flatten([ln, ln_2]),
    CrossSection=crosecselect_2.CrossSection,
    New=True,
    Remove=True,
    LimitDistance_m=0.005,
    Bending=toggle)  # -> Element, Points, Info
assemble = AssembleModelKaramba3D(
    Elem=[linetobeam.Element, linetobeam_2.Element, linetobeam_3.Element],
    Support=flatten(supp),
    Load=loads,
    LimitDistance_m=0.005)  # -> Model, Info, Mass_kg, CenterOfGravity
timer = Timer(TimerInterval=20, Target=counter)
nvibes = NaturalVibrationsKaramba3D(Model=assemble.Model, FromIndex=1, NumberOfModes=Slider(5, range=0..10), MaximumNumberOfIterations=30, Epsilon=1e-05)  # -> ModelWithVibrationModesAsLoadCaseResults, NaturalFrequencies_Hz, ModalMass_kg, ParticipationFactorInGlobalXYAndZDirection
colours = LegendColour()
counter = Counter(Reset=Button())
multiplication = Multiplication(A=counter, B="0.2")
sin = Sine(Value=multiplication)
modelview = ModelViewKaramba3D(
    Model=nvibes.ModelWithVibrationModesAsLoadCaseResults,
    LoadCaseFactorsForLinearSuperposition=sin,
    IndexOfVisibleLoadcase=-1,
    ListOfColorsForColoringPlots=colours)  # -> Model, DeformedMesh, DeformedAxes, DeformedModel
rec = DataRecorder(sin, DataLimit=-10, RecordData=True)
graph = QuickGraph(rec, SortOrder=0)
beamview = BeamViewKaramba3D(Model=modelview.Model)  # -> Model, MeshesOfRenderedBeams, DeformedBeamAxes, LegendColors, LegendTags
disassemble = DisassembleModelKaramba3D(Model=modelview.Model)  # -> Model, Point, Beam, Shell, Support, Load, Line, Mesh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
disassemble_2 = DisassembleModelKaramba3D(Model=modelview.DeformedModel)  # -> Model, Point, Beam, Shell, Support, Load, Line, Mesh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
number_slider_2 = Slider(10, range=0..100)
panel = Panel("30")
item_2 = ListItem(List=disassemble_2.Point, Index=number_slider_2, Wrap=True)
item_3 = ListItem(List=disassemble.Point, Index=number_slider_2, Wrap=True)
panel_2 = Panel("10")
vec = VectorXYZ(XComponent=0, YComponent=0, ZComponent=expr("-x", Slider(9.1, range=1..20)))  # -> Vector, Length
rec_2 = DataRecorder(item_2, DataLimit=-10, RecordData=True)
neg = Negative(Value=Slider(2, range=0..20))
item_4 = ListItem(List=rec_2, Index="-2", Wrap=True)
move_2 = Move(Geometry=item_2, Motion=vec.Vector)  # -> Geometry, Transform
subtraction = Subtraction(A=item_2, B=item_4)
ln_3 = Line(StartPoint=item_2, EndPoint=move_2.Geometry)
pdecon = Deconstruct(Point=subtraction)  # -> XComponent, YComponent, ZComponent
neg_2 = Negative(Value=pdecon.XComponent)
vec_2 = VectorXYZ(XComponent=neg_2, YComponent=0, ZComponent=neg)  # -> Vector, Length
load = Load(Point=move_2.Geometry, ForceVector=vec_2.Vector)
length_line = LengthLine(Line=ln_3, Strength=10)
anchor = Anchor(Point=item_2, Strength=10000)
show = Show(G=move_2.Geometry)
show_2 = Show(G=ln_3)
X = UnitX(Factor=neg_2)
multiplication_2 = Multiplication(A=X, B=Slider(10, range=0..10))
vdis = VectorDisplay(Anchor=item_3, Vector=multiplication_2)
entwine_2 = Entwine(Branch00=show, Branch01=show_2, Branch02=load, Branch03=length_line, Branch04=anchor, FlattenInputs=True)
zombiesolver = ZombieSolver(GoalObjects=entwine_2, Threshold=1e-10, Tolerance=0.01, MaxIterations=50000)  # -> I, V, O
unflatten = UnflattenTree(Tree=zombiesolver.O, Guide=entwine_2)
bang = ExplodeTree(Data=unflatten)  # -> Branch0, Branch1
sph = Sphere(Base=bang.Branch0, Radius=1)
pipe = Pipe(Curve=bang.Branch1, Radius=Slider(0.02, range=0..0.1), Caps=0)
preview = CustomPreview(
    Geometry=pipe,
    Material={diffuse=RGB(221, 160, 221), emission=RGB(66, 48, 66), shine=0.5, specular=RGB(255, 255, 255), transparency=0})
preview_2 = CustomPreview(
    Geometry=sph,
    Material={diffuse=RGB(221, 160, 221), emission=RGB(66, 48, 66), shine=0.5, specular=RGB(255, 255, 255), transparency=0})

# ==== cluster LegendColour: Legend colour for Karamba
merge = Merge(
    Data1=ColourSwatch(SwatchColor=RGB(255, 0, 0)),
    Data2=ColourSwatch(SwatchColor=RGB(255, 179, 0)),
    Data3=ColourSwatch(SwatchColor=RGB(255, 255, 0)),
    Data4=ColourSwatch(SwatchColor=RGB(0, 255, 0)),
    Data5=ColourSwatch(SwatchColor=RGB(0, 255, 255)),
    Data6=ColourSwatch(SwatchColor=RGB(4, 177, 255)),
    Data7=ColourSwatch(SwatchColor=RGB(0, 0, 255)),
    Data8=ColourSwatch(SwatchColor=RGB(129, 0, 190)),
    Data9=ColourSwatch(SwatchColor=RGB(75, 0, 130)))  # -> reverse(Result)
legend = ClusterOutput(merge)  # List of colours to plug on Karamba Legend
