# Grasshopper definition exportToGSA.gh (Grasshopper 1.0.7)
# plug-ins: BullAnt, ggGHgsa

populate_3d = Populate3D(Region={Plane=PlaneXY(0, 0, 0), X=Domain(0, 10), Y=Domain(0, 10), Z=Domain(0, 2)}, Count=100, Seed=1)
list_item = ListItem(List=populate_3d, Index=0, Wrap=True)  # -> Item, Item1, Item2
arc_3pt = Arc3Pt(PointA=list_item.Item, PointB=list_item.Item1, PointC=list_item.Item2)  # -> Arc, Plane, Radius
divide_curve = DivideCurve(Curve=arc_3pt.Arc, Count=10, Kinks=False)  # -> Points, Tangents, Parameters
polyline = PolyLine(Vertices=divide_curve.Points, Closed=False)
curve = Curve(polyline)
end_points = EndPoints(Curve=curve)  # -> Start, End
gggsabakemodel = GgGSABakeModel(ClipSummary=False, NewFile=True)
gggsaloadcase = GgGSALoadCase(Name="wind load", ID=1, LoadCaseType="WIND", Bridge=False)
gggsaloadcase_2 = GgGSALoadCase(Name="snow load", ID=1, LoadCaseType="SNOW", Bridge=False)
gggsaloadcase_3 = GgGSALoadCase(Name="Dead Load", ID=1, LoadCaseType="DEAD", Bridge=False)
panel = Panel("""1.21
1.3
1.8""")
gggsacreate_elastic_isotropic_material = GgGSACreateElasticIsotropicMaterial(
    Name="MarcoSteel",
    ElasticModulusPa=2.05e+11,
    PoissonsRatio=0.3,
    ShearModulusPa=0,
    Density=7850,
    CoefficientOfThermalExpansion=1.2e-05,
    DampingRatio=0)
ggcatalogueprofile = GgCatalogueProfile(Region="EuroProfile", Serial="L200x200x20", Type="EP L Angles")
boolean_toggle = BooleanToggle(True)
explode = Explode(Curve=curve, Recursive=True)  # -> Segments, Vertices
gggsaloadgravity = GgGSALoadGravity(LoadCase=gggsaloadcase_3, XGravityFactor=0, YGravityFactor=0, ZGravityFactor=-1)
gggsacreatesectionprop = GgGSACreateSectionProp(Profile=ggcatalogueprofile, Material=gggsacreate_elastic_isotropic_material)
gggsanoderestraint = GgGSANodeRestraint(
    RestraintX=boolean_toggle,
    RestraintY=boolean_toggle,
    RestraintZ=False,
    RestraintXX=False,
    RestraintYY=boolean_toggle,
    RestraintZZ=boolean_toggle)
gggsanoderestraint_2 = GgGSANodeRestraint(RestraintX=False, RestraintY=False, RestraintZ=Toggle(True), RestraintXX=False, RestraintYY=False, RestraintZZ=False)
gggsanodeatts = GgGSANodeAtts(Restraint=gggsanoderestraint, LowNodeID=1)
gggsanodeatts_2 = GgGSANodeAtts(Restraint=gggsanoderestraint_2, LowNodeID=1)
gggsacreateorfindnode = GgGSACreateOrFindNode(Location=end_points.Start, Atts=gggsanodeatts, DetectTol=0)
gggsacreateorfindnode_2 = GgGSACreateOrFindNode(Location=end_points.End, Atts=gggsanodeatts_2, DetectTol=0)
gggsacreatebeam = GgGSACreateBeam(Prop=gggsacreatesectionprop, NodeCL=explode.Segments, Angle=0)
gggsaanalysis_static = GgGSAAnalysisStatic(Name="Static from Gh", ID=0, GeometricFrontVector=Vector(0, 0, 1), MaxIterations=0)
gggsaanalysis_modal = GgGSAAnalysisModal(
    Name="Modal",
    ID=0,
    NumberOfModes=1,
    NumberOfIterations=128,
    StartMode=1,
    LowerFrequencyCutoff=0,
    HigherFrequencyCutoff=0)
panel_2 = Panel("""1.35
1.50
1.75""")
gggsaanalysis_case = GgGSAAnalysisCase(
    Name="Combo 1",
    ID=1,
    StructAnalysisTask=gggsaanalysis_static,
    StructLoadCase=[gggsaloadcase_3, gggsaloadcase_2, gggsaloadcase],
    LoadFactors=panel_2)
gggsaanalysis_case_2 = GgGSAAnalysisCase(Name="sdsada", ID=1, StructAnalysisTask=gggsaanalysis_modal)
gggsaquery_frequency = GgGSAQueryFrequency(Case=flatten(gggsaanalysis_case_2))
