# Grasshopper definition generic Cross section.gh (Grasshopper 1.0.7)
# plug-ins: ggGHgsa, Dodo

neg = Negative(Value="0.05")
neg_2 = Negative(Value="0.40")
neg_3 = Negative(Value="0.05")
dom = ConstructDomain(DomainStart=neg, DomainEnd="0.05")
dom_2 = ConstructDomain(DomainStart=neg_2, DomainEnd="0.40")
dom_3 = ConstructDomain(DomainStart=neg_3, DomainEnd="0.05")
crv = Curve(<curve referenced from the Rhino model>)
len = Length(Curve=crv)
division = Division(A=len, B="0.50")
rectangle = Rectangle(Plane=PlaneXY(0, 0, 0), XSize=dom_3, YSize="0.50", Radius=0)  # -> Rectangle, Length
rectangle_2 = Rectangle(Plane=PlaneXY(0, 0, 0), XSize=dom_2, YSize=dom, Radius=0)  # -> Rectangle, Length
divide = DivideCurve(Curve=crv, Count=division, Kinks=False)  # -> Points, Tangents, Parameters
crv_2 = Curve(rectangle.Rectangle)
pline = PolyLine(Vertices=divide.Points, Closed=False)
pi = Pi(Factor=Slider(6, range=1..8))
explode = Explode(Curve=pline, Recursive=True)  # -> Segments, Vertices
serieslist = SeriesFromList(List=explode.Segments, Start=0, Step=1)
dom_4 = ConstructDomain(DomainStart="0.00", DomainEnd=pi)
panel = Panel("0 to 6.28")
bnd = Bounds(Numbers=serieslist)
remap = RemapNumbers(Value=serieslist, Source=bnd, Target=dom_4)  # -> Mapped, Clipped
cos = Cosine(Value=remap.Mapped)
multiplication = Multiplication(A=cos, B=Slider(-30, range=-30..30))
graph = QuickGraph(multiplication, SortOrder=0)
rotate = Rotate(Geometry=rectangle_2.Rectangle, Angle=degrees(multiplication), Plane=PlaneXY(0, 0, 0))  # -> Geometry, Transform
crv_3 = Curve(rotate.Geometry)
lng = ListLength(List=crv_3)
repeat = RepeatData(Data=crv_2, Length=lng)
ins = InsertItems(List=graft(crv_3), Item=crv_2, Indices="0", Wrap=True)
merge = Merge(Data1=repeat, Data2=crv_3)
gggsabake = GgGSABakeModel(ClipSummary=False, NewFile=True)
ggmat = GgGSACreateMaterial(StandardStructureMaterial=0)
runion = RegionUnion(Curves=ins)
boundary = BoundarySurfaces(Edges=runion)
ggsp = GgGSACreateSectionProp(Profile=flatten(boundary), Name="Generic", Material=ggmat)
ggbeam = GgGSACreateBeam(Prop=ggsp, NodeCL=explode.Segments, Angle=0)
