# Grasshopper definition trave su più appoggi.gh (Grasshopper 1.0.7)
# plug-ins: karambaGH

genes = GenePool(Decimals=2, Maximum=1, Minimum=0, Value=[0.22, 0.61, 0.83, 0.47])

pt = Point(Point(0, 0, -8.631993629))
X = UnitX(Factor=Slider(24, range=0..100))
move = Move(Geometry=pt, Motion=X)  # -> Geometry, Transform
ln = Line(StartPoint=pt, EndPoint=move.Geometry)
shatter = Shatter(Curve=reparameterize(ln), Parameters=genes)
divide = DivideCurve(Curve=shatter, Count=10, Kinks=False)  # -> Points, Tangents, Parameters
join = JoinCurves(Curves=shatter, Preserve=False)
explode = Explode(Curve=join, Recursive=True)  # -> Segments, Vertices
crosecrselect = CrossSectionRangeSelectorKaramba(MaximumHeight_cm=-1, MaximumWidth_cm=-1, menu=[dropdown(1), dropdown(0), dropdown(3)])
Z = UnitZ(Factor="-60")
supp = SupportKaramba(PosInd=explode.Vertices, menu=[buttons(on, on, on, on, off, on)])
linetobeam = LineToBeamKaramba(Line=shatter, New=True, Remove=True, LimitDistance_m=0.005, BeamIdentifier="trave")  # -> Points, Element, Info
loads = LoadsKaramba(Vector=Z, BeamIdentifierS="trave", LCase=0, mode="Uniform Line", menu=[buttons(on, off, off)])
crosecselect = CrossSectionSelectorKaramba(ElementsIdentifiers="trave", NameOrListIndexOfCrossSection=Slider(20, range=0..100), CrossSections=crosecrselect)  # -> CrossSection, Info
assemble = AssembleModelKaramba(Elem=linetobeam.Element, Support=supp, Load=loads, CrossSection=crosecselect.CrossSection, LimitDistance_m=0.005)  # -> Model, Info, Mass_kg, CenterOfGravity
analyzethi = AnalyzeThIKaramba(Model=assemble.Model)  # -> CalculatedModel, MaximumDisplacement_m, ResultingForceOfGravity_kN, ElasticEnergy_kNm
modelview = ModelViewKaramba(
    Model=analyzethi.CalculatedModel,
    LoadCaseFactorsForLinearSuperposition=1,
    IndexIncrementOfVisibleLoadcase=0,
    ListOfColorsForColoringPlots=reverse([ColourSwatch(SwatchColor=RGB(255, 0, 0)), ColourSwatch(SwatchColor=RGB(255, 179, 0)), ColourSwatch(SwatchColor=RGB(255, 255, 0)), ColourSwatch(SwatchColor=RGB(0, 255, 0)), ColourSwatch(SwatchColor=RGB(0, 255, 255)), ColourSwatch(SwatchColor=RGB(4, 177, 255)), ColourSwatch(SwatchColor=RGB(0, 0, 255))]))  # -> Model, DeformedMesh, DeformedAxes, DeformedModel
beamview = BeamViewKaramba(Model=modelview.Model)  # -> Model, MeshesOfRenderedBeams, DeformedBeamAxes, LegendColors, LegendTags

pt_2 = Point(Point(0, 0, -19.06380671))
X_2 = UnitX(Factor=Slider(24, range=0..100))
move_2 = Move(Geometry=pt_2, Motion=X_2)  # -> Geometry, Transform
ln_2 = Line(StartPoint=pt_2, EndPoint=move_2.Geometry)
shatter_2 = Shatter(Curve=reparameterize(ln_2), Parameters=genes)
divide_2 = DivideCurve(Curve=shatter_2, Count=10, Kinks=False)  # -> Points, Tangents, Parameters
join_2 = JoinCurves(Curves=shatter_2, Preserve=False)
explode_2 = Explode(Curve=join_2, Recursive=True)  # -> Segments, Vertices
crosecrselect_2 = CrossSectionRangeSelectorKaramba(MaximumHeight_cm=-1, MaximumWidth_cm=-1, menu=[dropdown(1), dropdown(0), dropdown(3)])
Z_2 = UnitZ(Factor="-60")
supp_2 = SupportKaramba(PosInd=explode_2.Vertices, menu=[buttons(on, on, on, on, off, on)])
linetobeam_2 = LineToBeamKaramba(Line=shatter_2, New=True, Remove=True, LimitDistance_m=0.005, BeamIdentifier="trave")  # -> Points, Element, Info
loads_2 = LoadsKaramba(Vector=Z_2, BeamIdentifierS="trave", LCase=0, mode="Uniform Line", menu=[buttons(on, off, off)])
crosecselect_2 = CrossSectionSelectorKaramba(ElementsIdentifiers="trave", NameOrListIndexOfCrossSection=Slider(20, range=0..100), CrossSections=crosecrselect_2)  # -> CrossSection, Info
assemble_2 = AssembleModelKaramba(Elem=linetobeam_2.Element, Support=supp_2, Load=loads_2, CrossSection=crosecselect_2.CrossSection, LimitDistance_m=0.005)  # -> Model, Info, Mass_kg, CenterOfGravity
analyzethi_2 = AnalyzeThIKaramba(Model=assemble_2.Model)  # -> CalculatedModel, MaximumDisplacement_m, ResultingForceOfGravity_kN, ElasticEnergy_kNm
modelview_2 = ModelViewKaramba(
    Model=analyzethi_2.CalculatedModel,
    LoadCaseFactorsForLinearSuperposition=1,
    IndexIncrementOfVisibleLoadcase=0,
    ListOfColorsForColoringPlots=reverse([ColourSwatch(SwatchColor=RGB(255, 0, 0)), ColourSwatch(SwatchColor=RGB(255, 179, 0)), ColourSwatch(SwatchColor=RGB(255, 255, 0)), ColourSwatch(SwatchColor=RGB(0, 255, 0)), ColourSwatch(SwatchColor=RGB(0, 255, 255)), ColourSwatch(SwatchColor=RGB(4, 177, 255)), ColourSwatch(SwatchColor=RGB(0, 0, 255))]))  # -> Model, DeformedMesh, DeformedAxes, DeformedModel
beamview_2 = BeamViewKaramba(Model=modelview_2.Model)  # -> Model, MeshesOfRenderedBeams, DeformedBeamAxes, LegendColors, LegendTags

galapagos = Galapagos(fitness=analyzethi_3, gene=genes)
swatch = ColourSwatch(SwatchColor=RGB(255, 255, 255))

pt_3 = Point(Point(0, 0, 0))
X_3 = UnitX(Factor=Slider(24, range=0..100))
move_3 = Move(Geometry=pt_3, Motion=X_3)  # -> Geometry, Transform
ln_3 = Line(StartPoint=pt_3, EndPoint=move_3.Geometry)
shatter_3 = Shatter(Curve=reparameterize(ln_3), Parameters=genes)
divide_3 = DivideCurve(Curve=shatter_3, Count=10, Kinks=False)  # -> Points, Tangents, Parameters
join_3 = JoinCurves(Curves=shatter_3, Preserve=False)
explode_3 = Explode(Curve=join_3, Recursive=True)  # -> Segments, Vertices
crosecrselect_3 = CrossSectionRangeSelectorKaramba(MaximumHeight_cm=-1, MaximumWidth_cm=-1, menu=[dropdown(1), dropdown(0), dropdown(3)])
Z_3 = UnitZ(Factor="-200")
supp_3 = SupportKaramba(PosInd=explode_3.Vertices, menu=[buttons(on, on, on, on, off, on)])
linetobeam_3 = LineToBeamKaramba(Line=shatter_3, New=True, Remove=True, LimitDistance_m=0.005, BeamIdentifier="trave")  # -> Points, Element, Info
loads_3 = LoadsKaramba(Vector=Z_3, BeamIdentifierS="trave", LCase=0, mode="Uniform Line", menu=[buttons(on, off, off)])
crosecselect_3 = CrossSectionSelectorKaramba(ElementsIdentifiers="trave", NameOrListIndexOfCrossSection=Slider(20, range=0..100), CrossSections=crosecrselect_3)  # -> CrossSection, Info
assemble_3 = AssembleModelKaramba(Elem=linetobeam_3.Element, Support=supp_3, Load=loads_3, CrossSection=crosecselect_3.CrossSection, LimitDistance_m=0.005)  # -> Model, Info, Mass_kg, CenterOfGravity
analyzethi_3 = AnalyzeThIKaramba(Model=assemble_3.Model)  # -> CalculatedModel, MaximumDisplacement_m, ResultingForceOfGravity_kN, ElasticEnergy_kNm
modelview_3 = ModelViewKaramba(
    Model=analyzethi_3.CalculatedModel,
    LoadCaseFactorsForLinearSuperposition=1,
    IndexIncrementOfVisibleLoadcase=0,
    ListOfColorsForColoringPlots=reverse([ColourSwatch(SwatchColor=RGB(255, 0, 0)), ColourSwatch(SwatchColor=RGB(255, 179, 0)), ColourSwatch(SwatchColor=RGB(255, 255, 0)), ColourSwatch(SwatchColor=RGB(0, 255, 0)), ColourSwatch(SwatchColor=RGB(0, 255, 255)), ColourSwatch(SwatchColor=RGB(4, 177, 255)), ColourSwatch(SwatchColor=RGB(0, 0, 255))]))  # -> Model, DeformedMesh, DeformedAxes, DeformedModel
beamview_3 = BeamViewKaramba(Model=modelview_3.Model)  # -> Model, MeshesOfRenderedBeams, DeformedBeamAxes, LegendColors, LegendTags
multiplication = Multiplication(A=analyzethi_3.MaximumDisplacement_m, B=Slider(1000, range=0..1000))
concat = Concatenate(FragmentA="Displacement_", FragmentB=multiplication, FragmentC=" mm")
pt_4 = Point(<point referenced from the Rhino model>)
xz = XZPlane(Origin=pt_4)
tag = TextTag3D(Location=xz, Text=concat, Size=Slider(0.66, range=0.1..1), Colour=swatch, Justification=7)

mesh = Mesh(beamview_3.MeshesOfRenderedBeams)

number_slider = Slider(1, range=0..1)
vec = VectorXYZ(XComponent=0, YComponent=number_slider, ZComponent=number_slider)  # -> Vector, Length
medges = MeshEdges(Mesh=mesh)  # -> NakedEdges, InteriorEdges, NonManifoldEdges
swatch_2 = ColourSwatch(SwatchColor=RGB(0, 0, 0))
normshade = NormalShader(
    mesh=mesh,
    direction=vec.Vector,
    color=ColourSwatch(SwatchColor=RGB(255, 255, 255)),
    intensity=Slider(0.34, range=0..1),
    Reference="C:\USERS\MARCO\DESKTOP\old personal google drive\AA_Aarhus_Workshop_Folder\Grasshopper Resources\Libraries\SpatialSlur.dll")  # -> out, result; inputs mesh: Mesh, direction: Vector3d, color: Color, intensity: Double
# ---------- normshade: C# ----------
    if(mesh.Normals.Count != mesh.Vertices.Count)
      mesh.Normals.ComputeNormals();

    if(mesh.VertexColors.Count != mesh.Vertices.Count)
      mesh.VertexColors.CreateMonotoneMesh(Color.White);

    NormalShader(mesh, direction, color, intensity);
    result = mesh;
# ---------- normshade: C# additional code ----------
  //
  void NormalShader(Mesh mesh, Vector3d direction, Color color, double intensity)
  {
    if(!direction.Unitize())
      throw new System.ArgumentException("the direction vector cannot be zero length");

    Color[] vc = mesh.VertexColors.ToArray();

    var chunks = System.Collections.Concurrent.Partitioner.Create(0, mesh.Vertices.Count);
    System.Threading.Tasks.Parallel.ForEach(chunks, range =>
      {
      for (int i = range.Item1; i < range.Item2; i++)
      {
        double t = direction * mesh.Normals[i] * 0.5 + 0.5;
        vc[i] = vc[i].LerpTo(color, t * intensity);
      }
      });

    mesh.VertexColors.SetColors(vc);
  }
# ---------- end normshade ----------
displaycrv = DisplayCurve(curve=medges.NakedEdges, color=swatch_2, weight=Slider(6, range=1..20))  # -> out; inputs curve: Curve, color: Color, weight: Int32
# ---------- displaycrv: C# ----------
    // silently skip null curves
    if(curve == null) return;

    // add to display cache
    _curves.Add(curve);
    _colors.Add(color);
    _weights.Add(weight);
    _clippingBox.Union(curve.GetBoundingBox(false));
# ---------- displaycrv: C# additional code ----------
  List<Curve> _curves;
  List<Color> _colors;
  List<int> _weights;
  BoundingBox _clippingBox;


  /// <summary>
  /// This method will be called once every solution, before any calls to RunScript.
  /// </summary>
  public override void BeforeRunScript()
  {
    _curves = new List<Curve>();
    _colors = new List<Color>();
    _weights = new List<int>();
    _clippingBox = new BoundingBox();
  }


  //
  public override BoundingBox ClippingBox
  {
    get{return _clippingBox;}
  }


  //
  public override void DrawViewportWires(IGH_PreviewArgs args)
  {
    base.DrawViewportWires(args);

    for(int i = 0; i < _curves.Count; i++)
      args.Display.DrawCurve(_curves[i], _colors[i], _weights[i]);
  }
# ---------- end displaycrv ----------
displaycrv_2 = DisplayCurve(curve=medges.InteriorEdges, color=swatch_2, weight=Slider(1, range=1..20))  # -> out; inputs curve: Curve, color: Color, weight: Int32; same code as displaycrv

b_forces = BeamForcesKaramba(AnalyzedModel=beamview.Model, LCase=-1, MaximumDistanceBetweenResults_m=-1, NumberOfResultsPerBeamElement="10")  # -> AnalyzedModel, NormalForce_kN, ShearForceVz_kN, ShearForceVy_kN, BendingMomentMt_kNm, BendingMomentMy_kNm, BendingMomentMz_kNm
bnd = Bounds(Numbers=flatten(b_forces.BendingMomentMy_kNm))
dedomain = DeconstructDomain(Domain=bnd)  # -> Start, End
panel = Panel("""M max_
M min_""")
pt_5 = Point(<point referenced from the Rhino model>)
concat_2 = Concatenate(FragmentA=graft(panel), FragmentB=graft([dedomain.End, dedomain.Start]), FragmentC=" kNm")
Z_4 = UnitZ(Factor="-2")
xz_2 = XZPlane(Origin=pt_5)
move_4 = Move(Geometry=xz_2, Motion=Z_4)  # -> Geometry, Transform
b_forces_2 = BeamForcesKaramba(AnalyzedModel=beamview_2.Model, LCase=-1, MaximumDistanceBetweenResults_m=-1, NumberOfResultsPerBeamElement="10")  # -> AnalyzedModel, NormalForce_kN, ShearForceVz_kN, ShearForceVy_kN, BendingMomentMt_kNm, BendingMomentMy_kNm, BendingMomentMz_kNm
tag_2 = TextTag3D(Location=graft([xz_2, move_4.Geometry]), Text=concat_2, Size=Slider(0.66, range=0.1..1), Colour=swatch, Justification=7)
bnd_2 = Bounds(Numbers=flatten(b_forces_2.ShearForceVz_kN))
dedomain_2 = DeconstructDomain(Domain=bnd_2)  # -> Start, End
panel_2 = Panel("""T max_
T min_""")
pt_6 = Point(<point referenced from the Rhino model>)
concat_3 = Concatenate(FragmentA=graft(panel_2), FragmentB=graft([dedomain_2.End, dedomain_2.Start]), FragmentC=" kNm")
Z_5 = UnitZ(Factor="-2")
xz_3 = XZPlane(Origin=pt_6)
move_5 = Move(Geometry=xz_3, Motion=Z_5)  # -> Geometry, Transform
tag_3 = TextTag3D(Location=graft([xz_3, move_5.Geometry]), Text=concat_3, Size=Slider(0.64, range=0.1..1), Colour=swatch, Justification=7)
