# Grasshopper definition ChristmasTree.gh (Grasshopper 1.0.7)
# plug-ins: treesloth01, TT Toolbox

cone = Cone(Base=PlaneXY(0, 0, 0), Radius=Slider(1.3, range=0..10), Length=Slider(5.15, range=0..10))  # -> Cone, Tip
range = Range(Domain=Domain(0, 1), Steps=10)
range_2 = Range(Domain=Domain(0, 1), Steps=10)
pt = ConstructPoint(XCoordinate=range, YCoordinate=range_2, ZCoordinate=0)
crvsrf = CurveOnSurface(Surface=reparameterize(cone.Cone), UVCoordinates=pt, Closed=False)  # -> Curve, Length, Domain
division = Division(A="360", B=Slider(4, range=1..15))
range_3 = Range(Domain="360", Steps=division)
cull_i = CullIndex(List=range_3, Indices="0", Wrap=True)
rad = Radians(Degrees=cull_i)
rotate = Rotate(Geometry=crvsrf.Curve, Angle=rad, Plane=PlaneXY(0, 0, 0))  # -> Geometry, Transform
divide = DivideCurve(Curve=rotate.Geometry, Count=Slider(9, range=0..10), Kinks=False)  # -> Points, Tangents, Parameters
pline = PolyLine(Vertices=divide.Points, Closed=False)
flip = FlipCurve(Curve=pline)  # -> Curve, Flag

explode = Explode(Curve=flip.Curve, Recursive=True)  # -> Segments, Vertices
panel = Panel("0.10 to 0.60")
panel_2 = Panel("2")

cull_i_2 = CullIndex(List=explode.Segments, Indices="-1", Wrap=True)

lng = ListLength(List=flatten(cull_i_2))
random = Random(Range="0.10 to 1.00", Number=lng, Seed=2)
random_2 = Random(Range="0.10 to 1.00", Number=lng, Seed=Slider(60, range=1..100))
match = MatchTreeStructure(DataList=flatten(random), TreeMask=cull_i_2)
match_2 = MatchTreeStructure(DataList=flatten(random_2), TreeMask=cull_i_2)
ext = ExtendCurve(Curve=simplify(graft(cull_i_2)), Type=0, Start=simplify(graft("0")), End=simplify(graft(match_2)))

pipe = Pipe(Curve=ext, Radius="0.02", Caps=0)
lng_2 = ListLength(List=flatten(pipe))
pframe = PerpFrame(Curve=reparameterize(ext), Parameter="0.50")
random_3 = Random(Range="-20 to 20", Number=lng_2, Seed=2)
deplane = DeconstructPlane(Plane=pframe)  # -> Origin, XAxis, YAxis, ZAxis
match_3 = MatchTreeStructure(DataList=flatten(random_3), TreeMask=pipe)
rad_2 = Radians(Degrees=match_3)
rot3d = Rotate3D(Geometry=simplify(pipe), Angle=simplify(rad_2), Center=deplane.Origin, Axis=deplane.XAxis)  # -> Geometry, Transform
swatch = ColourSwatch(SwatchColor=RGB(0, 0, 0))
material = CreateMaterial(Diffuse=ColourSwatch(SwatchColor=RGB(255, 255, 255)), Specular=swatch, Emission=swatch, Transparency=0, Shine=0)
preview = CustomPreview(Geometry=rot3d.Geometry, Material=material)

shift = ShiftPaths(Data=rot3d.Geometry, Offset=-1)
tstat = TreeStatistics(Tree=shift)  # -> Paths, Length, Count
lng_3 = ListLength(List=tstat.Paths)
division_2 = Division(A=lng_3, B=Slider(5, range=1..6))
partition = PartitionList(List=tstat.Paths, Size=division_2)
bang = ExplodeTree(Data=partition)  # -> Branch0, Branch1, Branch2
split = SplitTree(Data=shift, Masks=flatten([bang.Branch0, bang.Branch2]))  # -> Positive, Negative
preview_2 = CustomPreview(Geometry=split.Positive, Material=ColourSwatch(SwatchColor=RGB(122, 138, 255)))
preview_3 = CustomPreview(Geometry=split.Negative, Material=ColourSwatch(SwatchColor=RGB(184, 184, 184)))
