# Grasshopper definition Gsa interaction.gh (Grasshopper 1.0.7)
# plug-ins: BullAnt, ggGHgsa, Bifocals

construct_point = ConstructPoint(XCoordinate=0, YCoordinate=0, ZCoordinate=0)
boolean_toggle = BooleanToggle(True)
gggsanoderestraint = GgGSANodeRestraint(
    RestraintX=boolean_toggle,
    RestraintY=boolean_toggle,
    RestraintZ=boolean_toggle,
    RestraintXX=boolean_toggle,
    RestraintYY=boolean_toggle,
    RestraintZZ=boolean_toggle)
gggsacreate_material = GgGSACreateMaterial(StandardStructureMaterial=0)
ggcatalogueprofile = GgCatalogueProfile(Region="EuroProfile", Serial="HE300B", Type="EP HE Beams")
unit_x = UnitX(Factor=Slider(5, range=5..8))
move = Move(Geometry=construct_point, Motion=unit_x)  # -> Geometry, Transform
gggsanodeatts = GgGSANodeAtts(Restraint=gggsanoderestraint, LowNodeID=1)
line = Line(StartPoint=construct_point, EndPoint=move.Geometry)
gggsacreatesectionprop = GgGSACreateSectionProp(Profile=ggcatalogueprofile, Material=gggsacreate_material)
gggsacreateorfindnode = GgGSACreateOrFindNode(Location=construct_point, NodeAtts=gggsanodeatts, DetectTol=0)
panel = Panel(gggsacreateorfindnode)
gggsacreatebeam = GgGSACreateBeam(Prop=gggsacreatesectionprop, NodeCL=line, Angle=0)
gggsanodeatts_2 = GgGSANodeAtts(Restraint="FFFFFF", LowNodeID=1)
gggsaloadcase = GgGSALoadCase(Name="Live Load", ID="2", LoadCaseType=6, Bridge=False)
gggsacreateorfindnode_2 = GgGSACreateOrFindNode(Location=move.Geometry, NodeAtts=gggsanodeatts_2, DetectTol=0)
unit_z = UnitZ(Factor=expr("-x", "10"))
gggsaloadcase_2 = GgGSALoadCase(Name="Dead Load", ID=1, LoadCaseType=6, Bridge=False)
gggsaloadnode = GgGSALoadNode(LoadCase=gggsaloadcase, LoadedNodes=gggsacreateorfindnode_2, LoadDirectionAndMagnitude=unit_z, Units=1)
gggsaloadgravity = GgGSALoadGravity(LoadCase=gggsaloadcase_2, XGravityFactor=0, YGravityFactor=0, ZGravityFactor=-1)
gggsabakemodel = GgGSABakeModel(ClipSummary=False, NewFile=True)
gggsaanalysis_static = GgGSAAnalysisStatic(Name="STATIC", ID=0, GeometricFrontVector=Vector(0, 0, 1), MaxIterations=0)
panel_2 = Panel("""1.35
1.5""")
gggsaanalysis_case = GgGSAAnalysisCase(Name="STATIC", ID=1)
gggsaanalysis_case_2 = GgGSAAnalysisCase(
    Name="STATIC",
    ID=1,
    StructAnalysisTask=gggsaanalysis_static,
    StructLoadCase=flatten([gggsaloadcase_2, gggsaloadcase]),
    LoadFactors=panel_2)
gggsasolver = GgGSASolver(Enabled=True, NewModel=True, CloseModel=True)
