# Grasshopper definition hexagon.gh (Grasshopper 1.0.7)
# plug-ins: MeshEdit Components, PlanarMesh, Kangaroo Components, LunchBox, Weaverbird, Starling

number_slider = Slider(1.26, range=1..3.5)
brep = Brep(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)
rebuildsrf = RebuildSurface(Surface=brep, UDegree=3, VDegree=3, UNumber=10, VNumber=10)
mesh = Mesh(rebuildsrf)
wbsplitquads = WeaverbirdsConstantQuadsSplitSubdivision(MeshCurves=mesh, Level=1, SmoothNakedEdges=1)
ll = Lloyds(Mesh=wbsplitquads, Metric="0", NumberOfFacets=Slider(100, range=10..180))
pm = PlanariseMesh(Mesh=ll)  # -> Proxies, graft(MeshAsCurves)
area = Area(Geometry=pm.MeshAsCurves)  # -> Area, Centroid
scale = Scale(Geometry=pm.MeshAsCurves, Center=area.Centroid, Factor=0.5)  # -> Geometry, Transform
meshloft = MeshLoft(polyA=pm.MeshAsCurves, polyB=scale.Geometry)  # -> out, flatten(result); inputs polyA: Polyline, polyB: Polyline
# ---------- meshloft: C# ----------
    result = MeshLoft(polyA, polyB);
# ---------- meshloft: C# additional code ----------
  //
  Mesh MeshLoft(Polyline polyA, Polyline polyB)
  {
    if(polyA.IsClosed && polyB.IsClosed)
      return MeshLoftClosed(polyA, polyB);
    else
      return MeshLoftOpen(polyA, polyB);
  }


  //
  Mesh MeshLoftOpen(Polyline polyA, Polyline polyB)
  {
    Mesh result = new Mesh();
    var verts = result.Vertices;
    var faces = result.Faces;

    int n = polyA.Count;

    // add vertices
    verts.AddVertices(polyA);
    verts.AddVertices(polyB);

    // add faces
    for(int i = 0; i < n - 1; i++)
      faces.AddFace(i, i + 1, i + n + 1, i + n);
    
    return result;
  }


  //
  Mesh MeshLoftClosed(Polyline polyA, Polyline polyB)
  {
    Mesh result = new Mesh();
    var verts = result.Vertices;
    var faces = result.Faces;

    int n = polyA.Count - 1;

    verts.AddVertices(polyA.Skip(1));
    verts.AddVertices(polyB.Skip(1));

    // add faces
    for(int i = 0, j = 1; i < n; i++, j++)
    {
      if(j == n) j = 0;
      faces.AddFace(i, j, j + n, i + n);
    }
    
    return result;
  }
# ---------- end meshloft ----------
clean = CombineClean(Meshes=meshloft.result)
wbcatmullclark = WeaverbirdsCatmullClarkSubdivision(MeshCurves=clean, Level=1, SmoothNakedEdges=1)
swatch = ColourSwatch(SwatchColor=RGB(116, 41, 0))
vec = VectorXYZ(XComponent=Slider(1, range=-1..1), YComponent=0, ZComponent=Slider(1, range=-1..1))  # -> Vector, Length
slrelax = SlRelax(Mesh=wbcatmullclark, Steps="20")
area_2 = MeshArea(Mesh=rebuildsrf)  # -> Area, Centroid
rotate = Rotate(Geometry=slrelax, Angle=degrees(Slider(721, range=0..721)), Plane=area_2.Centroid)  # -> Geometry, Transform
normshade = NormalShader(
    mesh=rotate.Geometry,
    direction=vec.Vector,
    color=swatch,
    intensity=Slider(1, range=0..1),
    Reference="C:\USERS\MARCO\DESKTOP\old personal google drive\AA_Aarhus_Workshop_Folder\Grasshopper Resources\Libraries\SpatialSlur.dll")  # -> out, result; inputs mesh: Mesh, direction: Vector3d, color: Color, intensity: Double
# ---------- normshade: C# ----------
    if(mesh.Normals.Count != mesh.Vertices.Count)
      mesh.Normals.ComputeNormals();

    if(mesh.VertexColors.Count != mesh.Vertices.Count)
      mesh.VertexColors.CreateMonotoneMesh(Color.White);

    NormalShader(mesh, direction, color, intensity);
    result = mesh;
# ---------- normshade: C# additional code ----------
  //
  void NormalShader(Mesh mesh, Vector3d direction, Color color, double intensity)
  {
    if(!direction.Unitize())
      throw new System.ArgumentException("the direction vector cannot be zero length");

    Color[] vc = mesh.VertexColors.ToArray();

    var chunks = System.Collections.Concurrent.Partitioner.Create(0, mesh.Vertices.Count);
    System.Threading.Tasks.Parallel.ForEach(chunks, range =>
      {
      for (int i = range.Item1; i < range.Item2; i++)
      {
        double t = direction * mesh.Normals[i] * 0.5 + 0.5;
        vc[i] = vc[i].LerpTo(color, t * intensity);
      }
      });

    mesh.VertexColors.SetColors(vc);
  }
# ---------- end normshade ----------
medges = MeshEdges(Mesh=normshade.result)  # -> NakedEdges, InteriorEdges, NonManifoldEdges
displaycrv = DisplayCurve(curve=medges.NakedEdges, color=swatch, weight=Slider(5, range=1..10))  # -> out; inputs curve: Curve, color: Color, weight: Int32
# ---------- displaycrv: C# ----------
    // silently skip null curves
    if(curve == null) return;

    // add to display cache
    _curves.Add(curve);
    _colors.Add(color);
    _weights.Add(weight);
    _clippingBox.Union(curve.GetBoundingBox(false));
# ---------- displaycrv: C# additional code ----------
  List<Curve> _curves;
  List<Color> _colors;
  List<int> _weights;
  BoundingBox _clippingBox;


  /// <summary>
  /// This method will be called once every solution, before any calls to RunScript.
  /// </summary>
  public override void BeforeRunScript()
  {
    _curves = new List<Curve>();
    _colors = new List<Color>();
    _weights = new List<int>();
    _clippingBox = new BoundingBox();
  }


  //
  public override BoundingBox ClippingBox
  {
    get{return _clippingBox;}
  }


  //
  public override void DrawViewportWires(IGH_PreviewArgs args)
  {
    base.DrawViewportWires(args);

    for(int i = 0; i < _curves.Count; i++)
      args.Display.DrawCurve(_curves[i], _colors[i], _weights[i]);
  }
# ---------- end displaycrv ----------
displaycrv_2 = DisplayCurve(curve=medges.InteriorEdges, color=ColourSwatch(SwatchColor=RGB(0, 0, 0)), weight=Slider(1, range=1..10))  # -> out; inputs curve: Curve, color: Color, weight: Int32; same code as displaycrv
