# Grasshopper definition topological 2.gh (Grasshopper 1.0.7)
# Copyright: Sebastian Białkowski
# plug-ins: tOpos, Millipede, Weaverbird

geo = Geometry(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)
debrep = DeconstructBrep(Brep=geo)  # -> Faces, Edges, Vertices
Z = UnitZ(Factor="-6")
item = ListItem(List=debrep.Faces, Index=0, Wrap=True)  # -> Item, Item1
extr = Extrude(Base=item.Item1, Direction=Z)
X = UnitX(Factor=Slider(10, range=0..10))
mesh = Mesh(extr)
sl = SurfaceLoad(LoadSurface=item.Item1, LoadValue="-10")
mesh_2 = Mesh(geo)
move = Move(Geometry=item.Item, Motion=expr("-x/2", X))  # -> Geometry, Transform
extr_2 = Extrude(Base=move.Geometry, Direction=X)
mesh_3 = Mesh(extr_2)
bdomain = BoundaryDomain(DomainMesh=mesh_2, DensityValue=1, YoungModul="210", PoissonNumber="0.3")
bcond = BoundaryConditions(Load=sl, Support=mesh_3)
bprop = BoundaryProperties(FixedMesh=mesh, DensityPattern="1")
res = Resolution(ResolutionX="50", sizeModeToggle=False)
model = Model(BoundaryDomain=bdomain, BoundaryCondition=bcond, BoundaryProperties=bprop, ModelResolution=res, gpuModeToggle=True)  # -> Model, Performance
dom = ConstructDomain(DomainStart=0, DomainEnd="500")
oparam = OptimiusParameters(
    OptimisationIteration=dom,
    VolumeFraction="0.30",
    Penalty=Domain(2, 3),
    Change=0.005,
    SensitivityFilterRadius=Domain(1.5, 1.5),
    DensityFilterType=0,
    GrayScaleFilter=False,
    HeavisideProjection=0,
    SensitivityFilterType=1)
aparam = AnalyserParameters(Iterations=4000, Tolerance=0.001)
analyser = Analyser(solverType=0)  # -> Model, Performance
optimus = Optimus(
    Model=model.Model,
    OptimusParameters=oparam,
    SubdivisionThreshold=0.5,
    Reset=Toggle(False),
    Run=Toggle(False),
    optimisationPreviewMode=True,
    solverType=0)  # -> Model, Compliance, Performance
number_slider = Slider(0.3595, range=0..1)
node = NodeData(Model=optimus.Model)  # -> Location, Density, Deflection; disabled
element = ElementData(Model=optimus.Model, densityMode=False)  # -> Location, Density, Compliance, Sensitivity, Size; disabled
panel = Panel("0.20")
pstress = PrincipalStress(Model=optimus.Model, Tolerance=0)  # -> PStressValues, PStressPlane, PStressCrosses, PStressCrossesColours, PStressMinMax, VonMiesesValues, VonMiesesCrossesColours, Performance; disabled
vox = VoxelMesh(Model=optimus.Model, Threshold=number_slider, asOneMeshMode=True, densityPreviewMode=False)  # disabled
iso = IsoMesh(Model=optimus.Model, IsoValue=number_slider, Deflection=0)
denspre = DensPreview(model=optimus.Model, iso=number_slider)
elepre = ElementDataPreview(model=optimus.Model, iso=number_slider)  # -> element_location, colours, colour_range; disabled
pstress_2 = PrincipalStress(Model=optimus.Model, Tolerance=0)  # -> PStressValues, PStressPlane, PStressCrosses, PStressCrossesColours, PStressMinMax, VonMiesesValues, VonMiesesCrossesColours, Performance; disabled
wbcatmullclark = WeaverbirdsCatmullClarkSubdivision(MeshCurves=iso, Level=1, SmoothNakedEdges=1)  # disabled
planes = Planes()  # -> Planes, Scale; disabled
panel_2 = Panel("20")  # disabled
reparameterization = Reparameterization(
    Mesh=iso,
    Omega=1,
    Scalefield=invert(True),
    Uselambda=invert(False),
    Smoothfactor=0,
    SmoothModulo=1,
    Iterations=panel_2,
    MeshDenisty=1)  # disabled
quads = Quads(System=reparameterization)  # disabled
mesh_4 = Mesh(quads)  # disabled

number_slider_2 = Slider(1, range=0..1)
vec = VectorXYZ(XComponent=0, YComponent=number_slider_2, ZComponent=number_slider_2)  # -> Vector, Length
medges = MeshEdges(Mesh=mesh_4)  # -> NakedEdges, InteriorEdges, NonManifoldEdges
swatch = ColourSwatch(SwatchColor=RGB(0, 0, 0))
normshade = NormalShader(
    mesh=mesh_4,
    direction=vec.Vector,
    color=ColourSwatch(SwatchColor=RGB(255, 255, 255)),
    intensity=Slider(0.34, range=0..1),
    Reference="C:\USERS\MARCO\DESKTOP\old personal google drive\AA_Aarhus_Workshop_Folder\Grasshopper Resources\Libraries\SpatialSlur.dll")  # -> out, result; inputs mesh: Mesh, direction: Vector3d, color: Color, intensity: Double
# ---------- normshade: C# ----------
    if(mesh.Normals.Count != mesh.Vertices.Count)
      mesh.Normals.ComputeNormals();

    if(mesh.VertexColors.Count != mesh.Vertices.Count)
      mesh.VertexColors.CreateMonotoneMesh(Color.White);

    NormalShader(mesh, direction, color, intensity);
    result = mesh;
# ---------- normshade: C# additional code ----------
  //
  void NormalShader(Mesh mesh, Vector3d direction, Color color, double intensity)
  {
    if(!direction.Unitize())
      throw new System.ArgumentException("the direction vector cannot be zero length");

    Color[] vc = mesh.VertexColors.ToArray();

    var chunks = System.Collections.Concurrent.Partitioner.Create(0, mesh.Vertices.Count);
    System.Threading.Tasks.Parallel.ForEach(chunks, range =>
      {
      for (int i = range.Item1; i < range.Item2; i++)
      {
        double t = direction * mesh.Normals[i] * 0.5 + 0.5;
        vc[i] = vc[i].LerpTo(color, t * intensity);
      }
      });

    mesh.VertexColors.SetColors(vc);
  }
# ---------- end normshade ----------
displaycrv = DisplayCurve(curve=medges.NakedEdges, color=swatch, weight=Slider(1, range=1..20))  # -> out; inputs curve: Curve, color: Color, weight: Int32
# ---------- displaycrv: C# ----------
    // silently skip null curves
    if(curve == null) return;

    // add to display cache
    _curves.Add(curve);
    _colors.Add(color);
    _weights.Add(weight);
    _clippingBox.Union(curve.GetBoundingBox(false));
# ---------- displaycrv: C# additional code ----------
  List<Curve> _curves;
  List<Color> _colors;
  List<int> _weights;
  BoundingBox _clippingBox;


  /// <summary>
  /// This method will be called once every solution, before any calls to RunScript.
  /// </summary>
  public override void BeforeRunScript()
  {
    _curves = new List<Curve>();
    _colors = new List<Color>();
    _weights = new List<int>();
    _clippingBox = new BoundingBox();
  }


  //
  public override BoundingBox ClippingBox
  {
    get{return _clippingBox;}
  }


  //
  public override void DrawViewportWires(IGH_PreviewArgs args)
  {
    base.DrawViewportWires(args);

    for(int i = 0; i < _curves.Count; i++)
      args.Display.DrawCurve(_curves[i], _colors[i], _weights[i]);
  }
# ---------- end displaycrv ----------
displaycrv_2 = DisplayCurve(curve=medges.InteriorEdges, color=swatch, weight=Slider(1, range=1..20))  # -> out; inputs curve: Curve, color: Color, weight: Int32; same code as displaycrv

# ==== cluster ElementDataPreview: Dot style preview of tOpos Model data including element Density, Compliance and Sensitivity
model = ClusterInput()  # tOpos Model to generate preview
iso = ClusterInput()  # Iso Threshold
move = ClusterInput()  # Space between particular data sets
M = Data(model)
iso_2 = Number(iso)
num = Number(move)
dom = ConstructDomain(DomainStart=0, DomainEnd=1)

element = ElementResult(Model=M, densityMode=False)  # -> Location, Density, Compliance, Sensitivity, Size
larger = LargerThan(FirstNumber=element.Density, SecondNumber=iso_2)  # -> LargerThan, OrEqualTo
dotsize = Slider(0.6, range=0..1)
cull = CullPattern(List=element.Location, CullPattern=larger.LargerThan)
multiplication = Multiplication(A=element.Size, B=dotsize)
bbox = BoundingBox(Content=cull, Plane=PlaneXY(0, 0, 0), UnionBox=True)  # -> Box, Box_2
boxprop = BoxProperties(Box=bbox.Box)  # -> Center, Diagonal, Area, Volume, Degeneracy
devec = DeconstructVector(Vector=boxprop.Diagonal)  # -> XComponent, YComponent, ZComponent
addition = Addition(A=num, B=devec.XComponent)
series = Series(Start=0, Step=addition, Count=3)
X = UnitX(Factor=series)
move_2 = Move(Geometry=cull, Motion=graft(X))  # -> simplify(Geometry), Transform

cull_2 = CullPattern(List=element.Density, CullPattern=larger.LargerThan)
gradient = Gradient(LowerLimit=0, UpperLimit=1, Parameter=cull_2, stops=[0: RGBA(255, 255, 255, 0), 1: RGB(0, 0, 0)])

bnd = Bounds(Numbers=element.Compliance)
cull_3 = CullPattern(List=element.Compliance, CullPattern=larger.LargerThan)
dedomain = DeconstructDomain(Domain=bnd)  # -> Start, End
gradient_2 = Gradient(
    LowerLimit=dedomain.Start,
    UpperLimit=dedomain.End,
    Parameter=cull_3,
    stops=[0.00371: RGBA(176, 53, 53, 0), 0.102: RGB(255, 250, 98), 0.5: RGB(46, 144, 208)])

bnd_2 = Bounds(Numbers=element.Sensitivity)
cull_4 = CullPattern(List=element.Sensitivity, CullPattern=larger.LargerThan)
dedomain_2 = DeconstructDomain(Domain=bnd_2)  # -> Start, End
gradient_3 = Gradient(
    LowerLimit=dedomain_2.Start,
    UpperLimit=dedomain_2.End,
    Parameter=cull_4,
    stops=[0.502: RGB(175, 53, 52), 0.895: RGB(255, 250, 98), 1: RGBA(46, 144, 209, 0)])

entwine = Entwine(Branch00=gradient, Branch01=gradient_2, Branch02=gradient_3, FlattenInputs=True)  # -> simplify(Result)

cloud = CloudDisplay(Points=move_2.Geometry, Colours=entwine, Size=multiplication, SpriteType=1)

pt = Point(cull)
col = Colour(entwine)
merge = Merge(Data1=flatten(dom), Data2=flatten(bnd), Data3=flatten(bnd_2))  # -> graft(Result)
range = Domain(merge)
element_location = ClusterOutput(pt)  # Element location (center) after culling by Iso parameter.
colours = ClusterOutput(col)  # Colous for each element (after culling by Iso Threshold) of particular data sets (dens, colpiance, sensitivity)
colour_range = ClusterOutput(range)  # Colour range of particular data sets (dens, colpiance, sensitivity) for creating legend

# ==== cluster DensPreview: Preview densities as a Blured Point Cloud
model = ClusterInput()  # tOpos Model
iso = ClusterInput()  # Iso Threshold
element = ElementData(Model=model, densityMode=False)  # -> Location, Density, Compliance, Sensitivity, Size
iso_2 = Number(iso)
larger = LargerThan(FirstNumber=element.Density, SecondNumber=iso_2)  # -> LargerThan, OrEqualTo
cull = CullPattern(List=element.Density, CullPattern=larger.LargerThan)
cull_2 = CullPattern(List=element.Location, CullPattern=larger.LargerThan)
gradient = Gradient(LowerLimit=0, UpperLimit=1, Parameter=cull, stops=[0: RGBA(255, 255, 255, 0), 0.462: RGB(0, 0, 0)])
cloud = CloudDisplay(Points=cull_2, Colours=gradient, Size=expr("x/2", element.Size), SpriteType=1)
