# Grasshopper definition nesting.gh (Grasshopper 1.0.7)
# plug-ins: Human, OpenNest

srf = Surface([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])

# ---- group: Parts can be either polylines or planar surfaces
crv = Curve(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)
repeat = RepeatData(Data=crv, Length=Slider(100, range=0..100))
merge = Merge(Data1=srf)  # -> flatten(Result)

# ----
debrep = DeconstructBrep(Brep=merge)  # -> Faces, Edges, Vertices
join = JoinCurves(Curves=debrep.Edges, Preserve=False)
project = Project(Polyline=join)  # -> Polyline, Plane
pack = PackObjects(Geo=project.Polyline, Plane=project.Plane, X=1, Y=1, Tolerabce=0)  # -> Geo, Transformation

# ----
# Nesting Shape with Holes -> Planar Surfaces
crv_2 = Curve(<curve referenced from the Rhino model>)
area = Area(Geometry=flatten(pack.Geo))  # -> Area, Centroid
number_slider = Slider(0, range=0..10)
opennest = OpenNest(
    Sheets=crv_2,
    Geo=flatten(pack.Geo),
    Spacing=Slider(0.01, range=0..1),
    Placement=1,
    Tolerance="0.001",
    Rotations="20",
    Iterations="5",
    Seed="3",
    Reset=True,
    Run=False)  # -> Sheets, Geo, ID, Transform, IDS
lng = ListLength(List=area.Centroid)
series = Series(Start=0, Step=1, Count=lng)
int = Integer(series)
text = Text(Location=area.Centroid, Text=int, Size="0.12")
group = Group(Objects=text)  # -> flatten(Group)

# ---- group: If you want to nest additional goemetry
transform = Transform(Geometry=group, Transform=opennest.Transform)

# ----
previewlw = CustomPreviewLineweights(Geometry=opennest.Geo, Shader=ColourSwatch(SwatchColor=RGB(0, 0, 0)), Thickness=Slider(3, range=1..5), Absolute=False)
previewlw_2 = CustomPreviewLineweights(Geometry=transform, Shader=ColourSwatch(SwatchColor=RGB(191, 0, 0)), Thickness=Slider(2, range=1..5), Absolute=False)
