# Grasshopper definition StairResearch_Rev03.gh (Grasshopper 1.0.7)
# plug-ins: MeshEdit Components, treesloth01, BullAnt, Human, ggGHgsa, Weaverbird, Kangaroo2 Components

number_slider = Slider(3, range=1..3)
concat = Concatenate(FragmentA="Landing::", FragmentB=number_slider)
concat_2 = Concatenate(FragmentA="Stringers::", FragmentB=number_slider)
dynamic_geometry_pipeline = DynamicGeometryPipeline(
    LayerFilter=concat_2,
    TypeFilter="Curve",
    NameFilter="*",
    GroupByLayer=False,
    GroupByType=False,
    IncludeHidden=True,
    IncludeLocked=True,
    enableFullPath=True,
    listenToAttributes=True)
dynamic_geometry_pipeline_2 = DynamicGeometryPipeline(
    LayerFilter=concat,
    TypeFilter="Curve",
    NameFilter="*",
    GroupByLayer=False,
    GroupByType=False,
    IncludeHidden=True,
    IncludeLocked=True,
    enableFullPath=True,
    listenToAttributes=True)
object_attributes = ObjectAttributes(ObjectOrAttributes=dynamic_geometry_pipeline)  # -> Name, LayerName, LayerFullPath, Color, MaterialName, LinetypeName, GroupIndices, PlotWeight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
object_attributes_2 = ObjectAttributes(ObjectOrAttributes=dynamic_geometry_pipeline_2)  # -> Name, LayerName, LayerFullPath, Color, MaterialName, LinetypeName, GroupIndices, PlotWeight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
create_set = CreateSet(List=object_attributes.Name)  # -> Set, Map
create_set_2 = CreateSet(List=object_attributes_2.Name)  # -> Set, Map
member_index = MemberIndex(Set=object_attributes.Name, Member=create_set.Set)  # -> Index, Count
member_index_2 = MemberIndex(Set=object_attributes_2.Name, Member=create_set_2.Set)  # -> Index, Count
list_item = ListItem(List=dynamic_geometry_pipeline, Index=member_index.Index, Wrap=True)  # -> simplify(Item)
list_item_2 = ListItem(List=dynamic_geometry_pipeline_2, Index=member_index_2.Index, Wrap=True)
explode = Explode(Curve=list_item, Recursive=True)  # -> simplify(Segments), Vertices
explode_2 = Explode(Curve=list_item_2, Recursive=True)  # -> simplify(Segments), Vertices
list_length = ListLength(List=explode.Vertices)  # -> expr("x-1", Length)
flip_last = FlipLast(Data=explode.Segments)
range = Range(Domain=graft(object_attributes.Name), Steps=list_length)
flip_last_2 = FlipLast(Data=explode_2.Segments)
loft = Loft(Curves=flip_last, Options={Adjust=False, Closed=False, LoftEnds=0, LoftSimp=0, LoftType=0, Rebuild=10, Refit=0.01})
unit_z = UnitZ(Factor=range)
loft_2 = Loft(Curves=flip_last_2, Options={Adjust=False, Closed=False, LoftEnds=0, LoftSimp=0, LoftType=0, Rebuild=10, Refit=0.01})  # -> simplify(Loft)
move = Move(Geometry=explode.Vertices, Motion=unit_z)  # -> Geometry, Transform
shift_paths = ShiftPaths(Data=simplify(loft), Offset=-1)
domain = Domain(graft(create_set.Set))
domain_2 = Domain(graft(create_set_2.Set))
shift_paths_2 = ShiftPaths(Data=simplify(loft_2), Offset=-1)  # -> simplify(Data)
list_length_2 = ListLength(List=shift_paths_2)
deconstruct_domain = DeconstructDomain(Domain=domain_2)  # -> Start, End
number = Number(expr("x-1", list_length_2))
deconstruct_domain_2 = DeconstructDomain(Domain=domain)  # -> Start, End
expression = Expression(x=number, Expression="if(x=0,1,x)")
subtraction = Subtraction(A=deconstruct_domain.End, B=deconstruct_domain.Start)
list_length_3 = ListLength(List=shift_paths)
subtraction_2 = Subtraction(A=deconstruct_domain_2.End, B=deconstruct_domain_2.Start)
number_2 = Number(expr("x+1", list_length_3))
division = Division(A=subtraction, B=expression)
division_2 = Division(A=subtraction_2, B=number_2)
series = Series(Start=simplify(deconstruct_domain.Start), Step=division, Count=list_length_2)
addition = Addition(A=deconstruct_domain_2.Start, B=division_2)
series_2 = Series(Start=simplify(addition), Step=division_2, Count=list_length_3)
unit_z_2 = UnitZ(Factor=series)
panel = Panel(division_2)
unit_z_3 = UnitZ(Factor=series_2)  # -> simplify(UnitVector)
panel_2 = Panel(series)
move_2 = Move(Geometry=shift_paths_2, Motion=unit_z_2)  # -> Geometry, Transform
move_3 = Move(Geometry=shift_paths, Motion=unit_z_3)  # -> Geometry, Transform
deconstruct_brep = DeconstructBrep(Brep=move_3.Geometry)  # -> Faces, Edges, Vertices
deconstruct_brep_2 = DeconstructBrep(Brep=move_2.Geometry)  # -> simplify(Faces), Edges, Vertices
surface = Surface(simplify(deconstruct_brep.Faces))
shift_paths_3 = ShiftPaths(Data=deconstruct_brep_2.Faces, Offset=-1)
shift_paths_4 = ShiftPaths(Data=surface, Offset=-1)
list_item_3 = ListItem(List=shift_paths_3, Index=0, Wrap=True)
deconstruct_brep_3 = DeconstructBrep(Brep=list_item_3)  # -> simplify(Faces), simplify(Edges), Vertices
list_item_4 = ListItem(List=deconstruct_brep_3.Edges, Index=0, Wrap=True)
surface_2 = Surface(shift_paths_4)
deconstruct_brep_4 = DeconstructBrep(Brep=surface_2)  # -> simplify(Faces), simplify(Edges), Vertices
list_item_5 = ListItem(List=deconstruct_brep_4.Edges, Index=0, Wrap=True)  # -> simplify(Item)
negative = Negative(Value=division_2)
shift_paths_5 = ShiftPaths(Data=list_item_5, Offset=-1)  # -> simplify(Data)
unit_z_4 = UnitZ(Factor=negative)
move_4 = Move(Geometry=shift_paths_5, Motion=unit_z_4)  # -> simplify(Geometry), Transform
graft_tree = GraftTree(Tree=shift_paths_5, IncludeEmptyLists=True, IncludeNullItems=True)
graft_tree_2 = GraftTree(Tree=move_4.Geometry, IncludeEmptyLists=True, IncludeNullItems=True)
merge = Merge(Data1=graft_tree, Data2=graft_tree_2)
loft_3 = Loft(Curves=merge, Options={Adjust=False, Closed=False, LoftEnds=0, LoftSimp=0, LoftType=0, Rebuild=10, Refit=0.01})
surface_3 = Surface(flatten(shift_paths_3))
surface_4 = Surface(flatten(loft_3))
iso_curve = IsoCurve(Surface=surface_3, UVPoint="0,0,0")  # -> simplify(UIsocurve), simplify(VIsocurve)
negative_2 = Negative(Value=division_2)
iso_curve_2 = IsoCurve(Surface=surface_4, UVPoint="0,0,0")  # -> simplify(UIsocurve), simplify(VIsocurve)
unit_z_5 = UnitZ(Factor=negative_2)
length = Length(Curve=iso_curve_2.UIsocurve)
length_2 = Length(Curve=iso_curve_2.VIsocurve)
move_5 = Move(Geometry=list_item_4, Motion=unit_z_5)  # -> simplify(Geometry), Transform
sort_list = SortList(Keys=flatten(length))  # -> Keys, ValuesValuesA
sort_list_2 = SortList(Keys=flatten(length_2))  # -> Keys, ValuesValuesA
length_3 = Length(Curve=iso_curve.VIsocurve)
list_item_6 = ListItem(List=sort_list.Keys, Index=0, Wrap=True)
graft_tree_3 = GraftTree(Tree=list_item_4, IncludeEmptyLists=True, IncludeNullItems=True)
graft_tree_4 = GraftTree(Tree=move_5.Geometry, IncludeEmptyLists=True, IncludeNullItems=True)
list_item_7 = ListItem(List=sort_list_2.Keys, Index=0, Wrap=True)
merge_2 = Merge(Data1=graft_tree_3, Data2=graft_tree_4)
division_3 = Division(A=list_item_6, B="0.10")
division_4 = Division(A=list_item_7, B="0.10")
loft_4 = Loft(Curves=merge_2, Options={Adjust=False, Closed=False, LoftEnds=0, LoftSimp=0, LoftType=0, Rebuild=10, Refit=0.01})
round = Round(Number=division_3)  # -> Nearest, Floor, Ceiling
round_2 = Round(Number=division_4)  # -> Nearest, Floor, Ceiling
shift_paths_6 = ShiftPaths(Data=round.Ceiling, Offset=-1)
shift_paths_7 = ShiftPaths(Data=round_2.Ceiling, Offset=-1)
mesh_surface = MeshSurface(Surface=surface_4, UCount=shift_paths_6, VCount=shift_paths_7, Overhang=True, Equalize=False)
mesh_surface_2 = MeshSurface(Surface=loft_4, UCount=shift_paths_6, VCount=shift_paths_7, Overhang=True, Equalize=False)
debrep = DeconstructBrep(Brep=surface_3)  # -> Faces, Edges, Vertices
panel_3 = Panel("""1
3""")
item = ListItem(List=debrep.Edges, Index=panel_3, Wrap=True)
mesh = Mesh([mesh_surface, mesh_surface_2])
panel_4 = Panel("""0
2""")
curve = Curve([dynamic_geometry_pipeline, dynamic_geometry_pipeline_2])
join_curves = JoinCurves(Curves=curve, Preserve=False)
curve_2 = Curve(graft(join_curves))
divide_curve = DivideCurve(Curve=curve_2, Count=10, Kinks=False)  # -> flatten(Points), Tangents, Parameters
plane_fit = PlaneFit(Points=divide_curve.Points)  # -> Plane, Deviation

# ----
# Create
# Material
gggsacreate_elastic_isotropic_material = GgGSACreateElasticIsotropicMaterial(
    ElasticModulusPa=2.05e+11,
    PoissonsRatio=0.3,
    ShearModulusPa=0,
    Density=7850,
    CoefficientOfThermalExpansion=1.2e-05,
    DampingRatio=0)
gggsacreate_material = GgGSACreateMaterial(StandardStructureMaterial=0)

# ----
# Load Case
panel_5 = Panel("HANDRAIL")
gggsaloadcase = GgGSALoadCase(Name="IL", ID="3", LoadCaseType=6, Bridge=False)
gggsaloadcase_2 = GgGSALoadCase(Name=panel_5, ID="4", LoadCaseType=6, Bridge=False)
gggsaloadcase_3 = GgGSALoadCase(Name="DL", ID="1", LoadCaseType=6, Bridge=False)
gggsaloadcase_4 = GgGSALoadCase(Name="SDL", ID="2", LoadCaseType=6, Bridge=False)

negative_3 = Negative(Value="814")
value_list = ValueList({"X": 0, "Y": 1, "Y": 2, "XX": 3, "YY": 4, "ZZ": 5}, selected="XX")
value_list_2 = ValueList({"X": 0, "Y": 1, "Y": 2, "XX": 3, "YY": 4, "ZZ": 5}, selected="XX")
panel_6 = Panel("-1489")
gggsaloadgravity = GgGSALoadGravity(LoadCase=gggsaloadcase_3, XGravityFactor=0, YGravityFactor=0, ZGravityFactor=-1)
panel_7 = Panel("""1,0,0
0,1,0
0,0,1
1,1,0.5
1.35,1.35,1.35""")
load_case = Data([gggsaloadcase_3, gggsaloadcase_4, gggsaloadcase])
text_split = TextSplit(Text=panel_7, Separators=",")

# ----
# Analysis Tasks
panel_8 = Panel("Static")
gggsaanalysis_static = GgGSAAnalysisStatic(Name=panel_8, ID=0, GeometricFrontVector=Vector(0, 0, 1), MaxIterations=0)
panel_9 = Panel("""DL
SDL
IL
SLS
ULS""")
gggsaanalysis_case = GgGSAAnalysisCase(
    Name=simplify(graft(panel_9)),
    ID=1,
    StructAnalysisTask=gggsaanalysis_static,
    StructLoadCase=load_case,
    LoadFactors=simplify(text_split))  # -> flatten(StructAnalysisCase)

panel_10 = Panel("""1
1
0.1""")
panel_11 = Panel(gggsaanalysis_case)
gggsaanalysis_modal_options = GgGSAAnalysisModalOptions(
    SolverRestraint=0,
    MassCalculationOption=1,
    MassScaleFactor=1,
    MassLoadCase=load_case,
    LoadCaseMassDirection=2,
    LoadCaseScaleFactor=panel_10,
    StiffnessProportion=1,
    MassProportion=1,
    SturmSequenceCheck=True,
    IgnoreElementOffsets=False,
    NormalizeDisplacements=True,
    ScaleFactorNormalization=1,
    NumberOfJacobiIterations=12)
gggsaanalysis_modal = GgGSAAnalysisModal(
    Name="Dynamic",
    ID=0,
    NumberOfModes="6",
    NumberOfIterations=128,
    StartMode=1,
    LowerFrequencyCutoff=0,
    HigherFrequencyCutoff=20)
gggsaanalysis_footfall = GgGSAAnalysisFootfall(
    Name="Footfall",
    ID=0,
    DynamicTask=gggsaanalysis_modal,
    DampingType=0,
    Damping=3,
    NumberOfSteps=100,
    WalkerMass=76,
    LowerFrequencyCutoff=1,
    HigherFrequencyCutoff=3.5,
    FrequencyWeighting=-1,
    Direction=2,
    WalkingMethod=0,
    ExcitationMethod=0)
gggsaanalysis_case_2 = GgGSAAnalysisCase(Name="Dynamic", ID=1, StructAnalysisTask=gggsaanalysis_modal)

# ----
# BAKE
gggsabakemodel = GgGSABakeModel(ClipSummary=False, GSAVersion="v9", NewFile=True)

gggsaanalysis_case_3 = GgGSAAnalysisCase(Name="Footfall", ID=1, StructAnalysisTask=gggsaanalysis_footfall)

surface_5 = Surface(shift_paths_4)
iso_curve_3 = IsoCurve(Surface=surface_5, UVPoint="0,0,0")  # -> UIsocurve, VIsocurve
length_4 = Length(Curve=iso_curve_3.UIsocurve)
length_5 = Length(Curve=iso_curve_3.VIsocurve)

sort_list_3 = SortList(Keys=flatten(length_4))  # -> Keys, ValuesValuesA
sort_list_4 = SortList(Keys=flatten(length_5))  # -> Keys, ValuesValuesA
list_item_8 = ListItem(List=sort_list_4.Keys, Index=0, Wrap=True)
list_item_9 = ListItem(List=sort_list_3.Keys, Index=0, Wrap=True)
division_5 = Division(A=length_3, B="0.10")
round_3 = Round(Number=division_5)  # -> Nearest, Floor, Ceiling
shift_paths_8 = ShiftPaths(Data=round_3.Ceiling, Offset=-1)
mesh_surface_3 = MeshSurface(Surface=surface_3, UCount=shift_paths_7, VCount=shift_paths_8, Overhang=True, Equalize=False)
mesh_join = MeshJoin(Meshes=mesh_surface_3)
mesh_weldvertices = MeshWeldVertices(Mesh=mesh_join, Tolerance=0.01)  # -> RuntimeMessage, Mesh
nv = NakedVertices(Mesh=mesh_weldvertices.Mesh)  # -> ClothedIndex, NakedIndex, ClothedPts, NakedPts
pt = Point(nv.NakedPts)
crv_cp = CurveClosestPoint(Point=pt, Curve=graft(item))  # -> Point, Parameter, Distance
smaller = SmallerThan(FirstNumber=crv_cp.Distance, SecondNumber="0.001")  # -> SmallerThan, OrEqualTo
cull = CullPattern(List=pt, CullPattern=smaller.SmallerThan)

# ---- group: method to split the mesh at corner --- not necessary animore
weaverbird_s_naked_boundary = WeaverbirdsNakedBoundary(MeshClosedPolylines=mesh_weldvertices.Mesh)
splitatcorners = SplitAtCorners(Poly=weaverbird_s_naked_boundary, Angle=1)  # -> Corners, Parts
panel_12 = Panel("""1
3""")
list_item_10 = ListItem(List=splitatcorners.Parts, Index=panel_12, Wrap=True)
explode_3 = Explode(Curve=list_item_10, Recursive=True)  # -> Segments, Vertices

# ----
duppt = RemoveDuplicatePts(Points=flatten(cull), Tolerance=0.01)

division_6 = Division(A=list_item_8, B="0.10")
round_4 = Round(Number=division_6)  # -> Nearest, Floor, Ceiling
shift_paths_9 = ShiftPaths(Data=round_4.Ceiling, Offset=-1)

ghpython_script = GhPythonScript(x=shift_paths_9)  # -> out, a
# ---------- ghpython_script: Python ----------
__author__ = "FORMAT"
__version__ = "2019.08.29"

import rhinoscriptsyntax as rs
a = []
if (x % 2) == 0:
    a = x
else:
    a = x + 1
# ---------- end ghpython_script ----------

mesh_surface_4 = MeshSurface(Surface=surface_5, UCount=shift_paths_7, VCount=ghpython_script.a, Overhang=True, Equalize=False)

weaverbird_s_naked_boundary_2 = WeaverbirdsNakedBoundary(MeshClosedPolylines=mesh_surface_4)
discontinuity = Discontinuity(Curve=weaverbird_s_naked_boundary_2, Level=1)  # -> Points, Parameters
shatter = Shatter(Curve=graft(weaverbird_s_naked_boundary_2), Parameters=discontinuity.Parameters)
list_item_11 = ListItem(List=shatter, Index=panel_4, Wrap=True)
explode_4 = Explode(Curve=list_item_11, Recursive=True)  # -> Segments, Vertices
list_length_4 = ListLength(List=explode_4.Vertices)
division_7 = Division(A=list_length_4, B="2")
round_5 = Round(Number=division_7)  # -> Nearest, Floor, Ceiling
list_item_12 = ListItem(List=explode_4.Vertices, Index=round_5.Floor, Wrap=True)
point = Point(flatten([duppt, list_item_12]))
move_to_plane = MoveToPlane(Geometry=point, Plane=plane_fit.Plane, Above=True, Below=True)  # -> Geometry, Transform
curve_closest_point = CurveClosestPoint(Point=move_to_plane.Geometry, Curve=curve_2)  # -> Point, Parameter, Distance
smaller_than = SmallerThan(FirstNumber=curve_closest_point.Distance, SecondNumber="0.01")  # -> SmallerThan, OrEqualTo
entwine = Entwine(Branch00=mesh, Branch01=mesh_surface_4, Branch02=mesh_surface_3, FlattenInputs=True)
cull_pattern = CullPattern(List=curve_closest_point.Point, CullPattern=smaller_than.SmallerThan)
cull_pattern_2 = CullPattern(List=point, CullPattern=smaller_than.SmallerThan)
explode_tree = ExplodeTree(Data=entwine)  # -> Branch0, Branch1, Branch2
sort_along_curve = SortAlongCurve(Points=cull_pattern, Curve=curve_2)  # -> Points, Indices
landing = Mesh(explode_tree.Branch2)
riser = Mesh(explode_tree.Branch0)
treads = Mesh(explode_tree.Branch1)
list_item_13 = ListItem(List=cull_pattern_2, Index=sort_along_curve.Indices, Wrap=True)
polyline = PolyLine(Vertices=list_item_13, Closed=False)
curve_3 = Curve(polyline)

# ----
# Beam
explode_5 = Explode(Curve=curve_3, Recursive=True)  # -> Segments, Vertices
curve_4 = Curve(curve_3)
rebuild_curve = RebuildCurve(Curve=curve_4, Degree="5", Count=10, Tangents=False)  # -> reparameterize(graft(Curve))
evaluate_curve = EvaluateCurve(Curve=reparameterize(explode_5.Segments), Parameter="0.50")  # -> Point, Tangent, Angle
number_3 = Number(expr("x/1000", "330"))
number_4 = Number(expr("x/1000", "80"))
number_5 = Number(expr("x/1000", "6"))
concatenate = Concatenate(FragmentA="RHS", FragmentB=number_3, FragmentC=number_4, JoinSeparator="_")
curve_closest_point_2 = CurveClosestPoint(Point=evaluate_curve.Point, Curve=rebuild_curve)  # -> Point, Parameter, Distance
gggeneraterhs = GgGenerateRHS(Name=concatenate, Depth=number_3, Breadth=number_4, Thickness=number_5)
perp_frame = PerpFrame(Curve=rebuild_curve, Parameter=curve_closest_point_2.Parameter)
gggsabeamrelease = GgGSABeamRelease(ReleaseX=False, ReleaseY=False, ReleaseZ=False, ReleaseXx=False, ReleaseYy=False, ReleaseZz=False)
gggsabeamrelease_2 = GgGSABeamRelease(ReleaseX=False, ReleaseY=False, ReleaseZ=False, ReleaseXx=False, ReleaseYy=False, ReleaseZz=False)
unit_z_6 = UnitZ(Factor=expr("-x/2", number_3))
unit_z_7 = UnitZ(Factor=1)
align_plane = AlignPlane(Plane=perp_frame, Direction=unit_z_7)  # -> Plane, Angle
gggsacreatesectionprop = GgGSACreateSectionProp(Profile=gggeneraterhs, Name=concatenate, Material=gggsacreate_material)
gggsabeamatts = GgGSABeamAtts(
    ReleaseA=gggsabeamrelease,
    ReleaseB=gggsabeamrelease_2,
    GlobalOffset=True,
    OffsetA=unit_z_6,
    OffsetB=unit_z_6,
    LowNodeID=1,
    LowBeamID=1,
    CoincidentNodeTol=0,
    BeamType=1,
    Dummy=False)
deconstruct_plane = DeconstructPlane(Plane=align_plane.Plane)  # -> Origin, XAxis, YAxis, ZAxis
gggsacreatebeam = GgGSACreateBeam(Prop=gggsacreatesectionprop, NodeCL=explode_5.Segments, Angle=0, BeamAtts=gggsabeamatts)  # -> simplify(flatten(StructureModelBeam))

# ----
# Shell
panel_13 = Panel("8")
number_6 = Number(expr("x/1000", panel_13))
concatenate_2 = Concatenate(FragmentA=panel_13, FragmentB="mm Steel Plate")
gggsacreate_2d_finite_element_prop = GgGSACreate2dFiniteElementProp(Name=concatenate_2, Thickness=number_6, Material=gggsacreate_material)
mesh_2 = Mesh(treads)
mesh_3 = Mesh(landing)
mesh_4 = Mesh(riser)
gggsameshconvertfiniteelements = GgGSAMeshConvertFiniteElements(Prop=gggsacreate_2d_finite_element_prop, Mesh=mesh_2, Angle=0, QuadShapeCheckAcceptance=0)  # -> StructureModelFiniteElements, StructureModelNodes, MeshIdentifyingFacesBreachingShapeChecks
gggsameshconvertfiniteelements_2 = GgGSAMeshConvertFiniteElements(Prop=gggsacreate_2d_finite_element_prop, Mesh=mesh_3, Angle=0, QuadShapeCheckAcceptance=0)  # -> StructureModelFiniteElements, StructureModelNodes, MeshIdentifyingFacesBreachingShapeChecks
gggsameshconvertfiniteelements_3 = GgGSAMeshConvertFiniteElements(Prop=gggsacreate_2d_finite_element_prop, Mesh=mesh_4, Angle=0, QuadShapeCheckAcceptance=0)  # -> StructureModelFiniteElements, StructureModelNodes, MeshIdentifyingFacesBreachingShapeChecks

end_points = EndPoints(Curve=curve_3)  # -> Start, End
point_2 = Point([end_points.Start, end_points.End])

# ----
# Support
boolean_toggle = BooleanToggle(True)
gggsanoderestraint = GgGSANodeRestraint(
    RestraintX=boolean_toggle,
    RestraintY=boolean_toggle,
    RestraintZ=boolean_toggle,
    RestraintXX=boolean_toggle,
    RestraintYY=boolean_toggle,
    RestraintZZ=boolean_toggle)
gggsanodeatts = GgGSANodeAtts(Restraint=gggsanoderestraint, LowNodeID=1)
gggsacreateorfindnode = GgGSACreateOrFindNode(Location=flatten(point_2), NodeAtts=gggsanodeatts, DetectTol=0)

merge_3 = Merge(
    Data1=gggsameshconvertfiniteelements.StructureModelFiniteElements,
    Data2=gggsameshconvertfiniteelements_2.StructureModelFiniteElements)  # -> flatten(Result)
data = Data(gggsacreatebeam)
data_2 = Data(merge_3)
data_3 = Data(merge_3)
gggsaloadcrvudl = GgGSALoadCrvUDL(
    LoadCase=gggsaloadcase_4,
    LoadedElements=flatten(data),
    LoadIntensity=panel_6,
    Direction=2,
    Projected=False,
    LocalAxis=False,
    LoadUnits=0)
gggsaload2dface = GgGSALoad2dFace(
    LoadCase=gggsaloadcase_4,
    LoadedElements=data_3,
    LoadPressure="-650",
    Axis="Z",
    Projected=False,
    LocalAxis=False,
    PressureUnit=4)
gggsaload2dface_2 = GgGSALoad2dFace(
    LoadCase=gggsaloadcase,
    LoadedElements=data_2,
    LoadPressure="-2000",
    Axis="Z",
    Projected=False,
    LocalAxis=False,
    PressureUnit=4)
gggsaloadcrvudl_2 = GgGSALoadCrvUDL(
    LoadCase=gggsaloadcase_2,
    LoadedElements=flatten(data),
    LoadIntensity="814",
    Direction=value_list_2,
    Projected=False,
    LocalAxis=invert(False),
    LoadUnits=0)
gggsaloadcrvudl_3 = GgGSALoadCrvUDL(
    LoadCase=gggsaloadcase_2,
    LoadedElements=flatten(data),
    LoadIntensity="-740",
    Direction=2,
    Projected=False,
    LocalAxis=False,
    LoadUnits=0)
gggsaloadcrvudl_4 = GgGSALoadCrvUDL(
    LoadCase=gggsaloadcase_2,
    LoadedElements=flatten(data),
    LoadIntensity=negative_3,
    Direction=value_list,
    Projected=False,
    LocalAxis=invert(False),
    LoadUnits=0)
