# Grasshopper definition Trave Irrigidita.gh (Grasshopper 1.0.7)
# plug-ins: Chromodoris, LunchBoxML, Weaverbird, Kangaroo2 Components, karambaGH

xz = XZPlane(Origin=Point(0, 0, 0))
rectangle = Rectangle(Plane=xz, XSize="6.00", YSize="0.50", Radius=0)  # -> Rectangle, Length
cpoly = ControlPolygon(Curve=rectangle.Rectangle)  # -> Polygon, Points
boundary = BoundarySurfaces(Edges=rectangle.Rectangle)
divide = DivideDomain²(Domain=boundary, UCount=10, VCount="1")
subsrf = Isotrim(Surface=boundary, Domain=divide)  # -> reparameterize(graft(Surface))
md_slider = MDSlider(SliderMode=0, slider_value=Point(0.5, 0.5, 0.5), x_domain=Domain(0, 1), y_domain=Domain(0, 1), z_domain=Domain(0, 1))
evalsrf = EvaluateSurface(Surface=subsrf, Point=md_slider)  # -> Point, Normal, UDirection, VDirection, Frame
debrep = DeconstructBrep(Brep=subsrf)  # -> Faces, Edges, Vertices
rtree_cp = RTreeClosestPoint()  # -> ClosestPoint, ClosestIndex
crv_cp = CurveClosestPoint(Point=evalsrf.Point, Curve=debrep.Edges)  # -> Point, Parameter, Distance
ln = Line(StartPoint=evalsrf.Point, EndPoint=crv_cp.Point)
len = Length(Curve=ln)
avr = Average(Input=len)
multiplication = Multiplication(A=avr, B=Slider(0.5758, range=0.3..1))
cir = Circle(Plane=evalsrf.Frame, Radius=multiplication)  # -> flatten(Circle)
srfsplit = SurfaceSplit(Surface=boundary, Curves=cir)
area = Area(Geometry=srfsplit)  # -> Area, Centroid
sort = SortList(Keys=area.Area, ValuesA=srfsplit)  # -> Keys, ValuesA
item = ListItem(List=reverse(sort.ValuesA), Index=0, Wrap=True)
mesh_breps = MeshBrepsKaramba3D(
    Brep=item,
    MeshResolution="0.03",
    EdgeRefinementFactor=0.67,
    PointReduction=False,
    SmoothingStepSize=0,
    SmoothingIterations=5)  # -> Mesh, Info
wbnaked = WeaverbirdsNakedBoundary(MeshClosedPolylines=mesh_breps.Mesh)
sort_2 = SortList(Keys=wbnaked, ValuesA=wbnaked)  # -> Keys, ValuesA
item_2 = ListItem(List=reverse(sort_2.ValuesA), Index=0, Wrap=True)
splitatcorners = SplitAtCorners(Poly=item_2, Angle=1)  # -> Corners, Parts
sort_3 = SortList(Keys=splitatcorners.Parts, ValuesA=splitatcorners.Parts)  # -> Keys, ValuesA
item_3 = ListItem(List=reverse(sort_3.ValuesA), Index=0, Wrap=True)  # -> Item, Item1
entwine = Entwine(Branch00=item_3.Item, Branch01=item_3.Item1, FlattenInputs=True)
crv = Curve(item_3.Item)
explode = Explode(Curve=entwine, Recursive=True)  # -> Segments, Vertices
neg = Negative(Value="0.15")
len_2 = Length(Curve=explode.Segments)
dom = ConstructDomain(DomainStart=neg, DomainEnd="0.15")
avr_2 = Average(Input=len_2)
dedomain = DeconstructDomain(Domain=dom)  # -> Start, End
subtraction = Subtraction(A=dedomain.End, B=dedomain.Start)
division = Division(A=subtraction, B=avr_2)
division_2 = Division(A=division, B="2")
int = Integer(division_2)
panel = Panel("0")
multiplication_2 = Multiplication(A=int, B="2")
range = Range(Domain=dom, Steps=multiplication_2)  # -> simplify(Range)
Y = UnitY(Factor=range)
move = Move(Geometry=entwine, Motion=simplify(Y))  # -> Geometry, Transform
number_slider = Slider(20, range=1..20)
mloft = MeshLoft(Polylines=move.Geometry, Cap=False)
item_4 = ListItem(List=cpoly.Points, Index=0, Wrap=True)  # -> Item, Item1
clean = CombineClean(Meshes=flatten(mloft))
neg_2 = Negative(Value="120")
pt = Point(item_4.Item1)
pt_2 = Point(item_4.Item)
unim = UnifyMesh(Mesh=mloft)  # -> Result, Count
Z = UnitZ(Factor=neg_2)
meshtoshell = MeshToShellKaramba3D(Mesh=mesh_breps.Mesh, LimitDistance_m=0.005)  # -> Element, Points, Info
supp = SupportKaramba3D(PosInd=pt, menu=[buttons(off, on, on, off, off, off)])
supp_2 = SupportKaramba3D(PosInd=pt_2, menu=[buttons(on, on, on, off, off, off)])
loads = LoadsKaramba3D(Vector=Z, LCase=0, mode="Gravity")
meshtoshell_2 = MeshToShellKaramba3D(Mesh=unim.Result, LimitDistance_m=0.005)  # -> Element, Points, Info
assemble = AssembleModelKaramba3D(Elem=flatten([meshtoshell.Element, meshtoshell_2.Element]), Support=[supp_2, supp], Load=loads, LimitDistance_m=0.005)  # -> Model, Info, Mass_kg, CenterOfGravity
gradient = Gradient(
    LowerLimit=0,
    UpperLimit=1,
    stops=[0: RGBA(237, 26, 58, 0), 0: RGBA(209, 0, 118, 0), 0: RGBA(242, 57, 0, 0), 0: RGB(103, 0, 120), 0.141: RGB(39, 72, 161), 0.283: RGB(1, 192, 229), 0.43: RGB(18, 178, 90), 0.56: RGB(79, 186, 8), 0.698: RGB(220, 237, 32), 0.838: RGB(247, 159, 20), 1: RGB(243, 57, 0)])
analyze = AnalyzeKaramba3D(Model=assemble.Model)  # -> CalculatedModel, MaximumDisplacement_cm, ResultingForceOfGravity_kN, ElasticEnergy_kNm
colours = LegendColour()
modelview = ModelViewKaramba3D(Model=analyze.CalculatedModel, LoadCaseFactorsForLinearSuperposition=1, IndexOfVisibleLoadcase=-1)  # -> Model, DeformedMesh, DeformedAxes, DeformedModel
shellview = ShellViewKaramba3D(Model=modelview.Model, IndexOfLayer=0)  # -> Model, MeshesOfRenderedShells, LegendColors, LegendTags

# ==== cluster LegendColour: Legend colour for Karamba
merge = Merge(
    Data1=ColourSwatch(SwatchColor=RGB(255, 0, 0)),
    Data2=ColourSwatch(SwatchColor=RGB(255, 179, 0)),
    Data3=ColourSwatch(SwatchColor=RGB(255, 255, 0)),
    Data4=ColourSwatch(SwatchColor=RGB(0, 255, 0)),
    Data5=ColourSwatch(SwatchColor=RGB(0, 255, 255)),
    Data6=ColourSwatch(SwatchColor=RGB(4, 177, 255)),
    Data7=ColourSwatch(SwatchColor=RGB(0, 0, 255)),
    Data8=ColourSwatch(SwatchColor=RGB(129, 0, 190)),
    Data9=ColourSwatch(SwatchColor=RGB(75, 0, 130)))  # -> reverse(Result)
legend = ClusterOutput(merge)  # List of colours to plug on Karamba Legend
