# Grasshopper definition Truss Shape Diver.gh (Grasshopper 0.9.76)
# plug-ins: ShapeDiver

l_trave = Slider(15.05, range=10..40)
pt = ConstructPoint(XCoordinate=0, YCoordinate=0, ZCoordinate=0)
srf = Surface([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])
X = UnitX(Factor=l_trave)
material = CreateMaterial(
    Diffuse=ColourSwatch(SwatchColor=RGB(255, 255, 255)),
    Specular=RGB(255, 255, 255),
    Emission=RGB(0, 0, 0),
    Transparency=0,
    Shine=0)
move = Move(Geometry=pt, Motion=X)  # -> Geometry, Transform
h_trave = Slider(2.33, range=0.5..5)
preview = CustomPreview(Geometry=srf, Shader=material)
ln = Line(StartPoint=pt, EndPoint=move.Geometry)
Y = UnitY(Factor=h_trave)
move_2 = Move(Geometry=ln, Motion=Y)  # -> Geometry, Transform
crv = Curve(move_2.Geometry)
crv_2 = Curve(ln)
n_di_celle = Slider(8, range=5..20)
panel = Panel("""VIERENDEEL
BROWN
PRATT
HOWE
WARREN
WARREN """)
divide = DivideCurve(Curve=crv_2, Count=n_di_celle, Kinks=False)  # -> Points, Tangents, Parameters
divide_2 = DivideCurve(Curve=crv, Count=n_di_celle, Kinks=False)  # -> Points, Tangents, Parameters
shift = ShiftList(List=divide.Points, Shift=1, Wrap=invert(True))
shift_2 = ShiftList(List=divide_2.Points, Shift=1, Wrap=invert(True))
divide_3 = DivideCurve(Curve=crv, Count=expr("x*2", n_di_celle), Kinks=False)  # -> Points, Tangents, Parameters
divide_4 = DivideCurve(Curve=crv, Count=expr("x*2", n_di_celle), Kinks=False)  # -> Points, Tangents, Parameters
divide_5 = DivideCurve(Curve=crv_2, Count=expr("x*2", n_di_celle), Kinks=False)  # -> Points, Tangents, Parameters
divide_6 = DivideCurve(Curve=crv_2, Count=expr("x*2", n_di_celle), Kinks=False)  # -> Points, Tangents, Parameters
short = ShortestList(ListA=divide_2.Points, ListB=shift, TrimMode=2)  # -> ListA, ListB
short_2 = ShortestList(ListA=divide.Points, ListB=shift_2, TrimMode=2)  # -> ListA, ListB
shift_3 = ShiftList(List=divide_5.Points, Shift=1, Wrap=invert(True))
shift_4 = ShiftList(List=divide_6.Points, Shift=1, Wrap=invert(True))
shift_5 = ShiftList(List=divide_3.Points, Shift=1, Wrap=invert(True))
shift_6 = ShiftList(List=divide_4.Points, Shift=1, Wrap=invert(True))
short_3 = ShortestList(ListA=divide_3.Points, ListB=shift_3, TrimMode=2)  # -> ListA, ListB
short_4 = ShortestList(ListA=divide_4.Points, ListB=shift_4, TrimMode=2)  # -> ListA, ListB
short_5 = ShortestList(ListA=divide_5.Points, ListB=shift_5, TrimMode=2)  # -> ListA, ListB
short_6 = ShortestList(ListA=divide_6.Points, ListB=shift_6, TrimMode=2)  # -> ListA, ListB

ln_2 = Line(StartPoint=short_3.ListA, EndPoint=short_3.ListB)
pline = PolyLine(Vertices=divide_2.Points, Closed=False)
ln_3 = Line(StartPoint=short_5.ListA, EndPoint=short_5.ListB)
pline_2 = PolyLine(Vertices=divide.Points, Closed=False)
ln_4 = Line(StartPoint=divide.Points, EndPoint=divide_2.Points)
item = ListItem(List=ln_4, Index=0, Wrap=True)  # -> Item1, Item
merge = Merge(Data1=Toggle(False), Data2=Toggle(True))
cull = CullPattern(List=ln_2, CullPattern=invert(merge))
cull_2 = CullPattern(List=ln_3, CullPattern=merge)
merge_2 = Merge(Data1=pline_2, Data2=cull_2, Data3=cull, Data4=pline, Data5=[item.Item1, item.Item])

ln_5 = Line(StartPoint=divide.Points, EndPoint=divide_2.Points)
ln_6 = Line(StartPoint=short.ListA, EndPoint=short.ListB)
pline_3 = PolyLine(Vertices=divide_2.Points, Closed=False)
ln_7 = Line(StartPoint=short_2.ListA, EndPoint=short_2.ListB)
pline_4 = PolyLine(Vertices=divide.Points, Closed=False)
lng = ListLength(List=ln_7)
lng_2 = ListLength(List=ln_7)
split = SplitList(List=ln_6, Index=expr("x/2", lng))  # -> ListA, ListB
split_2 = SplitList(List=ln_7, Index=expr("x/2", lng_2))  # -> ListA, ListB
crv_3 = Curve(split.ListB)
crv_4 = Curve(split_2.ListA)
merge_3 = Merge(Data1=pline_4, Data2=split_2.ListA, Data3=ln_5, Data4=crv_3, Data5=pline_3)

ln_8 = Line(StartPoint=short_4.ListA, EndPoint=short_4.ListB)
pline_5 = PolyLine(Vertices=divide_2.Points, Closed=False)
ln_9 = Line(StartPoint=short_6.ListA, EndPoint=short_6.ListB)
pline_6 = PolyLine(Vertices=divide.Points, Closed=False)
ln_10 = Line(StartPoint=divide.Points, EndPoint=divide_2.Points)
item_2 = ListItem(List=ln_10, Index=0, Wrap=True)  # -> Item1, Item
merge_4 = Merge(Data1=Toggle(True), Data2=Toggle(False))
cull_3 = CullPattern(List=ln_8, CullPattern=invert(merge_4))
cull_4 = CullPattern(List=ln_9, CullPattern=merge_4)
merge_5 = Merge(Data1=pline_6, Data2=cull_4, Data3=cull_3, Data4=pline_5, Data5=[item_2.Item1, item_2.Item])

ln_11 = Line(StartPoint=divide.Points, EndPoint=divide_2.Points)
ln_12 = Line(StartPoint=short.ListA, EndPoint=short.ListB)
pline_7 = PolyLine(Vertices=divide_2.Points, Closed=False)
ln_13 = Line(StartPoint=short_2.ListA, EndPoint=short_2.ListB)
pline_8 = PolyLine(Vertices=divide.Points, Closed=False)
lng_3 = ListLength(List=ln_13)
lng_4 = ListLength(List=ln_13)
split_3 = SplitList(List=ln_12, Index=expr("x/2", lng_3))  # -> ListA, ListB
split_4 = SplitList(List=ln_13, Index=expr("x/2", lng_4))  # -> ListA, ListB
crv_5 = Curve(split_3.ListA)
crv_6 = Curve(split_4.ListB)
merge_6 = Merge(Data1=pline_8, Data2=crv_6, Data3=ln_11, Data4=crv_5, Data5=pline_7)

# ---- group: Vierendel
pline_9 = PolyLine(Vertices=divide.Points, Closed=False)
pline_10 = PolyLine(Vertices=divide_2.Points, Closed=False)
ln_14 = Line(StartPoint=divide.Points, EndPoint=divide_2.Points)
merge_7 = Merge(Data1=pline_9, Data2=ln_14, Data3=pline_10)

# ----
number_slider = Slider(0.34, range=0.1..2)
list = ValueList({"VIERENDEEL": 0, "BROWN": 1, "PRATT": 2, "HOWE": 3, "WARREN": 4, "WARREN 2": 5}, selected="VIERENDEEL")
item_3 = ListItem(List=panel, Index=list, Wrap=True)

expression = Expression(x=item_3, Expression="Format(\"Tipologia {0}\",x)")

merge_8 = Merge(Data1=flatten("Trave Reticolare Parametrica"), Data3=flatten(expression), Data6=flatten(""))  # -> flatten(Result)
lng_5 = ListLength(List=merge_8)
series = Series(Start=Slider(-3.37, range=-50..50), Step=expr("-x*1.5", number_slider), Count=lng_5)
vec = VectorXYZ(XComponent=Slider(0, range=0..100), YComponent=series, ZComponent=0)  # -> Vector, Length
pt_2 = Point(vec.Vector)
xy = XYPlane(Origin=pt_2)

tag = TextTag3D(Location=xy, Text=merge_8, Size=number_slider, Colour=ColourSwatch(SwatchColor=RGB(255, 255, 255)), Justification=7)

ln_15 = Line(StartPoint=divide.Points, EndPoint=divide_2.Points)
ln_16 = Line(StartPoint=short.ListA, EndPoint=short.ListB)
pline_11 = PolyLine(Vertices=divide_2.Points, Closed=False)
ln_17 = Line(StartPoint=short_2.ListA, EndPoint=short_2.ListB)
pline_12 = PolyLine(Vertices=divide.Points, Closed=False)

item_4 = ListItem(List=ln_15, Index=0, Wrap=True)  # -> Item1, Item

merge_9 = Merge(Data1=pline_12, Data2=ln_17, Data3=[item_4.Item1, item_4.Item], Data4=ln_16, Data5=pline_11)

filter = StreamFilter(Gate=list, Stream0=merge_7, Stream1=merge_9, Stream2=merge_3, Stream3=merge_6, Stream4=merge_2, Stream5=merge_5)
exportdownload = ShapeDiverExportDownload(Geometry=filter, Format="dxf", Name="Reticolare Parametrica")
