# Grasshopper definition buckling analyses.gh (Grasshopper 0.9.76)
# plug-ins: Karamba

panel = Panel("""DL,SDL,WIND,SNOW
1,0,0,0
0,0,0,0
1,1,0,0
0,0,1,0
0,0,0,1
1.35,1.35,1.5,0.5
1.35,1.35,-1.5,-0.5
-1.35,1.35,1.5,0.5""")
cull_i = CullIndex(List=panel, Indices=0, Wrap=True)
lng = ListLength(List=cull_i)
series = Series(Start=0, Step=1, Count=lng)
split = TextSplit(Text=cull_i, Separators=",")  # -> simplify(Result)
int = Integer(graft(series))
int_2 = Integer(flatten(int))
lc = Panel(int_2)
ins = InsertItems(List=split, Item=int, Indices=0, Wrap=True)
flip = FlipMatrix(Data=ins)  # -> simplify(Data)
bang = ExplodeTree(Data=flip)  # -> simplify(graft(Branch0)), simplify(graft(Branch1)), simplify(graft(Branch2)), simplify(graft(Branch3)), simplify(graft(Branch4)), simplify(graft(Branch5)), simplify(graft(Branch6))

crv = Curve(Tree({0;0}: [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], {0;1}: [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], {0;2}: [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]))
curvepoint = PointOnCurve(crv, parameter=0.5)
linetobeam = LineToBeamKaramba(Line=crv, Points=curvepoint, New=True, Remove=True, LimitDistance_m=0.005)  # -> Element, Points, Info
pt = Point([Point(0, 0, 0), Point(10, 0, 0)])
supp = SupportKaramba(PosInd=pt, menu=[buttons(on, on, on, on, on, on)])
modifyelem = ModifyElementKaramba(Beam=linetobeam.Element, mode="Beam")
Z = UnitZ(Factor=expr("-x", bang.Branch1))
pt_2 = Point([Point(0, 0, 2), Point(2.5, 0, 2), Point(5, 0, 2), Point(7.5, 0, 2), Point(10, 0, 2)])
Z_2 = UnitZ(Factor=expr("-x", "2"))
Z_3 = UnitZ(Factor=expr("-x", "2"))
Z_4 = UnitZ(Factor=expr("-x", "5"))
multiplication = Multiplication(A=Z_2, B=bang.Branch4)
multiplication_2 = Multiplication(A=Z_3, B=bang.Branch3)
multiplication_3 = Multiplication(A=Z_4, B=bang.Branch2)
loads = LoadsKaramba(ForceVector=multiplication, Local=False, PosInd=pt_2, LCase=bang.Branch0, mode="Point")
loads_2 = LoadsKaramba(ForceVector=multiplication_2, Local=False, PosInd=pt_2, LCase=bang.Branch0, mode="Point")
loads_3 = LoadsKaramba(ForceVector=multiplication_3, Local=False, PosInd=pt_2, LCase=bang.Branch0, mode="Point")
loads_4 = LoadsKaramba(Vector=Z, LCase=bang.Branch0, mode="Gravity")
load = LoadKaramba([loads_4, loads_3, loads_2, loads])
assemble = AssembleModelKaramba(Elem=flatten(modifyelem), Support=supp, Load=flatten(load), LimitDistance_m=0.005)  # -> Model, Info, Mass_kg, CenterOfGravity
# Default Value
analyzethii = AnalyzeThIIKaramba(Model=assemble.Model, LoadCase=-1, RTolerance=1e-07, MaxIterations=50, NoTensionalNII=False)  # -> CalculatedModel, MaximumDisplacement_m, ResultingForceOfGravity_kN, ElasticEnergy_kNm
analyzethii_2 = AnalyzeThIIKaramba(Model=assemble.Model, LoadCase="2", RTolerance=1e-07, MaxIterations=50, NoTensionalNII=False)  # -> CalculatedModel, MaximumDisplacement_m, ResultingForceOfGravity_kN, ElasticEnergy_kNm
analyzethi = AnalyzeThIKaramba(Model=assemble.Model)  # -> CalculatedModel, MaximumDisplacement_m, ResultingForceOfGravity_kN, ElasticEnergy_kNm
disassemble = DisassembleModelKaramba(Model=analyzethii.CalculatedModel)  # -> Model, Point, Beam, Shell, Support, Load, Line, Mesh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
disassemble_2 = DisassembleModelKaramba(Model=analyzethii_2.CalculatedModel)  # -> Model, Point, Beam, Shell, Support, Load, Line, Mesh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
disassemble_3 = DisassembleElementKaramba(Model=analyzethii.CalculatedModel, Element=disassemble.Beam)  # -> Element, ElementIdentifier, AxisOfElement, CrossSection, Joints, Material, LocalCoordinateSystem, ElementIsActive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
disassemble_4 = DisassembleElementKaramba(Model=analyzethii_2.CalculatedModel, Element=disassemble_2.Beam)  # -> Element, ElementIdentifier, AxisOfElement, CrossSection, Joints, Material, LocalCoordinateSystem, ElementIsActive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
b_forces = BeamForcesKaramba(AnalyzedModel=analyzethi.CalculatedModel, LCase=-1, MaximumDistanceBetweenResults_m=-1, NumberOfResultsPerBeamElement=2)  # -> AnalyzedModel, NormalForce_kN, ShearForceVz_kN, ShearForceVy_kN, BendingMomentMt_kNm, BendingMomentMy_kNm, BendingMomentMz_kNm
avr = Average(Input=b_forces.NormalForce_kN)
panel_2 = Panel(disassemble_4.NII_kN)
panel_3 = Panel(disassemble_3.NII_kN)
trim = TrimTree(Tree=avr, Depth=1)
flip_2 = FlipMatrix(Data=trim)
item = ListItem(List=flip_2, Index="2", Wrap=True)
sort = SortList(Keys=flip_2)  # -> Keys, ValuesA
data = Data(flatten(item))
normal_force_combo_n = Panel(data)
item_2 = ListItem(List=sort.Keys, Index=0, Wrap=True)
data_2 = Data(flatten(item_2))
max_compression = Panel(data_2)
